# Grasshopper definition project.gh (Grasshopper 1.0.7)
# Copyright: Yury Nasonov
# plug-ins: Telepathy, Human UI, Human, MetaHopper, EleFront

# ----
# READ LAYERS &
# THEIR MATERIALS
layer_table = LayerTable(Update=True, AutoUpdate=False)  # -> Layers, FullLayerPaths, LayerColors, Linetypes, MaterialNames, Visible, PrintWidth, PrintColor
layers_to_get_material = Panel(""">::Regelelement::Window::Window - Panel
>::Regelelement::Window
>::Regelelement::Door::Door - Panel
>::Regelelement::Door
>::Regelelement::CurtainWall::CurtainWall - Panel
>::Regelelement::CurtainWall::CurtainWall - Frame
>::Regelelement::Vent-Other::Vent-Other - Panel
>::Regelelement::Subcontractors""")
key_value_search = KeyValueSearch(Keys=layer_table.FullLayerPaths, Values=layer_table.MaterialNames, Search=layers_to_get_material)
replace_text = ReplaceText(Text=key_value_search, Find=" _tr", RecursiveReplace=False)
replace_text_2 = ReplaceText(Text=replace_text, Find=" _wa", RecursiveReplace=False)

# ----
# PROJECT. MATERIALS
# ( IN 3DM FILE)
boolean_toggle = BooleanToggle(True)
material_table = MaterialTable(Update=boolean_toggle)  # -> MaterialName, Shader, Diffuse, Specular, Emission, Alpha, Gloss
create_set = CreateSet(List=material_table.MaterialName)  # -> Set, Map
sort_text = SortText(Keys=create_set.Set, Culture=127)  # -> Keys, Values
text = Text(sort_text.Keys)
panel = Panel(text)
project_listofmaterials = RemoteSender(text)

# ----
# Continue: HUI, Align, Attributes
boolean_toggle_2 = BooleanToggle(True)  # disabled
project_jsonpath = RemoteReceiver()  # disabled
panel_2 = Panel("""keeey1
keeey2""")  # disabled
panel_3 = Panel("""vaalue1
vaalue2""")  # disabled
# Title+X
kvtojson = AddKeyValueToJson(json_path=project_jsonpath, key=panel_2, value=panel_3, write_now=boolean_toggle_2)  # -> out; inputs write_now: Boolean; disabled
# ---------- kvtojson: Python ----------
# Adds key-value pair to json file

__author__ = "Yury Nasonov"
__version__ = "1"

ghenv.Component.Name = "add key-value to json"
ghenv.Component.NickName = 'KVtoJSON'
ghenv.Component.Message = 'add key-value to json'

# ———————————————————————————————————————————————————————————

import rhinoscriptsyntax as rs
import json

# ———————————————————————————————————————————————————————————

if write_now:
    with open(json_path, 'r+') as f:
        data = json.load(f)
        data[key] = value # <--- add `id` value.
        f.seek(0)        # <--- should reset file position to the beginning.
        json.dump(data, f, indent=4, ensure_ascii=False)
        f.truncate()     # remove remaining part
        f.close()
# ---------- end kvtojson ----------

# ----
# READ DEFAULT BLOCKS DATA
panel_4 = Panel(">::Block::Block - Default profile")
dynamic_geometry_pipeline = DynamicGeometryPipeline(
    LayerFilter=panel_4,
    TypeFilter="Block",
    NameFilter="*",
    GroupByLayer=False,
    GroupByType=False,
    IncludeHidden=True,
    IncludeLocked=True,
    enableFullPath=True,
    listenToAttributes=False)
explode_blocks = ExplodeBlocks(BlockObjects=dynamic_geometry_pipeline, explodeGeom=True)  # -> Geometry, Attributes, BlockName, BoundingBox, BlockTransform, InsertionPlane, InstanceCount
reference_by_layer = ReferenceByLayer(LayerName=panel_4, DisableAutoUpdate=False, ignoreCase=False)
panel_5 = Panel("""Profile - Default - Window jamb L
Profile - Default - Window mullion
Profile - Default - Window head
Profile - Default - Window transom
Profile - Default - Window sill
Profile - Default - CW jamb L
Profile - Default - CW mullion
Profile - Default - CW head
Profile - Default - CW transom
Profile - Default - CW sill""")
panel_6 = Panel(explode_blocks.Attributes)
deconstruct_block = DeconstructBlock(Block=reference_by_layer, recursive=False)  # -> flatten(Name), Plane, Geometry
deconstruct_block_2 = DeconstructBlock(Block=deconstruct_block.Geometry, recursive=False)  # -> flatten(Name), Plane, Geometry
member_index = MemberIndex(Set=deconstruct_block.Name, Member=panel_5)  # -> Index, Count
panel_7 = Panel("""HO_ProfileType
HO_ProfileW
HO_ProfileD""")
list_item = ListItem(List=deconstruct_block_2.Name, Index=member_index.Index, Wrap=True)  # -> flatten(Item)
list_item_2 = ListItem(List=reference_by_layer, Index=member_index.Index, Wrap=True)
panel_8 = Panel(list_item)
panel_9 = Panel(list_item_2)
get_user_value = GetUserValue(Geometry=list_item_2, Key=panel_7)  # disabled

# ----
# READ  JSON
# Read default materials
# Read default profiles
panel_10 = Panel("""defaults.materials.windowFrame
defaults.materials.windowPanel
defaults.materials.curtWallPanel
defaults.materials.curtWallProfile
defaults.materials.wallVent
defaults.materials.wallOther
defaults.profiles.windowFrameHoriz
defaults.profiles.windowFrameVert
defaults.profiles.windowMullionVert
defaults.profiles.windowMullionHoriz
defaults.profiles.wallPanelGaps""")  # disabled
project_jsonpath_2 = RemoteReceiver()  # disabled
getvaluefromnestednestedjson = GetValueFromJSON(json_path=project_jsonpath_2, key=panel_10)  # -> out, value; disabled
# ---------- getvaluefromnestednestedjson: Python ----------
# ACTION:     Reads Value from JSON file by key
# LIMITATION: Max depth of key input is 5 like key0.key1.key2.key3.key4
# TO DO:      Execute on readNow or auto-update

__author__ = "Yury Nasonov"
__version__ = "1"

ghenv.Component.Name = "Get value from JSON"
ghenv.Component.NickName = 'GetValueFromNestedNestedJSON'
ghenv.Component.Message = 'Get value from nested JSON'

# ———————————————————————————————————————————————————————————

import rhinoscriptsyntax as rs
import json

# ———————————————————————————————————————————————————————————

#read JSON
f = open(json_path, "r")
a = (f.read())
j = json.loads(a)

#get key depth 
key_list=key.split(".")
key_count = len(key_list)

#get values depending on key depth
if key_count==1:
    value=j[key]
else:
    if key_count==2:               #for input like key0.key1
        key0 =key_list[0]
        key1=key_list[1]
        value=j[key0][key1]
    if key_count==3:               #for input like key0.key1.key2
        key0 =key_list[0]
        key1=key_list[1]
        key2=key_list[2]
        value=j[key0][key1][key2]
    if key_count==4:               #for input like key0.key1.key2.key3
        key0 =key_list[0]
        key1=key_list[1]
        key2=key_list[2]
        key3=key_list[3]
        value=j[key0][key1][key2][key3]
    if key_count==5:               #for input like key0.key1.key2.key3.key4
        key0 =key_list[0]
        key1=key_list[1]
        key2=key_list[2]
        key3=key_list[3]
        key4=key_list[4]
        value=j[key0][key1][key2][key3][key4]

#close file
f.close()
# ---------- end getvaluefromnestednestedjson ----------
explode_tree = ExplodeTree(Data=getvaluefromnestednestedjson.value)  # -> Branch0, Branch1, Branch2, Branch3, Branch4, Branch5, simplify(graft(Branch6)), simplify(graft(Branch7))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; disabled
flip_matrix = FlipMatrix(Data=[explode_tree.Branch6, explode_tree.Branch7])  # disabled
flip_matrix_2 = FlipMatrix(Data=[explode_tree.Branch8, explode_tree.Branch9])  # disabled
default_material_for_wall_oth = RemoteSender(explode_tree.Branch5)  # disabled
default_material_for_window_frame = RemoteSender(explode_tree.Branch0)  # disabled
default_material_for_window_panel = RemoteSender(explode_tree.Branch1)  # disabled
default_material_for_curt_wall_panel = RemoteSender(explode_tree.Branch2)  # disabled
default_material_for_curt_wall_profile = RemoteSender(explode_tree.Branch3)  # disabled
default_material_for_wall_vent = RemoteSender(explode_tree.Branch4)  # disabled
list_item_3 = ListItem(List=flip_matrix, Index=0, Wrap=False)  # -> flatten(Item), flatten(Item1), flatten(Item2); disabled
list_item_4 = ListItem(List=flip_matrix_2, Index=0, Wrap=False)  # -> flatten(Item), flatten(Item1), flatten(Item2); disabled
merge = Merge(
    Data1=explode_tree.Branch0,
    Data2=explode_tree.Branch1,
    Data3=explode_tree.Branch2,
    Data4=explode_tree.Branch3,
    Data5=explode_tree.Branch4,
    Data6=explode_tree.Branch5)  # disabled
default_material_for_wall_oth_2 = RemoteReceiver(default_material_for_wall_oth)  # disabled
default_material_for_curt_wall_panel_2 = RemoteReceiver(default_material_for_curt_wall_panel)  # disabled
default_material_for_window_panel_2 = RemoteReceiver(default_material_for_window_panel)  # disabled
default_material_for_wall_vent_2 = RemoteReceiver(default_material_for_wall_vent)  # disabled
default_material_for_curt_wall_profile_2 = RemoteReceiver(default_material_for_curt_wall_profile)  # disabled
default_material_for_window_frame_2 = RemoteReceiver(default_material_for_window_frame)  # disabled

# ----
# Group materials
project_listofmaterials_2 = RemoteReceiver(project_listofmaterials)
text_split = TextSplit(Text=project_listofmaterials_2, Separators_="_")
list_item_5 = ListItem(List=text_split, Index1=1, Wrap=False)  # -> simplify(Item)
replace_nulls = ReplaceNulls(Items=list_item_5, Replacements=0)  # -> flatten(Items), Count
project_listofmaterials_3 = RemoteReceiver(project_listofmaterials)
expression = Expression(x=replace_nulls.Items, Expression="if(x=\"tr\",1,0)")
expression_2 = Expression(x=replace_nulls.Items, Expression="if(x=\"wa\",1,0)")
boolean = Boolean(invert(expression_2))
boolean_2 = Boolean(invert(expression))
dispatch = Dispatch(List=project_listofmaterials_3, DispatchPattern=expression)  # -> ListA, ListB
dispatch_2 = Dispatch(List=project_listofmaterials_2, DispatchPattern=expression_2)  # -> ListA, ListB
gate_and = GateAnd(A=boolean_2, B=boolean)
dispatch_3 = Dispatch(List=project_listofmaterials_3, DispatchPattern=gate_and)  # -> ListA, ListB
replace_text_3 = ReplaceText(Text=dispatch_2.ListA, Find_wa=" _wa", RecursiveReplace=False)
replace_text_4 = ReplaceText(Text=dispatch.ListA, Find_tr=" _tr", RecursiveReplace=False)
hui_non_transparent_non_wallmaterialslis = RemoteSender(dispatch_3.ListA)  # "HUI.Non-transparent&Non-wallMaterialsList"
hui_wallmaterialslist = RemoteSender(replace_text_3)
hui_transparentmaterialslist = RemoteSender(replace_text_4)

boolean_toggle_3 = BooleanToggle(True)
# HO_DefaultProfile-Window jamb L
# HO_DefaultProfile-Window mullion
# HO_DefaultProfile-Window head
# HO_DefaultProfile-Window transom
# HO_DefaultProfile-Window sill
# HO_DefaultProfile-Door jamb L
# HO_DefaultProfile-Door mullion
# HO_DefaultProfile-Door head
# HO_DefaultProfile-Door transom
# HO_DefaultProfile-Door sill
# HO_DefaultProfile-CW jamb L
# HO_DefaultProfile-CW mullion
# HO_DefaultProfile-CW head
# HO_DefaultProfile-CW transom
# HO_DefaultProfile-CW sill
# HO_DefaultProfile-Door jamb L
# HO_DefaultProfile-Door mullion
# HO_DefaultProfile-Door head
# HO_DefaultProfile-Door transom
# HO_DefaultProfile-Door sill
boolean_toggle_4 = BooleanToggle(False)
getdocumentusertext = GetDocumentUserText(key="HO_PanelDepthOffsets", checkNow=boolean_toggle_3)  # -> value
# ---------- getdocumentusertext: Python ----------
# Gets document user text from current 3dm file

__author__ = "Yury Nasonov"
__version__ = "1"

ghenv.Component.Name = "Get Document user text"
ghenv.Component.NickName = 'GetDocumentUserText'
ghenv.Component.Message = 'Get Document user text'

# ———————————————————————————————————————————————————————————

import rhinoscriptsyntax as rs
import scriptcontext as sc
import Rhino

# ———————————————————————————————————————————————————————————

sc.doc = Rhino.RhinoDoc.ActiveDoc

# checkNow is currently disabled
#if checkNow != False:
#    value = rs.GetDocumentUserText(key)

value = rs.GetDocumentUserText(key)
sc.doc = ghdoc

print value
# ---------- end getdocumentusertext ----------
getdocumentusertext_2 = GetDocumentUserText(key="HO_ProfileDepthOffsets", checkNow=boolean_toggle_3)  # -> value; same code as getdocumentusertext
# Window jamb L
# Window mullion
# Window head
# Window transom
# Window sill
# Door jamb L
# Door mullion
# Door head
# Door transom
# Door sill
# CW jamb L
# CW mullion
# CW head
# CW transom
# CW sill
x = Panel("""HO_DefaultProfile-Window head
HO_DefaultProfile-Window jamb L
HO_DefaultProfile-Window jamb R
HO_DefaultProfile-Window mullion
HO_DefaultProfile-Window sill
HO_DefaultProfile-Window transom
HO_DefaultProfile-Door head
HO_DefaultProfile-Door jamb L
HO_DefaultProfile-Door jamb R
HO_DefaultProfile-Door mullion
HO_DefaultProfile-Door sill
HO_DefaultProfile-Door transom
HO_DefaultProfile-CW head
HO_DefaultProfile-CW jamb L
HO_DefaultProfile-CW jamb R
HO_DefaultProfile-CW mullion
HO_DefaultProfile-CW sill
HO_DefaultProfile-CW transom""")
text_split_2 = TextSplit(Text=getdocumentusertext_2, Separators=",")
text_split_3 = TextSplit(Text=getdocumentusertext, Separators=";")
text_split_4 = TextSplit(Text=getdocumentusertext, Separators=",")
text_split_5 = TextSplit(Text=getdocumentusertext_2, Separators=",")
getdocumentusertext_3 = GetDocumentUserText(key=x, checkNow=boolean_toggle_3)  # -> value; same code as getdocumentusertext

split_list = SplitList(List=text_split_4, Index4=4)  # -> ListA, ListB
split_list_2 = SplitList(List=text_split_5, Index4=4)  # -> ListA, ListB

text_split_6 = TextSplit(Text=getdocumentusertext_3, Separators=";")
panel_11 = Panel(getdocumentusertext_3)
panel_depth_offsets = Panel(text_split_5)
list_item_6 = ListItem(List=text_split_6, Index=1, Wrap=True)  # -> Item, Item1, Item2
text_join = TextJoin(Text=[list_item_6.Item, list_item_6.Item1, list_item_6.Item2], Join=";")  # -> simplify(Result)

# ----
# Default offsets (D)
panel_12 = Panel("""Window
Door
CW
Wall""")
panel_13 = Panel("""100
100
100
0""")
create_label = CreateLabel(LabelText="Depth offsets:", LabelSize=18, Justification=0)
create_text_box = CreateTextBox(DefaultText=panel_13, UpdateButton=False, showLabel=True)

panel_14 = Panel(text_join)

panel_15 = Panel("""core
components_util
converters
ui""")  # disabled
path = FilePath("C:\Users\Admin\Dipl. - Ing. Herbert Hölscher Stahlbau Kleve GmbH & Co. KG\AUTOMATISIERUNG - Dokumente\Personal\Pavel\Projects\Development\")  # disabled
path_corrector = PathCorrector(orig_path=path)  # disabled
button = Button()  # disabled
button_2 = Button()  # disabled
panel_16 = Panel(path)  # disabled
devtool_import_modules = GhPythonScript(file=panel_15, reset=button)  # -> rep; inputs reset: Boolean; disabled
# ---------- devtool_import_modules: Python ----------
from ghpythonlib.componentbase import executingcomponent as component




class ImportModules(component):
    
    """GUID: 38fb008e-fb68-422b-967c-f7dfc0269462"""
    
    def __init__(self):
        self.Reseting = False
    
    def RunScript(self, file, reset):
        
        import sys
        import imp
        
        __author__ = "FurtsevPavel"
        __version__ = "2020.05.24"
        
        def recomputeCanvas(e):
            for obj in self.OnPingDocument().Objects:
                if not obj.InstanceGuid == self.InstanceGuid:
                    obj.ExpireSolution(False)
        
        rep = ""
        
        
        if reset:
            rep = "Reimporting....."
            self.Reseting = True
        
        else:
            module = map(__import__, [file])[0]
            imp.reload(module)
            rep = "imported: %s" %module
            
            if self.Reseting:
                self.OnPingDocument().ScheduleSolution(100, recomputeCanvas)
            
            self.Reseting = False
            
        return rep
# ---------- end devtool_import_modules ----------
devtool_backup = GhPythonScript(path=path_corrector, backup=button_2)  # disabled
# ---------- devtool_backup: Python ----------
from ghpythonlib.componentbase import executingcomponent as component
import Grasshopper, GhPython
import System
import Rhino
import rhinoscriptsyntax as rs
import os
import datetime

class Dev_Tool_BackUp(component):
    def __init__(self):
        self.Data = None
    
    def RunScript(self, path, backup):
        #!/usr/bin/python
        # -*- coding: utf-8 -*-
        __version__ = "1.0.0"
        __author__ = "PF"
        
        
        from ghpythonlib.componentbase import executingcomponent as component
        import Grasshopper, GhPython
        from Grasshopper.Kernel import GH_RuntimeMessageLevel as RML
        import System
        import Rhino
        import rhinoscriptsyntax as rs
        
        doc = ghenv.Component.OnPingDocument()
        obj = doc.Objects
        now = datetime.datetime.now()
        now = now.strftime("%d-%m_%H-%M")
        path = os.path.join(path, "Backup", now)
        
# UPDATE
        
        if backup:
            a = {}
            for o in obj:
                if type(o) == GhPython.Component.ZuiPythonComponent:
                    name = o.NickName
                    
                    if "Python" not in name and "DevTool" not in name:
                        if name not in a.Keys:
                            a[name] = [o]
                        else:
                            a[name].append(o)
            
            if not os.path.isdir(path):
                os.mkdir(path)
            
            
            for k in a.Keys:
                O = a[k]
                V = 1
                code = None
                for o in O:
                    name = k + "_V" + str(V) + ".py"
                    if code != o.Code:
                        p = os.path.join(path, name)
                        with open(p, 'w') as file:
                            file.write(o.Code.encode("utf8"))
                            print "File writen"
                        V += 1
                    if not code:
                        code = o.Code
            self.Message = now
        
        return None
    
    def Read(self, reader):
        try:
            #GH_IO.Serialization.GH_IReader.
            ok, newdata = reader.TryGetString('Message', self.Message)
            if ok and newdata:
                self.Message = newdata

        except Exception as e:
            System.Windows.Forms.MessageBox.Show(str(e), 'Script error read')
        
        return super(Dev_Tool_BackUp, self).Read(reader)
    
    def Write(self, writer):
        try:
            text = self.Message if self.Message else ""
            writer.SetString('Message', text)
        except Exception as e:
            System.Windows.Forms.MessageBox.Show(str(e), 'Script error write')
        
        return super(Dev_Tool_BackUp, self).Write(writer)
# ---------- end devtool_backup ----------
panel_17 = Panel(devtool_import_modules)  # disabled

create_label_2 = CreateLabel(LabelText=panel_12, LabelSize=12, Justification=0)

# ----
# PROJECT SETTINGS
panel_18 = Panel("Project settings                 ")
create_label_3 = CreateLabel(LabelText=panel_18, LabelSize=24, Justification=0)
create_true_only_button = CreateTrueOnlyButton(ButtonName=" ? ", ButtonStyle=2)
create_true_only_button_2 = CreateTrueOnlyButton(SubmitABug="💬", ButtonStyle=2)
value_listener = ValueListener(Elements=create_true_only_button, SomeProperty=True)  # -> Values, Indices
create_wrappanel = CreateWrapPanel(UIElements=[create_label_3, create_true_only_button, create_true_only_button_2], Horizontal=True)  # -> flatten(WrapPanel)
hui_submit_a_bug_buttons = RemoteSender(create_true_only_button_2)
input_showhelpwindow = RemoteSender(value_listener.Values)

create_text_box_2 = CreateTextBox(DefaultText=panel_13, UpdateButton=False, showLabel=True)

# ----
# TO FINISH
# Oops! Project with the same name already exists!
panel_19 = Panel("Succesfully saved in \DB\Projects\")
# TO DO: ability to rename
# created project
panel_20 = Panel("Open project folder")
create_text_block = CreateTextBlock(Text=panel_19, TextSize=12, Justification=0)
create_true_only_button_3 = CreateTrueOnlyButton(ButtonName=panel_20, ButtonStyle=0)
create_wrappanel_2 = CreateWrapPanel(UIElements=[create_text_block, create_true_only_button_3], Horizontal=True)
value_listener_2 = ValueListener(Elements=create_true_only_button_3, SomeProperty=True)  # -> Values, Indices
hide_show_element = HideShowElement(ElementToHideShow=create_wrappanel_2, Show=Toggle(False), Collapse=True, Disable=False)

panel_21 = Panel("""      
Panel   
Frame   """)
gzcommand = CSharpScript(
    command="_Cancel",
    runNow=Toggle(True),
    echo=False,
    Reference=["C:\Program Files\Rhino 7\Plug-ins\Grasshopper\Components\ScriptComponents.gha", "C:\Program Files\NoDoubts\Godzilla\System\Godzilla.dll", "C:\Program Files\NoDoubts\Godzilla\System\RhGodzilla.rhp"])  # -> done; inputs command: String, runNow: Boolean, echo: Boolean; same code as gzcommand
value_listener_3 = ValueListener(Elements=create_text_box, SomeProperty=True)  # -> flatten(Values), Indices
explode_tree_2 = ExplodeTree()  # -> Branch0, Branch1, Branch2; disabled
value_listener_4 = ValueListener(Elements=create_text_box_2, SomeProperty=True)  # -> flatten(Values), Indices
set_textbox_contents = SetTextBoxContents(TextBoxToModify=create_text_box_2, NewTextBoxContents=split_list_2.ListA)
set_textbox_contents_2 = SetTextBoxContents(TextBoxToModify=create_text_box, NewTextBoxContents=split_list.ListA)
create_label_4 = CreateLabel(LabelText=panel_21, LabelSize=12, Justification=0)
text_join_2 = TextJoin(Text=flatten([value_listener_3.Values, split_list.ListB]), Join=",")
text_join_3 = TextJoin(Text=flatten([value_listener_4.Values, split_list_2.ListB]), Join=",")
list_length = ListLength(List=explode_tree_2.Branch2)  # disabled

# ----
# Status
panel_22 = Panel("")  # disabled
create_text_block_2 = CreateTextBlock(Text=panel_22, TextSize=16, Justification=0)  # disabled
adjust_element_appearance = AdjustElementAppearance(ElementsToAdjust=create_text_block_2, Background=RGBA(255, 196, 196, 170))  # disabled
hide_show_element_2 = HideShowElement(ElementToHideShow=create_text_block_2, Show=list_length, Collapse=True, Disable=False)  # disabled
set_textblock_contents = SetTextBlockContents(TextBlockToModify=create_text_block_2, NewTextBlockContents=explode_tree_2.Branch2)  # disabled

list_item_7 = ListItem(List=create_label_4, Index=0, Wrap=True)  # -> Item, Item1, Item2
writedocumentusertext = WriteDocumentUserText(key="HO_PanelDepthOffsets", value=text_join_2, writeNow=boolean_toggle_3)  # -> value; inputs writeNow: Boolean
# ---------- writedocumentusertext: Python ----------
# Writes document user text to current 3dm file

__author__ = "Yury Nasonov"
__version__ = "1"

ghenv.Component.Name = "Write Document user text"
ghenv.Component.NickName = 'WriteDocumentUserText'
ghenv.Component.Message = 'Write Document user text'

# ———————————————————————————————————————————————————————————

import rhinoscriptsyntax as rs
import scriptcontext as sc
import Rhino

# ———————————————————————————————————————————————————————————

sc.doc = Rhino.RhinoDoc.ActiveDoc

if writeNow == True:
  value = rs.SetDocumentUserText(key,value)
  a=1
else:
  a=0

sc.doc = ghdoc

print value
# ---------- end writedocumentusertext ----------
writedocumentusertext_2 = WriteDocumentUserText(key="HO_ProfileDepthOffsets", value=text_join_3, writeNow=boolean_toggle_3)  # -> value; inputs writeNow: Boolean; same code as writedocumentusertext
entwine = Entwine(
    Branch00=[list_item_7.Item, create_label_2],
    Branch01=[list_item_7.Item1, create_text_box],
    Branch02=[list_item_7.Item2, create_text_box_2],
    FlattenInputs=True)
x_2 = Panel("""HO_DefaultProfile-Window head
HO_DefaultProfile-Window jamb L
HO_DefaultProfile-Window mullion
HO_DefaultProfile-Window sill
HO_DefaultProfile-Window transom
HO_DefaultProfile-Door head
HO_DefaultProfile-Door jamb L
HO_DefaultProfile-Door mullion
HO_DefaultProfile-Door sill
HO_DefaultProfile-Door transom
HO_DefaultProfile-CW head
HO_DefaultProfile-CW jamb L
HO_DefaultProfile-CW mullion
HO_DefaultProfile-CW sill
HO_DefaultProfile-CW transom""")
create_simple_grid = CreateSimpleGrid(UIElements=entwine, RowDefinitions="Auto", ColumnDefinitions="Auto")
merge_2 = Merge(Data1=create_label, Data3=flatten(create_simple_grid))  # -> flatten(Result)
panel_23 = Panel("""Window head
Window jamb L
Window mullion
Window sill
Window transom
Door head
Door jamb L
Door mullion
Door sill
Door transom
CW head
CW jamb L
CW mullion
CW sill
CW transom""")
hui_default_offsets = RemoteSender(merge_2)

create_modify_layers = CreateModifyLayers(LayerName=">::Building Profile", Visibility=False, DeleteLayer=False, enableFullPath=True)  # -> LayerNames, LayerFullPath

hui_default_offsets_2 = RemoteReceiver(hui_default_offsets)

# ----
# Save defaults +
# create blocks
panel_24 = Panel("Save defaults and create blocks")  # disabled
create_button = CreateButton(ButtonName=panel_24, ButtonStyle=1)  # -> flatten(Button); disabled
value_listener_5 = ValueListener(Elements=create_button, SomeProperty=True)  # -> flatten(Values), Indices; disabled
panel_25 = Panel("HO_AreDefaultsSaved")  # disabled
text_2 = Text(value_listener_5.Values)  # disabled
writedocumentusertext_3 = WriteDocumentUserText(key=panel_25, value=text_2, writeNow=value_listener_5.Values)  # -> value; inputs writeNow: Boolean; disabled; same code as writedocumentusertext
getdocumentusertext_4 = GetDocumentUserText(key=panel_25, updateNow=value_listener_5.Values)  # -> value; inputs updateNow: Boolean; disabled
# ---------- getdocumentusertext_4: Python ----------
# Gets document user text from current 3dm file

__author__ = "Yury Nasonov"
__version__ = "1"

ghenv.Component.Name = "Get Document user text"
ghenv.Component.NickName = 'GetDocumentUserText'
ghenv.Component.Message = 'Get Document user text'

# ———————————————————————————————————————————————————————————

import rhinoscriptsyntax as rs
import scriptcontext as sc
import Rhino

# ———————————————————————————————————————————————————————————

sc.doc = Rhino.RhinoDoc.ActiveDoc

if updateNow != True:
    value = rs.GetDocumentUserText(key)
sc.doc = ghdoc

print value
# ---------- end getdocumentusertext_4 ----------
addition = Addition(A=getdocumentusertext_4, B=0)  # disabled
panel_26 = Panel(writedocumentusertext_3)  # disabled
panel_27 = Panel(addition)  # disabled

# ----
# Export defaults
panel_28 = Panel("(Export defaults to file?)")  # disabled
create_file_picker = CreateFilePicker(ButtonLabelText="Browse...", DialogType=1, MustExist=False, Filter="All Files|*.*")  # disabled
create_label_5 = CreateLabel(LabelText=panel_28, LabelSize=18, Justification=0)  # disabled
merge_3 = Merge(Data1=create_label_5, Data2=create_file_picker)  # disabled

panel_29 = Panel(""">::Building Profile
>::FacadeFace
>::FacadeSubFace""")  # disabled
boolean_toggle_5 = BooleanToggle(False)  # disabled
stream_filter = StreamFilter(Gate=value_listener_5.Values, Stream1=panel_29)  # disabled

# ----
# Import defaults
panel_30 = Panel("Defaults")
create_file_picker_2 = CreateFilePicker(ButtonLabelText="Browse...", DialogType=0, MustExist=True, Filter="All Files|*.*")  # disabled
create_label_6 = CreateLabel(LabelText=panel_30, LabelSize=24, Justification=0)  # disabled
create_label_7 = CreateLabel(LabelText="Load defaults from another project", LabelSize=18, Justification=0)  # disabled

create_modify_layers_2 = CreateModifyLayers(LayerName=stream_filter, Visibility=boolean_toggle_5, DeleteLayer=False, enableFullPath=True)  # -> LayerNames, LayerFullPath; disabled
relay = Relay()  # disabled
brep = Brep(<brep referenced from the Rhino model>)  # disabled
gzusersettings = GzUserSettings(Reference=["C:\Program Files\Rhino 7\Plug-ins\Grasshopper\Components\ScriptComponents.gha", "C:\Program Files\NoDoubts\Godzilla\System\Godzilla.dll", "C:\Program Files\NoDoubts\Godzilla\System\RhGodzilla.rhp"])  # -> out, WindowHeight; inputs windowHeight: Int32
# ---------- gzusersettings: C# usings ----------
using RhGodzilla;
# ---------- gzusersettings: C# ----------
    if (windowHeight > 0 && !String.IsNullOrEmpty(windowHeight.ToString()))
    {
      RhGodzilla.GhApp.UserSettings.WindowHeight = windowHeight;///
    }
    WindowHeight = RhGodzilla.GhApp.UserSettings.WindowHeight;
# ---------- end gzusersettings ----------
# .gh" Enter Pause Enter Echo Enter
panel_31 = Panel(".gh\" Window Hide Enter")
panel_32 = Panel("! NoEcho ")  # disabled

# ----
# Bottom buttons
panel_33 = Panel("(Export)")
create_true_only_button_4 = CreateTrueOnlyButton(ButtonName=panel_33, ButtonStyle=3)  # disabled
create_true_only_button_5 = CreateTrueOnlyButton(ButtonName="(Support)", ButtonStyle=3)  # disabled
adjust_element_appearance_2 = AdjustElementAppearance(
    ElementsToAdjust=[create_true_only_button_4, create_true_only_button_5],
    Foreground=RGB(122, 115, 115),
    Background=RGB(245, 245, 245))  # disabled
adjust_element_positioning = AdjustElementPositioning(
    ElementsToAdjust=[create_true_only_button_4, create_true_only_button_5],
    Margin="0, 20 ,0, 0",
    AbsolutePositioning=False,
    Height=32)  # disabled
create_wrappanel_3 = CreateWrapPanel(UIElements=[create_true_only_button_4, create_true_only_button_5], Horizontal=True)  # disabled
value_listener_6 = ValueListener(Elements=create_true_only_button_4, SomeProperty=True)  # -> Values, Indices; disabled
value_listener_7 = ValueListener(Elements=create_true_only_button_5, SomeProperty=True)  # -> Values, Indices; disabled

gzuicolors = CSharpScript(Reference=["C:\Program Files\Rhino 7\Plug-ins\Grasshopper\Components\ScriptComponents.gha", "C:\Program Files\NoDoubts\Godzilla\System\Godzilla.dll", "C:\Program Files\NoDoubts\Godzilla\System\RhGodzilla.rhp"])  # -> Current_step_bg
# ---------- gzuicolors: C# ----------
    var gz = Rhino.RhinoApp.GetPlugInObject("RhGodzilla");
    var gz2 = RhGodzilla.RhGodzillaPlugin.Instance as RhGodzilla.RhGodzillaPlugin;

    Current_step_bg = RhGodzilla.GhApp.GhAppHelpers.GetUIColor("UI_color_current_step_bg");
# ---------- end gzuicolors ----------

# ----
# Upper line
create_rhino_pick_button = CreateRhinoPickButton(ButtonName="⭮", Prompt="Select faces", AllowMultiple=True, AllowNone=True, Type=1, ButtonStyle=3)  # disabled
create_rhino_pick_button_2 = CreateRhinoPickButton(ButtonName="ⓘ", Prompt="Select faces", AllowMultiple=True, AllowNone=True, Type=1, ButtonStyle=3)  # disabled
create_rhino_pick_button_3 = CreateRhinoPickButton(ButtonName="Hölsher", Prompt="Select faces", AllowMultiple=True, AllowNone=True, Type=1, ButtonStyle=3)  # disabled
create_wrappanel_4 = CreateWrapPanel(UIElements=flatten([create_rhino_pick_button_3, create_rhino_pick_button, create_rhino_pick_button_2]), Horizontal=True)  # disabled

# ----
# Support Window
panel_34 = Panel("Lorem ipsum dolor sit amet, consectetur adipiscing elit, sed do eiusmod tempor incididunt ut labore et dolore magna aliqua. Ut enim ad minim veniam, quis nostrud exercitation ullamco laboris nisi ut aliquip ex ea commodo consequat. Duis aute irure dolor in reprehenderit in voluptate velit esse cillum dolore eu fugiat nulla pariatur. Excepteur sint occaecat cupidatat non proident, sunt in culpa qui officia deserunt mollit anim id est laborum")
create_text_block_3 = CreateTextBlock(Text=panel_34, TextSize=12, Justification=0)  # disabled
launch_window = LaunchWindow(Show=value_listener_6.Values, Name=panel_33, Width=370, Height=400, ChildStatus=2, EnableHorizScroll=False)  # disabled
add_elements = AddElements(Window=launch_window, Elements=flatten(create_text_block_3), DoVLChecking=True)  # -> AddedElements, ElementNames; disabled

# ----
# Support Window
panel_35 = Panel("Lorem ipsum dolor sit amet, consectetur adipiscing elit, sed do eiusmod tempor incididunt ut labore et dolore magna aliqua. Ut enim ad minim veniam, quis nostrud exercitation ullamco laboris nisi ut aliquip ex ea commodo consequat. Duis aute irure dolor in reprehenderit in voluptate velit esse cillum dolore eu fugiat nulla pariatur. Excepteur sint occaecat cupidatat non proident, sunt in culpa qui officia deserunt mollit anim id est laborum")
create_text_block_4 = CreateTextBlock(Text=panel_35, TextSize=12, Justification=0)  # disabled
launch_window_2 = LaunchWindow(Show=value_listener_7.Values, Name="(Support)", Width=370, Height=400, ChildStatus=2, EnableHorizScroll=False)  # disabled
add_elements_2 = AddElements(Window=launch_window_2, Elements=flatten(create_text_block_4), DoVLChecking=True)  # -> AddedElements, ElementNames; disabled

panel_36 = Panel("Description")  # disabled
boolean_toggle_6 = BooleanToggle(True)  # disabled
input_showhelpwindow_2 = RemoteReceiver(input_showhelpwindow)  # disabled
create_text_box_3 = CreateTextBox(Label=panel_36, UpdateButton=True, showLabel=True)  # disabled
docinfo = DocumentInfo(AutoUpdate=False, Recursive=False)  # -> DocumentName, DocumentFilePath, Components, Params, _3rdPartyAssemblies
merge_4 = Merge(Data1=create_text_box_3)  # disabled
tsort = SortText(Keys=docinfo.Components, Culture=127)  # -> Keys, Values
# I would store all building profile in one layer and
#  set to them attributes HO_FloorNumber= .....
# To do: delete previously baked geo if
# csv path was changed
# Show ground level, dimensions
panel_37 = Panel(docinfo._3rdPartyAssemblies)
panel_38 = Panel(tsort.Keys)
gzaddreferences = CSharpScript(
    Run=True,
    Reference=["C:\Program Files\Rhino 7\Plug-ins\Grasshopper\Components\ScriptComponents.gha", "C:\Program Files\NoDoubts\Godzilla\System\Godzilla.dll", "C:\Program Files\NoDoubts\Godzilla\System\RhGodzilla.rhp"])  # -> Done; inputs Run: Boolean
# ---------- gzaddreferences: C# usings ----------
using ScriptComponents;
using System.IO;
# ---------- gzaddreferences: C# ----------
    Done = false;
    if (Run == false) return;
    //get paths
    string rhinoSysDir = RhinoApp.GetExecutableDirectory().FullName;
    string scriptComponentsPath = Path.GetFullPath(Path.Combine(rhinoSysDir, @"..\", @"Plug-ins\Grasshopper\Components\ScriptComponents.gha"));
    if(!File.Exists(scriptComponentsPath))   RhinoApp.WriteLine("Couldn't find library" + scriptComponentsPath);

    //Godzilla directory
    string gzSysDirectory = @"C:\Program Files\NoDoubts\Godzilla\System";

    //get gh components
    var objs = GrasshopperDocument.ActiveObjects();

    //proceed components
    foreach(var obj in objs)
    {
      //if a component is a CS script component
      if(obj.GetType().Name == "Component_CSNET_Script")
      {

        var cscomp = obj as ScriptComponents.Component_CSNET_Script;
        UpdateReferences(cscomp, gzSysDirectory, scriptComponentsPath);
      }
    }

    Done = true;
# ---------- gzaddreferences: C# additional code ----------
  public static void UpdateReferences(ScriptComponents.Component_CSNET_Script csc, string gzSysDirectory, string scriptComponentsPath)
  {
    csc.ScriptSource.References.Clear();
    csc.ScriptSource.References.Add(scriptComponentsPath);//to get access to c# components
    csc.ScriptSource.References.Add(gzSysDirectory + @"\Godzilla.dll");
    csc.ScriptSource.References.Add(gzSysDirectory + @"\RhGodzilla.rhp");
  }

  /// <summary>
  /// This method will be called once every solution, before any calls to RunScript.
  /// </summary>
  public override void BeforeRunScript()
  {

  }
  /// <summary>
  /// This method will be called once every solution, after any calls to RunScript.
  /// </summary>
  public override void AfterRunScript()
  { }
# ---------- end gzaddreferences ----------
# Go to clicked step
panel_39 = Panel(gzaddreferences)
input_boolean = Boolean()
ui_block = Data()
ui_block_2 = Data(ui_block)
input_boolean_2 = Boolean(input_boolean)

# ----
# WAS ACTIVE BEFORE GZ
panel_40 = Panel("""_-SetDisplayMode "HO RH"
_-NamedView _Restore Project _Enterend""")
boolean_toggle_7 = BooleanToggle(True)  # disabled
gzcommand_2 = CSharpScript(
    command=panel_40,
    runNow=boolean_toggle_7,
    echo=False,
    Reference=["C:\Program Files\Rhino 7\Plug-ins\Grasshopper\Components\ScriptComponents.gha", "C:\Program Files\NoDoubts\Godzilla\System\Godzilla.dll", "C:\Program Files\NoDoubts\Godzilla\System\RhGodzilla.rhp"])  # -> done; inputs command: String, runNow: Boolean, echo: Boolean; disabled; same code as gzcommand

input_submitbug = RemoteReceiver()  # disabled
gzaddreferences_2 = CSharpScript(
    Run=True,
    Reference=["C:\Program Files\Rhino 7\Plug-ins\Grasshopper\Components\ScriptComponents.gha", "C:\Program Files\NoDoubts\Godzilla\System\Godzilla.dll", "C:\Program Files\NoDoubts\Godzilla\System\RhGodzilla.rhp"])  # -> Done; inputs Run: Boolean
# ---------- gzaddreferences_2: C# ----------
    Done = false;
    if (Run == false) return;
    //get paths
    string rhinoSysDir = RhinoApp.GetExecutableDirectory().FullName;
    string scriptComponentsPath = Path.GetFullPath(Path.Combine(rhinoSysDir, @"..\", @"Plug-ins\Grasshopper\Components\ScriptComponents.gha"));
    if(!File.Exists(scriptComponentsPath))   RhinoApp.WriteLine("Couldn't find library" + scriptComponentsPath);

    //Godzilla directory
    string gzSysDirectory = Path.GetDirectoryName(Rhino.PlugIns.PlugIn.Find(new Guid("{9e6bd993-e133-49cb-b275-aab93167d1de}")).Assembly.Location);
    if (String.IsNullOrEmpty(gzSysDirectory)) RhinoApp.WriteLine("Couldn't find rhGodzilla library");
    //RhinoApp.WriteLine("gzSysDirectory = " + gzSysDirectory);

    //    // This CS component
    //    ScriptComponents.Component_CSNET_Script csc = (ScriptComponents.Component_CSNET_Script) Component;
    //    UpdateReferences(csc, gzSysDirectory, scriptComponentsPath);

    //get gh components
    var doc = GrasshopperDocument;
    var objs = doc.ActiveObjects();

    //proceed components
    foreach(var obj in objs)
    {
      //if a component is a CS script component
      if(obj.GetType().Name == "Component_CSNET_Script")
      {
        RhinoApp.WriteLine("CS Component found");

        var cscomp = obj as ScriptComponents.Component_CSNET_Script;
        UpdateReferences(cscomp, gzSysDirectory, scriptComponentsPath);
      }
    }

    Done = true;
# ---------- gzaddreferences_2: C# additional code ----------
  public static void UpdateReferences(ScriptComponents.Component_CSNET_Script csc, string gzSysDirectory, string scriptComponentsPath)
  {
    csc.ScriptSource.References.Clear();
    csc.ScriptSource.References.Add(scriptComponentsPath);//to get access to c# components
    csc.ScriptSource.References.Add(gzSysDirectory + @"\Godzilla.dll");
    csc.ScriptSource.References.Add(gzSysDirectory + @"\RhGodzilla.rhp");
  }

  /// <summary>
  /// This method will be called once every solution, before any calls to RunScript.
  /// </summary>
  public override void BeforeRunScript()
  {

  }
  /// <summary>
  /// This method will be called once every solution, after any calls to RunScript.
  /// </summary>
  public override void AfterRunScript()
  { }
# ---------- end gzaddreferences_2 ----------
panel_41 = Panel(gzaddreferences_2)
seetting_rhinodoc_attribute = Panel("HO_NorthRotation")
getdocumentusertext_5 = GetDocumentUserText(key=seetting_rhinodoc_attribute, checkNow=Toggle(True))  # -> value; same code as getdocumentusertext
number_slider = Slider(90, range=0..100)

# ----
# App settings
gh_app_path = Text()
ghpython_script = GhPythonScript(app_path=gh_app_path)  # -> out, RH_color_blue, RH_color_orange, RH_color_grey
# ---------- ghpython_script: Python ----------
import rhinoscriptsyntax as rs
import json

path = app_path + '\Data\AppSettings.db'
f = open(path, 'r')
a = (f.read())
y = json.loads(a)
RH_color_blue = y['RH_color_blue']
RH_color_orange = y['RH_color_orange']
RH_color_grey = y['RH_color_grey'] 

f.close()
# ---------- end ghpython_script ----------
relay_2 = Relay()
list_item_8 = ListItem(List=[ghpython_script.RH_color_blue, ghpython_script.RH_color_orange], Index=relay_2, Wrap=True)

geometry = Geometry()
# Outputs
relay_3 = Relay()
relay_4 = Relay()

# ----
# READ DOC ATTRIBUTES
getting_rhinodoc_attribute = Panel("""HO_ProjectName
HO_NorthRotation
HO_DefaultSize-PanelGaps
HO_DefaultState-CornerPanelsGap""")
python = PythonScript(key=getting_rhinodoc_attribute, checkNow=Toggle(True))  # -> value
# ---------- python: Python ----------
import rhinoscriptsyntax as rs
import scriptcontext as sc
import Rhino

sc.doc = Rhino.RhinoDoc.ActiveDoc

if checkNow == True:
    value = rs.GetDocumentUserText(key)

sc.doc = ghdoc

print value
# ---------- end python ----------
list_item_9 = ListItem(List=python, Index=0, Wrap=True)  # -> Item, Item1, Item2, Item3
project_defaults_wallpanelcornerstate = RemoteSender(list_item_9.Item3)
project_defaults_wallpanelgaps = RemoteSender(list_item_9.Item2)
project_name = RemoteSender(list_item_9.Item)
addition_2 = Addition(A=list_item_9.Item1, B=0)
project_northrotation = RemoteSender(addition_2)

# ----
# Wall panels default sizes
project_defaults_wallpanelcornerstate_2 = RemoteReceiver(project_defaults_wallpanelcornerstate)
panel_42 = Panel("""Separated
Merged""")
create_pulldown_menu = CreatePulldownMenu(Label="Corner panels", ListItems=panel_42, showLabel=True)
project_defaults_wallpanelgaps_2 = RemoteReceiver(project_defaults_wallpanelgaps)
create_label_8 = CreateLabel(LabelText="Ventilated facades", LabelSize=18, Justification=0)
create_text_box_4 = CreateTextBox(Label="Wall panel gaps", UpdateButton=False, showLabel=True)
create_button_2 = CreateButton(ButtonName="Update panels", ButtonStyle=0)
member_index_2 = MemberIndex(Set=panel_42, Member=project_defaults_wallpanelcornerstate_2)  # -> Index, Count
adjust_element_positioning_2 = AdjustElementPositioning(ElementsToAdjust=create_text_box_4, AbsolutePositioning=False, Width=Slider(256, range=0..1000))
value_listener_8 = ValueListener(Elements=create_pulldown_menu, SomeProperty=True)  # -> Values, Indices
create_wrappanel_5 = CreateWrapPanel(UIElements=[create_text_box_4, create_button_2], Horizontal=True)
value_listener_9 = ValueListener(Elements=create_button_2, SomeProperty=True)  # -> Values, Indices
set_textbox_contents_3 = SetTextBoxContents(TextBoxToModify=create_text_box_4, NewTextBoxContents=project_defaults_wallpanelgaps_2)
value_listener_10 = ValueListener(Elements=create_text_box_4, SomeProperty=True)  # -> Values, Indices
default_state_wall_panel_corner = RemoteSender(value_listener_8.Values)
input_updatepanelgaps = RemoteSender(value_listener_9.Values)
default_size_wall_panel_gap = RemoteSender(value_listener_10.Values)
panel_43 = Panel(value_listener_10.Values)
set_list_contents = SetListContents(ListToModify=create_pulldown_menu, NewListContents=panel_42, SelectedIndex=member_index_2.Index)
merge_5 = Merge(Data1=create_label_8, Data2=create_wrappanel_5, Data4=create_pulldown_menu)

# ----
# Nord rotation
panel_44 = Panel("°    It can not be changed later")
panel_45 = Panel("North rotation ⟲ : ")
create_label_9 = CreateLabel(LabelText="North rotation ⟳ : ", LabelSize=18, Justification=0)
create_label_10 = CreateLabel(LabelText=panel_44, LabelSize=12, Justification=0)
project_northrotation_2 = RemoteReceiver(project_northrotation)
create_text_box_5 = CreateTextBox(DefaultText="0", UpdateButton=False, showLabel=True)
adjust_element_positioning_3 = AdjustElementPositioning(ElementsToAdjust=create_label_10, Margin="-6,5,0,0", AbsolutePositioning=False)
value_listener_11 = ValueListener(Elements=create_text_box_5, SomeProperty=True)  # -> Values, Indices
create_wrappanel_6 = CreateWrapPanel(UIElements=[create_label_9, create_text_box_5, create_label_10], Horizontal=True)
set_textbox_contents_4 = SetTextBoxContents(TextBoxToModify=create_text_box_5, NewTextBoxContents=project_northrotation_2)
nord_rotation = Number(value_listener_11.Values)
negative = Negative(Value=value_listener_11.Values)
input_northrotation = RemoteSender(negative)

hui_wall_panel_gap = RemoteSender(merge_5)
default_size_wall_panel_gap_2 = RemoteReceiver(default_size_wall_panel_gap)
input_northrotation_2 = RemoteReceiver(input_northrotation)
text_3 = Text(input_northrotation_2)  # disabled
writedocumentusertext_4 = WriteDocumentUserText(key="HO_NorthRotation", value=text_3)  # -> value; inputs writeNow: Boolean; disabled; same code as writedocumentusertext
gznorthrotation = CSharpScript(
    update=Toggle(True),
    angle=input_northrotation_2,
    Reference=["C:\Program Files\Rhino 7\Plug-ins\Grasshopper\Components\ScriptComponents.gha", "C:\Program Files\NoDoubts\Godzilla\System\Godzilla.dll", "C:\Program Files\NoDoubts\Godzilla\System\RhGodzilla.rhp"])  # -> out, Angle; inputs update: Boolean, angle: Double
# ---------- gznorthrotation: C# ----------
    var gzPlugin = Rhino.RhinoApp.GetPlugInObject("RhGodzilla");
    var gz = RhGodzilla.RhGodzillaPlugin.Instance as RhGodzilla.RhGodzillaPlugin;
    if (update){
      var project = RhGodzilla.GhApp.GzProject.CurrentProject;
      if(!String.IsNullOrEmpty(angle.ToString()))
      {
        project.NorthRotation = angle;
      }
      Angle = project.NorthRotation;
    }
# ---------- end gznorthrotation ----------
input_northrotation_3 = RemoteReceiver(input_northrotation)

# ----
# 0.2. EDIT PANEL GAPS
default_size_wall_panel_gap_3 = RemoteReceiver(default_size_wall_panel_gap)
input_updatepanelgaps_2 = RemoteReceiver(input_updatepanelgaps)
cluster = Cluster_3(wall_panel_gaps=default_size_wall_panel_gap_3, update=input_updatepanelgaps_2)
help = Panel(cluster)

input_northrotation_4 = RemoteReceiver(input_northrotation)

# ----
# North Symbol
contour_curve = Curve()
end_points = EndPoints(Curve=contour_curve)  # -> Start, End
plane = Plane(end_points.Start)
xy_plane = XYPlane(Origin=Point(0, 0, 1))
plane_2 = Plane(xy_plane)
number_slider_2 = Slider(600, range=0..1000)
rotate = Rotate(Geometry=plane_2, Angle=1.570796327, Plane=plane_2)  # -> Geometry, Transform
point_polar = PointPolar(BasePlane=rotate.Geometry, XYAngle=degrees(input_northrotation_4), ZAngle=0, Offset=expr("x*0.95", number_slider_2))
circle = Circle(Plane=plane_2, Radius=number_slider_2)
line = Line(StartPoint=plane_2, EndPoint=point_polar)

# ----
# Display: colors
floor_volumes = Relay()
entwine_2 = Entwine(
    Branch00=floor_volumes,
    Branch01=ColourSwatch(SwatchColor=RGB(0, 0, 0)),
    Branch02=ColourSwatch(SwatchColor=RGB(117, 117, 117)),
    Branch03=list_item_8,
    Branch04=ghpython_script.RH_color_blue,
    Branch05=ghpython_script.RH_color_grey,
    Branch06=ColourSwatch(SwatchColor=RGBA(255, 61, 61, 200)),
    FlattenInputs=True)  # -> simplify(Result)

# ----
# Display: geo
north_symbol = Relay([line, circle])
relay_5 = Relay()
relay_6 = Relay()
relay_7 = Relay()
relay_8 = Relay()
entwine_3 = Entwine(
    Branch00=relay_3,
    Branch01=north_symbol,
    Branch02=relay_5,
    Branch03=relay_8,
    Branch04=relay_6,
    Branch05=relay_7,
    Branch06=flatten(relay_4),
    FlattenInputs=True)  # -> simplify(Result)

# ----
# Display: widths
north_symbol_2 = Relay([Slider(17, range=0..100), Slider(7, range=0..100)])
entwine_4 = Entwine(Branch01=north_symbol_2, Branch03=Slider(7, range=0..10), FlattenInputs=True)  # -> simplify(Result)

display_geo = DisplayGeo(entwine_3)  # Display: geo
display_colors = DisplayColors(entwine_2)  # Display: colors
display_widths = DisplayWidths(entwine_4)  # Display: widths
# Logical group
# Interface
# Important/
# /result
# Making window fullscreen with windows zoom =
# 1.25 (this part will be unnecessary in web-
# version)
gzconduit = CSharpScript(
    geo=entwine_3,
    colors=entwine_2,
    widths=entwine_4,
    Reference=["C:\Program Files\Rhino 7\Plug-ins\Grasshopper\Components\ScriptComponents.gha", "C:\Program Files\NoDoubts\Godzilla\System\Godzilla.dll", "C:\Program Files\NoDoubts\Godzilla\System\RhGodzilla.rhp"])  # -> out; inputs geo: tree, colors: tree of Color, widths: tree of Int32; same code as gzconduit

# ----
# READ PROFILE BLOCKS DATA
list_block_document = ListBlockDocument()
text_fragment = TextFragment(Text=list_block_document, Start=0, Count=Slider(6, range=0..100))
evaluate = Evaluate(Expression="if((x=\"Profil\") OR (x=\"Panel \"),1,0)", x=text_fragment)
evaluate_2 = Evaluate(Expression="if((x=\"Profil\"),1,0)", x=text_fragment)
evaluate_3 = Evaluate(Expression="if((x=\"Profil\"),1,0)", x=text_fragment)
dispatch_4 = Dispatch(List=list_block_document, DispatchPattern=evaluate)  # -> ListA, ListB
dispatch_5 = Dispatch(List=list_block_document, DispatchPattern=evaluate_2)  # -> ListA, ListB
dispatch_6 = Dispatch(List=list_block_document, DispatchPattern=evaluate_3)  # -> ListA, ListB
replace_text_5 = ReplaceText(Text=dispatch_5.ListA, Find="Profile - Rectangular -", Replace="▮", RecursiveReplace=False)
replace_text_6 = ReplaceText(Text=replace_text_5, Find="Profile custom", Replace="▶", RecursiveReplace=False)
replace_text_7 = ReplaceText(Text=replace_text_6, Find="Profile - Default - ", Replace="✔️", RecursiveReplace=False)
sort_text_2 = SortText(Keys=replace_text_7, Culture=127)  # -> Keys, Values

panel_46 = Panel(list_block_document)
panel_47 = Panel(replace_text_7)
text_fragment_2 = TextFragment(Text=sort_text_2.Keys, Start=0, Count=1)
evaluate_4 = Evaluate(Expression="if((x=\"▶\"),1,0)", x=text_fragment_2)
dispatch_7 = Dispatch(List=sort_text_2.Keys, DispatchPattern=evaluate_4)  # -> ListA, ListB
replace_text_8 = ReplaceText(Text=dispatch_7.ListA, Find="▶ #", RecursiveReplace=False)
text_split_7 = TextSplit(Text=replace_text_8, Separators="-")
list_item_10 = ListItem(List=text_split_7, Index=0, Wrap=True)  # -> flatten(Item)
integer = Integer(list_item_10)
panel_48 = Panel(integer)
clean_tree = CleanTree(RemoveNulls=True, RemoveInvalid=True, RemoveEmpty=True, Tree=integer)
sort_text_3 = SortText(Keys=clean_tree, Culture=127)  # -> Keys, Values
list_item_11 = ListItem(List=sort_text_3.Keys, Index=-1, Wrap=True)
addition_3 = Addition(A=list_item_11, B=1)
panel_49 = Panel(addition_3)

# ----
# Set default materials
# Window panel
# Window profile
# Curtain Wall panel
# Curtain Wall profile
# Wall Vent.
# Wall Other
hui_non_transparent_non_wallmaterialslis_2 = RemoteReceiver(hui_non_transparent_non_wallmaterialslis)  # "HUI.Non-transparent&Non-wallMaterialsList"
hui_transparentmaterialslist_2 = RemoteReceiver(hui_transparentmaterialslist)
hui_wallmaterialslist_2 = RemoteReceiver(hui_wallmaterialslist)
panel_51 = Panel("""Window panel        
Window profile      
Door panel             
Door profile            
Curtain Wall panel  
Curtain Wall profile
Wall Vent.               
Wall Other              """)
entwine_5 = Entwine(
    Branch00=hui_transparentmaterialslist_2,
    Branch01=hui_non_transparent_non_wallmaterialslis_2,
    Branch02=hui_transparentmaterialslist_2,
    Branch03=hui_non_transparent_non_wallmaterialslis_2,
    Branch04=hui_transparentmaterialslist_2,
    Branch05=hui_non_transparent_non_wallmaterialslis_2,
    Branch06=hui_non_transparent_non_wallmaterialslis_2,
    Branch07=hui_wallmaterialslist_2,
    FlattenInputs=True)
project_listofmaterials_4 = RemoteReceiver(project_listofmaterials)
member_index_3 = MemberIndex(Set=entwine_5, Member=graft(replace_text_2))  # -> Index, Count
create_pulldown_menu_2 = CreatePulldownMenu(Label=graft(panel_51), ListItems=entwine_5, SelectedIndex=member_index_3.Index, showLabel=True)  # -> flatten(Pulldown)
create_pulldown_menu_3 = CreatePulldownMenu(Label="Window panel", ListItems=project_listofmaterials_4, showLabel=True)  # -> flatten(Pulldown); disabled
create_button_3 = CreateButton(ButtonName="Save", ButtonStyle=0)  # disabled
create_label_11 = CreateLabel(LabelText="MATERIALS", LabelSize=18, Justification=0)  # disabled
value_listener_12 = ValueListener(Elements=create_pulldown_menu_2, SomeProperty=True)  # -> flatten(Values), Indices
panel_52 = Panel(""" _tr

 _tr

 _tr


 _wa""")
concatenate = Concatenate(FragmentA=value_listener_12.Values, FragmentB=panel_52)
panel_53 = Panel(value_listener_12.Values)
materials = Text(concatenate)
defaults_actual_materials = RemoteSender(materials)

merge_6 = Merge(Data2=create_label_11, Data3=create_pulldown_menu_2, Data4=create_pulldown_menu_3, Data5=create_button_3)

hui_default_materials = RemoteSender(merge_6)

panel_54 = Panel("""0
1
2
3
4
5
6
6
6
6
6
6
6
7""")
defaults_actual_materials_2 = RemoteReceiver(defaults_actual_materials)
list_item_12 = ListItem(List=defaults_actual_materials_2, Index=panel_54, Wrap=True)

# ----
# Create layers, set materials
panel_55 = Panel(""">::Regelelement::Window::Window - Panel
>::Regelelement::Window
>::Regelelement::Door::Door - Panel
>::Regelelement::Door
>::Regelelement::CurtainWall::CurtainWall - Panel
>::Regelelement::CurtainWall::CurtainWall - Frame
>::Regelelement::Vent-Other::Vent-Other - Panel
>::Regelelement::Aluminium::Aluminium - Panel
>::Regelelement::Attica::Attika - Panel
>::Regelelement::Ceilin::Ceiling - Panel
>::Regelelement::Column::Column - Panel
>::Regelelement::Glass/Stone::Glass/Stone - Panel
>::Regelelement::MS-Other::MS-Other - Panel
>::Regelelement::Steel Construction::Steel Construction - Base""")
create_modify_layers_3 = CreateModifyLayers(LayerName=panel_55, LayerMaterial=list_item_12, DeleteLayer=False, enableFullPath=True)  # -> LayerNames, LayerFullPath

hui_default_materials_2 = RemoteReceiver(hui_default_materials)
create_expander = CreateExpander(UIElements=hui_default_materials_2, Header="Materials", Open=True)  # -> flatten(Expander)
set_expander = SetExpander(Expander=create_expander, ExpandedOpen=invert(addition))  # disabled
value_listener_13 = ValueListener(Elements=create_expander, SomeProperty=True)  # -> Values, Indices; disabled
# Selectable preview
stream_filter_2 = StreamFilter(Gate=value_listener_13.Values, Stream0=brep, Stream1=relay)  # disabled
custom_preview = CustomPreview(Material=concatenate)  # disabled

# ----
# Step 0 is completed
panel_56 = Panel("That's it! Continue to the next step! 🡪")
# Important unobvious stuff:
# index 0 => 0
# index 1 => length or height (max number)
# index 2... => all other shifts
# Important unobvious  stuff:
# index 0 => 0
# index 1 => length or height (max number)
# index 2... => all other shifts
panel_57 = Panel("Please create the project first (check the top of the window).")
create_button_4 = CreateButton(ButtonName=panel_56, ButtonStyle=0)
create_text_block_5 = CreateTextBlock(Text=panel_57, TextSize=12, Justification=1)
adjust_element_appearance_3 = AdjustElementAppearance(ElementsToAdjust=create_text_block_5, Background=ColourSwatch(SwatchColor=RGB(253, 255, 235)))
value_listener_14 = ValueListener(Elements=create_button_4, SomeProperty=True)  # -> flatten(Values), Indices
merge_7 = Merge(Data1=create_button_4, Data2=create_text_block_5)

# ----
# New custom profile
# Adjust position
# Base point shift
project_of_next_unique_block = RemoteReceiver()
panel_58 = Panel("""Auto
Horizontal 
Vertical""")
create_radio_button = CreateRadioButton(
    RadioButtonName=Tree({1}: ["🡬  ", "🡨  ", "🡯  "], {2}: [" 🡩 ", " ◼ ", " 🡫 "], {3}: ["🡭  ", "🡪  ", "🡮  "]),
    RadioButtonGroup="Align",
    InitiallySelected=Tree({1}: [True, False, False], {2}: [False, False, False], {3}: [False, False, False]))
panel_59 = Panel("The profile orientation")
panel_60 = Panel("""Horizontal 
Vertical""")
panel_61 = Panel("""1
0""")
status_selected = Panel(" ")
rotate_2 = Slider(0, range=-180..180)
create_label_12 = CreateLabel(LabelText="X", LabelSize=18, Justification=0)
create_label_13 = CreateLabel(LabelText="Y", LabelSize=18, Justification=0)
create_label_14 = CreateLabel(LabelText="Z", LabelSize=18, Justification=0)
concatenate_2 = Concatenate(FragmentA="#", FragmentB=project_of_next_unique_block)
create_text_block_6 = CreateTextBlock(Text="#", TextSize=12, Justification=0)
create_text_box_6 = CreateTextBox(Label="#", DefaultText="-", UpdateButton=False, showLabel=True)
create_label_15 = CreateLabel(LabelText="Base point shift: ", LabelSize=18, Justification=0)
create_text_block_7 = CreateTextBlock(Text=status_selected, TextSize=12, Justification=0)
create_label_16 = CreateLabel(LabelText="Select curve(s) in XY plane", LabelSize=18, Justification=0)
create_button_5 = CreateButton(ButtonName="Select", ButtonStyle=1)
create_label_17 = CreateLabel(LabelText="Select curve(s) in XY plane", LabelSize=18, Justification=0)
create_button_6 = CreateButton(ButtonName="Select", ButtonStyle=1)
create_text_box_7 = CreateTextBox(DefaultText="0", UpdateButton=False, showLabel=True)
create_text_box_8 = CreateTextBox(DefaultText="0", UpdateButton=False, showLabel=True)
create_text_box_9 = CreateTextBox(DefaultText="0", UpdateButton=False, showLabel=True)
create_toggle = CreateToggle(Default=False, OnLabel="The profile is vertical     ", OffLabel="The profile is horizontal")
create_text_block_8 = CreateTextBlock(Text=panel_59, TextSize=16, Justification=0)
create_radio_button_2 = CreateRadioButton(RadioButtonName=panel_60, RadioButtonGroup=panel_59, InitiallySelected=panel_61)
create_button_7 = CreateButton(ButtonName="Bake AncorPoints to adjust them", ButtonStyle=0)
create_simple_grid_2 = CreateSimpleGrid(UIElements=create_radio_button, RowDefinitions="Auto", ColumnDefinitions="Auto")
set_textblock_contents_2 = SetTextBlockContents(TextBlockToModify=create_text_block_6, NewTextBlockContents=concatenate_2)
create_slider = CreateSlider(Slider=rotate_2, ShowBounds=False, ShowTicks=False, ShowTooltip=False, ShowValLabel=True, showLabel=True)
create_label_18 = CreateLabel(LabelText="Align", LabelSize=18, Justification=0)
value_listener_15 = ValueListener(Elements=create_toggle, SomeProperty=True)  # -> Values, Indices
value_listener_16 = ValueListener(Elements=create_button_7, SomeProperty=True)  # -> Values, Indices
adjust_element_positioning_4 = AdjustElementPositioning(ElementsToAdjust=create_text_block_6, AbsolutePositioning=False, WIDTH29=29, Height=26)
value_listener_17 = ValueListener(Elements=create_simple_grid_2, SomeProperty=True)  # -> flatten(Values), Indices
create_wrappanel_7 = CreateWrapPanel(UIElements=[create_text_block_8, create_radio_button_2], Horizontal=True)  # -> flatten(WrapPanel)
value_listener_18 = ValueListener(Elements=create_radio_button_2, SomeProperty=True)  # -> flatten(Values), Indices
create_wrappanel_8 = CreateWrapPanel(UIElements=[create_label_16, create_button_5, create_text_block_7], Horizontal=True)  # -> flatten(WrapPanel)
create_wrappanel_9 = CreateWrapPanel(UIElements=[create_label_17, create_button_6, create_text_block_7], Horizontal=True)  # -> flatten(WrapPanel)
value_listener_19 = ValueListener(Elements=create_button_6, SomeProperty=True)  # -> Values, Indices
adjust_element_appearance_4 = AdjustElementAppearance(
    ElementsToAdjust=create_button_6,
    Foreground=ColourSwatch(SwatchColor=RGB(255, 255, 255)),
    Background=ColourSwatch(SwatchColor=RGB(0, 0, 0)))
merge_8 = Merge(
    Data1=create_label_15,
    Data2=create_label_12,
    Data3=create_text_box_7,
    Data4=create_label_13,
    Data5=create_text_box_8,
    Data6=create_label_14,
    Data7=create_text_box_9)  # -> graft(Result)
create_text_box_10 = CreateTextBox(Label="Name:", DefaultText=" ", UpdateButton=False, showLabel=True)
value_listener_20 = ValueListener(Elements=create_slider, SomeProperty=True)  # -> Values, Indices
input_bake_ancor_points = RemoteSender(value_listener_16.Values)
create_simple_grid_3 = CreateSimpleGrid(UIElements=merge_8, RowDefinitions="Auto", ColumnDefinitions="Auto")  # -> flatten(SimpleGrid)
member_index_4 = MemberIndex(Set=value_listener_18.Values, Member=True)  # -> Index, Count
apply = Boolean()  # disabled
panel_62 = Panel("""0
3
6
1
4
7
2
5
8""")
value_listener_21 = ValueListener(Elements=[create_text_box_7, create_text_box_8, create_text_box_9], SomeProperty=True)  # -> flatten(Values), Indices
gate_or = GateOr(A=invert(value_listener_19.Values), B=apply)
adjust_element_positioning_5 = AdjustElementPositioning(ElementsToAdjust=create_text_box_10, AbsolutePositioning=False, WIDTH160=160, Height=26)
value_listener_22 = ValueListener(Elements=create_text_box_10, SomeProperty=True)  # -> Values, Indices
input_profile_orientation = RemoteSender(member_index_4.Index)
dispatch_8 = Dispatch(List=panel_62, DispatchPattern=value_listener_17.Values)  # -> ListA, ListB
stream_filter_3 = StreamFilter(Gate=0, Stream1=value_listener_20.Values)
objects_by_selection = ObjectsBySelection(Reset=gate_or, LiveMode=False)  # -> simplify(graft(SelectedGeometry))
input_block_name = RemoteSender(value_listener_22.Values)
filter_by_type = FilterByType(Geometry=objects_by_selection, ObjectType=["1", "0"])  # -> flatten(Geometry)
text_join_4 = TextJoin(Text=value_listener_21.Values, Join=",")
clean_tree_2 = CleanTree(RemoveNulls=True, RemoveInvalid=True, RemoveEmpty=False, Tree=filter_by_type)  # -> simplify(graft(Tree))
stream_filter_4 = StreamFilter(Gate=0, Stream1=text_join_4)
input_basepointcoordinates = RemoteSender(text_join_4)
custom_preview_2 = CustomPreview(Geometry=stream_filter_4, Material=ColourSwatch(SwatchColor=RGB(255, 255, 255)))
list_length_2 = ListLength(List=flatten(clean_tree_2))
addition_4 = Addition(A=list_length_2, B=0)
concatenate_3 = Concatenate(FragmentA=addition_4, FragmentB=" selected")
boolean_3 = Boolean(addition_4)
input_selectedgeoforcustomprofile = RemoteSender(clean_tree_2)
merge_9 = Merge(
    Data1=create_wrappanel_9,
    Data2=create_wrappanel_7,
    Data3=create_button_7,
    Data4=create_label_18,
    Data5=flatten(create_simple_grid_2),
    Data6=create_simple_grid_3,
    Data7=create_slider)  # -> flatten(Result)
set_textblock_contents_3 = SetTextBlockContents(TextBlockToModify=create_text_block_7, NewTextBlockContents=concatenate_3)
hui_selectgeotoblock = RemoteSender(merge_9)

point = Point(filter_by_type)
clean_tree_3 = CleanTree(RemoveNulls=True, RemoveInvalid=True, RemoveEmpty=False, Tree=point)
list_length_3 = ListLength(List=flatten(clean_tree_3))
addition_5 = Addition(A=list_length_3, B=0)
boolean_4 = Boolean(addition_5)
are_ancorpoints_selected = RemoteSender(boolean_4)
are_ancorpoints_selected_2 = RemoteReceiver(are_ancorpoints_selected)
boolean_5 = Boolean(invert(are_ancorpoints_selected_2))

# ----
# Existing profile
# State saving and restoration is
#  not working without label!
panel_63 = Panel("list of blocks")
create_pulldown_menu_4 = CreatePulldownMenu(Label=":", ListItems=panel_63, showLabel=True)
create_button_8 = CreateButton(ButtonName="update list", ButtonStyle=3)
set_list_contents_2 = SetListContents(ListToModify=create_pulldown_menu_4, NewListContents=sort_text_2.Keys)
value_listener_23 = ValueListener(Elements=create_button_8, SomeProperty=True)  # -> Values, Indices

enable_disable_object = EnableDisableObject(Enabled=invert(value_listener_23.Values))

value_listener_24 = ValueListener(Elements=create_pulldown_menu_4, SomeProperty=True)  # -> Values, Indices
input_selected_existing_profile = RemoteSender(value_listener_24.Values)

# ----
# New rectangular profile
panel_64 = Panel("W:")
create_text_box_11 = CreateTextBox(Label=panel_64, UpdateButton=False, showLabel=True)
create_text_box_12 = CreateTextBox(Label="D:", UpdateButton=False, showLabel=True)
set_textbox_contents_5 = SetTextBoxContents(TextBoxToModify=create_text_box_11, NewTextBoxContents=list_item_3.Item1)
adjust_element_positioning_6 = AdjustElementPositioning(
    ElementsToAdjust=[create_text_box_12, create_text_box_11],
    AbsolutePositioning=False,
    Width=Slider(84, range=0..100),
    Height=26)
value_listener_25 = ValueListener(Elements=create_text_box_11, SomeProperty=True)  # -> Values, Indices
value_listener_26 = ValueListener(Elements=create_text_box_12, SomeProperty=True)  # -> Values, Indices
set_textbox_contents_6 = SetTextBoxContents(TextBoxToModify=create_text_box_12, NewTextBoxContents=list_item_3.Item2)
input_rectanglewidth = RemoteSender(value_listener_25.Values)
list_item_13 = ListItem(List=flatten(value_listener_25.Values), Index=0, Wrap=False)  # -> Item, Item1
list_item_14 = ListItem(List=flatten(value_listener_26.Values), Index=0, Wrap=False)  # -> Item, Item1
input_rectangledepth = RemoteSender(value_listener_26.Values)

# ----
# Profile editor
# State saving and restoration is
#  not working without label!
panel_65 = Panel("Profile editor")
panel_66 = Panel("""Existing profile
New rectangular
New custom""")
create_true_only_button_6 = CreateTrueOnlyButton(SubmitABug="💬", ButtonStyle=2)
create_true_only_button_7 = CreateTrueOnlyButton(ButtonName=" ? ", ButtonStyle=2)
hui_submit_a_bug_buttons_2 = RemoteSender(create_true_only_button_6)
create_label_19 = CreateLabel(LabelText=panel_65, LabelSize=18, Justification=0)
create_label_20 = CreateLabel(LabelText="Select parts above to edit their profiles", LabelSize=12, Justification=1)
create_label_21 = CreateLabel(LabelText="Type", LabelSize=12, Justification=0)  # disabled
create_pulldown_menu_5 = CreatePulldownMenu(Label="Type", ListItems=panel_66, SelectedIndex=0, showLabel=True)  # -> flatten(Pulldown)
create_wrappanel_10 = CreateWrapPanel(UIElements=[create_label_19, create_true_only_button_7, create_true_only_button_6], Horizontal=True)
value_listener_27 = ValueListener(Elements=create_pulldown_menu_5, SomeProperty=True)  # -> Values, Indices
value_listener_28 = ValueListener(Elements=create_true_only_button_7, SomeProperty=True)  # -> Values, Indices
adjust_element_positioning_7 = AdjustElementPositioning(ElementsToAdjust=create_true_only_button_7, Margin="190,0,0,0", AbsolutePositioning=False, Width=30, Height=30)
input_showhelpforprofileeditor = RemoteSender(value_listener_28.Values)
input_profile_type_0_exist = RemoteSender(value_listener_27.Indices)
adjust_element_positioning_8 = AdjustElementPositioning(ElementsToAdjust=create_true_only_button_6, Margin="10,0,0,0", AbsolutePositioning=False, Width=30, Height=30)

input_showhelpforprofileeditor_2 = RemoteReceiver(input_showhelpforprofileeditor)  # disabled

# ----
# APPLY
panel_67 = Panel("Apply profiles")
create_button_9 = CreateButton(ButtonName=panel_67, ButtonStyle=1)
hui_apply = RemoteSender(create_button_9)
value_listener_29 = ValueListener(Elements=create_button_9, SomeProperty=True)  # -> Values, Indices
input_apply = RemoteSender(value_listener_29.Values)

input_apply_2 = RemoteReceiver(input_apply)
gate_or_2 = GateOr(A=Toggle(True), B=input_apply_2)
getdocumentusertext_6 = GetDocumentUserText(key="HO_Counter_CustomProfile", checkNow=gate_or_2)  # -> value; same code as getdocumentusertext
addition_6 = Addition(A=getdocumentusertext_6, B=1)
project_of_next_unique_block_2 = RemoteSender(addition_6)
input_apply_3 = RemoteReceiver(input_apply)
gate_or_3 = GateOr(A=Toggle(True), B=input_apply_3)
getdocumentusertext_7 = GetDocumentUserText(key=x_2, checkNow=gate_or_3)  # -> value; same code as getdocumentusertext
text_split_8 = TextSplit(Text=getdocumentusertext_7, Separators=";")
list_item_15 = ListItem(List=text_split_8, Index=0, Wrap=True)  # -> flatten(Item)
cluster_2 = Cluster_5(text=list_item_15)

# ----
# Default profiles - list
panel_68 = Panel("Default profiles (select to edit them below)")
create_label_22 = CreateLabel(LabelText=panel_68, LabelSize=18, Justification=0)
create_text_block_9 = CreateTextBlock(Text=["Part", panel_23], TextSize=12, Justification=0)
create_text_block_10 = CreateTextBlock(Text="Edit", TextSize=12, Justification=0)
create_checkbox = CreateCheckbox(Label=panel_23, StartingValue=False)
create_text_block_11 = CreateTextBlock(Text="D", TextSize=12, Justification=0)  # disabled
create_text_box_13 = CreateTextBox(UpdateButton=False, showLabel=True)  # disabled
set_textbox_contents_7 = SetTextBoxContents(TextBoxToModify=create_text_box_13, NewTextBoxContents=text_split_5)
adjust_element_positioning_9 = AdjustElementPositioning(ElementsToAdjust=create_text_box_13, AbsolutePositioning=False, Width=Slider(36, range=0..100))
entwine_6 = Entwine(
    Branch00=create_text_block_9,
    Branch01=[create_text_block_10, create_checkbox],
    Branch02=[create_text_block_11, create_text_box_13],
    FlattenInputs=True)
value_listener_30 = ValueListener(Elements=create_checkbox, SomeProperty=True)  # -> Values, Indices
mass_addition = MassAddition(Input=flatten(value_listener_30.Values))  # -> Result, PartialResults
set_checkbox = SetCheckBox(CheckBoxToModify=create_checkbox, NewCheckBoxLabel=cluster_2)
input_is_profile_selected_as_tree = RemoteSender(value_listener_30.Values)
panel_69 = Panel(value_listener_30.Values)
is_profile_to_edit_selected = RemoteSender(mass_addition.Result)
create_simple_grid_4 = CreateSimpleGrid(UIElements=entwine_6, RowDefinitions="Auto", ColumnDefinitions="Auto")  # -> flatten(SimpleGrid)
merge_10 = Merge(Data1=create_label_22, Data2=create_simple_grid_4)

is_profile_to_edit_selected_2 = RemoteReceiver(is_profile_to_edit_selected)
hide_show_element_3 = HideShowElement(ElementToHideShow=create_button_9, Show=is_profile_to_edit_selected_2, Collapse=True, Disable=False)

is_profile_to_edit_selected_3 = RemoteReceiver(is_profile_to_edit_selected)
hide_show_element_4 = HideShowElement(ElementToHideShow=create_label_20, Show=invert(is_profile_to_edit_selected_3), Collapse=True, Disable=False)
hide_show_element_5 = HideShowElement(
    ElementToHideShow=[create_label_21, create_pulldown_menu_5],
    Show=is_profile_to_edit_selected_3,
    Collapse=True,
    Disable=False)

is_profile_to_edit_selected_4 = RemoteReceiver(is_profile_to_edit_selected)
is_profile_to_edit_selected_5 = RemoteReceiver(is_profile_to_edit_selected)
is_profile_to_edit_selected_6 = RemoteReceiver(is_profile_to_edit_selected)

input_profile_type_0_exist_2 = RemoteReceiver(input_profile_type_0_exist)
equality = Equality(FirstNumber=input_profile_type_0_exist_2, SecondNumber=0)  # -> Equality, Inequality
gate_and_2 = GateAnd(A=equality.Equality, B=is_profile_to_edit_selected_4)
hide_show_element_6 = HideShowElement(ElementToHideShow=[create_pulldown_menu_4, create_button_8], Show=gate_and_2, Collapse=True, Disable=False)

input_profile_type_0_exist_3 = RemoteReceiver(input_profile_type_0_exist)
entwine_7 = Entwine(
    Branch00=input_profile_type_0_exist_3,
    Branch01=value_listener_25.Values,
    Branch02=value_listener_26.Values,
    FlattenInputs=True)
equality_2 = Equality(FirstNumber=input_profile_type_0_exist_3, SecondNumber=1)  # -> Equality, Inequality
flip_matrix_3 = FlipMatrix(Data=entwine_7)
text_join_5 = TextJoin(Text=flip_matrix_3, Join=",")  # -> flatten(Result)
gate_and_3 = GateAnd(A=equality_2.Equality, B=is_profile_to_edit_selected_5)
hide_show_element_7 = HideShowElement(ElementToHideShow=[create_text_box_11, create_text_box_12], Show=gate_and_3, Collapse=True, Disable=False)
concatenate_4 = Concatenate(FragmentA="[", FragmentB=text_join_5, FragmentC="]")

is_profile_to_edit_selected_7 = RemoteReceiver(is_profile_to_edit_selected)

input_profile_type_0_exist_4 = RemoteReceiver(input_profile_type_0_exist)
equality_3 = Equality(FirstNumber=input_profile_type_0_exist_4, SecondNumber=2)  # -> Equality, Inequality
gate_and_4 = GateAnd(A=equality_3.Equality, B=is_profile_to_edit_selected_6)
hide_show_element_8 = HideShowElement(ElementToHideShow=[create_text_box_10, create_text_block_6], Show=gate_and_4, Collapse=True, Disable=False)
isprofileeditoractive = RemoteSender(gate_and_4)
isprofileeditoractive_2 = RemoteReceiver(isprofileeditoractive)
hide_show_element_9 = HideShowElement(ElementToHideShow=hui_selectgeotoblock, Show=isprofileeditoractive_2, Collapse=True, Disable=False)

gate_and_5 = GateAnd(A=is_profile_to_edit_selected_7, B=boolean_5)
hide_show_element_10 = HideShowElement(ElementToHideShow=create_wrappanel_7, Show=gate_and_5, Collapse=True, Disable=False)

# ----
# PROFILE  EDITOR
entwine_8 = Entwine(
    Branch00=create_label_21,
    Branch01=create_pulldown_menu_5,
    Branch02=create_text_box_11,
    Branch03=create_text_box_12,
    Branch04=create_text_block_6,
    Branch05=create_text_box_10,
    Branch06=create_pulldown_menu_4,
    Branch07=create_button_8,
    FlattenInputs=True)  # -> flatten(Result)
create_wrappanel_11 = CreateWrapPanel(UIElements=flatten(entwine_8), Horizontal=True)  # -> flatten(WrapPanel)
hui_selectgeotoblock_2 = RemoteReceiver(hui_selectgeotoblock)
hui_apply_2 = RemoteReceiver(hui_apply)
merge_11 = Merge(
    Data1=create_wrappanel_10,
    Data2=create_label_20,
    Data3=create_wrappanel_11,
    Data4=hui_selectgeotoblock_2,
    Data6=hui_apply_2)  # -> flatten(Result)
hui_profile_editor = RemoteSender(merge_11)

hui_default_profiles = RemoteSender(merge_10)
hui_default_profiles_2 = RemoteReceiver(hui_default_profiles)

# ----
# SIZES EXPANDER
hui_wall_panel_gap_2 = RemoteReceiver(hui_wall_panel_gap)
hui_profile_editor_2 = RemoteReceiver(hui_profile_editor)
merge_12 = Merge(Data1=hui_wall_panel_gap_2, Data2=hui_default_offsets_2, Data3=hui_default_profiles_2, Data4=hui_profile_editor_2)
create_expander_2 = CreateExpander(UIElements=merge_12, Header="Sizes", Open=True)  # -> flatten(Expander)

input_is_profile_selected_as_tree_2 = RemoteReceiver(input_is_profile_selected_as_tree)

merge_13 = Merge(
    Data1=create_label_6,
    Data2=create_label_7,
    Data3=create_file_picker_2,
    Data4=create_expander,
    Data6=create_expander_2,
    Data7=create_button,
    Data8=merge_3)
hui_expaner_windowsdefaults = RemoteSender(merge_13)

# ----
# Write DB
# Continue
default_state_wall_panel_corner_2 = RemoteReceiver(default_state_wall_panel_corner)
default_size_wall_panel_gap_4 = RemoteReceiver(default_size_wall_panel_gap)
defaults_actual_materials_3 = RemoteReceiver(defaults_actual_materials)  # disabled
merge_14 = Merge(Data1=default_size_wall_panel_gap_4, Data2=default_state_wall_panel_corner_2, Data3=defaults_actual_materials_3)
merge_15 = Merge(Data1=defaults_actual_materials_3, Data2=text_join_5)  # disabled
panel_70 = Panel("""HO_DefaultSize-PanelGaps
HO_DefaultState-CornerPanelsGap""")
boolean_toggle_8 = BooleanToggle(False)  # disabled
project_jsonpath_3 = RemoteReceiver()
values = Text(merge_14)
boolean_6 = Boolean(Toggle(True))
# Insertin data from OMG dropdown
# To not freeze because of too small input
panel_71 = Panel(merge_15)  # disabled
python_2 = PythonScript(key=panel_70, value=values, writeNow=boolean_6)  # -> value; inputs writeNow: Boolean
# ---------- python_2: Python ----------
import rhinoscriptsyntax as rs
import scriptcontext as sc
import Rhino

sc.doc = Rhino.RhinoDoc.ActiveDoc

if writeNow == True:
  value = rs.SetDocumentUserText(key,value)
  a=1
else:
  a=0

sc.doc = ghdoc

print value
# ---------- end python_2 ----------
addkvtonestedjson = AddKeyValueToNestedJSON(json_path=project_jsonpath_3, key=panel_10, value=merge_15, write_now=boolean_toggle_8)  # -> out; inputs write_now: Boolean; disabled
# ---------- addkvtonestedjson: Python ----------
# Adds key-value pair to json file

__author__ = "Yury Nasonov"
__version__ = "1"

ghenv.Component.Name = "Add key-value to nested JSON"
ghenv.Component.NickName = 'AddKVtoNestedJSON'
ghenv.Component.Message = 'Add key-value to nested JSON'

# ———————————————————————————————————————————————————————————

import rhinoscriptsyntax as rs
import json

# ———————————————————————————————————————————————————————————

if write_now:
    #get key depth 
    key_list=key.split(".")
    key_count = len(key_list)
    with open(json_path, 'r+') as f:
        data = json.load(f)
        if key_count==1:
            data[key] = value # <--- add `id` value.
        else:
            if key_count==2:               #for input like key0.key1
                key0 =key_list[0]
                key1=key_list[1]
                data[key0][key1] = value
            if key_count==3:               #for input like key0.key1.key2
                key0 =key_list[0]
                key1=key_list[1]
                key2=key_list[2]
                data[key0][key1][key2] = value
            if key_count==4:               #for input like key0.key1.key2.key3
                key0 =key_list[0]
                key1=key_list[1]
                key2=key_list[2]
                key3=key_list[3]
                data[key0][key1][key2][key3] = value
            if key_count==5:               #for input like key0.key1.key2.key3.key4
                key0 =key_list[0]
                key1=key_list[1]
                key2=key_list[2]
                key3=key_list[3]
                key4=key_list[4]
                data[key0][key1][key2][key3][key4] = value
        f.seek(0)        # <--- should reset file position to the beginning.
        json.dump(data, f, indent=4, ensure_ascii=False)
        f.truncate()     # remove remaining part
        f.close()
# ---------- end addkvtonestedjson ----------

hui_expaner_windowsdefaults_2 = RemoteReceiver(hui_expaner_windowsdefaults)

# ----
# Create new project
# Read rhino file name
panel_72 = Panel("New project name:")
create_label_23 = CreateLabel(LabelText=panel_72, LabelSize=18, Justification=0)
create_button_10 = CreateButton(ButtonName="Create", ButtonStyle=0)
create_text_box_14 = CreateTextBox(UpdateButton=False, showLabel=True)
project_name_2 = RemoteReceiver(project_name)
create_text_block_12 = CreateTextBlock(Text="✔️ Project is created", TextSize=12, Justification=0)
value_listener_31 = ValueListener(Elements=create_text_box_14, SomeProperty=True)  # -> Values, Indices
create_wrappanel_12 = CreateWrapPanel(UIElements=[create_label_23, create_text_box_14, create_button_10], Horizontal=True)
set_textbox_contents_8 = SetTextBoxContents(TextBoxToModify=create_text_box_14, NewTextBoxContents=project_name_2)
value_listener_32 = ValueListener(Elements=create_button_10, SomeProperty=True)  # -> Values, Indices
adjust_element_positioning_10 = AdjustElementPositioning(ElementsToAdjust=create_text_box_14, AbsolutePositioning=False, Width=Slider(158, range=0..1000))
poject_name = Text(value_listener_31.Values)
boolean_7 = Boolean(invert(value_listener_32.Values))
c_script = CSharpScript(
    checkNow=boolean_7,
    Reference=["C:\Program Files\Rhino 7\Plug-ins\Grasshopper\Components\ScriptComponents.gha", "C:\Program Files\NoDoubts\Godzilla\System\Godzilla.dll", "C:\Program Files\NoDoubts\Godzilla\System\RhGodzilla.rhp"])  # -> out, A; inputs checkNow: Boolean
# ---------- c_script: C# ----------
    if (checkNow){
      A = System.IO.Path.GetFileNameWithoutExtension(RhinoDocument.Path);
    }
# ---------- end c_script ----------
expression_3 = Expression(x=poject_name, y=c_script.A, Expression="if (x=y, 1, 0)")

list_length_4 = ListLength(List=poject_name)
boolean_8 = Boolean(list_length_4)

addition_7 = Addition(A=expression_3, B=0)

is_project_saved = RemoteSender(addition_7)
list_item_16 = ListItem(List="✔ Project is created", Index=addition_7, Wrap=True)
set_textblock_contents_4 = SetTextBlockContents(TextBlockToModify=create_text_block_12, NewTextBlockContents=list_item_16)

is_project_saved_2 = RemoteReceiver(is_project_saved)
hide_show_element_11 = HideShowElement(ElementToHideShow=create_text_block_5, Show=invert(is_project_saved_2), Collapse=True, Disable=False)
gate_and_6 = GateAnd(A=value_listener_14.Values, B=is_project_saved_2)
hide_show_element_12 = HideShowElement(ElementToHideShow=create_button_4, Show=True, Collapse=True, Disable=invert(is_project_saved_2))

c_script_2 = CSharpScript(
    name=poject_name,
    Reference=["C:\Program Files\Rhino 7\Plug-ins\Grasshopper\Components\ScriptComponents.gha", "C:\Program Files\NoDoubts\Godzilla\System\Godzilla.dll", "C:\Program Files\NoDoubts\Godzilla\System\RhGodzilla.rhp"])  # -> N; inputs name: String
# ---------- c_script_2: C# ----------
    string nonEmptyName;
    if(String.IsNullOrEmpty(name)){
      nonEmptyName = string.Format("{0:yyyy-MM-dd_HH-mm-ss}", DateTime.Now);
    }
    else{
      nonEmptyName = name;
    }
      N =nonEmptyName;
# ---------- end c_script_2 ----------

# ----
# Write project name
# as doc attribute
boolean_toggle_9 = BooleanToggle(True)
seetting_rhinodoc_attribute_2 = Panel("HO_ProjectName")
text_4 = Text(poject_name)
python_3 = PythonScript(key=seetting_rhinodoc_attribute_2, value=text_4, writeNow=value_listener_32.Values)  # -> value
# ---------- python_3: Python ----------
import rhinoscriptsyntax as rs
import scriptcontext as sc
import Rhino

sc.doc = Rhino.RhinoDoc.ActiveDoc

if writeNow == True:
  value = rs.SetDocumentUserText(key,value)

sc.doc = ghdoc

print value
# ---------- end python_3 ----------

# ----
# Open project
# NOTE It will ignore
# incremental saved files
# NOT STABLE
panel_73 = Panel(""" 
 
 
 
 
 
 
 
 
 
 
 
 
 
 
 
 
 
 
 
 
 
 
 
 
 
 
 
 
 
 
 
 """)
create_button_11 = CreateButton(ButtonName=panel_73, ButtonStyle=0)
value_listener_33 = ValueListener(Elements=create_button_11, SomeProperty=True)  # -> Values, Indices
member_index_5 = MemberIndex(Set=flatten(value_listener_33.Values), Member=True)  # -> Index, Count
mass_addition_2 = MassAddition(Input=flatten(value_listener_33.Values))  # -> Result, PartialResults
mass_addition_3 = MassAddition(Input=flatten(value_listener_33.Values))  # -> Result, PartialResults
boolean_9 = Boolean(mass_addition_2.Result)
boolean_10 = Boolean(mass_addition_3.Result)
create_expander_3 = CreateExpander(UIElements=create_button_11, Header="Or open existing project", Open=False)
adjust_element_appearance_5 = AdjustElementAppearance(ElementsToAdjust=create_expander_3, Background=ColourSwatch(SwatchColor=RGB(255, 255, 255)))

merge_16 = Merge(
    Data1=create_wrappanel,
    Data2=create_wrappanel_12,
    Data3=create_text_block_12,
    Data4=create_expander_3,
    Data5=create_wrappanel_2,
    Data6=create_wrappanel_6)
# SUBMIT A BUG
cthulhu = Merge(
    Data1=create_text_box_14,
    Data2=create_button_10,
    Data3=create_text_block_12,
    Data4=create_button_11,
    Data5=create_text_block,
    Data6=create_true_only_button_3,
    Data7=create_text_box_5,
    Data8=create_pulldown_menu_2,
    Data9=create_text_box_4,
    Data10=create_button_2,
    Data11=create_pulldown_menu,
    Data12=create_text_box,
    Data13=create_text_box_2,
    Data14=create_checkbox,
    Data15=create_text_box_13,
    Data16=create_pulldown_menu_5,
    Data17=create_pulldown_menu_4,
    Data18=create_text_box_11,
    Data19=create_text_box_12,
    Data20=create_text_block_6,
    Data21=create_text_box_6,
    Data22=create_button_6,
    Data23=create_text_block_7,
    Data24=create_label_16,
    Data25=create_button_5,
    Data26=create_toggle,
    Data27=create_radio_button_2,
    Data28=create_button_7,
    Data29=flatten(create_radio_button),
    Data30=create_text_box_7,
    Data31=create_text_box_8,
    Data32=create_text_box_9,
    Data33=create_slider,
    Data34=create_button_9)  # disabled

# ----
# Save 3dm
# Create folder
panel_74 = Panel(c_script_2)

# ----
# Create project, JSON DB
# WIP part - need to fix
#  the order of execution
# Project Component: """Creates or loads a project from a database."""
# ------------------------
# IN 1: Name of the project
# IN 2: Database
# ------------------------
# OUT 1: Project object
# OUT 2: Info message
# Write json with defaults
panel_75 = Panel("""{
  "GUID": "guid1",
  "part": "window",
  "typeID": 0,
  "typeName": "Default",
  "instancesIDs": "<ID>, <ID>, <ID>, <ID>, <ID>",
  "form": "rectangular",
  "profiles": {
    "ID": "0",
    "closed": true,
    "pathPoints": [
      "100 , 100, 100",
      "100 , 100, 1000"
    ],
    "profile": [
      {
        "type": "rectangular",
        "w": 120,
        "d": 180,
        "pts": [],
        "RenderMat": "Paint-Black"
      },
      {
        "type": "standard",
        "name": "U",
        "h": 120,
        "w": "180"
      }
    ]
  },
  "panels": {
    "pathPoints": [
      "100 , 100, 100",
      "100 , 100, 1000"
    ],
    "widths": [
      5,
      5,
      5
    ],
    "planes": "1234"
  }
}""")
panel_76 = Panel("""{
	"Data": [
	{
  "GUID": "guid0",
  "part": "window",
  "typeID": 0,
  "typeName": "Default",
  "instancesIDs": "<ID>, <ID>, <ID>, <ID>, <ID>",
  "form": "rectangular",
  "profiles": {
    "ID": "0",
    "closed": true,
    "pathPoints": [
      "100 , 100, 100",
      "100 , 100, 1000"
    ],
    "profile": [
      {
        "type": "rectangular",
        "w": 120,
        "d": 180,
        "pts": [],
        "RenderMat": "Paint-Black"
      },
      {
        "type": "standard",
        "name": "U",
        "h": 120,
        "w": "180"
      }
    ]
  },
  "panels": {
    "pathPoints": [
      "100 , 100, 100",
      "100 , 100, 1000"
    ],
    "widths": [
      5,
      5,
      5
    ],
    "planes": "1234"
  }
}
	]
}""")
panel_77 = Panel("""{
    "window": [
        {}, 
        {}, 
        {}
    ], 
    "door": [
        {}, 
        {}, 
        {}
    ], 
    "profile": [
        {}, 
        {}, 
        {}
    ], 
    "wallMet": [
        {}, 
        {}, 
        {}
    ], 
    "project": [], 
    "defaults": {
        "profiles": {
		            "wallPanelGaps": 10, 
            "windowFrameVert": [
                0, 
                120, 
                50
            ], 
            "windowFrameHoriz": [
                0, 
                130, 
                60
            ], 
			"windowMullionHoriz": [
                0, 
                140, 
                70
            ],
            "windowMullionVert": [
                0, 
                140, 
                70
            ],
			"windowPanelZ": [
                20, 
                30,
				40
            ],
			"windowPanelThick": [
                3, 
                3,
				3
            ],
            "doorFrameVert": [
                0, 
                120, 
                50
            ], 
            "doorFrameHoriz": [
                0, 
                130, 
                60
            ], 
			"doorMullionHoriz": [
                0, 
                140, 
                70
            ],
            "doorMullionVert": [
                0, 
                140, 
                70
            ],
			"doorPanelZ": [
                20, 
                30,
				40
            ],
			"doorPanelThick": [
                3, 
                3,
				3
            ],
            "curtWallFrameVert": [
                0, 
                120, 
                50
            ], 
            "curtWallFrameHoriz": [
                0, 
                130, 
                60
            ], 
			"curtWallMullionHoriz": [
                0, 
                140, 
                70
            ],
            "curtWallMullionVert": [
                0, 
                140, 
                70
            ],
			"curtWallPanelZ": [
                20, 
                30,
				40
            ],
			"curtWallPanelThick": [
                3, 
                3,
				3
            ]
        }, 
        "materials": {
            "windowPanel": "Glass - enamel - light _tr", 
            "curtWallPanel": "Glass - enamel - light _tr", 
            "curtWallProfile": "Metal - cast iron reflective", 
            "wallOther": "Bricks - chocolate _wa", 
            "wallVent": "Paint - green", 
            "windowFrame": "Metal - cast iron reflective"
        }
    }, 
    "wallOth": [
        {}, 
        {}, 
        {}
    ]
}""")
stream_filter_5 = StreamFilter(Gate=value_listener_32.Values, Stream1=panel_74)  # disabled
enable_disable_object_2 = EnableDisableObject(Enabled=value_listener_32.Values)  # disabled
relay_9 = Relay()  # disabled
gate_or_4 = GateOr(A=value_listener_32.Values, B=relay_9)  # disabled

# ----
# Save block info to DocUserText
input_selectedgeoforcustomprofile_2 = RemoteReceiver(input_selectedgeoforcustomprofile)
input_basepointcoordinates_2 = RemoteReceiver(input_basepointcoordinates)
input_bake_ancor_points_2 = RemoteReceiver(input_bake_ancor_points)
input_profile_orientation_2 = RemoteReceiver(input_profile_orientation)
text_5 = Text(Tree({0}: ["HO_DefaultProfile-Window head"], {1}: ["HO_DefaultProfile-Window jamb L", "HO_DefaultProfile-Window jamb R"], {2}: ["HO_DefaultProfile-Window mullion"], {3}: ["HO_DefaultProfile-Window sill"], {4}: ["HO_DefaultProfile-Window transom"], {5}: ["HO_DefaultProfile-Door head"]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))
text_6 = Text(Tree({0}: ["1;0;LU"], {1}: ["0;0;LU", "0;1;LU"], {2}: ["0;0;MM"], {3}: ["1;0;RB"], {4}: ["1;0;MM"], {5}: ["1;0;LU"]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))
input_rectanglewidth_2 = RemoteReceiver(input_rectanglewidth)
input_rectangledepth_2 = RemoteReceiver(input_rectangledepth)
dispatch_9 = Dispatch(List=text_5, DispatchPattern=input_is_profile_selected_as_tree_2)  # -> flatten(ListA), ListB
dispatch_10 = Dispatch(List=text_6, DispatchPattern=input_is_profile_selected_as_tree_2)  # -> flatten(ListA), ListB
panel_78 = Panel(text_6)
input_selected_existing_profile_2 = RemoteReceiver(input_selected_existing_profile)
input_profile_type_0_exist_5 = RemoteReceiver(input_profile_type_0_exist)
concatenate_5 = Concatenate(
    FragmentA="Profile - Rectangular - ",
    FragmentB=input_rectanglewidth_2,
    FragmentC=" x ",
    FragmentD=input_rectangledepth_2,
    FragmentF=";",
    FragmentE=dispatch_10.ListA)
project_of_next_unique_block_3 = RemoteReceiver()
cluster_3 = Cluster_4(text=input_selected_existing_profile_2)
input_block_name_2 = RemoteReceiver(input_block_name)
input_apply_4 = RemoteReceiver(input_apply)

panel_79 = Panel(text_5)
concatenate_6 = Concatenate(FragmentA=cluster_3, FragmentF=";", FragmentE=dispatch_10.ListA)
concatenate_7 = Concatenate(
    FragmentA="Profile custom #",
    FragmentB=project_of_next_unique_block_3,
    FragmentE=" - ",
    FragmentD=input_block_name_2,
    FragmentC=";",
    FragmentF=dispatch_10.ListA)

stream_filter_6 = StreamFilter(Gate=input_profile_type_0_exist_5, Stream0=concatenate_6, Stream1=concatenate_5, Stream2=concatenate_7)
writedocumentusertext_5 = WriteDocumentUserText(key=dispatch_9.ListA, value=stream_filter_6, writeNow=input_apply_4)  # -> value; inputs writeNow: Boolean; same code as writedocumentusertext

# ----
# 0.1 CREATE PROFILE
input_selectedgeoforcustomprofile_3 = RemoteReceiver(input_selectedgeoforcustomprofile)
input_profile_type_0_exist_6 = RemoteReceiver(input_profile_type_0_exist)
input_basepointcoordinates_3 = RemoteReceiver(input_basepointcoordinates)
input_bake_ancor_points_3 = RemoteReceiver(input_bake_ancor_points)
input_profile_orientation_3 = RemoteReceiver(input_profile_orientation)
input_rectanglewidth_3 = RemoteReceiver(input_rectanglewidth)
input_rectangledepth_3 = RemoteReceiver(input_rectangledepth)
isprofileeditoractive_3 = RemoteReceiver(isprofileeditoractive)
input_block_name_3 = RemoteReceiver(input_block_name)
input_apply_5 = RemoteReceiver(input_apply)

project_of_next_unique_block_4 = RemoteReceiver()
create_profile = CreateProfile(
    isprofileeditoractive=isprofileeditoractive_3,
    profile_type=input_profile_type_0_exist_6,
    profile_orientation=input_profile_orientation_3,
    base_point_coordinates=input_basepointcoordinates_3,
    rectangle_width=input_rectanglewidth_3,
    rectangle_depth=input_rectangledepth_3,
    custom_profile_name=input_block_name_3,
    custom_profile_number=project_of_next_unique_block_4,
    customprofilegeo=input_selectedgeoforcustomprofile_3,
    bake_ancor_points=input_bake_ancor_points_3,
    apply=input_apply_5)  # -> generated_geo, gen_attributes, display_geo, display_colors, display_widths_2, ui_messages_2, block_name, done, ancorpts_used, info_help

explode_tree_3 = ExplodeTree(Data=create_profile.generated_geo)  # -> Branch0, Branch1

help_2 = Panel(create_profile.info_help)
gzconduit_2 = CSharpScript(
    geo=create_profile.display_geo,
    colors=create_profile.display_colors,
    widths=create_profile.display_widths_2,
    Reference=["C:\Program Files\Rhino 7\Plug-ins\Grasshopper\Components\ScriptComponents.gha", "C:\Program Files\NoDoubts\Godzilla\System\Godzilla.dll", "C:\Program Files\NoDoubts\Godzilla\System\RhGodzilla.rhp"])  # -> out; inputs geo: tree, colors: tree of Color, widths: tree of Int32; same code as gzconduit

# ----
# Save Custom profile counter
input_profile_type_0_exist_7 = RemoteReceiver(input_profile_type_0_exist)
project_of_next_unique_block_5 = RemoteReceiver()
equality_4 = Equality(FirstNumber=input_profile_type_0_exist_7, SecondNumber=2)  # -> Equality, Inequality
input_apply_6 = RemoteReceiver(input_apply)
gate_and_7 = GateAnd(A=input_apply_6, B=equality_4.Equality)

text_7 = Text(project_of_next_unique_block_5)

writedocumentusertext_6 = WriteDocumentUserText(key="HO_Counter_CustomProfile", value=text_7, writeNow=gate_and_7)  # -> value; inputs writeNow: Boolean; same code as writedocumentusertext

# ----
# The logic breaks if user types in
# a letter instead of number
# Insertin data from OMG dropdown
addition_8 = Addition(A=writedocumentusertext_6, B=1)

# ----
# GETTING  PATHS  &  SETTINGS
# GH App Path
# User settings
document_info = DocumentInfo(AutoUpdate=False, Recursive=False)  # -> DocumentName, DocumentFilePath, Components, Params, _3rdPartyAssemblies
gh_app_paths = GHAppPaths(gh_doc_path=document_info.DocumentFilePath, gh_depth=3)  # -> gh_app_dir, module_dir, gh_local_dir, user_settings_path, gh_depth_2
gh_app_path_2 = Text(gh_app_paths.gh_app_dir)
gh_document_name = Text("project")

# ----
# Paste this link on the website where your app is available for download or in the description section of the platform or marketplace you’re using.
# <div>Icons made by <a href="https://www.flaticon.com/authors/those-icons" title="Those Icons">Those Icons</a> from <a href="https://www.flaticon.com/" title="Flaticon">www.flaticon.com</a></div>
db_paths = DBPaths(gh_doc_path=document_info.DocumentFilePath, gh_depth=gh_app_paths.gh_depth_2, project_name=poject_name)  # -> db_path, project_path, json_path
panel_80 = Panel(db_paths.json_path)

# ----
# App settings
appsettings = AppSettings(app_path=gh_app_paths.gh_app_dir)  # -> ui_color_current_step_bg, info, status

db_path = RemoteSender(db_paths.db_path)

db_path_2 = RemoteReceiver(db_path)
concatenate_8 = Concatenate(A=db_path_2, B="\Projects\")
panel_81 = Panel(concatenate_8)
getfoldersinsidefolder = GetFoldersInsideFolder(path=concatenate_8)  # -> out, folders
# ---------- getfoldersinsidefolder: Python ----------
# ACTION:     Gets folders inside folder
# LIMITATION: 
# TO DO:      

__author__ = "Yury Nasonov"
__version__ = "1"

ghenv.Component.Name = "Get folders inside folder"
ghenv.Component.NickName = 'GetFoldersInsideFolder'
ghenv.Component.Message = 'Get folders inside folder'

# ———————————————————————————————————————————————————————————

import rhinoscriptsyntax as rs
import os

# ———————————————————————————————————————————————————————————


root, dirs, files = os.walk(path).next()
folders = dirs
# ---------- end getfoldersinsidefolder ----------
list_length_5 = ListLength(List=getfoldersinsidefolder.folders)
duplicate_data = DuplicateData(Data=Toggle(True), Number=list_length_5, Order=True)
dispatch_11 = Dispatch(List=getfoldersinsidefolder.folders, DispatchPattern=flatten(value_listener_33.Values))  # -> ListA, ListB
concatenate_9 = Concatenate(
    D="!-Open _No \"",
    A=db_path_2,
    B="\Projects\",
    E=getfoldersinsidefolder.folders,
    H="\",
    F=getfoldersinsidefolder.folders,
    G=".3dm\" _Echo _Cancel")
concatenate_10 = Concatenate(
    D="!-Open  \"",
    A=db_path_2,
    B="\Projects\",
    E=getfoldersinsidefolder.folders,
    H="\",
    F=getfoldersinsidefolder.folders,
    G=".3dm\" _Echo _Cancel")
merge_17 = Merge(Data1=flatten(duplicate_data), Data2=flatten(Toggle(False)))
panel_82 = Panel(dispatch_11.ListA)
set_button = SetButton(ButtonToModify=create_button_11, ButtonName=getfoldersinsidefolder.folders)
list_item_17 = ListItem(List=concatenate_9, Index=member_index_5.Index, Wrap=True)
list_item_18 = ListItem(List=concatenate_10, Index=member_index_5.Index, Wrap=True)
hide_show_element_13 = HideShowElement(ElementToHideShow=create_button_11, Show=merge_17, Collapse=True, Disable=False)
gzcommand_3 = CSharpScript(
    command=list_item_18,
    runNow=boolean_9,
    echo=Toggle(False),
    Reference=["C:\Program Files\Rhino 7\Plug-ins\Grasshopper\Components\ScriptComponents.gha", "C:\Program Files\NoDoubts\Godzilla\System\Godzilla.dll", "C:\Program Files\NoDoubts\Godzilla\System\RhGodzilla.rhp"])  # -> done; inputs command: String, runNow: Boolean, echo: Boolean; disabled; same code as gzcommand

gzcommand_4 = CSharpScript(
    command=[list_item_17, list_item_18],
    runNow=boolean_10,
    echo=Toggle(False),
    Reference=["C:\Program Files\Rhino 7\Plug-ins\Grasshopper\Components\ScriptComponents.gha", "C:\Program Files\NoDoubts\Godzilla\System\Godzilla.dll", "C:\Program Files\NoDoubts\Godzilla\System\RhGodzilla.rhp"])  # -> done; inputs command: String, runNow: Boolean, echo: Boolean; same code as gzcommand

db_path_3 = RemoteReceiver(db_path)
concatenate_11 = Concatenate(A=db_path_3, B="\Projects\", C=panel_74)
concatenate_12 = Concatenate(A=db_path_3, B="\Projects\", C=panel_74)
ghpython_script_2 = GhPythonScript(path=concatenate_12, create_now=value_listener_32.Values)  # -> out, a, done; inputs create_now: Boolean
# ---------- ghpython_script_2: Python ----------
__author__ = "Me"
__version__ = "2021.01.18"

import rhinoscriptsyntax as rs
import os

done = 0
if (create_now):
    try:
      os.mkdir(path)
    except OSError:
      done = 0
    else:
       done = 1
# ---------- end ghpython_script_2 ----------

projectfolder = RemoteSender(concatenate_11)
concatenate_13 = Concatenate(FragmentB="-_SaveAs \"", FragmentA=concatenate_11, FragmentF="\", FragmentG=panel_74, FragmentD=".3dm\"")
panel_83 = Panel(concatenate_12)

db_path_4 = RemoteReceiver(db_path)  # disabled
panel_84 = Panel(db_path_4)  # disabled
stream_filter_7 = StreamFilter(Gate=value_listener_32.Values, Stream1=db_path_4)  # disabled
database = GhPythonScript(P=stream_filter_7)  # -> DB, I; inputs P: tree; disabled
# ---------- database: Python ----------
#!/usr/bin/python
# -*- coding: utf-8 -*-
__version__ = "1.0.0"
__author__ = "PF"

import ghpythonlib as ghpy
from ghpythonlib.componentbase import executingcomponent as component
import Grasshopper, GhPython
from Grasshopper.Kernel import GH_RuntimeMessageLevel as RML
import System
import Rhino
from Rhino import Geometry as rg
import rhinoscriptsyntax as rs
import os

#hoelscher librery inputs
import core
import ui
import components_util

class DatabaseComponent(component):
    """Connects or creaters new database in the local file system"""
    
    def RunScript(self, path):
        DB = None
        self.Message = None
        path = self.CheckInput(path)
        
        if path:
            DB = self.TryGetDatabase(path)
        if DB:
            self.Message = "DB: %s" %DB.Name
            return DB, DB.Info
    
    def CheckInput(self, path):
        path = components_util.GetOnlyOneInput(self, "Path", path)
        if path:
            if self.CheckPath(path):
                return path
        else:
            return self.GetDefaultPath()
    
    def CheckPath(self, path):
        is_dir = os.path.isdir(path)
        is_file = os.path.isfile(path)
        
        if is_dir:
            return True
        elif is_file:
            base_name = os.path.basename(path)
            self.AddRuntimeMessage(RML.Error, """Ups... "%s" is not a database path it's a file!""" %base_name)
            return False
        else:
            self.AddRuntimeMessage(RML.Error, """Oh no... it's not a valid path!""")
            return False
    
    def TryGetDatabase(self, path):
        DB = core.Database(path)
        if DB.IsValid():
            return DB
        else:
            dialog = ui.QuestionDialog(""""%s" database does not exist.\n Do you want to create one?""" %DB.Name)
            rc = dialog.ShowModal(Rhino.UI.RhinoEtoApp.MainWindow)
            if (rc):
                if DB.New(True):
                    return DB
            else:
                self.AddRuntimeMessage(RML.Warning, """"%s" database does not exist""" %DB.Name)
    
    def GetDefaultPath(self):
        """
        Gets the default data path from the DBpath.db file
        """
        
        path = "AppData\Roaming\Grasshopper\Libraries\Hoelscher\DBpath.db"
        path = os.path.join(os.path.expandvars("%userprofile%"), path)
        
        if os.path.exists(path):
            with open(path, 'r') as f:
                data_path = f.read()
                data_path = data_path.decode(encoding='UTF-8', errors='strict')
                return data_path
        else:
            self.AddRuntimeMessage(RML.Error, "Could not find DBpath.db file in Grasshopper\Libraries\Hoelscher")
# ---------- end database ----------
project = GhPythonScript(N=stream_filter_5, DB=database.DB)  # -> P, I; inputs N: tree, DB: tree; disabled
# ---------- project: Python ----------
#!/usr/bin/python
# -*- coding: utf-8 -*-
__version__ = "1.0.0"
__author__ = "PF"

from ghpythonlib.componentbase import executingcomponent as component
import Grasshopper, GhPython
from Grasshopper.Kernel import GH_RuntimeMessageLevel as RML
import System
import Rhino
import rhinoscriptsyntax as rs


#hoelscher librery inputs
import components_util
import core
import ui

class Project(component):
    
    def RunScript(self, name, database):
        self.Message = None
        name, database = self.CheckInput(name, database)
        Prj = self.TryGetProject(name, database)
        if Prj:
            self.Message = "Project: %s" %Prj.Name
            return Prj, Prj.Info
    
    def TryGetProject(self, name, database):
        if name and database:
            Prj = core.Project(name, database)
            if Prj.IsValid():
                return Prj
            else:
                dialog = ui.QuestionDialog(""""%s" project does not exist.\n Do you want to create one?""" %Prj.Name)
                rc = dialog.ShowModal(Rhino.UI.RhinoEtoApp.MainWindow)
                if (rc):
                    if Prj.New(True):
                        return Prj
                else:
                    self.AddRuntimeMessage(RML.Warning, """"%s" project does nor exist""" %Prj.Name)
    
    def CheckInput(self, name, database):
        name = components_util.GetOnlyOneInput(self, "Name", name)
        database = components_util.GetOnlyOneInput(self, "Database", database)
        
        #Name
        illegal_chars = """"*.#'><,=?!%&$€§|"""
        if name:
            for char in name:
                if char in illegal_chars:
                    self.AddRuntimeMessage(RML.Error, "Name of the project cannot consist of [%s]!" %illegal_chars)
                    name = None
                    break
        else:
            self.AddRuntimeMessage(RML.Warning, "Name input is missing")
        
        #Database
        if database:
            try:
                if database.GetType() != "Database":
                    self.AddRuntimeMessage(RML.Error, "Expaxted Database got %s!" %type(database))
                    database = None
            except:
                self.AddRuntimeMessage(RML.Error, "Expaxted Database got %s!" %type(database))
                database = None
        else:
            self.AddRuntimeMessage(RML.Warning, "Database input is missing")
        
        return name, database
# ---------- end project ----------
panel_85 = Panel(stream_filter_7)  # disabled
list_length_6 = ListLength(List=project.P)  # disabled
panel_86 = Panel(project.P)  # disabled
panel_87 = Panel(project.I)  # disabled
addition_9 = Addition(A=list_length_6, B=0)  # disabled
concatenate_14 = Concatenate(A=db_path_4, B="\Projects\", C=panel_74, F="\", D="Elements.json")
boolean_11 = Boolean(addition_9)  # disabled
c_script_3 = CSharpScript(
    file_path=concatenate_14,
    text_to_write=panel_77,
    write_now=boolean_11,
    Reference=["C:\Program Files\Rhino 7\Plug-ins\Grasshopper\Components\ScriptComponents.gha", "C:\Program Files\NoDoubts\Godzilla\System\Godzilla.dll", "C:\Program Files\NoDoubts\Godzilla\System\RhGodzilla.rhp"])  # -> out, A; inputs file_path: String, text_to_write: String, write_now: Boolean; disabled
# ---------- c_script_3: C# ----------
    if (write_now == true){
      System.IO.File.WriteAllText(@file_path, text_to_write);
      A = true;}
    else{A = false;}
# ---------- end c_script_3 ----------
app_jsonpath = RemoteSender(concatenate_14)  # disabled
enable_disable_object_3 = EnableDisableObject(Enabled=addition_9)  # disabled
gzcommand_5 = CSharpScript(
    command=concatenate_13,
    runNow=relay_9,
    echo=False,
    Reference=["C:\Program Files\Rhino 7\Plug-ins\Grasshopper\Components\ScriptComponents.gha", "C:\Program Files\NoDoubts\Godzilla\System\Godzilla.dll", "C:\Program Files\NoDoubts\Godzilla\System\RhGodzilla.rhp"])  # -> done; inputs command: String, runNow: Boolean, echo: Boolean; disabled; same code as gzcommand
app_jsonpath_2 = RemoteReceiver(app_jsonpath)  # disabled
gzcommand_6 = CSharpScript(
    command=concatenate_13,
    runNow=addition_9,
    echo=False,
    Reference=["C:\Program Files\Rhino 7\Plug-ins\Grasshopper\Components\ScriptComponents.gha", "C:\Program Files\NoDoubts\Godzilla\System\Godzilla.dll", "C:\Program Files\NoDoubts\Godzilla\System\RhGodzilla.rhp"])  # -> done; inputs command: String, runNow: Boolean, echo: Boolean; disabled; same code as gzcommand
panel_88 = Panel(c_script_3.A)  # disabled
panel_89 = Panel(concatenate_14)  # disabled

gzcommand_7 = CSharpScript(
    command=concatenate_13,
    runNow=ghpython_script_2.done,
    echo=False,
    Reference=["C:\Program Files\Rhino 7\Plug-ins\Grasshopper\Components\ScriptComponents.gha", "C:\Program Files\NoDoubts\Godzilla\System\Godzilla.dll", "C:\Program Files\NoDoubts\Godzilla\System\RhGodzilla.rhp"])  # -> done; inputs command: String, runNow: Boolean, echo: Boolean; same code as gzcommand

projectfolder_2 = RemoteReceiver(projectfolder)

grasshopper_file_path_gh = RemoteSender(document_info.DocumentFilePath)
app_dbpath = RemoteSender(db_paths.db_path)
gz_menu = CSharpScript(Reference=["C:\Program Files\Rhino 7\Plug-ins\Grasshopper\Components\ScriptComponents.gha", "C:\Program Files\NoDoubts\Godzilla\System\Godzilla.dll", "C:\Program Files\NoDoubts\Godzilla\System\RhGodzilla.rhp"])  # -> resources, names, tooltips
# ---------- gz_menu: C# ----------
    //    var gz = Rhino.RhinoApp.GetPlugInObject("RhGodzilla");
    //    var gz2 = RhGodzilla.RhGodzillaPlugin.Instance as RhGodzilla.RhGodzillaPlugin;
    names = RhGodzilla.GhApp.GhAppHelpers.GetMenuNames();
    resources = RhGodzilla.GhApp.GhAppHelpers.GetMenuResourceNames();
    tooltips = RhGodzilla.GhApp.GhAppHelpers.GetMenuTooltips();
# ---------- end gz_menu ----------

# ----
# STEPS
# Buttons with steps
gh_document_name_2 = Text(gh_document_name)
panel_90 = Panel("""Export
Support""")
create_button_12 = CreateButton(ButtonName="↻", ButtonStyle=3)  # -> flatten(Button)
create_true_only_button_8 = CreateTrueOnlyButton(ButtonName=panel_90, ButtonStyle=1)  # disabled
create_button_13 = CreateButton(ButtonName=gz_menu.names, ButtonStyle=3)  # -> flatten(Button)
value_listener_34 = ValueListener(Elements=create_button_12, SomeProperty=True)  # -> flatten(Values), Indices
adjust_element_positioning_11 = AdjustElementPositioning(ElementsToAdjust=create_button_12, AbsolutePositioning=False, Height=32)
create_wrappanel_13 = CreateWrapPanel(UIElements=flatten([create_button_13, create_true_only_button_8, create_button_12]), Horizontal=True)  # -> flatten(WrapPanel)
value_listener_35 = ValueListener(Elements=create_button_13, SomeProperty=True)  # -> flatten(Values), Indices
expire_object = ExpireObject(Expire=value_listener_34.Values)

# ----
# Highlight current step button
# Remove * for
# "changed" definition
replace_text_9 = ReplaceText(Text=gh_document_name_2, Find="*", RecursiveReplace=False)
member_index_6 = MemberIndex(Set=gz_menu.resources, Member=replace_text_9)  # -> Index, Count
list_item_19 = ListItem(List=create_button_13, Index=member_index_6.Index, Wrap=True)
adjust_element_appearance_6 = AdjustElementAppearance(ElementsToAdjust=list_item_19, Background=gzuicolors)

tooltip = AttachTooltipToElement(ElementsToAttachTo=create_button_13, TooltipContent=gz_menu.tooltips, ShowDelay=500, Duration=2000)
hui_all_ui = RemoteSender(create_wrappanel_13)

# ---- group: index of next step
addition_10 = Addition(A=member_index_6.Index, B=1)

# ----
panel_91 = Panel(create_wrappanel_13)
hui_all_ui_2 = RemoteReceiver(hui_all_ui)

# ----
# MAIN WINDOW
merge_18 = Merge(
    Data1=create_wrappanel_13,
    Data3=flatten(merge_16),
    Data4=flatten(hui_expaner_windowsdefaults_2),
    Data5=flatten(merge_7),
    Data6=create_wrappanel_3)
launch_window_3 = LaunchWindow(
    Show=True,
    Name="Hölsher App: Project",
    Width=424,
    Height=gzusersettings.WindowHeight,
    ChildStatus=1,
    EnableHorizScroll=False)
hui_main_window = RemoteSender(launch_window_3)
set_window_properties = SetWindowProperties(Window=launch_window_3, StartingLocation=Point(0, 0, 0), ShowTitleBar=True, ScaleFactor=1)
add_elements_3 = AddElements(Window=launch_window_3, Elements=flatten(merge_18), DoVLChecking=True)  # -> AddedElements, ElementNames

# ----
# HELP WINDOW
replace_text_10 = ReplaceText(Text=gh_app_paths.module_dir, Find="\", Replace="/", RecursiveReplace=False)  # disabled
panel_92 = Panel("file:///")  # disabled
panel_93 = Panel("Profile-editor-help.html")  # disabled
number_slider_3 = Slider(1000, range=0..10000)  # disabled
concatenate_15 = Concatenate(FragmentC=panel_92, FragmentA=replace_text_10, FragmentE="/", FragmentD=panel_93)  # disabled
create_browser = CreateBrowser(URL=concatenate_15, Height=number_slider_3)  # disabled
launch_window_4 = LaunchWindow(
    Show=input_showhelpforprofileeditor_2,
    Help="Help: Profile editor",
    Width=424,
    Height=gzusersettings.WindowHeight,
    ChildStatus=1,
    EnableHorizScroll=False)  # disabled
add_elements_4 = AddElements(Window=launch_window_4, Elements=flatten(create_browser), DoVLChecking=True)  # -> AddedElements, ElementNames; disabled
make_child_window = MakeChildWindow(ParentWindow=launch_window_3, ChildWindow=launch_window_4)  # disabled
set_window_properties_2 = SetWindowProperties(Window=launch_window_4, StartingLocation=Point(424, 0, 0), ShowTitleBar=True, ScaleFactor=1)  # disabled

# ----
# HELP WINDOW
replace_text_11 = ReplaceText(Text=gh_app_paths.module_dir, Find="\", Replace="/", RecursiveReplace=False)  # disabled
panel_94 = Panel("file:///")  # disabled
panel_95 = Panel("-help.html")  # disabled
number_slider_4 = Slider(1000, range=0..10000)  # disabled
concatenate_16 = Concatenate(FragmentC=panel_94, FragmentA=replace_text_11, FragmentE="/", FragmentB=gh_document_name, FragmentD=panel_95)  # disabled
create_browser_2 = CreateBrowser(URL=concatenate_16, Height=number_slider_4)  # disabled
launch_window_5 = LaunchWindow(
    Show=input_showhelpwindow_2,
    Help="Help: Project",
    Width=424,
    Height=gzusersettings.WindowHeight,
    ChildStatus=1,
    EnableHorizScroll=False)  # disabled
adjust_element_positioning_12 = AdjustElementPositioning(ElementsToAdjust=create_browser_2, Margin="-10,-10,-11,0", AbsolutePositioning=False, Width=424)  # disabled
add_elements_5 = AddElements(Window=launch_window_5, Elements=flatten(create_browser_2), DoVLChecking=True)  # -> AddedElements, ElementNames; disabled
make_child_window_2 = MakeChildWindow(ParentWindow=launch_window_3, ChildWindow=launch_window_5)  # disabled
set_window_properties_3 = SetWindowProperties(Window=launch_window_5, StartingLocation=Point(424, 0, 0), ShowTitleBar=True, ScaleFactor=1)  # disabled

panel_96 = Panel(concatenate_16)  # disabled

# ----
# HELP WINDOW
launch_window_6 = LaunchWindow(
    Show=boolean_toggle_6,
    Help="Help: Building",
    Width=424,
    Height=gzusersettings.WindowHeight,
    ChildStatus=0,
    EnableHorizScroll=False)  # disabled
add_elements_6 = AddElements(Window=launch_window_6, Elements=flatten(merge_4), DoVLChecking=True)  # -> AddedElements, ElementNames; disabled
make_child_window_3 = MakeChildWindow(ParentWindow=launch_window_3, ChildWindow=launch_window_6)  # disabled
set_window_properties_4 = SetWindowProperties(Window=launch_window_6, StartingLocation=Point(424, 0, 0), ShowTitleBar=True, ScaleFactor=1)  # disabled

grasshopper_file_path_gh_2 = RemoteReceiver(grasshopper_file_path_gh)  # disabled
input_bug_modulename = RemoteReceiver()  # disabled
input_bug_description = RemoteReceiver()  # disabled
hui_main_window_2 = RemoteReceiver(hui_main_window)  # disabled
input_bugpriority = RemoteReceiver()  # disabled
input_bugtype = RemoteReceiver()  # disabled
app_dbpath_2 = RemoteReceiver(app_dbpath)  # disabled

# ----
# Steps and paths for them
panel_97 = Panel("\Gh-Steps")
concatenate_17 = Concatenate(FragmentA=gh_app_paths.gh_app_dir, FragmentB=panel_97)
replace_text_12 = ReplaceText(Text=concatenate_17, Find="\", Replace="/", RecursiveReplace=False)
# ! _SelNone -_Grasshopper Banner Disable Window Load Window Hide Document Open "
ghpython_script_3 = GhPythonScript(path=replace_text_12)  # -> out, folders
# ---------- ghpython_script_3: Python ----------
__author__ = "Yury Nasonov"
__version__ = "2020.10.14"

import rhinoscriptsyntax as rs
import os

root, dirs, files = os.walk(path).next()
folders = dirs
# ---------- end ghpython_script_3 ----------

# ---- group: To make ☰ not the last but the first
shift_list = ShiftList(List=ghpython_script_3.folders, Shift=-1, Wrap=True)

# ----
step_names = Text(shift_list)
step_names_2 = Text(step_names)
concatenate_18 = Concatenate(
    Text_before=panel_32,
    E=concatenate_13,
    D=" _SelNone -_GrasshopperPlayer \"",
    FOLDER_PATH=gh_app_paths.gh_app_dir,
    A="\Gh-Steps\",
    GH_DEF_PATH=step_names_2,
    C="\",
    B=step_names_2,
    Text_after=".gh\" _Enter _Pause _Enter _Echo _Enter")  # -> graft(Result)

panel_98 = Panel(concatenate_18)

adjust_element_positioning_13 = AdjustElementPositioning(ElementsToAdjust=create_button_13, Margin="0", AbsolutePositioning=False, Height=32)

member_index_7 = MemberIndex(Set=value_listener_35.Values, Member=True)  # -> Index, Count

stream_filter_8 = StreamFilter(Gate=gate_and_6, Stream0=member_index_7.Index, Stream1=addition_10)

list_item_20 = ListItem(List=flatten(gz_menu.resources), Index=stream_filter_8, Wrap=True)
text_length = TextLength(Text=list_item_20)
addition_11 = Addition(A=text_length, B=0)
boolean_12 = Boolean(addition_11)

c_script_4 = CSharpScript(
    folder=projectfolder_2,
    create=boolean_12,
    Reference=["C:\Program Files\Rhino 7\Plug-ins\Grasshopper\Components\ScriptComponents.gha", "C:\Program Files\NoDoubts\Godzilla\System\Godzilla.dll", "C:\Program Files\NoDoubts\Godzilla\System\RhGodzilla.rhp"])  # -> out, Created; inputs folder: String, create: Boolean
# ---------- c_script_4: C# ----------
    if(create){
          System.IO.Directory.CreateDirectory(folder);
    }
    Created = create;
# ---------- end c_script_4 ----------

gzopengh = CSharpScript(
    resName=list_item_20,
    runNow=c_script_4.Created,
    Reference=["C:\Program Files\Rhino 7\Plug-ins\Grasshopper\Components\ScriptComponents.gha", "C:\Program Files\NoDoubts\Godzilla\System\Godzilla.dll", "C:\Program Files\NoDoubts\Godzilla\System\RhGodzilla.rhp"])  # -> done; inputs resName: String, runNow: Boolean
# ---------- gzopengh: C# ----------
    done = false;
    if (runNow == true){
      RhGodzilla.GhApp.GhDefManager.Instance.OpenGetGhDefinition(resName, true);
    }
    done = runNow;
# ---------- end gzopengh ----------

# ==== cluster GHAppPaths: Gets paths used by app
gh_depth = ClusterInput()  # how many levels inside APP/GH directory is the file placed
gh_doc_path = ClusterInput()  # .gh doc path
text_split = TextSplit(Text=gh_doc_path, Separators="\")
text = Text(gh_depth)
split_list = SplitList(List=reverse(text_split), Index=gh_depth)  # -> ListA, reverse(ListB)
cull_index = CullIndex(List=text_split, Indices=-1, Wrap=True)
ghpython_script = GhPythonScript()  # -> gh_local_dir, user_settings_path
# ---------- ghpython_script: Python ----------
__author__ = "Yury Nasonov"
__version__ = "2020.11.03"

import os.path
home_dir = os.path.expanduser("~")
gh_local_dir = home_dir + "\AppData\Roaming\Hoelsher\GH"
user_settings_path = gh_local_dir + "\UserData\UserSettings.db"
# ---------- end ghpython_script ----------
text_join = TextJoin(Text=split_list.ListB, Join="\")
text_join_2 = TextJoin(Text=cull_index, Join="\")
panel = Panel(text_join)
gh_depth_2 = ClusterOutput(text)  # .gh depth
gh_app_dir = ClusterOutput(text_join)  # gh app dir
module_dir = ClusterOutput(text_join_2)  # module dir
gh_local_dir = ClusterOutput(ghpython_script.gh_local_dir)  # gh_local_dir
user_settings_path = ClusterOutput(ghpython_script.user_settings_path)  # user_settings_path

# ==== cluster AppSettings: Retrives App settings from database
app_path = ClusterInput()  # app_path
ghpython_script = GhPythonScript(app_path=app_path)  # -> out, UI_color_current_step_bg
# ---------- ghpython_script: Python ----------
__author__ = "Yury Nasonov"
__version__ = "2020.10.15"

import rhinoscriptsyntax as rs
import json

path = app_path + "\Data\AppSettings.db"
f = open(path, "r")
a = (f.read())
y = json.loads(a)
UI_color_current_step_bg = y["UI_color_current_step_bg"] 

f.close()
# ---------- end ghpython_script ----------
panel = Panel("""Retrieves User settings

CHANGELOG
15.10.2020
- component created""")
ui_color_current_step_bg = ClusterOutput(ghpython_script.UI_color_current_step_bg)  # UI_color_current_step_bg
info = ClusterOutput(panel)  # info
status = ClusterOutput(ghpython_script.out)  # status

# ==== cluster PathCorrector: Replaces someone's path to a file or directory in AUTOMATISIERUNG to correct path as it is on your's computer
orig_path = ClusterInput()  # orig_path
orig_path_2 = Text(orig_path)
text_split = TextSplit(Text=orig_path_2, Separators="\")
text_fragment = TextFragment(Text=text_split, Start=0, Count=15)
expression = Expression(x=text_fragment, Expression="if(x=\"AUTOMATISIERUNG\",1,0)")
member_index = MemberIndex(Set=expression, Member=1)  # -> expr("x+1", Index), Count
ghpython_script = GhPythonScript()  # -> AUTOMATIESIERUNG_path
# ---------- ghpython_script: Python ----------
__author__ = "Yury Nasonov"
__version__ = "2020.11.03"

import rhinoscriptsyntax as rs
import json
import os.path
home_dir = os.path.expanduser("~")
db_path = home_dir + "\AppData\Roaming\Hoelsher\PY\UserData\UserSettingsPy.db"

f = open(db_path, "r")
a = (f.read())

y = json.loads(a)
AUTOMATIESIERUNG_path = y["AUTOMATIESIERUNG_path"] 
f.close()
# ---------- end ghpython_script ----------
split_list = SplitList(List=text_split, Index=member_index.Index)  # -> ListA, ListB
text_join = TextJoin(Text=split_list.ListB, Join="\")
panel = Panel(ghpython_script)
concatenate = Concatenate(FragmentA=ghpython_script, FragmentB=text_join)
my_path = Text(concatenate)
my_path_2 = ClusterOutput(my_path)  # my_path

# ==== cluster DBPaths: Gets paths for fatabase, project and current json
project_name = ClusterInput()  # project_name
gh_doc_path = ClusterInput()  # .gh doc path
gh_depth = ClusterInput()  # how many levels inside APP/GH directory is the file placed
list_length = ListLength(List=project_name)
text_split = TextSplit(Text=gh_doc_path, Separators="\")
addition = Addition(A=list_length, B=0)
split_list = SplitList(List=reverse(text_split), Index=expr("x+1", gh_depth))  # -> ListA, reverse(ListB)

# ----
# Read project name
# Check now is disabled for now
getting_rhinodoc_attribute = Panel("HO_ProjectName")
addition_2 = Addition(A=addition, B=1)
python = PythonScript(key=getting_rhinodoc_attribute, checkNow=addition_2)  # -> value
# ---------- python: Python ----------
import rhinoscriptsyntax as rs
import scriptcontext as sc
import Rhino

sc.doc = Rhino.RhinoDoc.ActiveDoc

#if checkNow == True:
value = rs.GetDocumentUserText(key)

sc.doc = ghdoc

print value
# ---------- end python ----------
panel = Panel(python)

text_join = TextJoin(Text=flatten(split_list.ListB), Join="\")
concatenate = Concatenate(FragmentA=text_join, FragmentB="\DB")
stream_filter = StreamFilter(Gate=addition, Stream0=python, Stream1=project_name)
concatenate_2 = Concatenate(FragmentA=concatenate, FragmentB="\Projects\", FragmentC=stream_filter)
concatenate_3 = Concatenate(FragmentA=concatenate_2, FragmentB="\", FragmentC="elements.json")
db_path = ClusterOutput(concatenate)  # db_path
project_path = ClusterOutput(concatenate_2)  # project path
json_path = ClusterOutput(concatenate_3)  # json_path

# ==== cluster Cluster_3

# ----
# INPUTS
wall_panel_gaps = ClusterInput()  # Wall panel gaps to set
update = ClusterInput()  # Update?
default_size_wall_panel_gap = RemoteSender(wall_panel_gaps)
input_updatepanelgaps = RemoteSender(update)

panel = Panel(""">::Regelelement::Vent-Other::Vent-Other - Panel
>::Regelelement::MS-Other::MS-Other - Panel
>::Regelelement::Aluninium::Aluninium - Panel
>::Regelelement::Ceiling::Ceiling - Panel
>::Regelelement::Column::Column - Panel
>::Regelelement::Glass/Stone::Glass/Stone - Panel""")
reference_by_layer = ReferenceByLayer(LayerName=panel, DisableAutoUpdate=False, ignoreCase=False)
filter_by_type = FilterByType(Geometry=reference_by_layer, ObjectType="Block")
get_user_value = GetUserValue(Geometry=filter_by_type, Key="HO_Gap")
default_size_wall_panel_gap_2 = RemoteReceiver(default_size_wall_panel_gap)
equality = Equality(FirstNumber=default_size_wall_panel_gap_2, SecondNumber=get_user_value)  # -> Equality, Inequality
panel_2 = Panel(get_user_value)
dispatch = Dispatch(List=filter_by_type, DispatchPattern=equality.Equality)  # -> ListA, ListB
graft_tree = GraftTree(Tree=flatten(dispatch.ListB), IncludeEmptyLists=True, IncludeNullItems=True)  # -> simplify(Tree)
gh_geotobechanged = RemoteSender(graft_tree)

# ----
# Get transform for panels
gh_geotobechanged_2 = RemoteReceiver(gh_geotobechanged)
panel_3 = Panel("""HO_PlatteBreite
HO_PlatteHöhe""")
get_user_value_2 = GetUserValue(Geometry=gh_geotobechanged_2, Key="HO_Gap")
get_user_value_3 = GetUserValue(Geometry=gh_geotobechanged_2, Key=panel_3)
subtraction = Subtraction(A=default_size_wall_panel_gap_2, B=get_user_value_2)
get_user_value_4 = GetUserValue(Geometry=gh_geotobechanged_2, Key="HO_PlatteBasePlane")
subtraction_2 = Subtraction(A=get_user_value_3, B=subtraction)
cluster = Cluster(text=get_user_value_4)
# EDIT WALL PANELS' GAPS
division = Division(A=subtraction_2, B=get_user_value_3)
list_item = ListItem(List=division, Index=0, Wrap=True)  # -> Item, Item1
list_item_2 = ListItem(List=subtraction_2, Index=0, Wrap=True)  # -> Item, Item1
deconstruct_plane = DeconstructPlane(Plane=cluster)  # -> Origin, XAxis, YAxis, ZAxis
amplitude = Amplitude(Vector=deconstruct_plane.XAxis, Amplitude=expr("x/2", subtraction))
amplitude_2 = Amplitude(Vector=deconstruct_plane.YAxis, Amplitude=expr("x/2", subtraction))
addition = Addition(A=amplitude, B=amplitude_2)
move = Move(Geometry=cluster, Motion=addition)  # -> Geometry, Transform
scale_nu = ScaleNU(Plane=cluster, ScaleX=list_item.Item, ScaleY=list_item.Item1, ScaleZ=1)  # -> Geometry, simplify(Transform)
compound = Compound(Transforms=[scale_nu.Transform, move.Transform])  # -> flatten(Compound)

# ----
# Get attributes for panels
gh_geotobechanged_3 = RemoteReceiver(gh_geotobechanged)
transform = Transform(Geometry=cluster, Transform=move.Transform)
default_size_wall_panel_gap_3 = RemoteReceiver(default_size_wall_panel_gap)
cluster_2 = Cluster_2(plane=transform)
list_length = ListLength(List=gh_geotobechanged_3)
panel_4 = Panel("""HO_PlatteBreite
HO_PlatteHöhe
HO_PlatteBasePlane
HO_Gap""")
duplicate_data = DuplicateData(Data=default_size_wall_panel_gap_3, Number=list_length, Order=True)  # -> simplify(Data)
merge = Merge(Data1=simplify(list_item_2.Item), Data2=simplify(list_item_2.Item1), Data3=cluster_2, Data4=duplicate_data)
get_user_attributes = GetUserAttributes(Geometry=gh_geotobechanged_3)  # -> simplify(Keys), simplify(Values), BakeName
duplicate_data_2 = DuplicateData(Data=panel_4, Number=list_length, Order=True)  # -> simplify(Data)
get_rhino_attributes = GetRhinoAttributes(Geometry=gh_geotobechanged_3, readFullPath=True)  # -> Name, Layer, Color
input_updatepanelgaps_2 = RemoteReceiver(input_updatepanelgaps)
define_object_attributes = DefineObjectAttributes(
    UserKeys=[get_user_attributes.Keys, duplicate_data_2],
    UserValues=[get_user_attributes.Values, merge],
    Layer=get_rhino_attributes.Layer)
modify_rhinoobject_attributes = ModifyRhinoObjectAttributes(Geometry=gh_geotobechanged_3, Attributes=define_object_attributes, Modify=input_updatepanelgaps_2)

# ----
# TRANSFORM
# PANELS
gh_geotobechanged_4 = RemoteReceiver(gh_geotobechanged)
input_updatepanelgaps_3 = RemoteReceiver(input_updatepanelgaps)
button = Button()  # disabled
guid = Guid(flatten(gh_geotobechanged_4))
python = GhPythonScript(guid=guid, transform=compound, apply=button)  # inputs guid: Guid, transform: Transform, apply: Boolean; disabled
# ---------- python: Python ----------
# ACTION: transfoems Rhino native geometry    
# LIMITATION: 
# TO DO:      

__author__ = "Yury Nasonov"
__version__ = "1"

ghenv.Component.Message = 'transform geo'

# ———————————————————————————————————————————————————————————

import Rhino
import Grasshopper
import scriptcontext

# ———————————————————————————————————————————————————————————

if apply == True:
    scriptcontext.doc = Rhino.RhinoDoc.ActiveDoc
    scriptcontext.doc.Objects.Transform(guid, transform, True)
    scriptcontext.doc.Views.Redraw()
    scriptcontext.doc = ghdoc
# ---------- end python ----------
python_2 = GhPythonScript(guids=guid, transforms=compound, apply=input_updatepanelgaps_3)  # inputs guids: list of Guid, transforms: list of Transform, apply: Boolean
# ---------- python_2: Python ----------
# ACTION: transfoems Rhino native geometry    
# LIMITATION: 
# TO DO:      

__author__ = "Yury Nasonov"
__version__ = "1"

ghenv.Component.Message = 'transform geo'

# ———————————————————————————————————————————————————————————

import Rhino
import Grasshopper
import scriptcontext

# ———————————————————————————————————————————————————————————

scriptcontext.doc = Rhino.RhinoDoc.ActiveDoc

if apply == True:
    i = 0
    for transform in transforms:
        scriptcontext.doc.Objects.Transform(guids[i], transforms[i], True)
        i+=1

scriptcontext.doc.Views.Redraw()
scriptcontext.doc = ghdoc
# ---------- end python_2 ----------
python_3 = GhPythonScript(guids=guid, transforms=compound, apply=input_updatepanelgaps_3)  # inputs guids: list of Guid, transforms: list of Transform, apply: Boolean; disabled; same code as python_2

# ----
# Changelog
panel_5 = Panel("""CHANGELOG

17.02.2021 by Yury Nasonov
initial release

TO DO
Clean up 

REQUIREMENTS


BUGS or LIMITATIONS""")
text = Text(panel_5)

# ----
# OUTPUTS
info_help = ClusterOutput(text)  # Info&Help

# ==== cluster CreateProfile: Create Profile
value_list = ValueList({"Point": 0, "Curve": 1, "Arc": 2, "Circle": 3, "Ellipse": 4, "Line": 5, "Polyline": 6, "Surface": 7, "Brep": 8, "Mesh": 9, "Polysurface": 10, "Block": 11, "Text": 12, "TextDot": 13, "Dimension": 14, "LinearDimension": 15, "AngularDimension": 16, "Hatch": 17, "Leader": 18}, selected="Point")
input_is_profile_selected_as_tree = RemoteReceiver()  # disabled
text = Text(Tree({0}: ["HO_DefaultProfile-Window head"], {1}: ["HO_DefaultProfile-Window jamb L", "HO_DefaultProfile-Window jamb R"], {2}: ["HO_DefaultProfile-Window mullion"], {3}: ["HO_DefaultProfile-Window sill"], {4}: ["HO_DefaultProfile-Window transom"], {5}: ["HO_DefaultProfile-Door head"]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))  # disabled
text_2 = Text(Tree({0}: ["1;0;LU"], {1}: ["0;0;LU", "0;1;LU"], {2}: ["0;0;MM"], {3}: ["1;0;RB"], {4}: ["1;0;MM"], {5}: ["1;0;LU"]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))  # disabled
panel = Panel(text)  # disabled
dispatch = Dispatch(List=text, DispatchPattern=input_is_profile_selected_as_tree)  # -> flatten(ListA), ListB; disabled
dispatch_2 = Dispatch(List=text_2, DispatchPattern=input_is_profile_selected_as_tree)  # -> flatten(ListA), ListB; disabled
panel_2 = Panel(text_2)  # disabled
panel_3 = Panel("Profile - Rectangular - ")  # disabled
input_selected_existing_profile = RemoteReceiver()  # disabled
panel_4 = Panel(" x ")  # disabled
panel_5 = Panel(";")  # disabled
project_of_next_unique_block = RemoteReceiver()  # disabled
cluster = Cluster_4(text=input_selected_existing_profile)  # disabled
panel_6 = Panel(";")  # disabled
panel_7 = Panel("Profile custom #")  # disabled
input_block_name = RemoteReceiver()  # disabled
panel_8 = Panel(";")  # disabled
concatenate = Concatenate(FragmentA=cluster, FragmentF=panel_6, FragmentE=dispatch_2.ListA)  # disabled
concatenate_2 = Concatenate(
    FragmentA=panel_7,
    FragmentB=project_of_next_unique_block,
    FragmentE=" - ",
    FragmentD=input_block_name,
    FragmentC=panel_8,
    FragmentF=dispatch_2.ListA)  # disabled
panel_9 = Panel("""HO_GH-APP SMALL bottom
HO_GH-APP SMALL left""")
move_text = Panel("""{0,-20,0}
{-20,0,0}""")
vector_xyz = VectorXYZ(XComponent=Slider(281, range=-400..401), YComponent=Slider(46, range=-200..200), ZComponent=0)  # -> Vector, Length
vector_xyz_2 = VectorXYZ(XComponent=Slider(-89, range=-400..401), YComponent=Slider(-2, range=-200..200), ZComponent=0)  # -> Vector, Length
vector_xyz_3 = VectorXYZ(XComponent=Slider(234, range=-400..401), YComponent=Slider(-9, range=-200..200), ZComponent=0)  # -> Vector, Length
vector_xyz_4 = VectorXYZ(XComponent=Slider(-42, range=-400..401), YComponent=Slider(55, range=-200..200), ZComponent=0)  # -> Vector, Length
number_slider = Slider(81, range=0..1000)
value_list_2 = ValueList({"Default", "Millimeter Architectural", "Millimeter Large", "Millimeter Small", "HO_GH-APP", "HO_GH-APP BIG", "HO_GH-APP 100", "HO_GH-APP 200", "Millimeter Small2", "HO_GH-APP SMALL bottom", "HO_GH-APP SMALL left"}, selected="Millimeter Architectural")
colour_swatch = ColourSwatch(SwatchColor=RGB(54, 54, 54))
define_text_object = DefineTextObject(Plane=PlaneXY(0, 0, 0), DimensionStyle="HO_GH-APP 45", OutputType="Text")  # disabled
panel_10 = Panel("""HO_GH-APP SMALL bottom
HO_GH-APP SMALL left""")
colour_swatch_2 = ColourSwatch(SwatchColor=RGB(234, 255, 0))
colour_swatch_3 = ColourSwatch(SwatchColor=RGB(255, 255, 255))

# ----
# Changelog
panel_11 = Panel("""CHANGELOG

17.02.2021 by Yury Nasonov
initial release

TO DO
Clean up 

REQUIREMENTS


BUGS or LIMITATIONS""")
text_3 = Text(panel_11)

dimensions = Relay()
colour_swatch_4 = ColourSwatch(SwatchColor=RGB(0, 149, 255))
entwine = Entwine(
    Branch00=colour_swatch_4,
    Branch01=colour_swatch_4,
    Branch02=ColourSwatch(SwatchColor=RGB(54, 54, 54)),
    Branch03=ColourSwatch(SwatchColor=RGB(240, 74, 74)),
    Branch04=ColourSwatch(SwatchColor=RGB(224, 224, 224)),
    FlattenInputs=True)  # -> simplify(Result)
entwine_2 = Entwine(Branch00=Slider(11, range=0..20), Branch02=Slider(2, range=0..10), Branch03=Slider(8, range=0..10), FlattenInputs=True)  # -> simplify(Result)
entwine_3 = Entwine(FlattenInputs=True)  # -> simplify(Result)
display_widths = Number(entwine_2)

# ----
# General settings
# For rectangle profiles
# For custom profiles
# Actions
base_point_coordinates = ClusterInput()  # Base Point Coordinates
rectangle_depth = ClusterInput()  # Rectangle depth
isprofileeditoractive = ClusterInput()  # IsProfileEditorActive?
profile_type = ClusterInput()  # Profile type(0=rectangle,..)
profile_orientation = ClusterInput()  # Profile orientation
rectangle_width = ClusterInput()  # Rectangle width
custom_profile_name = ClusterInput()  # Custom profile name
custom_profile_number = ClusterInput()  # Custom profile number
customprofilegeo = ClusterInput()  # CustomProfileGeo
bake_ancor_points = ClusterInput()  # Bake ancor Points?
apply = ClusterInput()  # Apply

parameter = Parameter(x=profile_type)  # -> a
# ---------- parameter: Python ----------
# ACTION:   just uses input as output  
# LIMITATION: 
# TO DO:      

__author__ = "Yury Nasonov"
__version__ = "1"

ghenv.Component.Name = "Parameter"
ghenv.Component.NickName = 'Parameter'
ghenv.Component.Message = 'a = x'

a=x
# ---------- end parameter ----------
parameter_2 = Parameter(x=customprofilegeo)  # -> a; same code as parameter
parameter_3 = Parameter(x=profile_orientation)  # -> a; same code as parameter
parameter_4 = Parameter(x=base_point_coordinates)  # -> a; same code as parameter
parameter_5 = Parameter(x=rectangle_width)  # -> a; same code as parameter
parameter_6 = Parameter(x=rectangle_depth)  # -> a; same code as parameter
parameter_7 = Parameter(x=isprofileeditoractive)  # -> a; same code as parameter
parameter_8 = Parameter(x=custom_profile_name)  # -> a; same code as parameter
parameter_9 = Parameter(x=bake_ancor_points)  # -> a; same code as parameter
parameter_10 = Parameter(x=apply)  # -> a; same code as parameter
parameter_11 = Parameter(x=custom_profile_number)  # -> a; same code as parameter

input_selectedgeoforcustomprofile = RemoteSender(parameter_2)
input_profile_type_0_rectangle = RemoteSender(parameter)
input_of_next_unique_block = RemoteSender(parameter_11)
input_basepointcoordinates = RemoteSender(parameter_4)
input_profile_orientation = RemoteSender(parameter_3)
input_rectanglewidth = RemoteSender(parameter_5)
input_rectangledepth = RemoteSender(parameter_6)
isprofileeditoractive_2 = RemoteSender(parameter_7)
bake_ancor_points_2 = RemoteSender(parameter_9)
input_blockname = RemoteSender(parameter_8)
input_apply = RemoteSender(parameter_10)

input_profile_type_0_exist = RemoteSender(parameter)
# Save block info to DocUserText
input_rectanglewidth_2 = RemoteReceiver(input_rectanglewidth)  # disabled
input_rectangledepth_2 = RemoteReceiver(input_rectangledepth)  # disabled
input_profile_type_0_exist_2 = RemoteReceiver(input_profile_type_0_exist)  # disabled
concatenate_3 = Concatenate(
    FragmentA=panel_3,
    FragmentB=input_rectanglewidth_2,
    FragmentC=panel_4,
    FragmentD=input_rectangledepth_2,
    FragmentF=panel_5,
    FragmentE=dispatch_2.ListA)  # disabled
# CREATE PROFILE
stream_filter = StreamFilter(Gate=input_profile_type_0_exist_2, Stream0=concatenate, Stream1=concatenate_3, Stream2=concatenate_2)  # disabled
input_rectanglewidth_3 = RemoteReceiver(input_rectanglewidth)

# ----
# Create rectangular profile
input_rectanglewidth_4 = RemoteReceiver(input_rectanglewidth)
vector_xyz_5 = VectorXYZ(XComponent=expr("-x/2", input_rectanglewidth_4), YComponent=0, ZComponent=0)  # -> Vector, Length
point_0_0_0 = Point(Point(0, 0, 0))
move = Move(Geometry=point_0_0_0, Motion=vector_xyz_5.Vector)  # -> Geometry, Transform
vector_xyz_6 = VectorXYZ(XComponent=input_rectanglewidth_4, YComponent=0, ZComponent=0)  # -> Vector, Length
move_2 = Move(Geometry=move.Geometry, Motion=vector_xyz_6.Vector)  # -> Geometry, Transform
merge = Merge(Data1=move.Geometry, Data2=point_0_0_0, Data3=move_2.Geometry)
input_rectangledepth_3 = RemoteReceiver(input_rectangledepth)
gh_ancorpoints_for_rectangle_profile = RemoteSender(merge)
rectangle = Rectangle(Plane=move.Geometry, XSize=input_rectanglewidth_3, YSize=input_rectangledepth_3, Radius=0)  # -> Rectangle, Length
orient = Orient(Geometry=rectangle.Rectangle, Source=point_0_0_0, Target=PlaneXY(0, 0, 0))  # -> Geometry, Transform
gh_rectangle_at_xy_plane = RemoteSender(orient.Geometry)

input_profile_orientation_2 = RemoteReceiver(input_profile_orientation)
gh_ancorpoints_for_rectangle_profile_2 = RemoteReceiver(gh_ancorpoints_for_rectangle_profile)
input_profile_type_0_rectangle_2 = RemoteReceiver(input_profile_type_0_rectangle)
input_profile_orientation_3 = RemoteReceiver(input_profile_orientation)
input_apply_2 = RemoteReceiver(input_apply)
done = ClusterOutput(input_apply_2)  # Done

# ----
# Analyze ancor points
input_selectedgeoforcustomprofile_2 = RemoteReceiver(input_selectedgeoforcustomprofile)
panel_12 = Panel("Point")
filter_by_type = FilterByType(Geometry=input_selectedgeoforcustomprofile_2, ObjectType=value_list)  # -> flatten(Geometry)
unit_x = UnitX(Factor=1)
panel_13 = Panel("""0 to 44
45 to 134
135 to 224
225 to 314
314 to 360""")
_0_horizont_1_vert = Panel("""0
1
0
1
0""")
horizont = Panel("""L
M
R""")
panel_14 = Panel("""LU
MM
RB""")
panel_15 = Panel("""RB
MM
LU""")
vert = Panel("""B
M
U""")
horizont_2 = Panel("""LU
MM
RB""")

point = Point(input_selectedgeoforcustomprofile_2)

# ---- group: LB
# Create custom profile
# TO DO:  Align, rotate
input_selectedgeoforcustomprofile_3 = RemoteReceiver(input_selectedgeoforcustomprofile)
filter_by_type_2 = FilterByType(Geometry=input_selectedgeoforcustomprofile_3, ObjectType="Curve")  # -> flatten(Geometry)
curve = Curve(flatten(input_selectedgeoforcustomprofile_3))  # disabled
clean_tree = CleanTree(RemoveNulls=True, RemoveInvalid=True, RemoveEmpty=False, Tree=filter_by_type_2)
planar = Planar(Curve=clean_tree)  # -> Planar, Plane, Deviation
deconstruct = Deconstruct(Point=planar.Plane)  # -> XComponent, YComponent, ZComponent
input_basepointcoordinates_2 = RemoteReceiver(input_basepointcoordinates)
isprofileeditoractive_3 = RemoteReceiver(isprofileeditoractive_2)
symbol_simple = SymbolSimple(Style=Slider(3, range=0..100), Size=12, Rotation=0, Colour=RGB(255, 105, 180))
isprofileeditoractive_4 = RemoteReceiver(isprofileeditoractive_2)
symbol_simple_2 = SymbolSimple(Style=Slider(2, range=0..100), Size=15, Rotation=0, Colour=RGB(255, 105, 180))
panel_16 = Panel(deconstruct.ZComponent)
isprofileeditoractive_5 = RemoteReceiver(isprofileeditoractive_2)
unit_z = UnitZ(Factor=1)
move_3 = Move(Geometry=clean_tree, Motion=unit_z)  # -> Geometry, Transform
number_slider_2 = Slider(90, range=0..100)
number_slider_3 = Slider(0, range=0..100)
number_slider_4 = Slider(57, range=0..1000)
x = Panel("Interior")
x_2 = Panel("Exterior")
isprofileeditoractive_6 = RemoteReceiver(isprofileeditoractive_2)
isprofileeditoractive_7 = RemoteReceiver(isprofileeditoractive_2)
colour_swatch_5 = ColourSwatch(SwatchColor=RGB(224, 224, 224))

# ----
# AncorPointLU
# AncorPointRB
bounding_box = BoundingBox(Content=clean_tree, Plane=PlaneXY(0, 0, 0), UnionBox=True)  # -> Box, Box_2
deconstruct_brep = DeconstructBrep(Brep=bounding_box.Box)  # -> Faces, Edges, Vertices
list_item = ListItem(List=deconstruct_brep.Vertices, Index=0, Wrap=True)  # -> Item, Item1, Item2, Item3
point_2 = Point(list_item.Item)
point_3 = Point(list_item.Item1)
input_profile_orientation_4 = RemoteReceiver(input_profile_orientation)
line = Line(StartPoint=point_2, EndPoint=point_3)
line_2 = Line(StartPoint=point_2, EndPoint=list_item.Item3)
stream_filter_2 = StreamFilter(Gate=input_profile_orientation_4, Stream0=line, Stream1=line_2)
point_on_curve = PointOnCurve(stream_filter_2, parameter=0.5)
stream_filter_3 = StreamFilter(Gate=input_profile_orientation_4, Stream0=point_2, Stream1=list_item.Item3)
stream_filter_4 = StreamFilter(Gate=input_profile_orientation_4, Stream0=list_item.Item1, Stream1=point_2)
merge_2 = Merge(Data1=stream_filter_3, Data2=point_on_curve, Data3=stream_filter_4)

deconstruct_box = DeconstructBox(Box=bounding_box.Box)  # -> Plane, X, Y, Z; disabled
deconstruct_domain = DeconstructDomain(Domain=deconstruct_box.X)  # -> Start, End; disabled
deconstruct_domain_2 = DeconstructDomain(Domain=deconstruct_box.Y)  # -> Start, End; disabled
subtraction = Subtraction(A=deconstruct_domain.End, B=deconstruct_domain.Start)  # disabled
subtraction_2 = Subtraction(A=deconstruct_domain_2.End, B=deconstruct_domain_2.Start)  # disabled
display_selectedgeo = RemoteSender(move_3.Geometry)
display_selectedgeo_2 = RemoteReceiver(display_selectedgeo)

clean_tree_2 = CleanTree(RemoveNulls=True, RemoveInvalid=True, RemoveEmpty=False, Tree=point)  # -> flatten(Tree)
list_length = ListLength(List=clean_tree_2)
gh_ancorpoints = RemoteSender(clean_tree_2)
addition = Addition(A=list_length, B=0)
boolean = Boolean(addition)
gh_ancorpoints_2 = RemoteReceiver(gh_ancorpoints)
fit_line = FitLine(Points=gh_ancorpoints_2)
angle = Angle(VectorA=fit_line, VectorB=unit_x, Plane=PlaneXY(0, 0, 0))  # -> expr("deg(x)", Angle), Reflex
gh_ancorpoints_3 = RemoteReceiver(gh_ancorpoints)
find_domain = FindDomain(Domains=panel_13, Number=angle.Angle, Strict=False)  # -> Index, Neighbour
rotate = Rotate(Geometry=gh_ancorpoints_3, Angle=-1.570796327, Plane=PlaneXY(0, 0, 0))  # -> Geometry, Transform
list_item_2 = ListItem(List=_0_horizont_1_vert, Index=find_domain.Index, Wrap=True)
stream_filter_5 = StreamFilter(Gate=list_item_2, Stream0=gh_ancorpoints_3, Stream1=rotate.Geometry)
sort_points = SortPoints(Points=stream_filter_5)  # -> Points, Indices
stream_filter_6 = StreamFilter(Gate=list_item_2, Stream0=panel_14, Stream1=panel_15)
list_item_3 = ListItem(List=stream_filter_6, Index=sort_points.Indices, Wrap=True)

gh_ancorpoints_are_referenced = RemoteSender(boolean)
gh_referenced_ancorpoint_orientation = RemoteSender(list_item_2)
gh_ancorpoints_are_referenced_2 = RemoteReceiver(gh_ancorpoints_are_referenced)
gh_ancorpoints_are_referenced_3 = RemoteReceiver(gh_ancorpoints_are_referenced)

stream_filter_7 = StreamFilter(Gate=gh_ancorpoints_are_referenced_2, Stream0=horizont_2, Stream1=list_item_3)

# ----
# To do more stable when
# different amount of  points is used
gh_ancorpoints_4 = RemoteReceiver(gh_ancorpoints)
orient_2 = Orient(Geometry=gh_ancorpoints_4, Source=point_on_curve, Target=PlaneXY(0, 0, 0))  # -> Geometry, Transform
stream_filter_8 = StreamFilter(Gate=gh_ancorpoints_are_referenced_3, Stream0=merge_2, Stream1=orient_2.Geometry)
list_item_4 = ListItem(List=stream_filter_8, Index=0, Wrap=True)  # -> Item, Item1, Item2
panel_17 = Panel("""AncorPoint
AncorPoint
AncorPoint""")
panel_18 = Panel(">::SupportGeo::AncorPoints")
panel_19 = Panel("""HO_Type
HO_AncorPointType""")
merge_3 = Merge(Data1=graft(panel_17), Data2=graft(stream_filter_7))
define_object_attributes = DefineObjectAttributes(UserKeys=panel_19, UserValues=merge_3, Layer=panel_18)
bake_ancor_points_3 = RemoteReceiver(bake_ancor_points_2)
bake_objects = BakeObjects(Geometry=graft(stream_filter_8), Attributes=define_object_attributes, Bake=bake_ancor_points_3)

gh_referenced_ancorpoint_orientation_2 = RemoteReceiver(gh_referenced_ancorpoint_orientation)
gh_ancorpoints_are_referenced_4 = RemoteReceiver(gh_ancorpoints_are_referenced)
gh_referenced_ancorpoint_orientation_3 = RemoteReceiver(gh_referenced_ancorpoint_orientation)
stream_filter_9 = StreamFilter(
    Gate=gh_ancorpoints_are_referenced_4,
    Stream0=input_profile_orientation_2,
    Stream1=gh_referenced_ancorpoint_orientation_2)
gh_ancorpoints_5 = RemoteReceiver(gh_ancorpoints)
list_item_5 = ListItem(List=[number_slider_3, number_slider_2], Index=stream_filter_9, Wrap=True)
list_item_6 = ListItem(List=panel_9, Index=gh_referenced_ancorpoint_orientation_3, Wrap=True)
list_item_7 = ListItem(List=move_text, Index=gh_referenced_ancorpoint_orientation_3, Wrap=True)
move_4 = Move(Geometry=gh_ancorpoints_5, Motion=list_item_7)  # -> Geometry, Transform
define_text_object_2 = DefineTextObject(Text=stream_filter_7, Plane=move_4.Geometry, DimensionStyle=list_item_6, OutputType="Text")
display_text_for_ancorpoints = RemoteSender(define_text_object_2)
gh_ancorpoints_are_referenced_5 = RemoteReceiver(gh_ancorpoints_are_referenced)
stream_filter_10 = StreamFilter(Gate=gh_ancorpoints_are_referenced_5, Stream0=stream_filter_7, Stream1=stream_filter_7)
orient_3 = Orient(Geometry=stream_filter_8, Source=point_on_curve, Target=PlaneXY(0, 0, 0))  # -> Geometry, Transform
gh_referenced_ancorpoint_orientation_4 = RemoteReceiver(gh_referenced_ancorpoint_orientation)
gh_ancorpoints_are_referenced_6 = RemoteReceiver(gh_ancorpoints_are_referenced)
stream_filter_11 = StreamFilter(Gate=input_profile_type_0_rectangle_2, Stream1=gh_ancorpoints_for_rectangle_profile_2, Stream2=orient_3.Geometry)
gh_ancorpoints_are_referenced_7 = RemoteReceiver(gh_ancorpoints_are_referenced)

# ---- group: LB (continued)
project = Project(Geometry=list_item_4.Item1, Plane=PlaneXY(0, 0, 0))  # -> Geometry, Transform
stream_filter_12 = StreamFilter(Gate=isprofileeditoractive_3, Stream1=project.Geometry)
move_5 = Move(Geometry=project.Geometry, Motion=expr("-x", input_basepointcoordinates_2))  # -> Geometry, Transform
move_6 = Move(Geometry=stream_filter_12, Motion=Vector(0, 0, 2))  # -> Geometry, Transform
symbol_display = SymbolDisplay(Location=move_6.Geometry, Display=symbol_simple)
line_sdl = LineSDL(
    Start=move_5.Geometry,
    Direction=[Vector(1, 0, 0), Vector(0, 1, 0), Vector(-1, 0, 0), Vector(0, -1, 0)],
    Length=Slider(500, range=0..1000))
stream_filter_13 = StreamFilter(Gate=isprofileeditoractive_4, Stream1=move_5.Geometry)
stream_filter_14 = StreamFilter(Gate=isprofileeditoractive_5, Stream1=line_sdl)
symbol_display_2 = SymbolDisplay(Location=stream_filter_13, Display=symbol_simple_2)
plane = Plane(move_5.Geometry)
orient_4 = Orient(Geometry=clean_tree, Source=point_on_curve, Target=PlaneXY(0, 0, 0))  # -> Geometry, Transform
gh_custom_profile_at_xy_plane = RemoteSender(orient_4.Geometry)

# ----
display_axes = RemoteSender(stream_filter_14)
move_7 = Move(Geometry=plane, Motion=vector_xyz.Vector)  # -> Geometry, Transform
move_8 = Move(Geometry=plane, Motion=vector_xyz_2.Vector)  # -> Geometry, Transform
move_9 = Move(Geometry=plane, Motion=vector_xyz_3.Vector)  # -> Geometry, Transform
move_10 = Move(Geometry=plane, Motion=vector_xyz_4.Vector)  # -> Geometry, Transform
entwine_4 = Entwine(Branch00=[move_7.Geometry, move_8.Geometry], Branch01=[move_9.Geometry, move_10.Geometry], FlattenInputs=True)  # -> simplify(Result)
tree_branch = TreeBranch(Tree=entwine_4, Path=stream_filter_9, MaintainPaths=True)

# ---- group: LB (continued)
rotate_2 = Rotate(Geometry=tree_branch, Angle=degrees(list_item_5), Plane=move_5.Geometry)  # -> Geometry, Transform
stream_filter_15 = StreamFilter(Gate=isprofileeditoractive_6, Stream1=rotate_2.Geometry)
stream_filter_16 = StreamFilter(Gate=isprofileeditoractive_7, Stream1=rotate_2.Geometry)  # disabled

# ----
define_text_object_3 = DefineTextObject(Text=[x, x_2], Plane=[stream_filter_15, stream_filter_16], DimensionStyle="HO_GH-APP 45", OutputType="Text")

# ---- group: LB
text_tag_3d = TextTag3D(Location=stream_filter_15, Text=x, Size=number_slider_4, Colour=colour_swatch_5, Justification=7)
text_tag_3d_2 = TextTag3D(Location=stream_filter_16, Text=x_2, Size=number_slider_4, Colour=colour_swatch_5, Justification=3)

# ----
display_text_interior_exterior = RemoteSender(define_text_object_3)
display_text_interior_exterior_2 = RemoteReceiver(display_text_interior_exterior)
display_axes_2 = RemoteReceiver(display_axes)
display_axes_3 = RemoteReceiver(display_axes)
entwine_5 = Entwine(Branch00=display_axes_3, FlattenInputs=True)

# ----
# Display text for ancor points
number_slider_5 = Slider(40, range=0..1000)
text_tag_3d_3 = TextTag3D(Location=stream_filter_8, Text=stream_filter_7, Size=number_slider_5, Justification=5)  # disabled
input_profile_orientation_5 = RemoteReceiver(input_profile_orientation)
move_text_2 = Panel("""{0,-20,0}
{-20,0,0}""")
list_item_8 = ListItem(List=move_text_2, Index=input_profile_orientation_5, Wrap=True)
move_11 = Move(Geometry=stream_filter_8, Motion=list_item_8)  # -> Geometry, Transform

list_item_9 = ListItem(List=panel_10, Index=input_profile_orientation_5, Wrap=True)

define_text_object_4 = DefineTextObject(Text=stream_filter_7, Plane=move_11.Geometry, DimensionStyle=list_item_9, OutputType="Text")
display_text_for_ancorpoints_2 = RemoteSender(define_text_object_4)

display_text_for_ancorpoints_3 = RemoteReceiver([display_text_for_ancorpoints_2, display_text_for_ancorpoints])
move_12 = Move(Geometry=display_text_for_ancorpoints_3, Motion=Vector(0, 0, 10))  # -> Geometry, Transform

# ----
# Create block with profile
input_profile_type_0_rectangle_3 = RemoteReceiver(input_profile_type_0_rectangle)
gh_custom_profile_at_xy_plane_2 = RemoteReceiver(gh_custom_profile_at_xy_plane)
gh_rectangle_at_xy_plane_2 = RemoteReceiver(gh_rectangle_at_xy_plane)
unit_z_2 = UnitZ(Factor=1)
stream_filter_17 = StreamFilter(Gate=input_profile_type_0_rectangle_3, Stream1=gh_rectangle_at_xy_plane_2, Stream2=gh_custom_profile_at_xy_plane_2)
extrude = Extrude(Base=stream_filter_17, Direction=unit_z_2)
input_rectanglewidth_5 = RemoteReceiver(input_rectanglewidth)
input_rectangledepth_4 = RemoteReceiver(input_rectangledepth)
input_profile_type_0_rectangle_4 = RemoteReceiver(input_profile_type_0_rectangle)
cap_holes = CapHoles(Brep=extrude)
panel_20 = Panel("""HO_ProfileType
HO_W
HO_D""")
_1_rect_2_custom = Panel("HO_ProfileType")
input_rectanglewidth_6 = RemoteReceiver(input_rectanglewidth)
input_rectangledepth_5 = RemoteReceiver(input_rectangledepth)
merge_4 = Merge(Data1="1", Data2=input_rectanglewidth_5, Data3=input_rectangledepth_4)
input_of_next_unique_block_2 = RemoteReceiver()
input_blockname_2 = RemoteReceiver(input_blockname)
input_profile_type_0_rectangle_5 = RemoteReceiver(input_profile_type_0_rectangle)
panel_21 = Panel("""HO_W
HO_H""")
stream_filter_18 = StreamFilter(Gate=input_profile_type_0_rectangle_4, Stream1=merge_4, Stream2=_1_rect_2_custom)
stream_filter_19 = StreamFilter(Gate=input_profile_type_0_rectangle_4, Stream1=merge_4, Stream2="2")
concatenate_4 = Concatenate(
    FragmentA="Profile - Rectangular - ",
    FragmentB=input_rectanglewidth_6,
    FragmentC=" x ",
    FragmentD=input_rectangledepth_5)
concatenate_5 = Concatenate(FragmentA="Profile custom #", FragmentB=input_of_next_unique_block_2, FragmentE=" - ", FragmentD=input_blockname_2)
stream_filter_20 = StreamFilter(Gate=input_profile_type_0_rectangle_5, Stream1=concatenate_4, Stream2=concatenate_5)
input_apply_3 = RemoteReceiver(input_apply)
define_object_attributes_2 = DefineObjectAttributes(UserKeys=panel_19, UserValues=merge_3, Layer=panel_18)  # -> flatten(Attributes)
define_object_attributes_3 = DefineObjectAttributes(UserKeys=stream_filter_18, UserValues=stream_filter_19, Layer=">::Block::Block - Profile")
list_length_2 = ListLength(List=cap_holes)
gate_or = GateOr(B=input_apply_3)
xy_plane = XYPlane(Origin=Point(0, 0, 0))
gh_ancorpoints_for_rectangle_profile_3 = RemoteReceiver(gh_ancorpoints_for_rectangle_profile)
dispatch_3 = Dispatch(List=stream_filter_20, DispatchPattern=gate_or)  # -> ListA, ListB
rotate_3 = Rotate(Geometry=xy_plane, Angle=degrees(-90), Plane=xy_plane)  # -> Geometry, Transform
duplicate_data = DuplicateData(Data=define_object_attributes_3, Number=list_length_2, Order=True)  # -> flatten(Data)
input_profile_type_0_rectangle_6 = RemoteReceiver(input_profile_type_0_rectangle)
addition_2 = Addition(A=gh_referenced_ancorpoint_orientation_4, B=0)
merge_5 = Merge(Data1=cap_holes, Data2=stream_filter_11)  # -> flatten(Result)
merge_6 = Merge(Data1=duplicate_data, Data2=define_object_attributes_2)  # -> flatten(Result)
stream_filter_21 = StreamFilter(Gate=input_profile_type_0_rectangle_6, Stream1=gh_ancorpoints_for_rectangle_profile_3, Stream2=stream_filter_8)
gh_ancorpoints_are_referenced_8 = RemoteReceiver(gh_ancorpoints_are_referenced)
gh_ancorpoints_6 = RemoteReceiver(gh_ancorpoints)
hide_created_blocks = Panel("-_SelLayer \">::Block::Block - Profile\" _Hide")
input_profile_type_0_rectangle_7 = RemoteReceiver(input_profile_type_0_rectangle)
stream_filter_22 = StreamFilter(Gate=gh_ancorpoints_are_referenced_8, Stream0=stream_filter_21, Stream1=gh_ancorpoints_6)
list_length_3 = ListLength()  # disabled
define_object_attributes_4 = DefineObjectAttributes(Layer=">::Block::Block - Profile")
input_apply_4 = RemoteReceiver(input_apply)
boolean_2 = Boolean(input_profile_type_0_rectangle_7)
gzcommand = CSharpScript(command=hide_created_blocks, runNow=list_length_3, echo=False)  # -> done; inputs command: String, runNow: Boolean, echo: Boolean
# ---------- gzcommand: C# ----------
    done = false;
    if (runNow == true){
      Rhino.RhinoApp.RunScript(command, echo);
      done = true;
    }
# ---------- end gzcommand ----------
move_13 = Move(Geometry=stream_filter_22, Motion="{0,0,1}")  # -> Geometry, Transform
gate_and = GateAnd(A=input_apply_4, B=boolean_2)
cross_sign = Curve(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)
orient_5 = Orient(Geometry=cross_sign, Source=PlaneXY(0, 0, 0), Target=move_13.Geometry)  # -> Geometry, Transform
display_cross_signs = RemoteSender(orient_5.Geometry)

stream_filter_23 = StreamFilter(Gate=gh_ancorpoints_are_referenced_6, Stream0=input_profile_orientation_3, Stream1=addition_2)

stream_filter_24 = StreamFilter(Gate=stream_filter_23, Stream0=xy_plane, Stream1=rotate_3.Geometry)
define_block = DefineBlock(Geometry=flatten(merge_5), Attributes=flatten(merge_6), BlockName=stream_filter_20, BasePlane=stream_filter_24)
bake_objects_2 = BakeObjects(Geometry=define_block, BakeName=define_object_attributes_4, Bake=gate_and)

plane_origin = PlaneOrigin(Base=stream_filter_24)
display_cross_signs_2 = RemoteReceiver(display_cross_signs)
entwine_6 = Entwine(
    Branch00=display_selectedgeo_2,
    Branch01=move_12.Geometry,
    Branch02=display_axes_2,
    Branch03=display_cross_signs_2,
    Branch04=display_text_interior_exterior_2,
    FlattenInputs=True)  # -> simplify(Result)
gzconduit = CSharpScript(
    geo=entwine_6,
    colors=entwine,
    widths=display_widths,
    Reference=["C:\Users\ynasonov\dev\yury\Godzilla\RhGodzilla\bin\Debug\net48\Godzilla.dll", "C:\Users\ynasonov\dev\yury\Godzilla\RhGodzilla\bin\Debug\net48\RhGodzilla.rhp"])  # -> out; inputs geo: tree, colors: tree of Color, widths: tree of Int32
# ---------- gzconduit: C# usings ----------
using RhGodzilla;
using Godzilla;
# ---------- gzconduit: C# ----------
    var gzPlugin = Rhino.RhinoApp.GetPlugInObject("RhGodzilla");
    var gz = RhGodzilla.RhGodzillaPlugin.Instance as RhGodzilla.RhGodzillaPlugin;
    var conduit = gz.GhConduit;
    conduit.SetGeoAndData(geo, colors, widths);
    conduit.Enabled = true;
# ---------- end gzconduit ----------

# ----
# OUTPUTS
attributes = EFDataDescription()
ui_messages = Text(entwine_3)
info_help = ClusterOutput(text_3)  # Info&Help
ancorpts_used = ClusterOutput(gh_ancorpoints_are_referenced_7)  # AncorPts used?
gen_attributes = ClusterOutput(attributes)  # Gen. Attributes
display_widths_2 = ClusterOutput(display_widths)  # Display: widths
ui_messages_2 = ClusterOutput(ui_messages)  # UI Messages
generated_geo = ClusterOutput(entwine_5)  # Generated geo
display_geo = ClusterOutput(entwine_6)  # Display: geo
display_colors = ClusterOutput(entwine)  # Display: colors

block_name = ClusterOutput(stream_filter_20)  # Block name

# ==== cluster Cluster_5
text = ClusterInput()
replace_text = ReplaceText(Text=text, Find="Profile - Rectangular -", Replace="▮", RecursiveReplace=False)
replace_text_2 = ReplaceText(Text=replace_text, Find="Profile custom", Replace="▶", RecursiveReplace=False)
result = ClusterOutput(replace_text_2)

# ==== cluster Cluster
text = ClusterInput()

# ----
# Getting plane info
# from attributes
text_split = TextSplit(Text=text, Separators="/")
list_item = ListItem(List=text_split, Index=0, Wrap=True)  # -> Item, Item1, Item2
construct_plane = ConstructPlane(Origin=list_item.Item, XAxis=list_item.Item1, YAxis=list_item.Item2)  # -> simplify(Plane)

plane = ClusterOutput(construct_plane)

# ==== cluster Cluster_2
plane = ClusterInput()

# ----
# Plane info for attributes
deconstruct_plane = DeconstructPlane(Plane=simplify(graft(plane)))  # -> Origin, XAxis, YAxis, ZAxis
construct_plane = ConstructPlane(Origin=deconstruct_plane.Origin, XAxis=deconstruct_plane.XAxis, YAxis=deconstruct_plane.YAxis)
deconstruct_plane_2 = DeconstructPlane(Plane=construct_plane)  # -> Origin, XAxis, YAxis, ZAxis
text_join = TextJoin(Text=[deconstruct_plane_2.Origin, deconstruct_plane_2.XAxis, deconstruct_plane_2.YAxis], Join="/")  # -> simplify(Result)

result = ClusterOutput(text_join)

# ==== cluster Cluster_4
text = ClusterInput()
replace_text = ReplaceText(Text=text, Find="▮", Replace="Profile - Rectangular -", RecursiveReplace=False)
replace_text_2 = ReplaceText(Text=replace_text, Find="▶", Replace="Profile custom", RecursiveReplace=False)
result = ClusterOutput(replace_text_2)
