# Grasshopper definition regelelements.gh (Grasshopper 1.0.7)
# Copyright: Yury Nasonov
# plug-ins: Human UI, MetaHopper, Human, EleFront, Telepathy, ProvingGround.Conduit

# Title+X
# Title+Y
# Title+X
# Title+Y
# Important unobvious stuff:
# index 0 => 0
# index 1 => length or height (max number)
# index 2... => all other shifts
# Important unobvious  stuff:
# index 0 => 0
# index 1 => length or height (max number)
# index 2... => all other shifts
relay = Relay()  # disabled
project_listofmaterials = RemoteReceiver()

# ----
# Wall materials
# Achtung!
# Achtung!
# Achtung!
panel = Panel(""">::FacadeSubFace::Vent-Other
>::FacadeSubFace::MS-Other
>::FacadeSubFace::Column
>::FacadeSubFace::Attika""")
reference_by_layer = ReferenceByLayer(LayerName=panel, DisableAutoUpdate=False, ignoreCase=False)  # -> flatten(Geometry)
layers_with_walls = RemoteSender(panel)
get_user_value = GetUserValue(Geometry=reference_by_layer, Key="HO_RE-type-by-user")
create_set = CreateSet(List=get_user_value)  # -> Set, Map
create_tree = CreateTree(Data=get_user_value, Path=get_user_value)
list_length = ListLength(List=create_tree)  # -> flatten(Length)
create_label = CreateLabel(LabelText="Count", LabelSize=12, Justification=0)  # -> flatten(Label)
create_text_block = CreateTextBlock(Text=list_length, TextSize=12, Justification=1)
default_material_for_wall_oth = RemoteReceiver()
panel_2 = Panel("""1
2
3""")
default_material_for_wall_vent = RemoteReceiver()
list_length_2 = ListLength(List=create_set.Set)  # -> flatten(Length)
replace_text = ReplaceText(Text=default_material_for_wall_oth, Find=" _wa", RecursiveReplace=False)
create_checkbox = CreateCheckbox(Label=" ", StartingValue=True)
create_label_2 = CreateLabel(LabelText="Type", LabelSize=12, Justification=0)  # -> flatten(Label)
create_label_3 = CreateLabel(LabelText="Isol", LabelSize=12, Justification=0)  # -> flatten(Label)
create_label_4 = CreateLabel(LabelText="Render material", LabelSize=12, Justification=0)  # -> flatten(Label)
create_radio_button = CreateRadioButton(RadioButtonGroup="Type-Isolation", InitiallySelected=[True, False])
create_label_5 = CreateLabel(LabelText="Material by type", LabelSize=18, Justification=0)  # -> flatten(Label)
addition = Addition(A=list_length_2, B=0)
hui_wallmaterialslist = RemoteReceiver()
concatenate = Concatenate(Default="< Default: >", FragmentB=replace_text)
create_label_6 = CreateLabel(LabelText=panel_2, LabelSize=12, Justification=0)  # -> flatten(Label)
create_pulldown_menu = CreatePulldownMenu(Label=graft(""), ListItems=project_listofmaterials, showLabel=True)  # -> flatten(Pulldown)
sort_text = SortText(Keys=create_set.Set, Culture=127)  # -> Keys, Values
duplicate_data = DuplicateData(Data=Toggle(True), Number=addition, Order=True)
panel_3 = Panel(hui_wallmaterialslist)
merge = Merge(Data1=flatten(concatenate), Data2=flatten(hui_wallmaterialslist))
value_listener = ValueListener(Elements=create_checkbox, SomeProperty=True)  # -> Values, Indices
value_listener_2 = ValueListener(Elements=create_label_6, SomeProperty=True)  # -> Values, Indices
merge_2 = Merge(Data1=flatten(duplicate_data), Data2=Toggle(False))
set_list_contents = SetListContents(ListToModify=create_pulldown_menu, NewListContents=merge)
panel_4 = Panel(sort_text.Keys)
entwine = Entwine(
    Branch00=[create_label_2, create_label_6],
    Branch01=[create_checkbox, create_radio_button],
    Branch02=[create_label_4, create_pulldown_menu],
    Branch03=flatten([create_label, create_text_block]),
    FlattenInputs=True)
set_label_contents = SetLabelContents(LabelToModify=create_label_6, NewLabelContents=sort_text.Keys)
split_list = SplitList(List=flatten(value_listener_2.Values), Index=addition)  # -> ListA, ListB
value_listener_3 = ValueListener(Elements=create_pulldown_menu, SomeProperty=True)  # -> Values, Indices
create_simple_grid = CreateSimpleGrid(UIElements=entwine, RowDefinitions="Auto", ColumnDefinitions="Auto")
hide_show_element = HideShowElement(ElementToHideShow=create_pulldown_menu, Show=merge_2, Collapse=True, Disable=False)
hide_show_element_2 = HideShowElement(ElementToHideShow=create_radio_button, Show=merge_2, Collapse=True, Disable=value_listener.Values)
split_list_2 = SplitList(List=flatten(value_listener_3.Values), Index=addition)  # -> ListA, ListB
input_walltypes_all = RemoteSender(sort_text.Keys)
merge_3 = Merge(Data1=create_label_5, Data2=create_simple_grid)
replace_text_2 = ReplaceText(Text=split_list_2.ListA, Find="< Default: >", RecursiveReplace=False)
panel_5 = Panel(split_list_2.ListA)
hide_show_element_3 = HideShowElement(ElementToHideShow=create_label_6, Show=merge_2, Collapse=True, Disable=False)
hui_selectors_wallmaterialbytype = RemoteSender(merge_3)
create_radio_button_2 = CreateRadioButton(RadioButtonName="Doors", RadioButtonGroup="WinDooWalCur", InitiallySelected=False)
create_label_7 = CreateLabel(LabelText="Doors", LabelSize=12, Justification=0)
concatenate_2 = Concatenate(FragmentA=replace_text_2, FragmentB=" _wa")
value_listener_4 = ValueListener(Elements=create_radio_button_2, SomeProperty=True)  # -> Values, Indices
input_wallmaterialbytype = RemoteSender(concatenate_2)
hui_viewradiobutton_doors = RemoteSender(create_radio_button_2)
hide_show_element_4 = HideShowElement(ElementToHideShow=create_label_7, Show=value_listener_4.Values, Collapse=True, Disable=False)
panel_6 = Panel(input_wallmaterialbytype)
panel_7 = Panel(value_listener_4.Values)

# ----
# Adding panel gaps
default_size_wall_panel_gap = RemoteReceiver()  # disabled
curve = Curve(graft(reference_by_layer))  # disabled
offset_curve = OffsetCurve(Curve=curve, Distance=expr("x/2", default_size_wall_panel_gap), Plane=PlaneXY(0, 0, 0), Corners=1)  # disabled
offset_curve_2 = OffsetCurve(Curve=curve, Distance=expr("-x/2", default_size_wall_panel_gap), Plane=PlaneXY(0, 0, 0), Corners=1)  # disabled
area = Area(Geometry=offset_curve_2)  # -> Area, Centroid; disabled
area_2 = Area(Geometry=offset_curve)  # -> Area, Centroid; disabled
smaller_than = SmallerThan(FirstNumber=area_2.Area, SecondNumber=area.Area)  # -> SmallerThan, OrEqualTo; disabled
pick_n_choose = PickNChoose(Pattern=smaller_than.SmallerThan, Stream0=offset_curve_2, Stream1=offset_curve)  # disabled
surface = Surface(flatten(pick_n_choose))  # disabled

panel_8 = Panel(default_size_wall_panel_gap)  # disabled
number_slider = Slider(4, range=0..10)  # disabled
defaults_actual_materials = RemoteReceiver()  # disabled
custom_preview_materials = CustomPreviewMaterials(Geometry=surface, DiffuseColor=RGB(255, 255, 255))  # disabled
list_item = ListItem(List=defaults_actual_materials, Index=number_slider, Wrap=False)  # disabled
custom_preview = CustomPreview(Geometry=surface, Material=list_item)  # disabled
project_listofmaterials_2 = RemoteReceiver()  # disabled

# ----
# Curtain walls materials
panel_9 = Panel(">::FacadeSubFace::CurtainWall")
reference_by_layer_2 = ReferenceByLayer(LayerName=panel_9, DisableAutoUpdate=False, ignoreCase=False)  # disabled
get_user_value_2 = GetUserValue(Geometry=reference_by_layer_2, Key="HO_RE-type-by-user")  # disabled
create_set_2 = CreateSet(List=get_user_value_2)  # -> Set, Map; disabled
list_length_3 = ListLength(List=create_set_2.Set)  # -> flatten(Length); disabled
create_checkbox_2 = CreateCheckbox(Label=" ", StartingValue=True)  # disabled
create_label_8 = CreateLabel(LabelText="Type", LabelSize=12, Justification=0)  # -> flatten(Label); disabled
create_label_9 = CreateLabel(LabelText="Isol", LabelSize=12, Justification=0)  # -> flatten(Label); disabled
create_label_10 = CreateLabel(LabelText="Panels material", LabelSize=12, Justification=0)  # -> flatten(Label); disabled
create_label_11 = CreateLabel(LabelText="Mullions material", LabelSize=12, Justification=0)  # -> flatten(Label); disabled
create_label_12 = CreateLabel(LabelText="Count", LabelSize=12, Justification=0)  # -> flatten(Label); disabled
create_radio_button_3 = CreateRadioButton(RadioButtonGroup="Type-Isolation", InitiallySelected=[True, False])  # disabled
create_label_13 = CreateLabel(LabelText="Material by type", LabelSize=18, Justification=0)  # -> flatten(Label); disabled
create_label_14 = CreateLabel(LabelSize=12, Justification=0)  # -> flatten(Label); disabled
create_pulldown_menu_2 = CreatePulldownMenu(Label=graft(""), ListItems=project_listofmaterials_2, showLabel=True)  # -> flatten(Pulldown); disabled
boolean_toggle = BooleanToggle(True)  # disabled
boolean_toggle_2 = BooleanToggle(False)  # disabled
addition_2 = Addition(A=list_length_3, B=0)  # disabled
create_pulldown_menu_3 = CreatePulldownMenu(Label=graft(""), ListItems=project_listofmaterials_2, showLabel=True)  # -> flatten(Pulldown); disabled
sort_text_2 = SortText(Keys=create_set_2.Set, Culture=127)  # -> Keys, Values; disabled
duplicate_data_2 = DuplicateData(Data=boolean_toggle, Number=addition_2, Order=True)  # disabled
value_listener_5 = ValueListener(Elements=create_checkbox_2, SomeProperty=True)  # -> Values, Indices; disabled
value_listener_6 = ValueListener(Elements=create_label_14, SomeProperty=True)  # -> Values, Indices; disabled
merge_4 = Merge(Data1=flatten(duplicate_data_2), Data2=boolean_toggle_2)  # disabled
entwine_2 = Entwine(
    Branch00=[create_label_8, create_label_14],
    Branch01=[create_checkbox_2, create_radio_button_3],
    Branch02=[create_label_10, create_pulldown_menu_2],
    Branch03=[create_label_11, create_pulldown_menu_3],
    Branch04=create_label_12,
    FlattenInputs=True)  # disabled
set_label_contents_2 = SetLabelContents(LabelToModify=create_label_14, NewLabelContents=sort_text_2.Keys)  # disabled
value_listener_7 = ValueListener(Elements=create_pulldown_menu_2, SomeProperty=True)  # -> Values, Indices; disabled
split_list_3 = SplitList(List=flatten(value_listener_6.Values), Index=addition_2)  # -> ListA, ListB; disabled
hide_show_element_5 = HideShowElement(ElementToHideShow=create_pulldown_menu_3, Show=merge_4, Collapse=True, Disable=False)  # disabled
create_simple_grid_2 = CreateSimpleGrid(UIElements=entwine_2, RowDefinitions="Auto", ColumnDefinitions="Auto")  # disabled
hide_show_element_6 = HideShowElement(ElementToHideShow=create_pulldown_menu_2, Show=merge_4, Collapse=True, Disable=False)  # disabled
hide_show_element_7 = HideShowElement(ElementToHideShow=create_radio_button_3, Show=merge_4, Collapse=True, Disable=value_listener_5.Values)  # disabled
split_list_4 = SplitList(List=flatten(value_listener_7.Values), Index=addition_2)  # -> ListA, ListB; disabled
merge_5 = Merge(Data1=flatten(create_label_13), Data2=flatten(create_simple_grid_2))  # disabled
panel_10 = Panel(split_list_4.ListA)  # disabled
hide_show_element_8 = HideShowElement(ElementToHideShow=create_label_14, Show=merge_4, Collapse=True, Disable=False)  # disabled
hui_selectors_curtainwallmaterialbytype = RemoteSender(merge_5)  # disabled
create_radio_button_4 = CreateRadioButton(RadioButtonName="Doors", RadioButtonGroup="WinDooWalCur", InitiallySelected=False)  # disabled
create_label_15 = CreateLabel(LabelText="Doors", LabelSize=12, Justification=0)  # disabled
value_listener_8 = ValueListener(Elements=create_radio_button_4, SomeProperty=True)  # -> Values, Indices; disabled
hide_show_element_9 = HideShowElement(ElementToHideShow=create_label_15, Show=value_listener_8.Values, Collapse=True, Disable=False)  # disabled
panel_11 = Panel(value_listener_8.Values)  # disabled

panel_12 = Panel(""">::FacadeSubFace::*
>::FacadeSubFace::*""")
x = Panel("""HO_DefaultProfile-Window head
HO_DefaultProfile-Window jamb L
HO_DefaultProfile-Window mullion
HO_DefaultProfile-Window sill
HO_DefaultProfile-Window transom
HO_DefaultProfile-Door head
HO_DefaultProfile-Door jamb L
HO_DefaultProfile-Door mullion
HO_DefaultProfile-Door sill
HO_DefaultProfile-Door transom
HO_DefaultProfile-CW head
HO_DefaultProfile-CW jamb L
HO_DefaultProfile-CW mullion
HO_DefaultProfile-CW sill
HO_DefaultProfile-CW transom""")
create_true_only_button = CreateTrueOnlyButton(SubmitABug="💬", ButtonStyle=0)  # disabled
create_true_only_button_2 = CreateTrueOnlyButton(SubmitABug="💬", ButtonStyle=0)  # disabled
create_true_only_button_3 = CreateTrueOnlyButton(SubmitABug="💬", ButtonStyle=0)  # disabled
panel_13 = Panel("""Profile - Default - Window jamb L
Profile - Default - Window mullion
Profile - Default - Window head
Profile - Default - Window transom
Profile - Default - Window sill
Profile - Default - CW jamb L
Profile - Default - CW mullion
Profile - Default - CW head
Profile - Default - CW transom
Profile - Default - CW sill""")
panel_14 = Panel("""Window head
Window jamb L
Window mullion
Window sill
Window transom
Door head
Door jamb L
Door mullion
Door sill
Door transom
CW head
CW jamb L
CW mullion
CW sill
CW transom""")
merge_6 = Merge(Data2=create_true_only_button, Data3=create_true_only_button_2, Data4=create_true_only_button_3)  # disabled
hui_submit_a_bug_buttons = RemoteSender(merge_6)  # disabled

# ----
# SET  TYPE
panel_15 = Panel("""New
1
2
3
4
5
6
7
8""")
create_button = CreateButton(ButtonNameGetFromSelected="Get from selected", ButtonStyle=0)
create_button_2 = CreateButton(ButtonNameApply="Apply", ButtonStyle=0)
create_text_box = CreateTextBox(Label="or type:", UpdateButton=False, showLabel=True)
create_label_16 = CreateLabel(LabelText="Set type:", LabelSize=18, Justification=0)
create_button_3 = CreateButton(ButtonName=panel_15, ButtonStyle=0)
create_label_17 = CreateLabel(LabelText="or:", LabelSize=18, Justification=0)
value_listener_9 = ValueListener(Elements=create_button, SomeProperty=True)  # -> Values, Indices
create_wrappanel = CreateWrapPanel(UIElements=[create_label_17, create_button, create_text_box, create_button_2], Horizontal=True)
adjust_element_positioning = AdjustElementPositioning(ElementsToAdjust=create_text_box, AbsolutePositioning=False, Width=Slider(150, range=0..1000))
adjust_element_positioning_2 = AdjustElementPositioning(ElementsToAdjust=create_button_3, Margin=Slider(2, range=0..10), AbsolutePositioning=False)
create_wrappanel_2 = CreateWrapPanel(UIElements=[create_label_16, create_button_3], Horizontal=True)
objects_by_selection = ObjectsBySelection(Reset=invert(value_listener_9.Values), LiveMode=False)
list_item_2 = ListItem(List=objects_by_selection, Index=0, Wrap=True)
get_user_value_3 = GetUserValue(Geometry=list_item_2, Key="HO_RE-type-by-user")
set_textbox_contents = SetTextBoxContents(TextBoxToModify=create_text_box, NewTextBoxContents=get_user_value_3)

# ----
# Separator
number_slider_2 = Slider(2, range=0..100)
create_separator = CreateSeparator(
    Thickness=number_slider_2,
    Horizontal=True,
    Color=ColourSwatch(SwatchColor=RGB(232, 232, 232)),
    Height=Slider(17, range=0..100))
separator = Data(create_separator)

create_button_4 = CreateButton(ButtonName="123", ButtonStyle=0)  # disabled
value_listener_10 = ValueListener(Elements=create_button_4, SomeProperty=True)  # -> Values, Indices; disabled
objects_by_selection_2 = ObjectsBySelection(Reset=invert(value_listener_10.Values), LiveMode=False)  # disabled
filter_by_type = FilterByType(Geometry=objects_by_selection_2, ObjectType="Curve")  # disabled
filter_by_type_2 = FilterByType(Geometry=objects_by_selection_2, ObjectType="Point")  # disabled
create_text_box_2 = CreateTextBox(LabelW="W", DefaultText100="100", UpdateButton=False, showLabel=True)  # disabled
value_listener_11 = ValueListener(Elements=create_text_box_2, SomeProperty=True)  # -> flatten(Values), Indices; disabled
panel_16 = Panel(create_text_box_2)  # disabled
create_text_box_3 = CreateTextBox(LabelD="x   D", DefaultText100="100", UpdateButton=False, showLabel=True)  # disabled
value_listener_12 = ValueListener(Elements=create_text_box_3, SomeProperty=True)  # -> flatten(Values), Indices; disabled
create_text_block_2 = CreateTextBlock(TextOr="   or     ", TextSize=16, Justification=0)  # disabled
create_wrappanel_3 = CreateWrapPanel(UIElements=[create_text_box_2, create_text_box_3, create_text_block_2, create_button_4], Horizontal=True)  # disabled
# Set profiles
adjust_element_positioning_3 = AdjustElementPositioning(ElementsToAdjust=create_text_block_2, AbsolutePositioning=False, VerticalAlignment=1)  # disabled

# ----
# Set panel materials
panel_17 = Panel("Material")
hui_transparentmaterialslist = RemoteReceiver()
create_pulldown_menu_4 = CreatePulldownMenu(Label=panel_17, ListItems=panel_17, showLabel=True)  # -> flatten(Pulldown)
set_list_contents_2 = SetListContents(ListToModify=create_pulldown_menu_4, NewListContents=hui_transparentmaterialslist)
value_listener_13 = ValueListener(Elements=create_pulldown_menu_4, SomeProperty=True)  # -> flatten(Values), Indices
create_button_5 = CreateButton(ButtonName="Apply", ButtonStyle=0)
create_expander = CreateExpander(UIElements=[create_pulldown_menu_4, create_button_5], Header="Set panel materials", Open=False)  # -> flatten(Expander)
value_listener_14 = ValueListener(Elements=create_expander, SomeProperty=True)  # -> Values, Indices
relay_2 = Relay()
brep = Brep(<brep referenced from the Rhino model>)
# Selectable preview
stream_filter = StreamFilter(Gate=value_listener_14.Values, Stream0=brep, Stream1=relay_2)
hui_expaner_setpanelmaterials = RemoteSender(create_expander)
custom_preview_2 = CustomPreview(Material=value_listener_13.Values)

# ----
# Separator
number_slider_3 = Slider(2, range=0..100)  # disabled
colour_swatch = ColourSwatch(SwatchColor=RGB(232, 232, 232))  # disabled
colour_swatch_2 = ColourSwatch(SwatchColor=RGB(0, 0, 0))  # disabled
number_slider_4 = Slider(17, range=0..100)  # disabled
create_separator_2 = CreateSeparator(Thickness=number_slider_3, Horizontal=True, Color=colour_swatch_2, Height=number_slider_4)  # disabled
separator_2 = Data(create_separator_2)  # disabled

# ----
# Title + help button
panel_18 = Panel("Add inner divisions             ")
create_true_only_button_4 = CreateTrueOnlyButton(ButtonName=" ? ", ButtonStyle=2)
create_label_18 = CreateLabel(LabelText=panel_18, LabelSize=18, Justification=0)
number_slider_5 = Slider(30, range=0..100)
attach_tooltip_to_element = AttachTooltipToElement(ElementsToAttachTo=create_true_only_button_4, TooltipContent="Help", ShowDelay=500, Duration=2000)
value_listener_15 = ValueListener(Elements=create_true_only_button_4, SomeProperty=True)  # -> Values, Indices
adjust_element_positioning_4 = AdjustElementPositioning(
    ElementsToAdjust=create_true_only_button_4,
    Margin="100,3,0,0",
    AbsolutePositioning=False,
    Width=number_slider_5,
    Height=number_slider_5,
    HorizontalAlignment=2)
create_wrappanel_4 = CreateWrapPanel(UIElements=[create_label_18, create_true_only_button_4], Horizontal=True)  # -> flatten(WrapPanel)
header_help = Data(create_wrappanel_4)

# ----
# Separator
number_slider_6 = Slider(2, range=0..100)
create_separator_3 = CreateSeparator(
    Thickness=number_slider_6,
    Horizontal=True,
    Color=ColourSwatch(SwatchColor=RGB(232, 232, 232)),
    Height=Slider(17, range=0..100))
separator_3 = Data(create_separator_3)

# ----
# SPLIT button
panel_19 = Panel("Save division")
create_button_6 = CreateButton(ButtonName=panel_19, ButtonStyle=1)
create_button_7 = CreateButton(ButtonName=panel_19, ButtonStyle=1)
value_listener_16 = ValueListener(Elements=create_button_6, SomeProperty=True)  # -> flatten(Values), Indices
adjust_element_appearance = AdjustElementAppearance(
    ElementsToAdjust=create_button_6,
    Foreground=ColourSwatch(SwatchColor=RGB(255, 255, 255)),
    Background=ColourSwatch(SwatchColor=RGB(0, 0, 0)))
apply = Boolean(value_listener_16.Values)
split_button = Data(create_button_6)

# ----
# APPLY
panel_20 = Panel("Apply")
create_button_8 = CreateButton(ButtonName=panel_20, ButtonStyle=1)
value_listener_17 = ValueListener(Elements=create_button_8, SomeProperty=True)  # -> Values, Indices
input_apply = RemoteSender(value_listener_17.Values)

input_apply_2 = RemoteReceiver(input_apply)
gate_or = GateOr(A=Toggle(True), B=input_apply_2)
getdocumentusertext = GetDocumentUserText(key=x, checkNow=gate_or)  # -> value; same code as getdocumentusertext_2
text_split = TextSplit(Text=getdocumentusertext, Separators=";")
list_item_3 = ListItem(List=text_split, Index=0, Wrap=True)  # -> flatten(Item)
create_button_9 = CreateButton(ButtonName="Select all FacadeSubFaces", ButtonStyle=0)

# ----
# Select geo to block
panel_21 = Panel("Bake")
create_button_10 = CreateButton(ButtonName=panel_21, ButtonStyle=1)  # disabled
boolean_toggle_3 = BooleanToggle(True)  # disabled
create_button_11 = CreateButton(ButtonName="Create Regelelements", ButtonStyle=1)
create_label_19 = CreateLabel(LabelText=" from selected FacadeSubFaces", LabelSize=12, Justification=0)
apply_2 = Boolean(apply)  # disabled
gate_or_2 = GateOr(A=boolean_toggle_3, B=apply_2)  # disabled
value_listener_18 = ValueListener(Elements=create_button_10, SomeProperty=True)  # -> Values, Indices
create_wrappanel_5 = CreateWrapPanel(UIElements=[create_button_11, create_label_19, create_button_9], Horizontal=True)  # -> flatten(WrapPanel)
value_listener_19 = ValueListener(Elements=create_button_11, SomeProperty=True)  # -> Values, Indices
adjust_element_appearance_2 = AdjustElementAppearance(
    ElementsToAdjust=create_button_11,
    Foreground=ColourSwatch(SwatchColor=RGB(255, 255, 255)),
    Background=ColourSwatch(SwatchColor=RGB(0, 0, 0)))
adjust_element_positioning_5 = AdjustElementPositioning(ElementsToAdjust=create_button_11, Margin="3,15,0,12", AbsolutePositioning=False)
apply_3 = Boolean(apply)  # disabled
gate_or_3 = GateOr(A=invert(value_listener_19.Values), B=apply_3)
hui_selectgeotoblock = RemoteSender([create_wrappanel_5, create_button_10])
input_bakeblocks = RemoteSender(gate_or_3)

create_button_12 = CreateButton(ButtonName="Assign to selected", ButtonStyle=1)
create_rhino_pick_button = CreateRhinoPickButton(
    ButtonName="Assign to selected",
    Prompt="Please select geometry...",
    AllowMultiple=True,
    AllowNone=True,
    Type=0,
    ButtonStyle=1)
# Select
panel_22 = Panel("Stats")
create_button_13 = CreateButton(ButtonName="Create", ButtonStyle=0)
value_listener_20 = ValueListener(Elements=create_button_9, SomeProperty=True)  # -> Values, Indices
value_listener_21 = ValueListener(Elements=create_rhino_pick_button, SomeProperty=True)  # -> Values, Indices
create_label_20 = CreateLabel(LabelText=panel_22, LabelSize=12, Justification=0)
gzcommand = CSharpScript(
    command="_SelNone",
    runNow=gate_or_2,
    echo=False,
    Reference=["C:\Program Files\Rhino 7\Plug-ins\Grasshopper\Components\ScriptComponents.gha", "C:\Program Files\NoDoubts\Godzilla\System\Godzilla.dll", "C:\Program Files\NoDoubts\Godzilla\System\RhGodzilla.rhp"])  # -> done; inputs command: String, runNow: Boolean, echo: Boolean; disabled; same code as gzcommand
value_listener_22 = ValueListener(Elements=create_button_2, SomeProperty=True)  # -> Values, Indices
value_listener_23 = ValueListener(Elements=create_button_13, SomeProperty=True)  # -> Values, Indices
guid = Guid(value_listener_21.Values)
value_listener_24 = ValueListener(Elements=create_text_box, SomeProperty=True)  # -> Values, Indices
guid_2 = Guid(value_listener_21.Values)
list_length_4 = ListLength(List=value_listener_21.Values)
adjust_element_positioning_6 = AdjustElementPositioning(ElementsToAdjust=create_label_19, Margin="0,19,0,0", AbsolutePositioning=False)
adjust_element_positioning_7 = AdjustElementPositioning(ElementsToAdjust=create_button_9, Margin="0,0,0,10", AbsolutePositioning=False)
objects_by_selection_3 = ObjectsBySelection(Reset=list_length_4, LiveMode=False)
gzcommand_2 = CSharpScript(
    command="_SelKeyValue HO_Type FacadeSubFace",
    runNow=value_listener_20.Values,
    echo=False,
    Reference=["C:\Program Files\Rhino 7\Plug-ins\Grasshopper\Components\ScriptComponents.gha", "C:\Program Files\NoDoubts\Godzilla\System\Godzilla.dll", "C:\Program Files\NoDoubts\Godzilla\System\RhGodzilla.rhp"])  # -> done; inputs command: String, runNow: Boolean, echo: Boolean; same code as gzcommand
panel_23 = Panel(value_listener_19.Values)
input_blocktoreplace = RemoteSender(guid)
addition_3 = Addition(A=list_length_4, B=0)
input_create_profile = RemoteSender(value_listener_23.Values)
panel_24 = Panel(guid)
integer = Integer(value_listener_22.Values)

# ----
# Default profiles - list
replace_text_3 = ReplaceText(Text=panel_13, Find="Profile - Default - ", RecursiveReplace=False)
create_label_21 = CreateLabel(LabelText="Default profiles", LabelSize=18, Justification=0)
create_text_block_3 = CreateTextBlock(Text=["Part", replace_text_3], TextSize=12, Justification=0)
create_text_block_4 = CreateTextBlock(Text="Edit", TextSize=12, Justification=0)
create_checkbox_3 = CreateCheckbox(Label=replace_text_3, StartingValue=False)
create_text_block_5 = CreateTextBlock(Text="D", TextSize=12, Justification=0)
create_text_box_4 = CreateTextBox(UpdateButton=False, showLabel=True)
adjust_element_positioning_8 = AdjustElementPositioning(ElementsToAdjust=create_text_box_4, AbsolutePositioning=False, Width=Slider(36, range=0..100))
entwine_3 = Entwine(
    Branch00=create_text_block_3,
    Branch01=[create_text_block_4, create_checkbox_3],
    Branch02=[create_text_block_5, create_text_box_4],
    FlattenInputs=True)
value_listener_25 = ValueListener(Elements=create_checkbox_3, SomeProperty=True)  # -> Values, Indices
replace_text_4 = ReplaceText(Find="Profile - Rectangular - ", RecursiveReplace=False)
mass_addition = MassAddition(Input=flatten(value_listener_25.Values))  # -> Result, PartialResults
set_checkbox = SetCheckBox(CheckBoxToModify=create_checkbox_3, NewCheckBoxLabel=replace_text_4)
is_profile_to_edit_selected = RemoteSender(Toggle(True))
create_simple_grid_3 = CreateSimpleGrid(UIElements=entwine_3, RowDefinitions="Auto", ColumnDefinitions="Auto")  # -> flatten(SimpleGrid)
merge_7 = Merge(Data1=create_label_21, Data2=create_simple_grid_3)

is_profile_to_edit_selected_2 = RemoteReceiver(is_profile_to_edit_selected)
is_profile_to_edit_selected_3 = RemoteReceiver(is_profile_to_edit_selected)
is_profile_to_edit_selected_4 = RemoteReceiver(is_profile_to_edit_selected)
is_profile_to_edit_selected_5 = RemoteReceiver(is_profile_to_edit_selected)
input_apply_3 = RemoteReceiver(input_apply)  # disabled

# ----
# Profile editor
panel_25 = Panel("Profile editor")
panel_26 = Panel("""Existing profile
New rectangular
New custom""")
create_label_22 = CreateLabel(LabelText=panel_25, LabelSize=18, Justification=0)
create_label_23 = CreateLabel(LabelText="Select profiles to edit", LabelSize=12, Justification=1)
create_label_24 = CreateLabel(LabelText="Type", LabelSize=12, Justification=0)
create_pulldown_menu_5 = CreatePulldownMenu(ListItems=panel_26, showLabel=True)  # -> flatten(Pulldown)
value_listener_26 = ValueListener(Elements=create_pulldown_menu_5, SomeProperty=True)  # -> Values, Indices
hide_show_element_10 = HideShowElement(ElementToHideShow=create_label_23, Show=invert(is_profile_to_edit_selected_2), Collapse=True, Disable=False)
hide_show_element_11 = HideShowElement(
    ElementToHideShow=[create_label_24, create_pulldown_menu_5],
    Show=is_profile_to_edit_selected_2,
    Collapse=True,
    Disable=False)
input_profile_type_0_rectangle = RemoteSender(value_listener_26.Indices)

# ----
# New rectangular profile
panel_27 = Panel("W:")
create_text_box_5 = CreateTextBox(Label=panel_27, UpdateButton=False, showLabel=True)
create_text_box_6 = CreateTextBox(Label="D:", UpdateButton=False, showLabel=True)
set_textbox_contents_2 = SetTextBoxContents(TextBoxToModify=create_text_box_5)
adjust_element_positioning_9 = AdjustElementPositioning(
    ElementsToAdjust=[create_text_box_6, create_text_box_5],
    AbsolutePositioning=False,
    Width=Slider(84, range=0..100),
    Height=26)
value_listener_27 = ValueListener(Elements=create_text_box_5, SomeProperty=True)  # -> Values, Indices
value_listener_28 = ValueListener(Elements=create_text_box_6, SomeProperty=True)  # -> Values, Indices
set_textbox_contents_3 = SetTextBoxContents(TextBoxToModify=create_text_box_6)
input_profile_type_0_rectangle_2 = RemoteReceiver(input_profile_type_0_rectangle)
input_rectanglewidth = RemoteSender(value_listener_27.Values)
equality = Equality(FirstNumber=input_profile_type_0_rectangle_2, SecondNumber=1)  # -> Equality, Inequality
entwine_4 = Entwine(
    Branch00=input_profile_type_0_rectangle_2,
    Branch01=value_listener_27.Values,
    Branch02=value_listener_28.Values,
    FlattenInputs=True)
list_item_4 = ListItem(List=flatten(value_listener_27.Values), Index=0, Wrap=False)  # -> Item, Item1
list_item_5 = ListItem(List=flatten(value_listener_28.Values), Index=0, Wrap=False)  # -> Item, Item1
flip_matrix = FlipMatrix(Data=entwine_4)
text_join = TextJoin(Text=flip_matrix, Join=",")  # -> flatten(Result)
gate_and = GateAnd(A=equality.Equality, B=is_profile_to_edit_selected_4)
hide_show_element_12 = HideShowElement(ElementToHideShow=[create_text_box_5, create_text_box_6], Show=gate_and, Collapse=True, Disable=False)
concatenate_3 = Concatenate(FragmentA="[", FragmentB=text_join, FragmentC="]")
input_rectangledepth = RemoteSender(value_listener_28.Values)

input_assigntoselected = RemoteSender(addition_3)
input_assigntoselected_2 = RemoteReceiver(input_assigntoselected)
enable_disable_object = EnableDisableObject(Enabled=invert(input_assigntoselected_2))  # disabled
panel_28 = Panel("""Parent
Sibling
Child""")
panel_29 = Panel("""0
1
0""")
panel_30 = Panel("""Parent
Sibling
Child""")
panel_31 = Panel("1000|2000|1200")
input_profile_type_0_exist = RemoteSender(value_listener_26.Indices)

apply_4 = Boolean(apply)
gate_or_4 = GateOr(A=Toggle(True), B=apply_4)
gzcommand_3 = CSharpScript(
    command="_SelNone",
    runNow=gate_or_4,
    echo=False,
    Reference=["C:\Program Files\Rhino 7\Plug-ins\Grasshopper\Components\ScriptComponents.gha", "C:\Program Files\NoDoubts\Godzilla\System\Godzilla.dll", "C:\Program Files\NoDoubts\Godzilla\System\RhGodzilla.rhp"])  # -> done; inputs command: String, runNow: Boolean, echo: Boolean; same code as gzcommand

create_radio_button_5 = CreateRadioButton(RadioButtonName=panel_28, RadioButtonGroup="1234567", InitiallySelected=panel_29)
create_radio_button_6 = CreateRadioButton(RadioButtonName=panel_30, RadioButtonGroup="1234567srdfgv", InitiallySelected=panel_29)
create_label_25 = CreateLabel(LabelText="Start (L/B)", LabelSize=12, Justification=0)
create_label_26 = CreateLabel(LabelText="End (R/U)", LabelSize=12, Justification=0)
create_pulldown_menu_6 = CreatePulldownMenu(Label="Material", ListItems="<materials>", showLabel=True)  # -> flatten(Pulldown)

# ----
# Separator
number_slider_7 = Slider(2, range=0..100)
colour_swatch_3 = ColourSwatch(SwatchColor=RGB(0, 0, 0))
create_separator_4 = CreateSeparator(
    Thickness=number_slider_7,
    Horizontal=True,
    Color=ColourSwatch(SwatchColor=RGB(209, 209, 209)),
    Height=Slider(17, range=0..100))
separator_4 = Data(create_separator_4)

create_checkbox_4 = CreateCheckbox(Label="Select the whole chain", StartingValue=False)
hui_non_transparent_non_wallmaterialslis = RemoteReceiver()  # "HUI.Non-transparent&Non-wallMaterialsList"
create_button_14 = CreateButton(ButtonName="Apply", ButtonStyle=0)
create_wrappanel_6 = CreateWrapPanel(UIElements=[create_label_26, create_radio_button_6], Horizontal=False)
value_listener_29 = ValueListener(Elements=create_radio_button_6, SomeProperty=True)  # -> flatten(Values), Indices
value_listener_30 = ValueListener(Elements=create_pulldown_menu_6, SomeProperty=True)  # -> flatten(Values), Indices
create_wrappanel_7 = CreateWrapPanel(UIElements=[create_label_25, create_radio_button_5], Horizontal=False)
value_listener_31 = ValueListener(Elements=create_radio_button_5, SomeProperty=True)  # -> flatten(Values), Indices
value_listener_32 = ValueListener(Elements=create_checkbox_4, SomeProperty=True)  # -> Values, Indices
hui_default_profiles = RemoteSender(merge_7)  # disabled

# ----
# READ DEFAULT BLOCKS DATA
# Filter curves and Breps
cluster = Cluster_8(text=list_item_3)
create_label_27 = CreateLabel(LabelText="Default profiles (check to edit)", LabelSize=18, Justification=0)
create_text_block_6 = CreateTextBlock(Text=["Part", panel_14], TextSize=12, Justification=0)
create_text_block_7 = CreateTextBlock(Text="Edit", TextSize=12, Justification=0)
create_checkbox_5 = CreateCheckbox(Label=panel_14, StartingValue=False)
create_text_block_8 = CreateTextBlock(Text="D", TextSize=12, Justification=0)
create_text_box_7 = CreateTextBox(UpdateButton=False, showLabel=True)
set_textbox_contents_4 = SetTextBoxContents(TextBoxToModify=create_text_box_7)
adjust_element_positioning_10 = AdjustElementPositioning(ElementsToAdjust=create_text_box_7, AbsolutePositioning=False, Width=Slider(36, range=0..100))
entwine_5 = Entwine(
    Branch00=create_text_block_6,
    Branch01=[create_text_block_7, create_checkbox_5],
    Branch02=[create_text_block_8, create_text_box_7],
    FlattenInputs=True)
value_listener_33 = ValueListener(Elements=create_checkbox_5, SomeProperty=True)  # -> Values, Indices
mass_addition_2 = MassAddition(Input=flatten(value_listener_33.Values))  # -> Result, PartialResults
set_checkbox_2 = SetCheckBox(CheckBoxToModify=create_checkbox_5, NewCheckBoxLabel=cluster)
input_is_profile_selected_as_tree = RemoteSender(value_listener_33.Values)
panel_32 = Panel(value_listener_33.Values)
create_simple_grid_4 = CreateSimpleGrid(UIElements=entwine_5, RowDefinitions="Auto", ColumnDefinitions="Auto")  # -> flatten(SimpleGrid)
merge_8 = Merge(Data1=create_label_27, Data2=create_simple_grid_4)
hui_default_profiles_2 = RemoteSender(merge_8)
hui_default_profiles_3 = RemoteReceiver([hui_default_profiles_2, hui_default_profiles])
create_expander_2 = CreateExpander(UIElements=hui_default_profiles_3, Header="Check default profiles", Open=False)
colour_swatch_4 = ColourSwatch(SwatchColor=RGB(255, 255, 255))
adjust_element_appearance_3 = AdjustElementAppearance(ElementsToAdjust=create_expander_2, Background=ColourSwatch(SwatchColor=RGB(255, 255, 255)))

create_wrappanel_8 = CreateWrapPanel(UIElements=[create_wrappanel_7, create_wrappanel_6], Horizontal=True)
member_index = MemberIndex(Set=value_listener_31.Values, Member=True)  # -> Index, Count
member_index_2 = MemberIndex(Set=value_listener_29.Values, Member=True)  # -> Index, Count
set_list_contents_3 = SetListContents(ListToModify=create_pulldown_menu_6, NewListContents=hui_non_transparent_non_wallmaterialslis)
relay_3 = Relay()  # disabled

# ----
# New custom profile
# Adjust position
# Base point shift
project_of_next_unique_block = RemoteReceiver()
panel_33 = Panel("""Auto
Horizontal 
Vertical""")
create_radio_button_7 = CreateRadioButton(
    RadioButtonName=Tree({1}: ["  ", "  ", "  "], {2}: ["  ", " ◼ ", "  "], {3}: ["  ", "  ", "  "]),
    RadioButtonGroup="Align",
    InitiallySelected=Tree({1}: [True, False, False], {2}: [False, False, False], {3}: [False, False, False]))
panel_34 = Panel("""1
0
0""")
panel_35 = Panel("The profile orientation")
panel_36 = Panel("""Horizontal 
Vertical""")
status_selected = Panel(" ")
rotate = Slider(0, range=-180..180)
create_label_28 = CreateLabel(LabelText="X", LabelSize=18, Justification=0)
create_label_29 = CreateLabel(LabelText="Y", LabelSize=18, Justification=0)
create_label_30 = CreateLabel(LabelText="Z", LabelSize=18, Justification=0)
concatenate_4 = Concatenate(FragmentA="#", FragmentB=project_of_next_unique_block)
create_text_block_9 = CreateTextBlock(Text="#", TextSize=12, Justification=0)
create_text_box_8 = CreateTextBox(Label="#", DefaultText="-", UpdateButton=False, showLabel=True)
create_label_31 = CreateLabel(LabelText="Base point shift: ", LabelSize=18, Justification=0)
create_text_block_10 = CreateTextBlock(Text=status_selected, TextSize=12, Justification=0)
create_label_32 = CreateLabel(LabelText="Select curve(s) in XY plane", LabelSize=18, Justification=0)
create_button_15 = CreateButton(ButtonName="Select", ButtonStyle=1)
create_label_33 = CreateLabel(LabelText="Select curve(s) in XY plane", LabelSize=18, Justification=0)
create_button_16 = CreateButton(ButtonName="Select", ButtonStyle=1)
create_text_box_9 = CreateTextBox(DefaultText="0", UpdateButton=False, showLabel=True)
create_text_box_10 = CreateTextBox(DefaultText="0", UpdateButton=False, showLabel=True)
create_toggle = CreateToggle(Default=False, OnLabel="The profile is vertical     ", OffLabel="The profile is horizontal")
create_text_block_11 = CreateTextBlock(Text=panel_35, TextSize=16, Justification=0)
create_radio_button_8 = CreateRadioButton(RadioButtonName=panel_36, RadioButtonGroup=panel_35, InitiallySelected=panel_34)
create_button_17 = CreateButton(ButtonName="Bake AncorPoints to adjust them", ButtonStyle=0)
create_text_box_11 = CreateTextBox(DefaultText="0", UpdateButton=False, showLabel=True)
create_simple_grid_5 = CreateSimpleGrid(UIElements=create_radio_button_7, RowDefinitions="Auto", ColumnDefinitions="Auto")
set_textblock_contents = SetTextBlockContents(TextBlockToModify=create_text_block_9, NewTextBlockContents=concatenate_4)
create_slider = CreateSlider(Slider=rotate, ShowBounds=False, ShowTicks=False, ShowTooltip=False, ShowValLabel=True, showLabel=True)
create_label_34 = CreateLabel(LabelText="Align", LabelSize=18, Justification=0)
value_listener_34 = ValueListener(Elements=create_toggle, SomeProperty=True)  # -> Values, Indices
value_listener_35 = ValueListener(Elements=create_button_17, SomeProperty=True)  # -> Values, Indices
adjust_element_positioning_11 = AdjustElementPositioning(ElementsToAdjust=create_text_block_9, AbsolutePositioning=False, WIDTH29=29, Height=26)
value_listener_36 = ValueListener(Elements=create_simple_grid_5, SomeProperty=True)  # -> flatten(Values), Indices
create_wrappanel_9 = CreateWrapPanel(UIElements=[create_text_block_11, create_radio_button_8], Horizontal=True)  # -> flatten(WrapPanel)
value_listener_37 = ValueListener(Elements=create_radio_button_8, SomeProperty=True)  # -> flatten(Values), Indices
create_wrappanel_10 = CreateWrapPanel(UIElements=[create_label_32, create_button_15, create_text_block_10], Horizontal=True)  # -> flatten(WrapPanel)
create_wrappanel_11 = CreateWrapPanel(UIElements=[create_label_33, create_button_16, create_text_block_10], Horizontal=True)  # -> flatten(WrapPanel)
value_listener_38 = ValueListener(Elements=create_button_16, SomeProperty=True)  # -> Values, Indices
adjust_element_appearance_4 = AdjustElementAppearance(
    ElementsToAdjust=create_button_16,
    Foreground=ColourSwatch(SwatchColor=RGB(255, 255, 255)),
    Background=ColourSwatch(SwatchColor=RGB(0, 0, 0)))
merge_9 = Merge(
    Data1=create_label_31,
    Data2=create_label_28,
    Data3=create_text_box_9,
    Data4=create_label_29,
    Data5=create_text_box_10,
    Data6=create_label_30,
    Data7=create_text_box_11)  # -> graft(Result)
create_text_box_12 = CreateTextBox(Label="Name:", DefaultText=" ", UpdateButton=False, showLabel=True)
value_listener_39 = ValueListener(Elements=create_slider, SomeProperty=True)  # -> Values, Indices
input_bake_ancor_points = RemoteSender(value_listener_35.Values)
create_simple_grid_6 = CreateSimpleGrid(UIElements=merge_9, RowDefinitions="Auto", ColumnDefinitions="Auto")  # -> flatten(SimpleGrid)
member_index_3 = MemberIndex(Set=value_listener_37.Values, Member=True)  # -> Index, Count
apply_5 = Boolean()  # disabled
input_profile_type_0_rectangle_3 = RemoteReceiver(input_profile_type_0_rectangle)
hide_show_element_13 = HideShowElement(ElementToHideShow=create_wrappanel_9, Show=invert(True), Collapse=True, Disable=False)
panel_37 = Panel("""0
3
6
1
4
7
2
5
8""")
value_listener_40 = ValueListener(Elements=[create_text_box_9, create_text_box_10, create_text_box_11], SomeProperty=True)  # -> flatten(Values), Indices
gate_or_5 = GateOr(A=invert(value_listener_38.Values), B=apply_5)
adjust_element_positioning_12 = AdjustElementPositioning(ElementsToAdjust=create_text_box_12, AbsolutePositioning=False, WIDTH160=160, Height=26)
value_listener_41 = ValueListener(Elements=create_text_box_12, SomeProperty=True)  # -> Values, Indices
dispatch = Dispatch(List=panel_37, DispatchPattern=value_listener_36.Values)  # -> ListA, ListB
stream_filter_2 = StreamFilter(Gate=0, Stream1=value_listener_39.Values)
input_profile_orientation = RemoteSender(member_index_3.Index)
objects_by_selection_4 = ObjectsBySelection(Reset=gate_or_5, LiveMode=False)  # -> simplify(graft(SelectedGeometry))
equality_2 = Equality(FirstNumber=input_profile_type_0_rectangle_3, SecondNumber=2)  # -> Equality, Inequality
input_block_name = RemoteSender(value_listener_41.Values)
filter_by_type_3 = FilterByType(Geometry=objects_by_selection_4, ObjectType=["1", "0"])  # -> flatten(Geometry)
text_join_2 = TextJoin(Text=value_listener_40.Values, Join=",")
clean_tree = CleanTree(RemoveNulls=True, RemoveInvalid=True, RemoveEmpty=False, Tree=filter_by_type_3)  # -> simplify(graft(Tree))
stream_filter_3 = StreamFilter(Gate=0, Stream1=text_join_2)
input_basepointcoordinates = RemoteSender(text_join_2)
gate_and_2 = GateAnd(A=equality_2.Equality, B=is_profile_to_edit_selected_5)
hide_show_element_14 = HideShowElement(ElementToHideShow=[create_text_box_12, create_text_block_9], Show=gate_and_2, Collapse=True, Disable=False)
isprofileeditoractive = RemoteSender(gate_and_2)
custom_preview_3 = CustomPreview(Geometry=stream_filter_3, Material=ColourSwatch(SwatchColor=RGB(255, 255, 255)))
list_length_5 = ListLength(List=flatten(clean_tree))
addition_4 = Addition(A=list_length_5, B=0)
concatenate_5 = Concatenate(FragmentA=addition_4, FragmentB=" selected")
boolean = Boolean(addition_4)
input_selectedgeoforcustomprofile = RemoteSender(clean_tree)
merge_10 = Merge(
    Data1=create_wrappanel_11,
    Data2=create_wrappanel_9,
    Data3=create_button_17,
    Data4=create_label_34,
    Data5=flatten(create_simple_grid_5),
    Data6=create_simple_grid_6,
    Data7=create_slider,
    Data8=create_rhino_pick_button)  # -> flatten(Result)
set_textblock_contents_2 = SetTextBlockContents(TextBlockToModify=create_text_block_10, NewTextBlockContents=concatenate_5)
hui_selectgeotoblock1 = RemoteSender(merge_10)
isprofileeditoractive_2 = RemoteReceiver(isprofileeditoractive)
hide_show_element_15 = HideShowElement(ElementToHideShow=hui_selectgeotoblock1, Show=Toggle(True), Collapse=True, Disable=False)

# ----
# Separator
number_slider_8 = Slider(2, range=0..100)
create_separator_5 = CreateSeparator(
    Thickness=number_slider_8,
    Horizontal=True,
    Color=ColourSwatch(SwatchColor=RGB(255, 255, 255)),
    Height=Slider(6, range=0..100))
separator_5 = Data(create_separator_5)

hui_submit_a_bug_buttons_2 = RemoteReceiver(hui_submit_a_bug_buttons)
boolean_toggle_4 = BooleanToggle(True)
relay_4 = Relay()  # disabled
panel_38 = Panel("View & stats")

# ----
# SUBMIT A BUG WINDOW
# Desscription input
# Status
create_label_35 = CreateLabel(LabelPriority="Priority", LabelSize=12, Justification=0)
create_label_36 = CreateLabel(LabelType="Type    ", LabelSize=12, Justification=0)
panel_39 = Panel("""As you click a button below we are going to save screenshots of your screens to the cloud and to save .3dm and .gh files (owerwrite them) and to send them to the cloud as well, so:

Please check that it is:
- no private info is on your screens now
- the problem is visible now OR you filled the description
- it is OK to owerwrite 3dm and gh files""")
panel_40 = Panel("""Bug
Not clear
Wish""")
panel_41 = Panel("""1
0""")
panel_42 = Panel("""Low
Medium
High
Highest""")
panel_43 = Panel("""0
1
0
0""")
hui_submit_a_bug_buttons_3 = RemoteReceiver(hui_submit_a_bug_buttons)
create_button_18 = CreateButton(ButtonName="I checked it. Submit the bug", ButtonStyle=1)
create_radio_button_9 = CreateRadioButton(RadioButtonName=panel_40, RadioButtonGroup="bug type", InitiallySelected=panel_41)
create_radio_button_10 = CreateRadioButton(RadioButtonName=panel_42, RadioButtonGroup="bug priority", InitiallySelected=panel_43)
create_text_block_12 = CreateTextBlock(Text=panel_39, TextSize=16, Justification=0)
list_of_modules_submit_a_bug_buttons = Panel("""RE types
Create RE
Edit RE""")
value_listener_42 = ValueListener(Elements=hui_submit_a_bug_buttons_3, SomeProperty=True)  # -> flatten(Values), Indices
value_listener_43 = ValueListener(Elements=create_button_18, SomeProperty=True)  # -> Values, Indices
create_text_box_13 = CreateTextBox(UpdateButton=False, showLabel=True)
value_listener_44 = ValueListener(Elements=create_radio_button_9, SomeProperty=True)  # -> Values, Indices
create_label_37 = CreateLabel(LabelText="Description (if it is not clear from current view)", LabelSize=12, Justification=0)
value_listener_45 = ValueListener(Elements=create_radio_button_10, SomeProperty=True)  # -> Values, Indices
create_wrappanel_12 = CreateWrapPanel(UIElements=[create_label_36, create_radio_button_9], Horizontal=True)
create_wrappanel_13 = CreateWrapPanel(UIElements=[create_label_35, create_radio_button_10], Horizontal=True)
member_index_4 = MemberIndex(Set=value_listener_42.Values, Member=True)  # -> Index, Count
input_submitbug = RemoteSender(value_listener_43.Values)
value_listener_46 = ValueListener(Elements=create_text_box_13, SomeProperty=True)  # -> Values, Indices
member_index_5 = MemberIndex(Set=flatten(value_listener_44.Values), Member=True)  # -> Index, Count
member_index_6 = MemberIndex(Set=flatten(value_listener_45.Values), Member=True)  # -> Index, Count
mass_addition_3 = MassAddition(Input=value_listener_42.Values)  # -> Result, PartialResults
list_item_6 = ListItem(List=list_of_modules_submit_a_bug_buttons, Index=member_index_4.Index, Wrap=True)
input_bug_description = RemoteSender(value_listener_46.Values)
hui_show_submit_bug_window = RemoteSender(mass_addition_3.Result)
list_item_7 = ListItem(List=panel_40, Index=member_index_5.Index, Wrap=False)
list_item_8 = ListItem(List=panel_42, Index=member_index_6.Index, Wrap=False)
input_bug_modulename = RemoteSender(list_item_6)
merge_11 = Merge(
    Data1=create_label_37,
    Data2=create_text_box_13,
    Data3=create_wrappanel_12,
    Data4=create_wrappanel_13,
    Data5=create_text_block_12,
    Data6=create_button_18)
input_bugpriority = RemoteSender(list_item_8)
input_bugtype = RemoteSender(list_item_7)

# ----
# STEPS
# Buttons with steps
gz_menu = CSharpScript(Reference=["C:\Program Files\Rhino 7\Plug-ins\Grasshopper\Components\ScriptComponents.gha", "C:\Program Files\NoDoubts\Godzilla\System\Godzilla.dll", "C:\Program Files\NoDoubts\Godzilla\System\RhGodzilla.rhp"])  # -> resources, names, tooltips; same code as gz_menu
panel_44 = Panel("""Export
Support""")
create_button_19 = CreateButton(ButtonName=gz_menu.names, ButtonStyle=3)  # -> flatten(Button)
create_button_20 = CreateButton(ButtonName="↻", ButtonStyle=3)
create_true_only_button_5 = CreateTrueOnlyButton(ButtonName=panel_44, ButtonStyle=1)  # disabled
value_listener_47 = ValueListener(Elements=create_button_20, SomeProperty=True)  # -> flatten(Values), Indices
adjust_element_positioning_13 = AdjustElementPositioning(ElementsToAdjust=create_button_20, AbsolutePositioning=False, Height=32)
create_wrappanel_14 = CreateWrapPanel(UIElements=flatten([create_button_19, create_true_only_button_5, create_button_20]), Horizontal=True)  # -> flatten(WrapPanel)
value_listener_48 = ValueListener(Elements=create_button_19, SomeProperty=True)  # -> flatten(Values), Indices
expire_object = ExpireObject(Expire=value_listener_47.Values)

# ----
# Bottom buttons
panel_45 = Panel("(Export)")  # disabled
panel_46 = Panel("(Support)")  # disabled
create_true_only_button_6 = CreateTrueOnlyButton(ButtonName=panel_46, ButtonStyle=3)  # disabled
create_true_only_button_7 = CreateTrueOnlyButton(ButtonName=panel_45, ButtonStyle=3)  # disabled
adjust_element_positioning_14 = AdjustElementPositioning(
    ElementsToAdjust=[create_true_only_button_7, create_true_only_button_6],
    Margin="0, 20 ,0, 0",
    AbsolutePositioning=False,
    Height=32)  # disabled
create_wrappanel_15 = CreateWrapPanel(UIElements=[create_true_only_button_7, create_true_only_button_6], Horizontal=True)  # disabled
value_listener_49 = ValueListener(Elements=create_true_only_button_7, SomeProperty=True)  # -> Values, Indices; disabled
value_listener_50 = ValueListener(Elements=create_true_only_button_6, SomeProperty=True)  # -> Values, Indices; disabled

adjust_element_appearance_5 = AdjustElementAppearance(
    ElementsToAdjust=[create_true_only_button_7, create_true_only_button_6],
    Foreground=RGB(122, 115, 115),
    Background=RGB(245, 245, 245))  # disabled
tooltip = AttachTooltipToElement(ElementsToAttachTo=create_button_19, TooltipContent=gz_menu.tooltips, ShowDelay=500, Duration=2000)
gzuicolors = CSharpScript(Reference=["C:\Program Files\Rhino 7\Plug-ins\Grasshopper\Components\ScriptComponents.gha", "C:\Program Files\NoDoubts\Godzilla\System\Godzilla.dll", "C:\Program Files\NoDoubts\Godzilla\System\RhGodzilla.rhp"])  # -> Current_step_bg; same code as gzuicolors

# ----
# Highlight current step button
member_index_7 = MemberIndex(Set=gz_menu.resources, Member="regelelements")  # -> Index, Count
list_item_9 = ListItem(List=create_button_19, Index=member_index_7.Index, Wrap=True)
adjust_element_appearance_6 = AdjustElementAppearance(ElementsToAdjust=list_item_9, Background=gzuicolors)

# ----
# HELP WINDOW: SPLITTER
panel_47 = Panel("file:///")  # disabled
replace_text_5 = ReplaceText(Find="\", Replace="/", RecursiveReplace=False)  # disabled
panel_48 = Panel("-help-split.html")  # disabled
concatenate_6 = Concatenate(FragmentC=panel_47, FragmentA=replace_text_5, FragmentE="/", FragmentD=panel_48)  # disabled
create_browser = CreateBrowser(URL=concatenate_6)  # disabled
adjust_element_positioning_15 = AdjustElementPositioning(ElementsToAdjust=create_browser, Margin="-2,-20,0,0", AbsolutePositioning=invert(False))  # disabled
launch_window = LaunchWindow(
    Show=value_listener_15.Values,
    Help="Help: Split facade faces",
    Width=424,
    Height=700,
    ChildStatus=1,
    EnableHorizScroll=False)  # disabled
add_elements = AddElements(Window=launch_window, Elements=flatten(create_browser), DoVLChecking=True)  # -> AddedElements, ElementNames; disabled
set_window_properties = SetWindowProperties(Window=launch_window, StartingLocation=Point(424, 0, 0), ShowTitleBar=True, ScaleFactor=1)  # disabled
make_child_window = MakeChildWindow(ChildWindow=launch_window)  # disabled

# ----
# Support Window
panel_49 = Panel("Lorem ipsum dolor sit amet, consectetur adipiscing elit, sed do eiusmod tempor incididunt ut labore et dolore magna aliqua. Ut enim ad minim veniam, quis nostrud exercitation ullamco laboris nisi ut aliquip ex ea commodo consequat. Duis aute irure dolor in reprehenderit in voluptate velit esse cillum dolore eu fugiat nulla pariatur. Excepteur sint occaecat cupidatat non proident, sunt in culpa qui officia deserunt mollit anim id est laborum")  # disabled
create_text_block_13 = CreateTextBlock(Text=panel_49, TextSize=12, Justification=0)  # disabled
launch_window_2 = LaunchWindow(Show=value_listener_49.Values, Name=panel_45, Width=370, Height=400, ChildStatus=2, EnableHorizScroll=False)  # disabled
add_elements_2 = AddElements(Window=launch_window_2, Elements=flatten(create_text_block_13), DoVLChecking=True)  # -> AddedElements, ElementNames; disabled

# ----
# Support Window
panel_50 = Panel("Lorem ipsum dolor sit amet, consectetur adipiscing elit, sed do eiusmod tempor incididunt ut labore et dolore magna aliqua. Ut enim ad minim veniam, quis nostrud exercitation ullamco laboris nisi ut aliquip ex ea commodo consequat. Duis aute irure dolor in reprehenderit in voluptate velit esse cillum dolore eu fugiat nulla pariatur. Excepteur sint occaecat cupidatat non proident, sunt in culpa qui officia deserunt mollit anim id est laborum")  # disabled
create_text_block_14 = CreateTextBlock(Text=panel_50, TextSize=12, Justification=0)  # disabled
launch_window_3 = LaunchWindow(Show=value_listener_50.Values, Name=panel_46, Width=370, Height=400, ChildStatus=2, EnableHorizScroll=False)  # disabled
add_elements_3 = AddElements(Window=launch_window_3, Elements=flatten(create_text_block_14), DoVLChecking=True)  # -> AddedElements, ElementNames; disabled

panel_51 = Panel("""4. BG-Breite
5. BG-Höhe""")
# Run in the very end!
panel_52 = Panel("_SelNone")
gzaddreferences = CSharpScript(
    Run=True,
    Reference=["C:\Program Files\Rhino 7\Plug-ins\Grasshopper\Components\ScriptComponents.gha", "C:\Program Files\NoDoubts\Godzilla\System\Godzilla.dll", "C:\Program Files\NoDoubts\Godzilla\System\RhGodzilla.rhp"])  # -> Done; inputs Run: Boolean; same code as gzaddreferences

input_bakeblocks_2 = RemoteReceiver(input_bakeblocks)
objects_by_selection_5 = ObjectsBySelection(Reset=gate_or_3, LiveMode=False)  # -> simplify(graft(SelectedGeometry))
item_selector = ItemSelector(objects_by_selection_5)
panel_53 = Panel(""">::SupportGeo::CurtainWall::CW-railHead
>::SupportGeo::CurtainWall::CW-railJambL
>::SupportGeo::CurtainWall::CW-railJambR
>::SupportGeo::CurtainWall::CW-railMullion
>::SupportGeo::CurtainWall::CW-railTransom
>::SupportGeo::CurtainWall::CW-railSill""")
filter_by_type_4 = FilterByType(Geometry=objects_by_selection_5, ObjectType=["1", "8"])  # -> flatten(Geometry)
get_user_value_4 = GetUserValue(Geometry=item_selector, Key="HO_RE-Type")
curve_2 = Curve(item_selector)
colour_swatch_5 = ColourSwatch(SwatchColor=RGBA(255, 247, 0, 28))  # disabled
colour_swatch_6 = ColourSwatch(SwatchColor=RGBA(255, 247, 0, 125))  # disabled
custom_preview_4 = CustomPreview(Geometry=filter_by_type_4, Material=colour_swatch_5)  # disabled
panel_54 = Panel(get_user_value_4)
filter_by_layer = FilterByLayer(Geometry=filter_by_type_4, Layer=panel_53)  # -> flatten(Geometry)
panel_55 = Panel(""">::FacadeSubFace*
>::Axes::MullionAxes""")
clean_tree_2 = CleanTree(RemoveNulls=True, RemoveInvalid=True, RemoveEmpty=False, Tree=filter_by_type_4)  # -> simplify(graft(Tree))
list_length_6 = ListLength(List=flatten(clean_tree_2))
input_selection = RemoteSender(clean_tree_2)
addition_5 = Addition(A=list_length_6, B=0)
boolean_2 = Boolean(addition_5)
are_facadesubfaces_selected = RemoteSender(boolean_2)

are_facadesubfaces_selected_2 = RemoteReceiver(are_facadesubfaces_selected)
list_item_10 = ListItem(List=panel_12, Index=are_facadesubfaces_selected_2, Wrap=True)
reference_by_layer_3 = ReferenceByLayer(LayerName=list_item_10, DisableAutoUpdate=False, ignoreCase=False)
list_length_7 = ListLength(List=reference_by_layer_3)
project_number_of_facadesubfaces = RemoteSender(list_length_7)
input_selection_2 = RemoteReceiver(flatten(input_selection))
list_length_8 = ListLength(List=input_selection_2)
gzcommand_4 = CSharpScript(
    command=panel_52,
    runNow=list_length_8,
    echo=False,
    Reference=["C:\Program Files\Rhino 7\Plug-ins\Grasshopper\Components\ScriptComponents.gha", "C:\Program Files\NoDoubts\Godzilla\System\Godzilla.dll", "C:\Program Files\NoDoubts\Godzilla\System\RhGodzilla.rhp"])  # -> done; inputs command: String, runNow: Boolean, echo: Boolean; same code as gzcommand

elevations_0_or_spacings_1 = Boolean(False)

panel_56 = Panel(gzaddreferences)

project_of_next_unique_block_2 = RemoteReceiver()
input_create_profile_2 = RemoteReceiver(input_create_profile)

# ----
# 0.1 CREATE PROFILE
input_selectedgeoforcustomprofile_2 = RemoteReceiver(input_selectedgeoforcustomprofile)
input_profile_type_0_rectangle_4 = RemoteReceiver(input_profile_type_0_rectangle)
input_basepointcoordinates_2 = RemoteReceiver(input_basepointcoordinates)
input_bake_ancor_points_2 = RemoteReceiver(input_bake_ancor_points)
input_profile_orientation_2 = RemoteReceiver(input_profile_orientation)
input_rectanglewidth_2 = RemoteReceiver(input_rectanglewidth)
input_rectangledepth_2 = RemoteReceiver(input_rectangledepth)
isprofileeditoractive_3 = RemoteReceiver(isprofileeditoractive)
input_block_name_2 = RemoteReceiver(input_block_name)
create_profile = CreateProfile(
    isprofileeditoractive=Toggle(True),
    profile_type=input_profile_type_0_rectangle_4,
    profile_orientation=input_profile_orientation_2,
    base_point_coordinates=input_basepointcoordinates_2,
    rectangle_width=input_rectanglewidth_2,
    rectangle_depth=input_rectangledepth_2,
    custom_profile_name=input_block_name_2,
    custom_profile_number=project_of_next_unique_block_2,
    customprofilegeo=input_selectedgeoforcustomprofile_2,
    bake_ancor_points=input_bake_ancor_points_2,
    apply=input_create_profile_2)  # -> generated_geo, gen_attributes, display_geo, display_colors, display_widths_2, ui_messages_2, block_name, done, ancorpts_used, info_help
help = Panel(create_profile.info_help)

# ----
# TO DO: simplify
panel_57 = Panel(""">::FacadeSubFace::Window
>::FacadeSubFace::Door
>::FacadeSubFace::CurtainWall""")
panel_58 = Panel("""0
1
3""")
layers_with_walls_2 = RemoteReceiver(layers_with_walls)
path_mapper = PathMapper(layers_with_walls_2, source="{A}", target="{2}")
create_tree_2 = CreateTree(Data=panel_57, Path=panel_58)
merge_12 = Merge(Data1=create_tree_2, Data2=path_mapper)
replace_text_6 = ReplaceText(Text=merge_12, Find="FacadeSubFace", Replace="Regelelement", RecursiveReplace=False)

panel_59 = Panel("""0
1
2
3
4""")
input_boolean = Boolean()
# Interface
ui_block = Data()
# Logical group
# Important/
# /result
ui_block_2 = Data(ui_block)
gzcommand_5 = CSharpScript(
    command="_Cancel _-SetDisplayMode \"Rendered\"",
    runNow=Toggle(True),
    echo=False,
    Reference=["C:\Program Files\Rhino 7\Plug-ins\Grasshopper\Components\ScriptComponents.gha", "C:\Program Files\NoDoubts\Godzilla\System\Godzilla.dll", "C:\Program Files\NoDoubts\Godzilla\System\RhGodzilla.rhp"])  # -> done; inputs command: String, runNow: Boolean, echo: Boolean; same code as gzcommand
input_boolean_2 = Boolean(input_boolean)
delete_preview_geo = Panel("_NoEcho -_SelLayer GH_Preview Delete Echo")

# ----
# Select by ID
panel_60 = Panel("""0e47907c-83a1-4c61-8955-df9ea4d3b8cd
d715db68-d348-4593-9558-7a7ba6803c87
778f1a53-aa81-4c77-a0d6-e93a3f8d65e7
eafb94d9-7d6b-4776-956a-966e438f51d4
a629608c-b1bc-4106-b2b7-f70737dde59b
afe4b7ef-10e3-4339-a4b1-09ce09b2b1f2
0a0de57e-5fda-4c79-b7f4-5a52659d5121
44596b35-6fd5-4dd9-ac4e-a3d7f1947514
0cdb7796-360d-446d-97c0-7b89b793abb0
613dc4b2-8799-412e-8d7e-d398e1a5d911
0baa9871-1584-4ee3-aa5b-1b9f2843dd2d
55d1a2be-ec88-48d9-96d8-341e0be19f30
5a8f6234-20c6-4e27-9a6c-2d6e5b2d6d18
948fc85c-cd9c-4607-901c-3fa5a32b766c
308d42f7-73dc-485b-8db3-dc9e87a373de
6a6b10fa-80dd-46b5-8fe8-7ff71fe9652e
ae839216-fd74-4184-b745-1adaa737c197
211f2af6-243b-4cd7-ac60-1bec187e8cfa
61dad5dd-6e3d-473d-9a61-80f47773987c
d0b77416-ce48-4b28-8d65-fcb4a4bb1488
57ac92a3-0b0f-4a7f-8f41-e51f46d148b8
2d87de8f-9aa3-4f1b-bdb4-90d710f4e675
ec1b872a-1e38-4a97-8e85-020bad831ab5
baf0d55d-87b2-4e30-b07b-f8fddd1cd09a
2d9b5bad-ef81-4ea5-80df-6d7afbcca6a7
fd98fe1a-7120-418f-b134-dee8d6416004
4697bbde-f5b6-4213-99b4-ff9462b51fdd
25420a83-8e29-4314-b5c0-cecad750d3ee
11843081-f600-4eb3-a925-57b34d24a830
07d9fda9-234b-4629-b9f3-7bf3bea8115c
52d1e62b-593c-4008-b4e2-ab31ec82367d
36019c84-396d-491e-829f-558782ac6539
d80b7767-e067-4d48-b022-2cb024706dc3
4876f571-e5c2-4650-a539-58fca584679e
0b38d759-3e58-450a-ba5a-0952e142e04d
950920d6-1840-4c30-82e2-89260a9fd9f1
603fecfc-2482-4ab3-8124-8d0d13a23ed8
8bab122b-7801-402e-b347-7eeff70fa0e3
fb03dcec-1223-45c1-ad56-4c7c64f59238
6af6b722-0d51-42c7-8434-cc7fc22153f1
a8a6f350-a399-4298-a79c-0240b2265202
cfb71c01-d001-49ef-8abe-61249053db4e
371aff74-de27-43fd-a675-db0669b04405
db31b445-ac35-4529-9caf-9693d39e8d72
c66c497e-1c5c-4f70-8aab-1af7c529d885
538e4030-21c4-486b-b83b-6d650a690cc5
1b5bac3f-6c40-4a0f-860c-f056f1d9cb84
f4fa2710-8217-44f8-ac44-3c4f54cbbbda
728f6215-090e-4050-ab66-052b5dc69f9b
b0a2e012-22eb-420f-bccc-68abc505b0e9
2994ec31-495d-42bd-a398-1b2fe3aa24d9
e857cd7a-18d6-45c1-8409-79a90af21843
5717fd22-9f25-4e9d-b980-6d7453b8d33b
6cb15c05-3d41-4947-b60d-d9af98dd81e3
191c537d-2dad-448b-987b-7e098be8976b
7e749a5d-618b-4f86-afa4-9b6fef6216c2""")  # disabled
panel_61 = Panel("SelID ")  # disabled
guid_3 = Guid(objects_by_selection_5)
concatenate_7 = Concatenate(FragmentA=panel_61, FragmentB=panel_60)  # disabled
geometry = Geometry(panel_60)  # disabled
text_join_3 = TextJoin(Text=concatenate_7, Join=" ")  # disabled
get_objects_by_guid = GetObjectsByGuid(
    id=panel_60,
    Reference=["C:\Program Files\Rhino 7\Plug-ins\Grasshopper\Components\ScriptComponents.gha", "C:\Program Files\NoDoubts\Godzilla\System\Godzilla.dll", "C:\Program Files\NoDoubts\Godzilla\System\RhGodzilla.rhp"])  # -> out, A; inputs id: Guid; disabled
# ---------- get_objects_by_guid: C# ----------
    //get objects by layer name
    Rhino.DocObjects.RhinoObject rhobj = doc.Objects.Find(id);
    A = rhobj;
# ---------- end get_objects_by_guid ----------
get_object_by_guid_wip = GetObjectByGuidWIP(id=panel_60)  # -> out, a; inputs id: Guid; disabled
# ---------- get_object_by_guid_wip: Python ----------
__author__ = "Me"
__version__ = "2021.01.25"

import rhinoscriptsyntax as rs
import scriptcontext
import Rhino
doc = Rhino.RhinoDoc.ActiveDoc

a = doc.Objects.Find(id)
# ---------- end get_object_by_guid_wip ----------
panel_62 = Panel(text_join_3)  # disabled
button = Button()  # disabled
gzcommand_6 = CSharpScript(
    command=panel_62,
    runNow=button,
    echo=False,
    Reference=["C:\Program Files\Rhino 7\Plug-ins\Grasshopper\Components\ScriptComponents.gha", "C:\Program Files\NoDoubts\Godzilla\System\Godzilla.dll", "C:\Program Files\NoDoubts\Godzilla\System\RhGodzilla.rhp"])  # -> done; inputs command: String, runNow: Boolean, echo: Boolean; disabled; same code as gzcommand

x_2 = Panel(create_profile.block_name)
# Go to clicked step
gzopengh = CSharpScript(Reference=["C:\Program Files\Rhino 7\Plug-ins\Grasshopper\Components\ScriptComponents.gha", "C:\Program Files\NoDoubts\Godzilla\System\Godzilla.dll", "C:\Program Files\NoDoubts\Godzilla\System\RhGodzilla.rhp"])  # -> done; inputs resName: String, runNow: Boolean; same code as gzopengh
gz_menu_2 = CSharpScript(Reference=["C:\Program Files\Rhino 7\Plug-ins\Grasshopper\Components\ScriptComponents.gha", "C:\Program Files\NoDoubts\Godzilla\System\Godzilla.dll", "C:\Program Files\NoDoubts\Godzilla\System\RhGodzilla.rhp"])  # -> resources, names, tooltips; same code as gz_menu
docinfo = DocumentInfo(AutoUpdate=False, Recursive=False)  # -> DocumentName, DocumentFilePath, Components, Params, _3rdPartyAssemblies
elevations_0_or_spacings_1_2 = Boolean(elevations_0_or_spacings_1)
gzcommand_7 = CSharpScript(
    runNow=False,
    echo=False,
    Reference=["C:\Program Files\Rhino 7\Plug-ins\Grasshopper\Components\ScriptComponents.gha", "C:\Program Files\NoDoubts\Godzilla\System\Godzilla.dll", "C:\Program Files\NoDoubts\Godzilla\System\RhGodzilla.rhp"])  # -> done; inputs command: String, runNow: Boolean, echo: Boolean; same code as gzcommand
tsort = SortText(Keys=docinfo.Components, Culture=127)  # -> Keys, Values
gzuicolors_2 = CSharpScript(Reference=["C:\Program Files\Rhino 7\Plug-ins\Grasshopper\Components\ScriptComponents.gha", "C:\Program Files\NoDoubts\Godzilla\System\Godzilla.dll", "C:\Program Files\NoDoubts\Godzilla\System\RhGodzilla.rhp"])  # -> Current_step_bg; same code as gzuicolors
panel_63 = Panel(docinfo._3rdPartyAssemblies)
panel_64 = Panel(tsort.Keys)
panel_65 = Panel(">::FacadeSubFace::Window")
filter_by_user_attributes = FilterByUserAttributes(Key="HO_Type", Val="RE-Block")  # -> Objects, Key, Val
select_by_guid = SelectByGUID(Reference=["C:\Program Files\Rhino 7\Plug-ins\Grasshopper\Components\ScriptComponents.gha", "C:\Program Files\NoDoubts\Godzilla\System\Godzilla.dll", "C:\Program Files\NoDoubts\Godzilla\System\RhGodzilla.rhp"])  # -> out, A; inputs guids: list of Guid, select_now: Boolean
# ---------- select_by_guid: C# ----------
    if(select_now){
      this.RhinoDocument.Objects.UnselectAll();
      foreach(Guid guid in guids){
        if(this.RhinoDocument.Objects.FindId(guid).Attributes.Name == null){
          this.RhinoDocument.Objects.Select(guid, true, true, true);
        }
      }
    }
# ---------- end select_by_guid ----------
addkvtonestedjson = AddKeyValueToNestedJSON(write_now=False)  # -> out; inputs write_now: Boolean
# ---------- addkvtonestedjson: Python ----------
# Adds key-value pair to json file

__author__ = "Yury Nasonov"
__version__ = "1"

ghenv.Component.Name = "Add key-value to nested JSON"
ghenv.Component.NickName = 'AddKVtoNestedJSON'
ghenv.Component.Message = 'Add key-value to nested JSON'

# ———————————————————————————————————————————————————————————

import rhinoscriptsyntax as rs
import json

# ———————————————————————————————————————————————————————————

if write_now:
    #get key depth 
    key_list=key.split(".")
    key_count = len(key_list)
    with open(json_path, 'r+') as f:
        data = json.load(f)
        if key_count==1:
            data[key] = value # <--- add `id` value.
        else:
            if key_count==2:               #for input like key0.key1
                key0 =key_list[0]
                key1=key_list[1]
                data[key0][key1] = value
            if key_count==3:               #for input like key0.key1.key2
                key0 =key_list[0]
                key1=key_list[1]
                key2=key_list[2]
                data[key0][key1][key2] = value
            if key_count==4:               #for input like key0.key1.key2.key3
                key0 =key_list[0]
                key1=key_list[1]
                key2=key_list[2]
                key3=key_list[3]
                data[key0][key1][key2][key3] = value
            if key_count==5:               #for input like key0.key1.key2.key3.key4
                key0 =key_list[0]
                key1=key_list[1]
                key2=key_list[2]
                key3=key_list[3]
                key4=key_list[4]
                data[key0][key1][key2][key3][key4] = value
        f.seek(0)        # <--- should reset file position to the beginning.
        json.dump(data, f, indent=4, ensure_ascii=False)
        f.truncate()     # remove remaining part
        f.close()
# ---------- end addkvtonestedjson ----------
panel_67 = Panel("D:\Dipl. - Ing. Herbert Hölscher Stahlbau Kleve GmbH & Co. KG\AUTOMATISIERUNG - Documents\Personal\Yury\APP\DB\Bugs\1.txt")
panel_68 = Panel("user_name")
button_2 = Button()
replace_text_7 = ReplaceText(Text=panel_67, Find="\", Replace="\\", RecursiveReplace=False)

free_vert_space_in_the_start = Boolean()
highlight = Integer()
apply_6 = Boolean(apply)
free_horiz_space_in_the_start = Boolean()
elevations_0_or_spacings_1_3 = Boolean(elevations_0_or_spacings_1)

text = Text(Tree({0}: ["Type", "1", "2", "3"], {1}: ["SF", "4", "5", "6"], {2}: ["RE", "7", "8", "9"]))

# ----
# READ PROFILE BLOCKS DATA
are_facadesubfaces_selected_3 = RemoteReceiver(are_facadesubfaces_selected)
panel_69 = Panel("""1
1""")
list_block_document = ListBlockDocument()
panel_70 = Panel(list_block_document)
text_fragment = TextFragment(Text=list_block_document, Start=0, Count=Slider(6, range=0..100))
evaluate = Evaluate(Expression="if((x=\"Profil\") OR (x=\"Panel \"),1,0)", x=text_fragment)
evaluate_2 = Evaluate(Expression="if((x=\"Profil\"),1,0)", x=text_fragment)
evaluate_3 = Evaluate(Expression="if((x=\"Profil\"),1,0)", x=text_fragment)
dispatch_2 = Dispatch(List=list_block_document, DispatchPattern=evaluate)  # -> ListA, ListB
dispatch_3 = Dispatch(List=list_block_document, DispatchPattern=evaluate_2)  # -> ListA, ListB
dispatch_4 = Dispatch(List=list_block_document, DispatchPattern=evaluate_3)  # -> ListA, ListB
re_blocks_list = RemoteSender(dispatch_2.ListB)
replace_text_8 = ReplaceText(Text=dispatch_3.ListA, Find="Profile - Rectangular -", Replace="▮", RecursiveReplace=False)
replace_text_9 = ReplaceText(Text=replace_text_8, Find="Profile custom", Replace="▶", RecursiveReplace=False)
replace_text_10 = ReplaceText(Text=replace_text_9, Find="Profile - Default - ", Replace="✔️", RecursiveReplace=False)
sort_text_3 = SortText(Keys=replace_text_10, Culture=127)  # -> Keys, Values
panel_71 = Panel(replace_text_10)

insert_block = InsertBlock(BlockName=dispatch_2.ListA, SourcePlane=PlaneXY(0, 0, 0))
deconstruct_block = DeconstructBlock(Block=insert_block, recursive=False)  # -> Name, Plane, Geometry
deconstruct_attributes = DeconstructAttributes(ReferencedGeometryOrAttributes=deconstruct_block.Geometry)  # -> Keys, Values
panel_72 = Panel(deconstruct_attributes.Keys)

# ----
# Existing profile
panel_73 = Panel("list of blocks")
create_pulldown_menu_7 = CreatePulldownMenu(ListItems=panel_73, showLabel=True)
create_button_21 = CreateButton(ButtonName="update list", ButtonStyle=3)
set_list_contents_4 = SetListContents(ListToModify=create_pulldown_menu_7, NewListContents=sort_text_3.Keys)
value_listener_51 = ValueListener(Elements=create_button_21, SomeProperty=True)  # -> Values, Indices
input_profile_type_0_rectangle_5 = RemoteReceiver(input_profile_type_0_rectangle)
equality_3 = Equality(FirstNumber=input_profile_type_0_rectangle_5, SecondNumber=0)  # -> Equality, Inequality
gate_and_3 = GateAnd(A=equality_3.Equality, B=is_profile_to_edit_selected_3)
hide_show_element_16 = HideShowElement(ElementToHideShow=create_pulldown_menu_7, Show=gate_and_3, Collapse=True, Disable=False)

gate_or_6 = GateOr(A=are_facadesubfaces_selected_3, B=value_listener_51.Values)
list_item_11 = ListItem(List=panel_69, Index=gate_or_6, Wrap=True)
enable_disable_object_2 = EnableDisableObject(Enabled=list_item_11)

value_listener_52 = ValueListener(Elements=create_pulldown_menu_7, SomeProperty=True)  # -> Values, Indices
input_selected_existing_profile = RemoteSender(value_listener_52.Values)

# ----
# PROFILE  EDITOR
entwine_6 = Entwine(
    Branch00=create_label_24,
    Branch01=create_pulldown_menu_5,
    Branch02=create_text_box_5,
    Branch03=create_text_box_6,
    Branch04=create_text_block_9,
    Branch05=create_text_box_12,
    Branch06=create_pulldown_menu_7,
    Branch07=create_button_21,
    Branch08=create_button_13,
    FlattenInputs=True)  # -> flatten(Result)
create_wrappanel_16 = CreateWrapPanel(UIElements=flatten(entwine_6), Horizontal=True)  # -> flatten(WrapPanel)
hui_selectgeotoblock1_2 = RemoteReceiver(hui_selectgeotoblock1)
merge_13 = Merge(
    Data1=create_label_22,
    Data2=create_label_23,
    Data3=create_wrappanel_16,
    Data4=hui_selectgeotoblock1_2,
    Data5=input_apply_3)  # -> flatten(Result)
hui_profile_editor = RemoteSender(merge_13)

hui_profile_editor_2 = RemoteReceiver(hui_profile_editor)
merge_14 = Merge(
    Data1=create_checkbox_4,
    Data2=hui_profile_editor_2,
    Data3=create_wrappanel_3,
    Data5=create_wrappanel_8,
    Data6=relay_3,
    Data7=create_pulldown_menu_6,
    Data8=create_button_14)  # -> flatten(Result)
create_expander_3 = CreateExpander(UIElements=merge_14, Header="Set profiles", Open=True)  # -> flatten(Expander)

# ----
# 3.1 CREATE RE Blocks
input_selection_3 = RemoteReceiver(input_selection)
re_blocks_list_2 = RemoteReceiver(re_blocks_list)
create_re_blocks = CreateREBlocks(selected_facadesubfaces=input_selection_3, existing_blocks_list=re_blocks_list_2)

# ----
# Used block name
input_profile_type_0_exist_2 = RemoteReceiver(input_profile_type_0_exist)
input_selected_existing_profile_2 = RemoteReceiver(input_selected_existing_profile)
larger_than = LargerThan(FirstNumber=input_profile_type_0_exist_2, SecondNumber=0)  # -> LargerThan, OrEqualTo
cluster_2 = Cluster_2(text=input_selected_existing_profile_2)
stream_filter_4 = StreamFilter(Gate=larger_than.LargerThan, Stream0=cluster_2, Stream1=create_profile.block_name)
panel_74 = Panel(stream_filter_4)
input_selectedblocktoreplacewith = RemoteSender(stream_filter_4)

input_selectedblocktoreplacewith_2 = RemoteReceiver(input_selectedblocktoreplacewith)
input_assigntoselected_3 = RemoteReceiver(input_assigntoselected)
input_blocktoreplace_2 = RemoteReceiver(input_blocktoreplace)
objects_by_selection_6 = ObjectsBySelection(Reset=input_assigntoselected_3, LiveMode=False)

# ----
# REPLACE BLOCK
replace_block = ReplaceBlock(
    block_to_replace=objects_by_selection_6,
    relay=input_blocktoreplace_2,
    block_to_replace_with=input_selectedblocktoreplacewith_2,
    replace_now=input_assigntoselected_3)

# ----
# RECIPIES  EXPANDER
# Take recipie from...
# This Project
# Library
# Another project....
# New
# Name of Recipie
panel_75 = Panel("""THIS PROJECT
LIBRARY
NEW""")  # disabled
panel_76 = Panel("""BONN - Window 1st Floor
BONN - Window typical Floor
BONN - Window block B""")  # disabled
panel_77 = Panel("""Apply to selected
Save current options as new recipie""")  # disabled
create_button_22 = CreateButton(ButtonName=panel_77, ButtonStyle=0)  # disabled
create_pulldown_menu_8 = CreatePulldownMenu(ListItems=panel_76, showLabel=True)  # disabled
panel_78 = Panel("Recipies")  # disabled

# ----
# VISIBILITY SETTINGS
# To do: cplanes from previous steps
# TABS
panel_79 = Panel("""Windows
Doors
Walls
Curtain walls""")
number_slider_9 = Slider(16, range=0..100)
panel_80 = Panel("""Off
Windows
Doors
Walls
Curtain walls""")
create_label_38 = CreateLabel(LabelText="Filter:", LabelSize=18, Justification=0)
tabbed_view = TabbedView(TabNames=panel_80, TabTextSize=number_slider_9)  # -> flatten(Tabs)
value_listener_53 = ValueListener(Elements=tabbed_view, SomeProperty=True)  # -> Values, Indices
create_wrappanel_17 = CreateWrapPanel(UIElements=[create_label_38, tabbed_view], Horizontal=True)  # -> flatten(WrapPanel)
panel_81 = Panel("""Window
Door
Wall
Curtain wall""")
subtraction = Subtraction(A=value_listener_53.Indices, B=1)
hui_selected_tab_name = RemoteSender(value_listener_53.Values)
hui_selected_tab_index = RemoteSender(subtraction)
hui_selected_tab_index_2 = RemoteReceiver(hui_selected_tab_index)
list_item_12 = ListItem(List=panel_81, Index=hui_selected_tab_index_2, Wrap=True)
panel_82 = Panel("""Types
Materials""")
highlight_opacity = Slider(0.6, range=0..1)
panel_83 = Panel("iew")
create_radio_button_11 = CreateRadioButton(RadioButtonName=panel_82, RadioButtonGroup="TypesOrMaterials", InitiallySelected=[True, False])  # disabled
create_toggle_2 = CreateToggle(Default=False, OnLabel="      Active part only", OffLabel="                 All parts")  # disabled
create_toggle_3 = CreateToggle(Default=False, OnLabel="Simplified display", OffLabel="Show blocks")  # disabled
create_label_39 = CreateLabel(LabelText="Visibility", LabelSize=18, Justification=0)  # disabled
create_label_40 = CreateLabel(LabelText="Display:", LabelSize=12, Justification=0)  # disabled
create_toggle_4 = CreateToggle(Default=True, OnLabel="       Top      ", OffLabel="Perspective")  # disabled
create_toggle_5 = CreateToggle(Default=False, OnLabel="Show library", OffLabel="Hide library ")  # disabled
value_listener_54 = ValueListener(Elements=create_toggle_4, SomeProperty=True)  # -> Values, Indices; disabled
panel_84 = Panel("""'_CPlane _Object '_SetView _CPlane _Bottom
Cancel""")
value_listener_55 = ValueListener(Elements=create_toggle_3, SomeProperty=True)  # -> Values, Indices
create_wrappanel_18 = CreateWrapPanel(UIElements=[create_label_40, create_radio_button_11, create_toggle_2], Horizontal=True)  # -> flatten(WrapPanel)
value_listener_56 = ValueListener(Elements=create_radio_button_11, SomeProperty=True)  # -> Values, Indices
gzcommand_8 = CSharpScript(
    command=panel_84,
    runNow=value_listener_54.Values,
    echo=False,
    Reference=["C:\Program Files\Rhino 7\Plug-ins\Grasshopper\Components\ScriptComponents.gha", "C:\Program Files\NoDoubts\Godzilla\System\Godzilla.dll", "C:\Program Files\NoDoubts\Godzilla\System\RhGodzilla.rhp"])  # -> done; inputs command: String, runNow: Boolean, echo: Boolean; disabled; same code as gzcommand
bool = Boolean(invert(value_listener_54.Values))
value_listener_57 = ValueListener(Elements=create_toggle_5, SomeProperty=True)  # -> Values, Indices
member_index_8 = MemberIndex(Set=flatten(value_listener_56.Values), Member=True)  # -> Index, Count
gzcommand_9 = CSharpScript(
    command="'_SetView _World _Perspective ZS Cancel",
    runNow=bool,
    echo=False,
    Reference=["C:\Program Files\Rhino 7\Plug-ins\Grasshopper\Components\ScriptComponents.gha", "C:\Program Files\NoDoubts\Godzilla\System\Godzilla.dll", "C:\Program Files\NoDoubts\Godzilla\System\RhGodzilla.rhp"])  # -> done; inputs command: String, runNow: Boolean, echo: Boolean; disabled; same code as gzcommand

tabbed_view_2 = TabbedView(TabNames=panel_80, TabTextSize=number_slider_9)  # -> flatten(Tabs)
adjust_element_positioning_16 = AdjustElementPositioning(ElementsToAdjust=tabbed_view, Margin="0,6,0,0", AbsolutePositioning=False)
input_selected_tab = RemoteSender(value_listener_53.Indices)
create_slider_2 = CreateSlider(Slider=highlight_opacity, ShowBounds=False, ShowTicks=False, ShowTooltip=False, ShowValLabel=False, showLabel=True)
input_selected_tab_2 = RemoteReceiver(input_selected_tab)
boolean_3 = Boolean(input_selected_tab_2)

# ----
# Lock/unlock layers
# Unlock layers
# Lock layers
input_selected_tab_3 = RemoteReceiver(input_selected_tab)
off = Panel("0")
elements = Panel("""1
2
3
4""")
equality_4 = Equality(FirstNumber=input_selected_tab_3, SecondNumber=off)  # -> Equality, Inequality
equality_5 = Equality(FirstNumber=input_selected_tab_3, SecondNumber=elements)  # -> Equality, Inequality
dispatch_5 = Dispatch(List=elements, DispatchPattern=equality_5.Equality)  # -> ListA, ListB
text_2 = Text(Tree({1}: [">::FacadeSubFace::Window", ">::Regelelement::Window"], {2}: [">::FacadeSubFace::Door", ">::Regelelement::Door"], {3}: [">::FacadeSubFace::Vent-Other", ">::Regelelement::Vent-Other", ">::FacadeSubFace::MS-Other", ">::Regelelement::MS-Other", ">::FacadeSubFace::Aluninium", ">::Regelelement::Aluminium", ">::FacadeSubFace::Attika", ">::Regelelement::Attika", ">::FacadeSubFace::Ceiling", ">::Regelelement::Ceiling", ">::FacadeSubFace::Column", ">::Regelelement::Column", ">::FacadeSubFace::Glass/Stone", ">::Regelelement::Glass/Stone"], {4}: [">::FacadeSubFace::CurtainWall", ">::Regelelement::CurtainWall"]))
tree_branch = TreeBranch(Tree=text_2, Path=dispatch_5.ListA, MaintainPaths=True)
tree_branch_2 = TreeBranch(Tree=text_2, Path=dispatch_5.ListB, MaintainPaths=True)
stream_filter_5 = StreamFilter(Gate=equality_4.Equality, Stream0=tree_branch_2)
stream_filter_6 = StreamFilter(Gate=equality_4.Equality, Stream0=tree_branch, Stream1=text_2)
nickname = Name(layer_name=stream_filter_6, is_locked=Toggle(False))  # -> out, a; inputs is_locked: Boolean
# ---------- nickname: Python ----------
# ACTION:     
# LIMITATION: 
# TO DO:      

__author__ = "Yury Nasonov"
__version__ = "1"

ghenv.Component.Name = "Name"
ghenv.Component.NickName = 'NickName'
ghenv.Component.Message = 'Lock layer'

# ———————————————————————————————————————————————————————————

import rhinoscriptsyntax as rs
from scriptcontext import doc
import Rhino
import scriptcontext

# ———————————————————————————————————————————————————————————

scriptcontext.doc = Rhino.RhinoDoc.ActiveDoc


import rhinoscriptsyntax as rs

rs.LayerLocked(layer_name, is_locked)

scriptcontext.doc = ghdoc
# ---------- end nickname ----------
nickname_2 = Name(layer_name=stream_filter_5, is_locked=Toggle(True))  # -> out, a; inputs is_locked: Boolean; same code as nickname

# ----
# BLOCKS
# Tree:
# 0) Windows
# 1) Doors
# 2) Walls
# 3) Curtain walls
# Get geometry and data
# SUBFACES
# Tree:
# 0) Windows
# 1) Doors
# 2) Walls
# 3) Curtain walls
reference_by_layer_4 = ReferenceByLayer(LayerName=graft(replace_text_6), DisableAutoUpdate=False, ignoreCase=False)  # -> simplify(Geometry)
hui_selected_tab_index_3 = RemoteReceiver(hui_selected_tab_index)
shift_paths = ShiftPaths(Data=reference_by_layer_4, Offset=-1)
panel_85 = Panel(reference_by_layer_4)
reference_by_layer_5 = ReferenceByLayer(LayerName=graft(merge_12), DisableAutoUpdate=False, ignoreCase=False)  # -> simplify(Geometry)
tree_branch_3 = TreeBranch(Tree=shift_paths, Path=hui_selected_tab_index_3, MaintainPaths=True)  # -> simplify(graft(Branch))
hui_selected_tab_index_4 = RemoteReceiver(hui_selected_tab_index)
deconstruct_block_2 = DeconstructBlock(Block=tree_branch_3)  # -> Name, Plane, Geometry
shift_paths_2 = ShiftPaths(Data=reference_by_layer_5, Offset=-1)
tree_branch_4 = TreeBranch(Tree=shift_paths_2, Path=hui_selected_tab_index_4, MaintainPaths=True)  # -> simplify(graft(Branch))
filter_by_layer_2 = FilterByLayer(Geometry=deconstruct_block_2.Geometry, Layer=">::SupportGeo::RE-Base")
merge_15 = Merge(Data1=flatten(filter_by_layer_2), Data2=flatten(tree_branch_4))  # -> graft(Result)
gh_base_surfaces = RemoteSender(merge_15)
get_user_value_5 = GetUserValue(Geometry=merge_15, Key="HO_RE-type-by-user")
gh_re_type_by_user = RemoteSender(get_user_value_5)

input_selected_tab_4 = RemoteReceiver(input_selected_tab)
boolean_4 = Boolean(input_selected_tab_4)
panel_86 = Panel(stream_filter_6)

# ----
# Setting type of object
# To do: if Separators counter is already filled
# then add new number
# To do: if selecteg geo is FacadeFace -
# copy it to the subFace layer
panel_87 = Panel("  Selected geometry is in status:")
create_true_only_button_8 = CreateTrueOnlyButton(ButtonName="Select undefined", ButtonStyle=0)
create_label_41 = CreateLabel(LabelText="0 selected", LabelSize=12, Justification=0)
create_button_23 = CreateButton(ButtonName="Reset selection", ButtonStyle=0)
create_text_block_15 = CreateTextBlock(Text=panel_87, TextSize=12, Justification=0)
create_wrappanel_19 = CreateWrapPanel(UIElements=[create_true_only_button_8, create_label_41, create_button_23], Horizontal=True)
value_listener_58 = ValueListener(Elements=create_button_23, SomeProperty=True)  # -> Values, Indices
value_listener_59 = ValueListener(Elements=create_true_only_button_8, SomeProperty=True)  # -> Values, Indices
value_listener_60 = ValueListener(Elements=create_button_3, SomeProperty=True)  # -> Values, Indices
adjust_element_positioning_17 = AdjustElementPositioning(ElementsToAdjust=create_label_41, AbsolutePositioning=False, VerticalAlignment=1)
boolean_5 = Boolean(invert(value_listener_59.Values))
integer_2 = Integer(value_listener_60.Values)
mass_addition_4 = MassAddition(Input=flatten([integer_2, integer]))  # -> Result, PartialResults
member_index_9 = MemberIndex(Set=flatten(integer_2), Member=1)  # -> Index, Count
objects_by_selection_7 = ObjectsBySelection(Reset=mass_addition_4.Result, LiveMode=False)  # -> simplify(graft(SelectedGeometry))
mass_addition_5 = MassAddition(Input=[value_listener_58.Values, mass_addition_4.Result])  # -> Result, PartialResults
stream_filter_7 = StreamFilter(Gate=boolean_5, Stream0=">::FacadeSubFace")
enable_disable_object_3 = EnableDisableObject(Enabled=invert(mass_addition_5.Result))
filter_by_user_attributes_2 = FilterByUserAttributes(Attributes=objects_by_selection_7, Key="HO_Type", Val="FacadeSubFace")  # -> SelectedGeometry, Key, Val
reference_by_layer_6 = ReferenceByLayer(LayerName=stream_filter_7)
list_length_9 = ListLength(List=reference_by_layer_6)
addition_6 = Addition(A=list_length_9, B=0)
boolean_6 = Boolean(list_length_9)
integer_3 = Integer(boolean_6)
concatenate_8 = Concatenate(FragmentA=addition_6, FragmentB=" selected")
addition_7 = Addition(A=integer_3, B=0)
stream_filter_8 = StreamFilter(Gate=addition_7, Stream0=filter_by_user_attributes_2.SelectedGeometry, Stream1=reference_by_layer_6)
set_label_contents_3 = SetLabelContents(LabelToModify=create_label_41, NewLabelContents=concatenate_8)
graft_tree = GraftTree(Tree=filter_by_user_attributes_2.SelectedGeometry, IncludeEmptyLists=True, IncludeNullItems=True)
custom_preview_5 = CustomPreview(Geometry=filter_by_user_attributes_2.SelectedGeometry, Material=ColourSwatch(SwatchColor=RGBA(255, 247, 0, 125)))
get_user_attributes = GetUserAttributes(Geometry=simplify(graft(graft_tree)))  # -> Keys, Values, BakeName
insert_items = InsertItems(List=reverse(get_user_attributes.Keys), Item="HO_RE-type-by-user", Indices="0", Wrap=True)  # -> reverse(simplify(List))
get_rhino_attributes = GetRhinoAttributes(Geometry=graft_tree, readFullPath=True)  # -> Name, Layer, Color
panel_88 = Panel(insert_items)
panel_89 = Panel(graft_tree)

# ----
# Statistics table
# Select all
panel_90 = Panel("")
entwine_7 = Entwine(FlattenInputs=True)  # -> simplify(Result)
entwine_8 = Entwine(FlattenInputs=True)  # -> simplify(Result)
create_button_24 = CreateButton(ButtonName=entwine_8, ButtonStyle=3)
value_listener_61 = ValueListener(Elements=flatten(create_button_24), SomeProperty=True)  # -> flatten(Values), Indices
create_button_25 = CreateButton(ButtonStyle=0)
create_button_26 = CreateButton(ButtonStyle=0)
text_3 = Text(Tree({0}: ["Type"], {1}: ["SF"], {2}: ["Sel"], {3}: ["RE"], {4}: ["Sel"]))
text_4 = Text(Tree({0}: ["Type", "1", "2"], {1}: ["FSS", "4", "5", "6"], {2}: ["Sel"], {3}: ["RE", "7", "8", "9"], {4}: ["Sel"], {5}: ["Sum"]))
concatenate_9 = Concatenate(FragmentA=text_4, FragmentB="b")
member_index_10 = MemberIndex(Set=value_listener_61.Values, MemberTrue=True)  # -> Index, Count
entwine_9 = Entwine(Branch02=create_button_25, Branch04=create_button_26, FlattenInputs=True)  # -> simplify(Result); disabled
panel_91 = Panel("""1
1
1
1""")
division = Division(A=member_index_10.Index, B="50")
modulus = Modulus(A=member_index_10.Index, B="50")
headers = Panel("""Type
FSF
RE
Σ""")
round = Round(Number=division)  # -> Nearest, Floor, Ceiling
create_text_block_16 = CreateTextBlock(Text=graft(headers), TextSize=12, Justification=0)
panel_92 = Panel("_SelKeyValue ")
colour_swatch_7 = ColourSwatch(SwatchColor=RGB(232, 232, 232))
create_text_block_17 = CreateTextBlock(TypesNumber=graft("0"), TextSize=12, Justification=0)  # -> simplify(TextBlock)
create_button_27 = CreateButton(ButtonName=Tree({1}: [" "], {2}: [" "], {3}: [" "]), ButtonStyle=3)
adjust_element_appearance_7 = AdjustElementAppearance(
    ElementsToAdjust=[create_button_24, create_button_27],
    Foreground=graft([ColourSwatch(SwatchColor=RGB(255, 255, 255)), ColourSwatch(SwatchColor=RGB(0, 0, 0))]),
    Background=graft([ColourSwatch(SwatchColor=RGB(0, 0, 0)), ColourSwatch(SwatchColor=RGB(235, 209, 209)), ColourSwatch(SwatchColor=RGB(223, 235, 209)), ColourSwatch(SwatchColor=RGB(209, 234, 235))]))
adjust_element_positioning_18 = AdjustElementPositioning(ElementsToAdjust=[create_button_24, create_button_27], AbsolutePositioning=False, Width=Slider(85, range=0..100))
number_slider_10 = Slider(840, range=0..1000)
merge_16 = Merge(Data1=simplify(create_text_block_16), Data2=create_button_24, Data3=entwine_9)
number_slider_11 = Slider(35, range=0..150)
number_slider_12 = Slider(50, range=0..150)
number_slider_13 = Slider(50, range=0..150)
number_slider_14 = Slider(60, range=0..150)
number_slider_15 = Slider(50, range=0..150)
merge_17 = Merge(Data1=simplify(create_text_block_16), Data2=create_button_24, Data3=entwine_9)
value_listener_62 = ValueListener(Elements=flatten(create_button_27), SomeProperty=True)  # -> flatten(Values), Indices
create_simple_grid_7 = CreateSimpleGrid(
    UIElements=merge_16,
    Width=number_slider_10,
    RowDefinitions="Auto",
    ColumnDefinitions=[number_slider_11, number_slider_15, number_slider_12, number_slider_13, number_slider_14])  # -> flatten(SimpleGrid)
panel_93 = Panel("""'_SelSrf '_SelPolySrf
'_SelBlockInstance
'_SelAll""")
merge_18 = Merge(Data1=create_text_block_17, Data2=create_button_27)
adjust_element_positioning_19 = AdjustElementPositioning(
    ElementsToAdjust=[merge_16, merge_18],
    AbsolutePositioning=False,
    Height=Slider(24, range=0..100),
    HorizontalAlignment=1,
    VerticalAlignment=1)
create_simple_grid_8 = CreateSimpleGrid(
    UIElements=merge_18,
    Width=number_slider_10,
    RowDefinitions="Auto",
    ColumnDefinitions=[number_slider_11, number_slider_15, number_slider_12, number_slider_13, number_slider_14])
gzcommand_10 = CSharpScript(
    command=panel_93,
    runNow=value_listener_62.Values,
    echo=False,
    Reference=["C:\Program Files\Rhino 7\Plug-ins\Grasshopper\Components\ScriptComponents.gha", "C:\Program Files\NoDoubts\Godzilla\System\Godzilla.dll", "C:\Program Files\NoDoubts\Godzilla\System\RhGodzilla.rhp"])  # -> done; inputs command: String, runNow: Boolean, echo: Boolean; same code as gzcommand
merge_19 = Merge(Data1=create_simple_grid_7, Data2=separator_4, Data3=create_simple_grid_8)  # -> flatten(Result)
panel_94 = Panel("To see Statistics and selection tools filter object type first")
input_selected_tab_5 = RemoteReceiver(input_selected_tab)
panel_95 = Panel("""Off
Windows
Doors
Walls
Curtain walls""")
create_text_block_18 = CreateTextBlock(Text=panel_94, TextSize=12, Justification=0)
input_selected_tab_6 = RemoteReceiver(input_selected_tab)
list_item_13 = ListItem(List=panel_95, Index=input_selected_tab_5, Wrap=True)
create_expander_4 = CreateExpander(UIElements=merge_19, Header="Statistics and selection", Open=True)
boolean_7 = Boolean(input_selected_tab_6)
concatenate_10 = Concatenate(FragmentA=list_item_13, FragmentB=": Statistics and selection")
hide_show_element_17 = HideShowElement(ElementToHideShow=create_text_block_18, Show=invert(boolean_7), Collapse=True, Disable=False)
hide_show_element_18 = HideShowElement(ElementToHideShow=create_expander_4, Show=boolean_7, Collapse=True, Disable=False)
set_expander = SetExpander(Expander=create_expander_4, Name=concatenate_10)
adjust_element_appearance_8 = AdjustElementAppearance(ElementsToAdjust=create_expander_4, Background=ColourSwatch(SwatchColor=RGB(255, 255, 255)))
value_listener_63 = ValueListener(Elements=create_expander_4, SomeProperty=True)  # -> Values, Indices
adjust_element_positioning_20 = AdjustElementPositioning(ElementsToAdjust=create_expander_4, Margin="0,15,0,8", AbsolutePositioning=False)
merge_20 = Merge(Data1=create_expander_4, Data2=create_text_block_18)
hui_is_stats_expander_open = RemoteSender(value_listener_63.Values)

value_listener_64 = ValueListener(Elements=create_slider_2, SomeProperty=True)  # -> Values, Indices
input_type_color_opacity = RemoteSender(value_listener_64.Values)
input_displaymode_0_types_1_materials = RemoteSender(boolean_3)
hide_show_element_19 = HideShowElement(ElementToHideShow=create_slider_2, Show=boolean_3, Collapse=True, Disable=False)
merge_21 = Merge(
    Data1=hui_submit_a_bug_buttons_2,
    Data2=create_wrappanel_17,
    Data3=create_label_39,
    Data5=create_wrappanel_18,
    Data6=create_toggle_3,
    Data7=create_slider_2,
    Data8=separator,
    Data9=merge_20,
    Data10=separator,
    Data11=relay_4,
    Data12=create_wrappanel_2,
    Data13=create_wrappanel,
    Data15=separator_5)

create_expander_5 = CreateExpander(UIElements=merge_21, Header="Types", Open=True)
hui_all_re_types_ui = RemoteSender(create_expander_5)
input_displaymode_0_types_1_materials_2 = RemoteReceiver(input_displaymode_0_types_1_materials)
hui_is_stats_expander_open_2 = RemoteReceiver(hui_is_stats_expander_open)
gate_and_4 = GateAnd(A=hui_is_stats_expander_open_2, B=boolean_4)
stream_filter_9 = StreamFilter(Gate=gate_and_4, Stream1=stream_filter_6)
dispatch_6 = Dispatch(List=stream_filter_9, DispatchPattern=[True, False])  # -> ListA, ListB
# FacadeSubFaces: types, counting
reference_by_layer_7 = ReferenceByLayer(LayerName=dispatch_6.ListA, DisableAutoUpdate=False, ignoreCase=False)  # -> flatten(Geometry)
# Blocks (Fegelelements): types, counting
reference_by_layer_8 = ReferenceByLayer(LayerName=dispatch_6.ListB, DisableAutoUpdate=False, ignoreCase=False)  # -> flatten(Geometry)
get_user_value_6 = GetUserValue(Geometry=reference_by_layer_7, Key="HO_RE-type-by-user")
get_user_value_7 = GetUserValue(Geometry=reference_by_layer_8, Key="HO_RE-type-by-user")
merge_22 = Merge(Data1=reference_by_layer_7, Data2=reference_by_layer_8)
create_set_3 = CreateSet(List=get_user_value_6)  # -> Set, Map
create_set_4 = CreateSet(List=get_user_value_7)  # -> Set, Map

# ----
# Display Color by type
gh_re_type_by_user_2 = RemoteReceiver(gh_re_type_by_user)
create_set_5 = CreateSet(List=flatten(gh_re_type_by_user_2))  # -> Set, graft(Map)
list_length_10 = ListLength(List=create_set_5.Set)  # -> expr("x+1", Length)
gradient = Gradient(
    LowerLimit=0,
    UpperLimit=list_length_10,
    Parameter=create_set_5.Map,
    stops=[0: RGB(243, 57, 0), 0.1: RGB(236, 27, 60), 0.2: RGB(210, 0, 118), 0.3: RGB(103, 0, 120), 0.4: RGB(39, 72, 161), 0.5: RGB(1, 192, 229), 0.6: RGB(18, 178, 90), 0.7: RGB(79, 186, 8), 0.8: RGB(220, 237, 32), 0.9: RGB(247, 159, 20)])
smaller_than_2 = SmallerThan(FirstNumber=create_set_5.Map, SecondNumber=0)  # -> SmallerThan, OrEqualTo
input_type_color_opacity_2 = RemoteReceiver(input_type_color_opacity)
split_argb = SplitARGB(Colour=gradient)  # -> Alpha, Red, Green, Blue
colour_rgb_f = ColourRGBF(Alpha=input_type_color_opacity_2, Red=split_argb.Red, Green=split_argb.Green, Blue=split_argb.Blue)
pick_n_choose_2 = PickNChoose(Pattern=smaller_than_2.SmallerThan, Stream0=colour_rgb_f, Stream1=ColourSwatch(SwatchColor=RGB(0, 0, 0)))
gh_base_surfaces_2 = RemoteReceiver(gh_base_surfaces)
custom_preview_6 = CustomPreview(Geometry=gh_base_surfaces_2, Material=pick_n_choose_2)  # disabled

create_tree_3 = CreateTree(Data=create_set_3.Map, Path=create_set_3.Map)
create_tree_4 = CreateTree(Data=create_set_4.Map, Path=create_set_4.Map)
list_length_11 = ListLength(List=create_tree_3)  # -> flatten(Length)
list_length_12 = ListLength(List=create_tree_4)  # -> flatten(Length)
merge_23 = Merge(Data1=create_set_3.Set, Data2=create_set_4.Set)
addition_8 = Addition(A=list_length_11, B=0)
create_set_6 = CreateSet(List=merge_23)  # -> Set, Map
panel_96 = Panel(list_length_11)
sort_text_4 = SortText(Keys=create_set_6.Set, Culture=127)  # -> graft(Keys), Values

# ----
# New smallest type - rewrite in python
series = Series(Start=1, Step=1, Count=50)
integer_4 = Integer(flatten(series))
integer_5 = Integer(flatten(sort_text_4.Keys))
set_difference_s = SetDifferenceS(SetA=integer_4, SetB=integer_5)
list_item_14 = ListItem(List=set_difference_s, Index=0, Wrap=True)
panel_97 = Panel(list_item_14)

replace_items = ReplaceItems(List=panel_15, Item=list_item_14, Indices=0, Wrap=False)
gh_fss_re_types_a_z = RemoteSender(sort_text_4.Keys)
panel_98 = Panel(create_set_6.Set)
text_5 = Text(simplify(sort_text_4.Keys))
text_6 = Text(create_set_3.Set)
text_7 = Text(addition_8)
text_8 = Text(create_set_4.Set)
text_9 = Text(list_length_12)
key_value_search = KeyValueSearch(Keys=text_6, Values=text_7, Search=text_5)
key_value_search_2 = KeyValueSearch(Keys=text_8, Values=text_9, Search=text_5)
list_length_13 = ListLength(List=flatten(sort_text_4.Keys))
addition_9 = Addition(A=key_value_search, B=0)
addition_10 = Addition(A=key_value_search_2, B=0)
gh_total_number_of_types = RemoteSender(list_length_13)
gzconduit = CSharpScript(
    geo=gh_base_surfaces_2,
    colors=pick_n_choose_2,
    Reference=["C:\Program Files\Rhino 7\Plug-ins\Grasshopper\Components\ScriptComponents.gha", "C:\Program Files\NoDoubts\Godzilla\System\Godzilla.dll", "C:\Program Files\NoDoubts\Godzilla\System\RhGodzilla.rhp"])  # -> out; inputs geo: tree, colors: tree of Color, widths: tree of Int32
# ---------- gzconduit: C# ----------
//    var gzPlugin = Rhino.RhinoApp.GetPlugInObject("RhGodzilla");
//    var gz = RhGodzilla.RhGodzillaPlugin.Instance as RhGodzilla.RhGodzillaPlugin;
//    var conduit = gz.GhConduit;
    var conduit = RhGodzilla.GhAppConduit.Instance;
    conduit.SetGeoAndData(geo, colors, widths);
    conduit.Enabled = true;
# ---------- end gzconduit ----------
panel_99 = Panel(addition_9)
addition_11 = Addition(A=addition_9, B=addition_10)
mass_addition_6 = MassAddition(Input=flatten(addition_10))  # -> Result, PartialResults
mass_addition_7 = MassAddition(Input=flatten(addition_9))  # -> Result, PartialResults
merge_24 = Merge(Data1=text_5, Data2=addition_9, Data3=addition_10, Data4=addition_11)
gh_total_re_count = RemoteSender(mass_addition_6.Result)
gh_total_fsf_count = RemoteSender(mass_addition_7.Result)
gh_total_number_of_types_2 = RemoteReceiver(gh_total_number_of_types)
flip_matrix_2 = FlipMatrix(Data=merge_24)
explode_tree = ExplodeTree(Data=flip_matrix_2)  # -> Branch0, Branch1, Branch2, Branch3
duplicate_data_3 = DuplicateData(Data="s", Number=gh_total_number_of_types_2, Order=True)
entwine_10 = Entwine(
    Branch00=explode_tree.Branch0,
    Branch01=explode_tree.Branch1,
    Branch02=explode_tree.Branch2,
    Branch03=explode_tree.Branch3,
    FlattenInputs=True)  # -> simplify(Result)
gh_stats_for_hui = RemoteSender(entwine_10)

gh_total_number_of_types_3 = RemoteReceiver(gh_total_number_of_types)
duplicate_data_4 = DuplicateData(Data=Toggle(True), Number1=expr("x+1", gh_total_number_of_types_3), Order=True)  # -> simplify(Data)
gh_stats_for_hui_2 = RemoteReceiver(gh_stats_for_hui)
gh_stats_for_hui_3 = RemoteReceiver(gh_stats_for_hui)
gh_fss_re_types_a_z_2 = RemoteReceiver(gh_fss_re_types_a_z)
merge_25 = Merge(Data1=flatten(duplicate_data_4), Data2=flatten(Toggle(False)))
set_button = SetButton(ButtonToModify=create_button_24, ButtonName=gh_stats_for_hui_2)
gh_total_fsf_count_2 = RemoteReceiver(gh_total_fsf_count)
gh_total_re_count_2 = RemoteReceiver(gh_total_re_count)
panel_100 = Panel(gh_stats_for_hui_2)
duplicate_data_5 = DuplicateData(Data=merge_25, Number=graft(panel_91), Order=True)  # -> simplify(Data)
addition_12 = Addition(A=gh_total_fsf_count_2, B=gh_total_re_count_2)
list_item_15 = ListItem(List=flatten(gh_fss_re_types_a_z_2), Index=modulus, Wrap=invert(True))
stream_filter_10 = StreamFilter(Gate=round.Floor, Stream0=merge_22, Stream1=reference_by_layer_7, Stream2=reference_by_layer_8, Stream3=merge_22)
merge_26 = Merge(Data2=gh_total_fsf_count_2, Data4=gh_total_re_count_2, Data6=addition_12)
gh_stats_for_hui_4 = RemoteReceiver(gh_stats_for_hui)
gh_total_number_of_types_4 = RemoteReceiver(gh_total_number_of_types)
filter_by_user_attributes_3 = FilterByUserAttributes(Attributes=stream_filter_10, Key="HO_RE-type-by-user", Val=list_item_15)  # -> Objects, Key, Val
set_textblock_contents_3 = SetTextBlockContents(TextBlockToModify=create_button_24, NewTextBlockContents=gh_stats_for_hui_4)  # disabled
guid_4 = Guid(filter_by_user_attributes_3.Objects)
hide_show_element_20 = HideShowElement(ElementToHideShow=merge_16, Show=duplicate_data_5, Collapse=True, Disable=False)
list_length_14 = ListLength(List=guid_4)
set_textblock_contents_4 = SetTextBlockContents(TextBlockToModify=create_text_block_17, NewTextBlockContents=gh_total_number_of_types_4)
set_button_2 = SetButton(ButtonToModify=create_button_27, ButtonName=graft(merge_26))
select_by_guid_2 = SelectByGUID(
    guids=guid_4,
    select_now=list_length_14,
    Reference=["C:\Program Files\Rhino 7\Plug-ins\Grasshopper\Components\ScriptComponents.gha", "C:\Program Files\NoDoubts\Godzilla\System\Godzilla.dll", "C:\Program Files\NoDoubts\Godzilla\System\RhGodzilla.rhp"])  # -> out, A; inputs guids: list of Guid, select_now: Boolean; same code as select_by_guid

# ----
# Axes
# Horizontal
# Planes
# Vertical
# Selecting Right axes
# to mirror them
# Points
# BasePlanes
panel_101 = Panel(entwine_10)

# ----
# Status
panel_102 = Panel("Status")
create_text_block_19 = CreateTextBlock(Text=panel_102, TextSize=12, Justification=0)
create_label_42 = CreateLabel(LabelText="Sorry, I can use spacings with sum more than 100 for now", LabelSize=12, Justification=0)
create_label_43 = CreateLabel(LabelText="Ups! Text detected. Lines marked by ❌ will be skipped.", LabelSize=12, Justification=0)  # disabled
colour_swatch_8 = ColourSwatch(SwatchColor=RGB(0, 0, 0))
adjust_element_appearance_9 = AdjustElementAppearance(ElementsToAdjust=create_label_42, Foreground=colour_swatch_8, Background=ColourSwatch(SwatchColor=RGBA(255, 64, 64, 70)))
set_label_contents_4 = SetLabelContents(LabelToModify=create_label_43)
hide_show_element_21 = HideShowElement(ElementToHideShow=create_label_43, Show=True, Collapse=True, Disable=False)
adjust_element_appearance_10 = AdjustElementAppearance(
    ElementsToAdjust=create_label_43,
    Foreground=colour_swatch_8,
    Background=ColourSwatch(SwatchColor=RGBA(255, 188, 3, 70)),
    FontSize=12)
adjust_element_positioning_21 = AdjustElementPositioning(ElementsToAdjust=[create_label_42, create_label_43], Margin="5,5,5,5", AbsolutePositioning=False, Height=30)
merge_27 = Merge(Data1=create_text_block_19, Data2=create_label_42, Data3=create_label_43)
messages = Data(merge_27)

# ----
# Horizontal spacings
# Use Elevations or Spacings?
panel_103 = Panel("   Horizontal (x)        ")
reset_button = Panel("⌫")
create_label_44 = CreateLabel(LabelText=panel_103, LabelSize=12, Justification=0)
create_button_28 = CreateButton(ButtonName=reset_button, ButtonStyle=0)
create_text_box_14 = CreateTextBox(UpdateButton=False, showLabel=True)
panel_104 = Panel("""You can type:
1 (2+3)*4 5 6""")
create_wrappanel_20 = CreateWrapPanel(UIElements=flatten([create_label_44, create_button_28]), Horizontal=True)  # -> flatten(WrapPanel)
value_listener_65 = ValueListener(Elements=create_button_28, SomeProperty=True)  # -> Values, Indices
enable_disable_object_4 = EnableDisableObject(Enabled=invert(value_listener_65.Values))
value_listener_66 = ValueListener(Elements=create_text_box_14, SomeProperty=True)  # -> Values, Indices

# ----
# SPLIT FACADE FACES
input_horizontal_spacings = RemoteSender(value_listener_66.Values)

# ---- group: To be able to type in several values in one field
text_split_2 = TextSplit(Text=value_listener_66.Values)

# ----
input_horizontal_spacings_2 = RemoteReceiver(input_horizontal_spacings)

# ----
# Vertical spacings
panel_105 = Panel("      Vertical (y)             ")
reset_button_2 = Panel("⌫")
create_button_29 = CreateButton(ButtonName=reset_button_2, ButtonStyle=0)
create_label_45 = CreateLabel(LabelText=panel_105, LabelSize=12, Justification=0)
create_text_box_15 = CreateTextBox(UpdateButton=False, showLabel=True)
adjust_element_positioning_22 = AdjustElementPositioning(ElementsToAdjust=create_text_box_15, AbsolutePositioning=False, Width=Slider(130, range=0..1000))
create_wrappanel_21 = CreateWrapPanel(UIElements=flatten([create_label_45, create_button_29]), Horizontal=True)  # -> flatten(WrapPanel)
value_listener_67 = ValueListener(Elements=create_button_29, SomeProperty=True)  # -> Values, Indices
enable_disable_object_5 = EnableDisableObject(Enabled=invert(value_listener_67.Values))
value_listener_68 = ValueListener(Elements=create_text_box_15, SomeProperty=True)  # -> Values, Indices
input_vertical_spacings = RemoteSender(value_listener_68.Values)

attach_tooltip_to_element_2 = AttachTooltipToElement(ElementsToAttachTo=[create_button_28, create_button_29], TooltipContent="Clear input", ShowDelay=500, Duration=2000)
attach_tooltip_to_element_3 = AttachTooltipToElement(ElementsToAttachTo=[create_text_box_14, create_text_box_15], TooltipContent=panel_104, ShowDelay=3000, Duration=2000)
adjust_element_positioning_23 = AdjustElementPositioning(ElementsToAdjust=[create_text_box_15, create_text_box_14], AbsolutePositioning=False, Width=Slider(130, range=0..1000))

# ---- group: To be able to type in several values in one field
text_split_3 = TextSplit(Text=value_listener_68.Values)

# ----
# Table: Headers
number_slider_16 = Slider(195, range=0..1000)
entwine_11 = Entwine(Branch00=create_wrappanel_20, Branch01=create_wrappanel_21, FlattenInputs=True)
create_simple_grid_9 = CreateSimpleGrid(UIElements=entwine_11, RowDefinitions="Auto", ColumnDefinitions="Auto")  # -> flatten(SimpleGrid)
adjust_element_positioning_24 = AdjustElementPositioning(ElementsToAdjust=entwine_11, AbsolutePositioning=False, Width=number_slider_16, HorizontalAlignment=1)

input_vertical_spacings_2 = RemoteReceiver(input_vertical_spacings)

# ----
# SELECT  OBJECT TO EDIT
panel_106 = Panel("❌ Cancel ")
panel_107 = Panel("""Top
Persp""")
# Status: what is selected
create_button_30 = CreateButton(ButtonName=panel_106, ButtonStyle=1)
create_button_31 = CreateButton(ButtonName="✓  Apply  ", ButtonStyle=1)
create_rhino_pick_button_2 = CreateRhinoPickButton(
    ButtonName="Edit selected Regelelement",
    Prompt="Please select geometry...",
    AllowMultiple=False,
    AllowNone=True,
    Type=0,
    ButtonStyle=1)
create_label_46 = CreateLabel(LabelText="ObjectView", LabelSize=12, Justification=0)
create_button_32 = CreateButton(ButtonName=panel_107, ButtonStyle=0)
value_listener_69 = ValueListener(Elements=create_button_30, SomeProperty=True)  # -> Values, Indices
value_listener_70 = ValueListener(Elements=create_button_31, SomeProperty=True)  # -> Values, Indices
adjust_element_appearance_11 = AdjustElementAppearance(
    ElementsToAdjust=create_button_31,
    Foreground=ColourSwatch(SwatchColor=RGB(0, 0, 0)),
    Background=ColourSwatch(SwatchColor=RGB(141, 186, 117)))
value_listener_71 = ValueListener(Elements=create_rhino_pick_button_2, SomeProperty=True)  # -> Values, Indices
value_listener_72 = ValueListener(Elements=create_button_32, SomeProperty=True)  # -> Values, Indices
create_label_47 = CreateLabel(LabelText="Edit Element type mode", LabelSize=18, Justification=0)
adjust_element_appearance_12 = AdjustElementAppearance(
    ElementsToAdjust=create_rhino_pick_button_2,
    Foreground=ColourSwatch(SwatchColor=RGB(255, 255, 255)),
    Background=ColourSwatch(SwatchColor=RGB(0, 0, 0)))
adjust_element_appearance_13 = AdjustElementAppearance(
    ElementsToAdjust=create_button_30,
    Foreground=ColourSwatch(SwatchColor=RGB(0, 0, 0)),
    Background=ColourSwatch(SwatchColor=RGBA(255, 66, 66, 128)))
member_index_11 = MemberIndex(Set=flatten(value_listener_72.Values), Member=True)  # -> Index, Count
gate_or_7 = GateOr(A=value_listener_69.Values, B=value_listener_70.Values)
enable_disable_object_6 = EnableDisableObject(Enabled=invert(gate_or_7))
guid_5 = Guid(value_listener_71.Values)
create_wrappanel_22 = CreateWrapPanel(UIElements=[create_label_46, create_button_32], Horizontal=True)  # -> flatten(WrapPanel)
extended_geometry = ExtendedGeometry(guid_5)
input_selectedgeotosplit = RemoteSender(extended_geometry)
panel_108 = Panel(member_index_11.Index)
list_length_15 = ListLength(List=flatten(member_index_11.Index))
objects_by_selection_8 = ObjectsBySelection(Reset=list_length_15, LiveMode=False)
create_wrappanel_23 = CreateWrapPanel(UIElements=[create_label_47, create_button_30, create_button_31], Horizontal=True)  # -> flatten(WrapPanel)
create_wrappanel_24 = CreateWrapPanel(UIElements=create_rhino_pick_button_2, Horizontal=True)
adjust_element_positioning_25 = AdjustElementPositioning(ElementsToAdjust=create_wrappanel_23, Margin="0,5,0,0", AbsolutePositioning=False)
merge_28 = Merge(Data1=create_wrappanel_24, Data2=create_wrappanel_23, Data4=create_label_20, Data5=create_wrappanel_22)  # -> flatten(Result)
select = Data(merge_28)
hui_selectobjecttodivide = Data(select)
apply_7 = Boolean(apply)
stream_filter_11 = StreamFilter(Gate=0, Stream1=hui_selectobjecttodivide)
enable_disable_object_7 = EnableDisableObject(Enabled=invert(apply_7))

input_applyallchanges = RemoteSender(value_listener_70.Values)
list_length_16 = ListLength(List=value_listener_71.Values)
input_cancel = RemoteSender(value_listener_69.Values)
_0 = Addition(A=list_length_16, B=0)
input_view_to_set = RemoteSender(member_index_11.Index)
input_geo_to_orient_view = RemoteSender(objects_by_selection_8)

# ----
# Filter selection
input_selectedgeotosplit_2 = RemoteReceiver(input_selectedgeotosplit)
filter_by_type_5 = FilterByType(Geometry=flatten(input_selectedgeotosplit_2), ObjectType="Block")
clean_tree_3 = CleanTree(RemoveNulls=True, RemoveInvalid=True, RemoveEmpty=False, Tree=filter_by_type_5)  # -> simplify(Tree)
selected_geometry = RemoteSender(clean_tree_3)

list_length_17 = ListLength(List=flatten(clean_tree_3))
addition_13 = Addition(A=list_length_17, B=0)
boolean_8 = Boolean(addition_13)

# ----
# Proceed in the end
remove_seldup_delete = Panel("-_SelLayer \"HO_Preview\" _Delete -_SelLayer \"HO_TempToDel\" _Delete  _SelDup _Delete")
gzcommand_11 = CSharpScript(
    command=remove_seldup_delete,
    runNow=gate_or_7,
    echo=False,
    Reference=["C:\Program Files\Rhino 7\Plug-ins\Grasshopper\Components\ScriptComponents.gha", "C:\Program Files\NoDoubts\Godzilla\System\Godzilla.dll", "C:\Program Files\NoDoubts\Godzilla\System\RhGodzilla.rhp"])  # -> done; inputs command: String, runNow: Boolean, echo: Boolean; same code as gzcommand

hui_isblockselectedtoedit = RemoteSender(boolean_8)

# ----
# SET PANEL MATERIALS
hui_expaner_setpanelmaterials_2 = RemoteReceiver(hui_expaner_setpanelmaterials)
hui_isblockselectedtoedit_2 = RemoteReceiver(hui_isblockselectedtoedit)
stream_filter_12 = StreamFilter(Gate=hui_isblockselectedtoedit_2, Stream1=hui_expaner_setpanelmaterials_2)

# ----
# SET PROFILES
hui_isblockselectedtoedit_3 = RemoteReceiver(hui_isblockselectedtoedit)
stream_filter_13 = StreamFilter(Gate=hui_isblockselectedtoedit_3, Stream1=create_expander_3)

selected_geometry_2 = RemoteReceiver(selected_geometry)

# ----
# Element edit mode overlay
colour_picker = ColourPicker(PickedColour=RGB(181, 47, 47))
get_viewport_boundary_dimensions = GetViewportBoundaryDimensions(Refresh=True, Origin=Point(0, 0, 0), Scale=0.25, xDim=533, yDim=514)
colour_picker_2 = ColourPicker(PickedColour=RGB(65, 177, 224))
horizontal_tiles = HorizontalTiles(
    Boundary=get_viewport_boundary_dimensions,
    RelativeSizes=[1, 1, 1],
    Height=Slider(0.272, range=0..1),
    WidthPadding=0.02,
    HeightPadding=Slider(0.039, range=0..1))
conduit_font = ConduitFont(
    Font="Arial",
    TextHeight=Slider(15, range=0..100),
    AdaptiveHeight=False,
    TextSpacing=1.15,
    Alignment=0,
    Bold=False,
    Italic=False,
    Color=RGB(0, 0, 0))
list_item_16 = ListItem(List=horizontal_tiles, Index=0, Wrap=True)
button_name_branched = Text("Element edit mode is on")
ui_element_edit_mode_color = RemoteSender(colour_picker)
explode = Explode(Curve=get_viewport_boundary_dimensions, Recursive=True)  # -> Segments, Vertices
concatenate_11 = Concatenate(FragmentA="                   ", FragmentB=flatten(button_name_branched))
color = Text(colour_picker)
draw_lines = DrawLines(Lines=explode.Segments, ThicknessOverride=Slider(7, range=0..10), ColorOverride=colour_picker, PixelDepth=1)
draw_text = DrawText(
    Boundary=list_item_16,
    Text=reverse(concatenate_11),
    TextOrdering=1,
    TextDistribution=1,
    ColorOverride=colour_picker,
    OrientVertically=False,
    CustomFont=conduit_font)
draw_text_2 = DrawText(
    Boundary=list_item_16,
    Text="               ⓘ",
    TextOrdering=1,
    TextDistribution=1,
    ColorOverride=reverse(color),
    OrientVertically=False,
    CustomFont=conduit_font)
hui_isblockselectedtoedit_4 = RemoteReceiver(hui_isblockselectedtoedit)
heads_up_display_hud = HeadsUpDisplayHUD(
    ShowHUD=hui_isblockselectedtoedit_4,
    DrawingObjects=[draw_text, draw_text_2, draw_lines],
    DrawingBoundary=get_viewport_boundary_dimensions,
    ConduitStyleSheet="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")

object_attributes = ObjectAttributes(ObjectOrAttributes=selected_geometry_2)  # -> Name, LayerName, LayerFullPath, Color, MaterialName, LinetypeName, GroupIndices, PlotWeight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
key_value_search_3 = KeyValueSearch(Keys=object_attributes.UserDataKeys, Values=object_attributes.UserDataValues, Search=panel_51)
list_item_17 = ListItem(List=key_value_search_3, Index=0, Wrap=True)  # -> Item, Item1
selected_geometry_3 = RemoteReceiver(selected_geometry)
selected_geometry_4 = RemoteReceiver(selected_geometry)
get_user_value_8 = GetUserValue(Geometry=selected_geometry_3, Key="4. BG-Breite")
get_user_value_9 = GetUserValue(Geometry=selected_geometry_4, Key="5. BG-Höhe")
replace_text_11 = ReplaceText(Text=text_split_3, FindY="y", ReplaceY=get_user_value_9, RecursiveReplace=False)
replace_text_12 = ReplaceText(Text=text_split_2, FindX="x", ReplaceX=get_user_value_8, RecursiveReplace=False)
replace_text_13 = ReplaceText(Text=replace_text_11, FindY="Y", ReplaceY=get_user_value_9, RecursiveReplace=False)
# To Do
replace_text_14 = ReplaceText(Text=replace_text_12, FindX="X", ReplaceX=get_user_value_8, RecursiveReplace=False)
integer_6 = Integer(replace_text_14)
clean_tree_4 = CleanTree(RemoveNulls=True, RemoveInvalid=True, RemoveEmpty=True, Tree=integer_6)  # -> simplify(Tree)

# ----
# 3.1 Set View/CPlane
input_geo_to_orient_view_2 = RemoteReceiver(input_geo_to_orient_view)
input_view_to_set_2 = RemoteReceiver(input_view_to_set)
setviewcplane = SetViewAndCplaneToObject(view=input_view_to_set_2)

panel_109 = Panel(replace_text_14)

# ----
# Actual indexes
list_length_18 = ListLength(List=flatten(clean_tree_4))
series_2 = Series(Start=1, Step=1, Count=list_length_18)
tree_statistics = TreeStatistics(Tree=clean_tree_4)  # -> Paths, Length, Count
unflatten_tree = UnflattenTree(Tree=series_2, Guide=clean_tree_4)
deconstruct_path = DeconstructPath(Branch=tree_statistics.Paths)
list_length_19 = ListLength(List=unflatten_tree)  # -> expr("x-1", Length)
dispatch_7 = Dispatch(List=unflatten_tree, DispatchPattern=list_length_19)  # -> ListA, ListB
dispatch_8 = Dispatch(List="-", DispatchPattern=list_length_19)  # -> ListA, ListB
list_item_18 = ListItem(List=dispatch_7.ListA, Index=0, Wrap=True)
list_item_19 = ListItem(List=reverse(dispatch_7.ListA), Index=0, Wrap=True)
text_join_4 = TextJoin(Text=[list_item_18, dispatch_8.ListA, list_item_19])
merge_29 = Merge(Data1=text_join_4, Data2=dispatch_7.ListB)
integer_7 = Integer(merge_29)
null_item = NullItem(Item=integer_7)  # -> NullFlags, InvalidFlags, Description

# ----
# Inserting data from OMG dropdown
relay_5 = Relay()
number = Number(flatten(clean_tree_4))
list_length_20 = ListLength(List=relay_5)  # -> expr("x+0", Length)
relay_6 = Relay()
boolean_9 = Boolean(list_length_20)
insert_items_2 = InsertItems(List=number, Item=relay_5, Indices=relay_6, Wrap=True)
addition_14 = Addition(A=boolean_9, B=0)
stream_filter_14 = StreamFilter(Gate=addition_14, Stream0=number, Stream1=insert_items_2)

# ----
# remove  panels
# from the list
apply_8 = Boolean(apply)  # disabled
gate_or_8 = GateOr(A=invert(value_listener_71.Values), B=apply_8)  # disabled
objects_by_selection_9 = ObjectsBySelection(Reset=gate_or_8, LiveMode=False)  # -> simplify(graft(SelectedGeometry)); disabled
input_selected_re = RemoteSender(objects_by_selection_9)  # disabled
explode_blocks = ExplodeBlocks(BlockObjects=objects_by_selection_9, explodeGeom=True)  # -> Geometry, Attributes, BlockName, BoundingBox, BlockTransform, InsertionPlane, InstanceCount; disabled
selected_geometry_5 = Geometry(objects_by_selection_9)  # disabled
reference_block_by_name = ReferenceBlockByName(BlockName=explode_blocks.BlockName, DisableAutoUpdate=False)  # disabled
list_item_20 = ListItem(List=reference_block_by_name, Index=0, Wrap=True)  # disabled

input_cancel_2 = RemoteReceiver(input_cancel)

# ----
# Lines filled
tree_statistics_2 = TreeStatistics(Tree=simplify(clean_tree_4))  # -> Paths, Length, Count
list_item_21 = ListItem(List=reverse(tree_statistics_2.Paths), Index=0, Wrap=True)
deconstruct_path_2 = DeconstructPath(Branch=list_item_21)  # -> flatten(Indices)
list_item_22 = ListItem(List=deconstruct_path_2, Index=0, Wrap=True)

gzcommand_12 = CSharpScript(
    command=delete_preview_geo,
    runNow=input_cancel_2,
    echo=False,
    Reference=["C:\Program Files\Rhino 7\Plug-ins\Grasshopper\Components\ScriptComponents.gha", "C:\Program Files\NoDoubts\Godzilla\System\Godzilla.dll", "C:\Program Files\NoDoubts\Godzilla\System\RhGodzilla.rhp"])  # -> done; inputs command: String, runNow: Boolean, echo: Boolean; disabled; same code as gzcommand
panel_110 = Panel(deconstruct_path)

# ---- group: Stupid solution
expression = Expression(x=list_item_22, Expression="if(x=0, 1, x+1)")

# ----
# To not freeze because of too small input
number_slider_17 = Slider(100, range=0..1000)
mass_addition_8 = MassAddition(Input=stream_filter_14)  # -> Result, PartialResults
larger_than_2 = LargerThan(FirstNumber=mass_addition_8.Result, SecondNumber=number_slider_17)  # -> LargerThan, OrEqualTo
dispatch_9 = Dispatch(List=stream_filter_14, DispatchPattern=larger_than_2.LargerThan)  # -> ListA, ListB

panel_111 = Panel(list_item_22)

# ----
# Move geometry to
# temporary hidden layer
input_selectedgeotosplit_3 = RemoteReceiver(input_selectedgeotosplit)
get_rhino_attributes_2 = GetRhinoAttributes(Geometry=input_selectedgeotosplit_3, readFullPath=True)  # -> Name, Layer, Color
panel_112 = Panel(get_rhino_attributes_2.Layer)
get_user_attributes_2 = GetUserAttributes(Geometry=input_selectedgeotosplit_3)  # -> Keys, Values, BakeName
stream_filter_15 = StreamFilter(Gate=gate_or_7, Stream0="HO_TempHidden", Stream1=panel_112)
define_object_attributes = DefineObjectAttributes(UserKeys=get_user_attributes_2.Keys, UserValues=get_user_attributes_2.Values, Layer=stream_filter_15)
delete_rhino_geometry2 = DeleteRhinoGeometry2(geo_to_delete=input_selectedgeotosplit_3, delete_now=gate_or_7)  # -> deleted; inputs delete_now: Boolean
# ---------- delete_rhino_geometry2: Python ----------
import Rhino
import Grasshopper
import scriptcontext
scriptcontext.doc = Rhino.RhinoDoc.ActiveDoc
if delete_now == True:
    deleted = scriptcontext.doc.Objects.Delete(geo_to_delete)
    scriptcontext.doc.Views.Redraw()
else:
    deleted = False
scriptcontext.doc = ghdoc
# ---------- end delete_rhino_geometry2 ----------
modify_rhinoobject_attributes = ModifyRhinoObjectAttributes(Geometry=input_selectedgeotosplit_3, Attributes=define_object_attributes, Modify=Toggle(True))

# ---- group: Actual indexes for horiz input
dispatch_10 = Dispatch(List=merge_29, DispatchPattern=null_item.NullFlags)  # -> ListA, flatten(ListB)

# ----
horizontal_spacings = Text(dispatch_9.ListA)
clean_tree_5 = CleanTree(RemoveNulls=True, RemoveInvalid=True, RemoveEmpty=False, Tree=dispatch_9.ListA)
panel_113 = Panel(clean_tree_5)

selected_geometry_6 = RemoteReceiver(selected_geometry)

entwine_12 = Entwine(
    Branch0X=selected_geometry_6,
    Branch1X=input_horizontal_spacings_2,
    Branch2X=free_horiz_space_in_the_start,
    Branch3X=elevations_0_or_spacings_1_3,
    Branch4X=input_vertical_spacings_2,
    Branch5X=free_vert_space_in_the_start,
    Branch6X=highlight,
    Branch7X=apply_6,
    FlattenInputs=False)

# ----
# DIVIDE ELEMENT
divide_element = DivideElement(
    facade_sub_face_to_split=selected_geometry_6,
    horizontal_spacings=input_horizontal_spacings_2,
    free_space_in_the_start=False,
    elevations_0_or_spacings_1=True,
    vertical_spacings_or_elevations=input_vertical_spacings_2,
    free_space_in_the_start_2=False,
    apply=apply_6)  # -> generated_geo, gen_attributes, display_geo, display_colors, display_widths_2, ui_messages_2, create_mullions, info_help
help_2 = Panel(divide_element.info_help)
ui_messages = Text(divide_element.ui_messages_2)
custom_preview_lineweights = CustomPreviewLineweights(
    Geometry=divide_element.display_geo,
    Shader=divide_element.display_colors,
    Thickness=divide_element.display_widths_2,
    Absolute=False)

explode_tree_2 = ExplodeTree(DATAFROMTHECOMPONENT=ui_messages)  # -> simplify(graft(Branch0)), simplify(graft(Branch1))

panel_114 = Panel(explode_tree_2.Branch1)
panel_115 = Panel(divide_element.create_mullions)

input_applyallchanges_2 = RemoteReceiver(input_applyallchanges)
selected_geometry_7 = RemoteReceiver(selected_geometry)

# ----
# CREATE MULLIONS
# AND TRANSOMS
add_mullions_and_transoms = AddMullionsAndTransoms(
    selected_geometry=selected_geometry_7,
    divide_element=divide_element.create_mullions,
    input_applyallchanges=input_applyallchanges_2)  # -> generated_geo, gen_attributes, display_geo, display_colors, display_widths_2, ui_messages_2, info_help
selection_info = RemoteSender(add_mullions_and_transoms.ui_messages_2)
custom_preview_lineweights_2 = CustomPreviewLineweights(
    Geometry=add_mullions_and_transoms.display_geo,
    Shader=add_mullions_and_transoms.display_colors,
    Thickness=add_mullions_and_transoms.display_widths_2,
    Absolute=False)
help_3 = Panel(add_mullions_and_transoms.info_help)

selection_info_2 = RemoteReceiver(selection_info)

# ----
# Cancel / Apply
hui_isblockselectedtoedit_5 = RemoteReceiver(hui_isblockselectedtoedit)
hui_isblockselectedtoedit_6 = RemoteReceiver(hui_isblockselectedtoedit)
hide_show_element_22 = HideShowElement(ElementToHideShow=create_rhino_pick_button_2, Show=invert(hui_isblockselectedtoedit_6), Collapse=True, Disable=False)
set_label_contents_5 = SetLabelContents(LabelToModify=create_label_20, NewLabelContents=selection_info_2)
gzcommand_13 = CSharpScript(
    command="-_Layer _Current \"Manual drawings\"",
    runNow=_0,
    echo=False,
    Reference=["C:\Program Files\Rhino 7\Plug-ins\Grasshopper\Components\ScriptComponents.gha", "C:\Program Files\NoDoubts\Godzilla\System\Godzilla.dll", "C:\Program Files\NoDoubts\Godzilla\System\RhGodzilla.rhp"])  # -> done; inputs command: String, runNow: Boolean, echo: Boolean; disabled; same code as gzcommand
hide_show_element_23 = HideShowElement(
    ElementToHideShow=[create_button_30, create_button_31, create_wrappanel_22, create_label_20, create_label_47],
    Show=hui_isblockselectedtoedit_5,
    Collapse=True,
    Disable=False)

panel_116 = Panel(selection_info_2)

hui_isblockselectedtoedit_7 = RemoteReceiver(hui_isblockselectedtoedit)  # disabled

text_10 = Text(ui_messages)
explode_tree_3 = ExplodeTree(Data=text_10)  # -> Branch0, Branch1, Branch2
panel_117 = Panel(explode_tree_3.Branch2)
set_textblock_contents_5 = SetTextBlockContents(TextBlockToModify=create_text_block_19, NewTextBlockContents=explode_tree_3.Branch2)

list_item_23 = ListItem(List=replace_items, Index=member_index_9.Index, Wrap=True)

stream_filter_16 = StreamFilter(Gate=value_listener_22.Values, Stream0=list_item_23, Stream1=value_listener_24.Values)

insert_items_3 = InsertItems(List=reverse(get_user_attributes.Values), Item=stream_filter_16, Indices="0", Wrap=True)  # -> reverse(simplify(List))
define_object_attributes_2 = DefineObjectAttributes(UserKeys=insert_items, UserValues=insert_items_3, Name=get_rhino_attributes.Name, Layer=get_rhino_attributes.Layer)
panel_118 = Panel(insert_items_3)
modify_rhinoobject_attributes_2 = ModifyRhinoObjectAttributes(Geometry=graft_tree, Attributes=define_object_attributes_2, Modify=mass_addition_4.Result)

panel_119 = Panel("You turned all FacadeSubfaces into Regelelement blocks. Congratulations.")
project_number_of_facadesubfaces_2 = RemoteReceiver(project_number_of_facadesubfaces)
hui_selectgeotoblock_2 = RemoteReceiver(hui_selectgeotoblock)
create_text_block_20 = CreateTextBlock(Text=panel_119, TextSize=12, Justification=0)
merge_30 = Merge(Data1=create_expander_2, Data2=hui_selectgeotoblock_2, Data3=separator_2)
boolean_10 = Boolean(project_number_of_facadesubfaces_2)
concatenate_12 = Concatenate(FragmentA="Create RegelElements", FragmentB=" (", FragmentC=project_number_of_facadesubfaces_2, FragmentD=" to proceed)")
create_expander_6 = CreateExpander(UIElements=merge_30, Header="Create RegelElements", Open=boolean_10)  # -> flatten(Expander)
create_expander_7 = CreateExpander(UIElements=create_text_block_20, Header="Create RegelElements    ✓ completed", Open=False)  # -> flatten(Expander)
set_expander_2 = SetExpander(Expander=create_expander_6, Name=concatenate_12, ExpandedOpen=project_number_of_facadesubfaces_2)
hide_show_element_24 = HideShowElement(ElementToHideShow=create_expander_7, Show=invert(boolean_10), Collapse=True, Disable=False)

hide_show_element_25 = HideShowElement(ElementToHideShow=create_expander_6, Show=boolean_10, Collapse=True, Disable=False)
merge_31 = Merge(Data1=create_expander_6, Data2=create_expander_7)

hui_all_create_re_ui = RemoteSender(merge_31)

# ----
# GETTING  PATHS  &  SETTINGS
# Go to clicked step
document_info = DocumentInfo(AutoUpdate=False, Recursive=False)  # -> DocumentName, DocumentFilePath, Components, Params, _3rdPartyAssemblies
gh_app_paths = GHAppPaths_2(gh_doc_path=document_info.DocumentFilePath, gh_depth=3)  # -> gh_app_dir, module_dir, gh_local_dir, user_settings_path, gh_depth_2
db_paths = DBPaths(gh_doc_path=document_info.DocumentFilePath, gh_depth=gh_app_paths.gh_depth_2)  # -> db_path, project_path, json_path
project_jsonpath = RemoteSender(db_paths.json_path)
app_dbpath = RemoteSender(db_paths.db_path)
adjust_element_positioning_26 = AdjustElementPositioning(ElementsToAdjust=create_button_19, Margin="0", AbsolutePositioning=False, Height=32)
steps = Data(create_wrappanel_14)

app_dbpath_2 = RemoteReceiver(app_dbpath)  # disabled
ghpython_script = GhPythonScript(db_path=app_dbpath_2)  # -> out, projects; disabled
# ---------- ghpython_script: Python ----------
__author__ = "Yury Nasonov"
__version__ = "2020.10.14"

import rhinoscriptsyntax as rs
import os
path= db_path + "\Projects"
root, dirs, files = os.walk(path).next()
projects = dirs
# ---------- end ghpython_script ----------
project_names = Panel(ghpython_script.projects)  # disabled
concatenate_13 = Concatenate(FragmentA="PROJECT: ", FragmentB=project_names)  # disabled
merge_32 = Merge(Data1=flatten(panel_75), Data2=flatten(concatenate_13))  # disabled
create_pulldown_menu_9 = CreatePulldownMenu(ListItems=merge_32, showLabel=True)  # disabled
create_wrappanel_25 = CreateWrapPanel(UIElements=[create_pulldown_menu_9, create_pulldown_menu_8, create_button_22], Horizontal=True)  # disabled
create_expander_8 = CreateExpander(UIElements=create_wrappanel_25, Header=panel_78, Open=True)  # -> flatten(Expander); disabled
stream_filter_17 = StreamFilter(Gate=hui_isblockselectedtoedit_7, Stream1=create_expander_8)  # disabled
hui_recipiesexpander = RemoteSender(stream_filter_17)

panel_120 = Panel(document_info.DocumentFilePath)
grasshopper_file_path_gh = RemoteSender(document_info.DocumentFilePath)
panel_121 = Panel(db_paths.json_path)

# ----
# User settings
user_settings = UserSettings(user_path=gh_app_paths.gh_local_dir)  # -> db_path, ui_window_height, user_name, status

app_user_name = RemoteSender(user_settings.user_name)

# ----
# SUBMIT A BUG
# Dangerous thing-
# could override current gh file
grasshopper_file_path_gh_2 = RemoteReceiver(grasshopper_file_path_gh)  # disabled
input_bug_modulename_2 = RemoteReceiver(input_bug_modulename)  # disabled
input_bug_description_2 = RemoteReceiver(input_bug_description)  # disabled
input_submitbug_2 = RemoteReceiver(input_submitbug)  # disabled
input_bugpriority_2 = RemoteReceiver(input_bugpriority)  # disabled
input_bugtype_2 = RemoteReceiver(input_bugtype)  # disabled
app_dbpath_3 = RemoteReceiver(app_dbpath)  # disabled

app_user_name_2 = RemoteReceiver(app_user_name)
addkvtojson = AddKeyValueToJSON(json_path=panel_67, key="user_name", value=app_user_name_2, write_now=button_2)  # -> out; inputs write_now: Boolean
# ---------- addkvtojson: Python ----------
# Adds key-value pair to json file

__author__ = "Yury Nasonov"
__version__ = "1"

ghenv.Component.Name = "Add key-value to JSON"
ghenv.Component.NickName = 'AddKVtoJSON'
ghenv.Component.Message = 'Add key-value to JSON'

# ———————————————————————————————————————————————————————————

import rhinoscriptsyntax as rs
import json

# ———————————————————————————————————————————————————————————
if write_now:
    with open(json_path, 'w') as f:
        data = json.load(f)
        data[key] = value # <--- add `id` value.
        f.seek(0)        # <--- should reset file position to the beginning.
        json.dump(data, f, indent=4, ensure_ascii=True)
        f.truncate()     # remove remaining part
        f.close()
# ---------- end addkvtojson ----------
addkvtojson_2 = AddKeyValueToJSON(json_path=panel_67, key="user_name", value=app_user_name_2, write_now=button_2)  # -> out; inputs write_now: Boolean
# ---------- addkvtojson_2: Python ----------
# Adds key-value pair to json file

__author__ = "Yury Nasonov"
__version__ = "1"

ghenv.Component.Name = "Add key-value to JSON"
ghenv.Component.NickName = 'AddKVtoJSON'
ghenv.Component.Message = 'Add key-value to JSON'

# ———————————————————————————————————————————————————————————

import rhinoscriptsyntax as rs
import json

# ———————————————————————————————————————————————————————————
f = open(json_path, "w")
f.write("qwertyui!")
f.close()
if write_now:
    with open(json_path, 'w') as f:
        data = json.load(f)
        data[key] = value # <--- add `id` value.
        f.seek(0)        # <--- should reset file position to the beginning.
        json.dump(data, f, indent=4, ensure_ascii=True)
        f.truncate()     # remove remaining part
        f.close()
# ---------- end addkvtojson_2 ----------
panel_122 = Panel(addkvtojson)
hui_recipiesexpander_2 = RemoteReceiver(hui_recipiesexpander)

# ----
# Steps and paths for them
panel_123 = Panel("\Gh-Steps")
concatenate_14 = Concatenate(FragmentA=gh_app_paths.gh_app_dir, FragmentB=panel_123)
replace_text_15 = ReplaceText(Text=concatenate_14, Find="\", Replace="/", RecursiveReplace=False)
ghpython_script_2 = GhPythonScript(path=replace_text_15)  # -> out, folders
# ---------- ghpython_script_2: Python ----------
__author__ = "Yury Nasonov"
__version__ = "2020.10.14"

import rhinoscriptsyntax as rs
import os

root, dirs, files = os.walk(path).next()
folders = dirs
# ---------- end ghpython_script_2 ----------

# ---- group: To make ☰ not the last but the first
shift_list = ShiftList(List=ghpython_script_2.folders, Shift=-1, Wrap=True)

# ----
step_names = Text(shift_list)
step_names_2 = Text(step_names)
concatenate_15 = Concatenate(
    Text_before="!_NoEcho _SelNone -_GrasshopperPlayer \"",
    FOLDER_PATH=gh_app_paths.gh_app_dir,
    A="\Gh-Steps\",
    GH_DEF_PATH=step_names_2,
    C="\",
    B=step_names_2,
    Text_after=".gh\" Editor Hide Enter Echo")  # -> graft(Result)

colour_picker_3 = ColourPicker(PickedColour=RGB(158, 150, 150))
ui_element_edit_mode_color_2 = RemoteReceiver(ui_element_edit_mode_color)

# ----
# HELP WINDOW
document_info_2 = DocumentInfo(AutoUpdate=invert(False), Recursive=False)  # -> DocumentName, DocumentFilePath, Components, Params, _3rdPartyAssemblies; disabled
number_slider_18 = Slider(1, range=0..10)  # disabled
gh_app_paths_2 = GHAppPaths(gh_doc_path=document_info_2.DocumentFilePath, gh_depth=number_slider_18)  # -> gh_app_dir, module_dir, gh_local_dir, user_settings_path; disabled
relay_7 = Relay()  # disabled
replace_text_16 = ReplaceText(Find="\", Replace="/", RecursiveReplace=False)  # disabled
panel_124 = Panel("file:///")  # disabled
panel_125 = Panel("-help.html")  # disabled
number_slider_19 = Slider(1000, range=0..10000)  # disabled
concatenate_16 = Concatenate(FragmentC=panel_124, FragmentA=replace_text_16, FragmentE="/", FragmentB=relay_7, FragmentD=panel_125)  # disabled
create_browser_2 = CreateBrowser(URL=concatenate_16, Height=number_slider_19)  # disabled
launch_window_4 = LaunchWindow(Help="Help: Building", Width=424, Height=700, ChildStatus=1, EnableHorizScroll=False)  # disabled
adjust_element_positioning_27 = AdjustElementPositioning(ElementsToAdjust=create_browser_2, Margin="-10,-10,-11,0", AbsolutePositioning=False, Width=424)  # disabled
add_elements_4 = AddElements(Window=launch_window_4, Elements=flatten(create_browser_2), DoVLChecking=True)  # -> AddedElements, ElementNames; disabled
set_window_properties_2 = SetWindowProperties(Window=launch_window_4, StartingLocation=Point(424, 0, 0), ShowTitleBar=True, ScaleFactor=1)  # disabled

# ----
# Writing configurator step
member_index_12 = MemberIndex(Set=value_listener_48.Values, Member=True)  # -> Index, Count
step_names_3 = Text(gz_menu.names)

merge_33 = Merge(Data1=member_index_12.Index)

list_item_24 = ListItem(List=flatten(gz_menu.resources), Index=merge_33, Wrap=True)
list_item_25 = ListItem(List=flatten(step_names_3), Index=merge_33, Wrap=invert(True))
text_length = TextLength(Text=list_item_24)
addition_15 = Addition(A=text_length, B=0)
clicked_step = Text(list_item_25)
boolean_11 = Boolean(addition_15)
python = PythonScript(key="HO_CurrentStep", value=clicked_step, writeNow=boolean_11)  # -> value; inputs writeNow: Boolean; same code as python

addition_16 = Addition(A=python, B=0)
opengh = CSharpScript(
    resName=list_item_24,
    run=addition_16,
    Reference=["C:\Program Files\Rhino 7\Plug-ins\Grasshopper\Components\ScriptComponents.gha", "C:\Program Files\NoDoubts\Godzilla\System\Godzilla.dll", "C:\Program Files\NoDoubts\Godzilla\System\RhGodzilla.rhp"])  # inputs resName: String, run: Boolean
# ---------- opengh: C# ----------
    if (run == true){
          RhGodzilla.GhApp.GhDefManager.Instance.OpenGetGhDefinition(resName, true);
    }
# ---------- end opengh ----------

# ----
# MAIN WINDOW
all_ui_for_single_type_settings = Data()  # disabled
hui_all_re_types_ui_2 = RemoteReceiver(hui_all_re_types_ui)
hui_all_create_re_ui_2 = RemoteReceiver(hui_all_create_re_ui)
launch_window_5 = LaunchWindow(
    Show=True,
    Name="Hölsher App: Element confugurator",
    Width=424,
    Height=user_settings.ui_window_height,
    ChildStatus=1,
    EnableHorizScroll=False)
set_window_properties_3 = SetWindowProperties(Window=launch_window_5, StartingLocation=Point(0, 0, 0), ShowTitleBar=True, ScaleFactor=1)

hui_show_submit_bug_window_2 = RemoteReceiver(hui_show_submit_bug_window)
launch_window_6 = LaunchWindow(
    Show=hui_show_submit_bug_window_2,
    SubmitABug="Submit a bug",
    Width=424,
    Height=700,
    ChildStatus=1,
    EnableHorizScroll=False)
make_child_window_2 = MakeChildWindow(ParentWindow=launch_window_5, ChildWindow=launch_window_6)
add_elements_5 = AddElements(Window=launch_window_6, Elements=flatten(merge_11), DoVLChecking=True)  # -> AddedElements, ElementNames
set_window_properties_4 = SetWindowProperties(Window=launch_window_6, StartingLocation=Point(0, 30, 0), ShowTitleBar=True, ScaleFactor=1)

make_child_window_3 = MakeChildWindow(ParentWindow=launch_window_5, ChildWindow=launch_window_4)  # disabled

integer_8 = Integer(replace_text_13)
clean_tree_6 = CleanTree(RemoveNulls=True, RemoveInvalid=True, RemoveEmpty=True, Tree=integer_8)  # -> simplify(Tree)
number_2 = Number(flatten(clean_tree_6))

panel_126 = Panel(integer_8)

# ----
# To not freeze because of too small input
stream_gate = StreamGate(Stream=number_2, Gate=elevations_0_or_spacings_1_2)  # -> Target0, Target1
mass_addition_9 = MassAddition(Input=stream_gate.Target1)  # -> Result, PartialResults
larger_than_3 = LargerThan(FirstNumber=mass_addition_9.Result, SecondNumber=Slider(100, range=0..1000))  # -> LargerThan, OrEqualTo
dispatch_11 = Dispatch(List=stream_gate.Target1, DispatchPattern=larger_than_3.LargerThan)  # -> ListA, ListB
elevations_0_or_spacings_1_4 = Boolean(elevations_0_or_spacings_1)
stream_filter_18 = StreamFilter(Gate=elevations_0_or_spacings_1_4, Stream0=stream_gate.Target0, Stream1=dispatch_11.ListA)

boolean_12 = Boolean(invert([larger_than_2.LargerThan, larger_than_3.LargerThan]))
mass_addition_10 = MassAddition(Input=boolean_12)  # -> Result, PartialResults
addition_17 = Addition(A=mass_addition_10.Result, B=0)
gate_and_5 = GateAnd(A=mass_addition_8.Result, B=addition_17)
hide_show_element_26 = HideShowElement(ElementToHideShow=create_label_42, Show=gate_and_5, Collapse=True, Disable=False)

mass_addition_11 = MassAddition(Input=stream_filter_18)  # -> Result, PartialResults

vertical_spacings_or_elevations = Text(stream_filter_18)

# ----
# Actual indexes
list_length_21 = ListLength(List=flatten(clean_tree_6))
series_3 = Series(Start=1, Step=1, Count=list_length_21)
tree_statistics_3 = TreeStatistics(Tree=clean_tree_6)  # -> Paths, Length, Count
unflatten_tree_2 = UnflattenTree(Tree=series_3, Guide=clean_tree_6)
deconstruct_path_3 = DeconstructPath(Branch=tree_statistics_3.Paths)
list_item_26 = ListItem(List=reverse(tree_statistics_3.Paths), Index=0, Wrap=True)
list_length_22 = ListLength(List=unflatten_tree_2)  # -> expr("x-1", Length)
deconstruct_path_4 = DeconstructPath(Branch=list_item_26)  # -> flatten(Indices)
list_item_27 = ListItem(List=deconstruct_path_4, Index=0, Wrap=True)
dispatch_12 = Dispatch(List=unflatten_tree_2, DispatchPattern=list_length_22)  # -> ListA, ListB
dispatch_13 = Dispatch(List="-", DispatchPattern=list_length_22)  # -> ListA, ListB
list_item_28 = ListItem(List=dispatch_12.ListA, Index=0, Wrap=True)
list_item_29 = ListItem(List=reverse(dispatch_12.ListA), Index=0, Wrap=True)
text_join_5 = TextJoin(Text=[list_item_28, dispatch_13.ListA, list_item_29])
merge_34 = Merge(Data1=text_join_5, Data2=dispatch_12.ListB)
integer_9 = Integer(merge_34)
null_item_2 = NullItem(Item=integer_9)  # -> NullFlags, InvalidFlags, Description

expression_2 = Expression(x=list_item_27, Expression="if(x=0, 1, x+1)")

addition_18 = Addition(A=expression_2, B=0)

addition_19 = Addition(A=expression, B=0)
maximum = Maximum(A=addition_19, B=addition_18)
maximum_2 = Maximum(A=maximum, B=1)
addition_20 = Addition(A=maximum_2, B=Slider(0, range=0..10))

# ---- group: Show field row?
duplicate_data_6 = DuplicateData(Data=True, Number=addition_20, Order=True)
boolean_13 = Boolean(maximum)
merge_35 = Merge(Data1=flatten(duplicate_data_6), Data2=boolean_13, Data3=Toggle(False))

# ----
hide_show_element_27 = HideShowElement(ElementToHideShow=create_text_box_15, Show=merge_35, Collapse=True, Disable=False)

# ---- group: Show number and radiobutton?
duplicate_data_7 = DuplicateData(Data=True, Number=addition_20, Order=True)
merge_36 = Merge(Data1=flatten(duplicate_data_7), Data2=Toggle(False))

# ---- group: Actual indexes for horiz input
dispatch_14 = Dispatch(List=merge_34, DispatchPattern=null_item_2.NullFlags)  # -> ListA, flatten(ListB)

# ----
# Table: fields
panel_127 = Panel("❌")
duplicate_data_8 = DuplicateData(Data=panel_127, Number=100, Order=True)
duplicate_data_9 = DuplicateData(Data="❌", Number=100, Order=True)
replace_items_2 = ReplaceItems(List=flatten(duplicate_data_8), Item=dispatch_10.ListB, Indices=flatten(deconstruct_path), Wrap=False)
replace_items_3 = ReplaceItems(List=flatten(duplicate_data_9), Item=dispatch_14.ListB, Indices=flatten(deconstruct_path_3), Wrap=False)
create_label_48 = CreateLabel(LabelText=flatten(duplicate_data_8), LabelSize=12, Justification=1)
create_label_49 = CreateLabel(LabelText=flatten(duplicate_data_9), LabelSize=12, Justification=1)
adjust_element_positioning_28 = AdjustElementPositioning(ElementsToAdjust=create_label_48, AbsolutePositioning=False, Width=Slider(42, range=0..1000))
set_label_contents_6 = SetLabelContents(LabelToModify=create_label_48, NewLabelContents=replace_items_2)
adjust_element_positioning_29 = AdjustElementPositioning(ElementsToAdjust=create_label_49, AbsolutePositioning=False, Width=Slider(42, range=0..1000))
set_label_contents_7 = SetLabelContents(LabelToModify=create_label_49, NewLabelContents=replace_items_3)
relay_8 = Relay()
entwine_13 = Entwine(
    Branch00=create_label_48,
    Branch01=create_text_box_14,
    Branch02=relay_8,
    Branch03=create_label_49,
    Branch04=create_text_box_15,
    FlattenInputs=True)
create_simple_grid_10 = CreateSimpleGrid(UIElements=entwine_13, RowDefinitions="Auto", ColumnDefinitions="Auto")  # -> flatten(SimpleGrid)
merge_37 = Merge(Data1=create_simple_grid_9, Data2=create_simple_grid_10)

hide_show_element_28 = HideShowElement(ElementToHideShow=create_label_48, Show=merge_36, Collapse=True, Disable=False)
hide_show_element_29 = HideShowElement(ElementToHideShow=create_text_box_14, Show=merge_35, Collapse=True, Disable=False)
hide_show_element_30 = HideShowElement(ElementToHideShow=relay_8, Show=merge_36, Collapse=True, Disable=False)
hide_show_element_31 = HideShowElement(ElementToHideShow=create_label_49, Show=merge_36, Collapse=True, Disable=False)
hide_show_element_32 = HideShowElement(ElementToHideShow=create_text_box_15, Show=merge_35, Collapse=True, Disable=False)

the_whole_table = Data(merge_37)
the_whole_table_2 = Data(the_whole_table)

# ----
# DIVIDE  EXPANDER
elevations_or_spacings = Data()
hidden_superpower = Data()
the_whole_table_3 = Data(the_whole_table)
header_help_2 = Data(header_help)
checking_time = Data()
select_2 = Data(select)
split_button_2 = Data(split_button)
separator_6 = Data(separator_3)
messages_2 = Data(messages)
separator_7 = Data()
merge_38 = Merge(
    Data1=header_help_2,
    Data3=elevations_or_spacings,
    Data4=separator_6,
    Data5=the_whole_table_3,
    Data6=messages_2,
    Data7=hidden_superpower,
    Data8=checking_time,
    Data9=split_button_2,
    Data10=separator_7)
hui_isblockselectedtoedit_8 = RemoteReceiver(hui_isblockselectedtoedit)
create_expander_9 = CreateExpander(UIElements=merge_38, Header="Divide: new mullions and transoms", Open=False)  # -> flatten(Expander)
stream_filter_19 = StreamFilter(Gate=hui_isblockselectedtoedit_8, Stream1=create_expander_9)

adjust_element_appearance_14 = AdjustElementAppearance(
    ElementsToAdjust=[create_expander_3, create_expander_9, create_expander],
    Foreground=ColourSwatch(SwatchColor=RGB(0, 0, 0)),
    Background=colour_picker_3)

hui_selectors_curtainwallmaterialbytype_2 = RemoteReceiver(flatten(hui_selectors_curtainwallmaterialbytype))  # disabled
hui_selectors_wallmaterialbytype_2 = RemoteReceiver(flatten(hui_selectors_wallmaterialbytype))  # disabled
merge_39 = Merge(Data1=hui_recipiesexpander_2, Data2=stream_filter_19)
merge_40 = Merge(Data2=merge_39, Data3=stream_filter_13, Data4=stream_filter_12)
hui_selected_tab_index_5 = RemoteReceiver(hui_selected_tab_index)
panel_128 = Panel("""0
1
2
3""")
entwine_14 = Entwine(
    Branch00=flatten(merge_40),
    Branch02=hui_selectors_wallmaterialbytype_2,
    Branch03=hui_selectors_curtainwallmaterialbytype_2,
    FlattenInputs=True)
equality_6 = Equality(FirstNumber=hui_selected_tab_index_5, SecondNumber=panel_128)  # -> graft(Equality), Inequality
hide_show_element_33 = HideShowElement(Show=equality_6.Equality, Collapse=True, Disable=False)

merge_41 = Merge(Data1=hui_selectobjecttodivide, Data2=flatten(entwine_14))  # -> flatten(Result)
create_expander_10 = CreateExpander(UIElements=merge_41, Header="Edit Regelelement", Open=True)
# Insert blocks:
# default panels
# NOT in 9 branches
# Transform unique
# panels blocks
# OBLECT TYPE
# = Branch to place
#  the index
# Paths to graft
# by data
# Tree according
# to unique RE
# New attributes:
# Element
# Block names
# (what to use)
# PROFILE BLOCKS
# Insert blocks:
# default profiles
# in 14 branches
# Transform
# profile blocks
# Attributes for
# profile blocks
# Layer to bake
# Continue: attributes of new geometry
# Continue: attributes of new geometry
hui_all_edit_re_ui = RemoteSender(create_expander_10)

hui_all_edit_re_ui_2 = RemoteReceiver(hui_all_edit_re_ui)

merge_42 = Merge(
    Data1=steps,
    Data2=hui_all_re_types_ui_2,
    Data3=hui_all_create_re_ui_2,
    Data4=hui_all_edit_re_ui_2,
    Data5=all_ui_for_single_type_settings,
    Data6=create_wrappanel_15)
add_elements_6 = AddElements(Window=launch_window_5, Elements=flatten(merge_42), DoVLChecking=True)  # -> AddedElements, ElementNames

# ----
# Display type
gh_re_type_by_user_3 = RemoteReceiver(gh_re_type_by_user)
gh_base_surfaces_3 = RemoteReceiver(gh_base_surfaces)
null_item_3 = NullItem(Item=gh_re_type_by_user_3)  # -> NullFlags, InvalidFlags, Description
pick_n_choose_3 = PickNChoose(Pattern=null_item_3.NullFlags, Stream0=gh_re_type_by_user_3, Stream1="⚠ NONE")

cluster_3 = Cluster_5(geometry=gh_base_surfaces_3)
area_3 = Area(Geometry=gh_base_surfaces_3)  # -> Area, Centroid
plane_origin = PlaneOrigin(Base=cluster_3, Origin=area_3.Centroid)

text_tag_3d = TextTag3D(
    Location=simplify(plane_origin),
    Text=pick_n_choose_3,
    Size=250,
    Colour=ColourSwatch(SwatchColor=RGB(255, 255, 255)),
    Justification=5)

# ==== cluster GHAppPaths: Gets paths used by app
gh_depth = ClusterInput()  # how many levels inside APP/GH directory is the file placed
gh_doc_path = ClusterInput()  # .gh doc path
text_split = TextSplit(Text=gh_doc_path, Separators="\")
split_list = SplitList(List=reverse(text_split), Index=gh_depth)  # -> ListA, reverse(ListB)
cull_index = CullIndex(List=text_split, Indices=-1, Wrap=True)
ghpython_script = GhPythonScript()  # -> gh_local_dir, user_settings_path
# ---------- ghpython_script: Python ----------
__author__ = "Yury Nasonov"
__version__ = "2020.11.03"

import os.path
home_dir = os.path.expanduser("~")
gh_local_dir = home_dir + "\AppData\Roaming\Hoelsher\GH"
user_settings_path = gh_local_dir + "\UserData\UserSettings.db"
# ---------- end ghpython_script ----------
text_join = TextJoin(Text=split_list.ListB, Join="\")
text_join_2 = TextJoin(Text=cull_index, Join="\")
panel = Panel(text_join)
gh_app_dir = ClusterOutput(text_join)  # gh app dir
module_dir = ClusterOutput(text_join_2)  # module dir
gh_local_dir = ClusterOutput(ghpython_script.gh_local_dir)  # gh_local_dir
user_settings_path = ClusterOutput(ghpython_script.user_settings_path)  # user_settings_path

# ==== cluster DivideElement: Divide element

# ----
# All blocks of
# the same type
clustered = BooleanToggle(True)
explode_tree = ExplodeTree()  # -> Branch0, Branch1, Branch2, Branch3, Branch4, Branch5, Branch6, Branch7, Branch8
merge = Merge(Data1=explode_tree.Branch6, Data2=explode_tree.Branch7)

# ----
# INPUTS
vertical_spacings_or_elevations = ClusterInput()  # Vertical spacings or elevations
elevations_0_or_spacings_1 = ClusterInput()  # Elevations (0) or Spacings (1)?
facade_sub_face_to_split = ClusterInput()  # (FacadeSub)Face to split
free_space_in_the_start = ClusterInput()
free_space_in_the_start_2 = ClusterInput()  # Free space in the End/Start (Vertical flip)
horizontal_spacings = ClusterInput()  # Horizontal spacings
highlight = ClusterInput()  # Highlight#
apply = ClusterInput()  # Apply
stream_filter = StreamFilter(Gate=clustered, Stream0=explode_tree.Branch1, Stream1=horizontal_spacings)
stream_filter_2 = StreamFilter(Gate=clustered, Stream0=explode_tree.Branch2, Stream1=free_space_in_the_start)
stream_filter_3 = StreamFilter(Gate=clustered, Stream0=explode_tree.Branch3, Stream1=elevations_0_or_spacings_1)
stream_filter_4 = StreamFilter(Gate=clustered, Stream0=explode_tree.Branch4, Stream1=vertical_spacings_or_elevations)
stream_filter_5 = StreamFilter(Gate=clustered, Stream0=explode_tree.Branch5, Stream1=free_space_in_the_start_2)
stream_filter_6 = StreamFilter(Gate=clustered, Stream0=merge, Stream1=highlight)
stream_filter_7 = StreamFilter(Gate=clustered, Stream0=explode_tree.Branch8, Stream1=apply)
stream_filter_8 = StreamFilter(Gate=clustered, Stream0=explode_tree.Branch0, Stream1=facade_sub_face_to_split)
apply_2 = Boolean(stream_filter_7)

input_horizontal_spacings = RemoteSender(stream_filter)
input_vertical_spacings = RemoteSender(stream_filter_4)
elevations_0_or_spacings_1_2 = Text(stream_filter_3)
horizontal_flip = Boolean(stream_filter_2)
highlight_2 = Text(stream_filter_6)
vertical_flip = Boolean(stream_filter_5)
panel = Panel("Surface")
gzaddreferences = CSharpScript(
    Run=True,
    Reference=["C:\Program Files\Rhino 7\Plug-ins\Grasshopper\Components\ScriptComponents.gha", "C:\Program Files\NoDoubts\Godzilla\System\Godzilla.dll", "C:\Program Files\NoDoubts\Godzilla\System\RhGodzilla.rhp"])  # -> Done; inputs Run: Boolean
# ---------- gzaddreferences: C# usings ----------
using ScriptComponents;
using System.IO;
# ---------- gzaddreferences: C# ----------
    Done = false;
    if (Run == false) return;
    //get paths
    string rhinoSysDir = RhinoApp.GetExecutableDirectory().FullName;
    string scriptComponentsPath = Path.GetFullPath(Path.Combine(rhinoSysDir, @"..\", @"Plug-ins\Grasshopper\Components\ScriptComponents.gha"));
    if(!File.Exists(scriptComponentsPath))   RhinoApp.WriteLine("Couldn't find library" + scriptComponentsPath);

    //Godzilla directory
    string gzSysDirectory = @"C:\Program Files\NoDoubts\Godzilla\System";

    //get gh components
    var objs = GrasshopperDocument.ActiveObjects();

    //proceed components
    foreach(var obj in objs)
    {
      //if a component is a CS script component
      if(obj.GetType().Name == "Component_CSNET_Script")
      {

        var cscomp = obj as ScriptComponents.Component_CSNET_Script;
        UpdateReferences(cscomp, gzSysDirectory, scriptComponentsPath);
      }
    }

    Done = true;
# ---------- gzaddreferences: C# additional code ----------
  public static void UpdateReferences(ScriptComponents.Component_CSNET_Script csc, string gzSysDirectory, string scriptComponentsPath)
  {
    csc.ScriptSource.References.Clear();
    csc.ScriptSource.References.Add(scriptComponentsPath);//to get access to c# components
    csc.ScriptSource.References.Add(gzSysDirectory + @"\Godzilla.dll");
    csc.ScriptSource.References.Add(gzSysDirectory + @"\RhGodzilla.rhp");
  }

  /// <summary>
  /// This method will be called once every solution, before any calls to RunScript.
  /// </summary>
  public override void BeforeRunScript()
  {

  }
  /// <summary>
  /// This method will be called once every solution, after any calls to RunScript.
  /// </summary>
  public override void AfterRunScript()
  { }
# ---------- end gzaddreferences ----------
filter_by_type = FilterByType(Geometry=flatten(stream_filter_8), ObjectType="Brep")  # -> flatten(Geometry)
panel_2 = Panel(gzaddreferences)
panel_3 = Panel(">::SupportGeo::Window::BaseSrf")

# ----
# GET SELECED BLOCK SIZETYPES
# ADD OTHER
panel_4 = Panel("Block")
filter_by_type_2 = FilterByType(Geometry=flatten(stream_filter_8), ObjectType=panel_4)  # -> flatten(Geometry)
value_list = ValueList({"Point": 0, "Curve": 1, "Arc": 2, "Circle": 3, "Ellipse": 4, "Line": 5, "Polyline": 6, "Surface": 7, "Brep": 8, "Mesh": 9, "Polysurface": 10, "Block": 11, "Text": 12, "TextDot": 13, "Dimension": 14, "LinearDimension": 15, "AngularDimension": 16, "Hatch": 17, "Leader": 18}, selected="Block")
extended_geometry = ExtendedGeometry(filter_by_type_2)
reference_by_type = ReferenceByType(ObjectType=value_list)
get_user_value = GetUserValue(Geometry=extended_geometry, Key="HO_RE-Type")
filter_by_user_attributes = FilterByUserAttributes(Attributes=reference_by_type, Key="HO_RE-Type", Val=get_user_value)  # -> Geometry, Key, Val
get_user_value_2 = GetUserValue(Geometry=extended_geometry, Key="HO_RE-type-by-user")
filter_by_user_attributes_2 = FilterByUserAttributes(Attributes=filter_by_user_attributes.Geometry, Key="HO_RE-type-by-user", Val=get_user_value_2)  # -> Objects, Key, Val
text = Text(filter_by_user_attributes_2.Objects)
text_2 = Text(extended_geometry)
member_index = MemberIndex(Set=text, Member=text_2)  # -> Index, Count
cull_index = CullIndex(List=filter_by_user_attributes_2.Objects, Indices=member_index.Index, Wrap=True)
merge_2 = Merge(Data1=extended_geometry, Data2=cull_index)  # -> flatten(Result)
deconstruct_block = DeconstructBlock(Block=merge_2, recursive=False)  # -> Name, Plane, Geometry
text_3 = Text(flatten(deconstruct_block.Name))
list_length = ListLength(List=merge_2)
create_set = CreateSet(List=text_3)  # -> Set, Map
panel_5 = Panel(list_length)
member_index_2 = MemberIndex(Set=text_3, Member=graft(create_set.Set))  # -> Index, Count
list_item = ListItem(List=member_index_2.Index, Index=0, Wrap=True)  # -> flatten(Item)
list_item_2 = ListItem(List=merge_2, Index=list_item, Wrap=True)  # -> flatten(Item)
gh_blocks_to_work_with = RemoteSender(list_item_2)

filter_by_layer = FilterByLayer(Geometry=deconstruct_block.Geometry, Layer="RE-Base")
curve = Curve(filter_by_layer)
gh_contours_of_all_re_of_selected_type = RemoteSender(curve)
gh_blocks_to_work_with_2 = RemoteReceiver(gh_blocks_to_work_with)
deconstruct_block_2 = DeconstructBlock(Block=simplify(graft(gh_blocks_to_work_with_2)))  # -> Name, Plane, Geometry
filter_by_layer_2 = FilterByLayer(Geometry=deconstruct_block_2.Geometry, Layer=">::SupportGeo::RE-Base")
entwine = Entwine(Branch00=filter_by_layer_2, Branch01=filter_by_type, FlattenInputs=True)
clean_tree = CleanTree(RemoveNulls=True, RemoveInvalid=True, RemoveEmpty=False, Tree=flatten(entwine))  # -> simplify(graft(Tree))
path_mapper = PathMapper(clean_tree, source=["{A}", "{A;B}"], target=["{A}", "{A}"])
selected_geometry = RemoteSender(path_mapper)
selected_geometry_2 = RemoteReceiver(selected_geometry)
panel_6 = Panel("""4. BG-Breite
5. BG-Höhe""")
get_user_value_3 = GetUserValue(Geometry=selected_geometry_2, Key=panel_6)
list_item_3 = ListItem(List=get_user_value_3, Index=0, Wrap=True)  # -> Item, Item1
# PROCEED INPUT
input_horizontal_spacings_2 = RemoteReceiver(input_horizontal_spacings)
input_vertical_spacings_2 = RemoteReceiver(input_vertical_spacings)

# ---- group: To be able to type in several values in one field
text_split = TextSplit(Text=input_horizontal_spacings_2)

# ----
panel_7 = Panel(list_item_3.Item1)

# ---- group: To be able to type in several values in one field
text_split_2 = TextSplit(Text=input_vertical_spacings_2)

# ----
replace_text = ReplaceText(Text=text_split, FindX="x", ReplaceX=list_item_3.Item, RecursiveReplace=False)
text_4 = Text(text_split_2)
panel_8 = Panel(text_split)
replace_text_2 = ReplaceText(Text=replace_text, FindX="X", ReplaceX=list_item_3.Item, RecursiveReplace=False)
flatten_tree = FlattenTree(Tree=text_split_2, Path="{0}")

elevations_0_or_spacings_1_3 = Boolean(False)

integer = Integer(replace_text_2)
text_length = TextLength(Text=flatten_tree)
panel_9 = Panel(text_split_2)
clean_tree_2 = CleanTree(RemoveNulls=True, RemoveInvalid=True, RemoveEmpty=True, Tree=integer)  # -> simplify(Tree)
# To Do
flatten_tree_2 = FlattenTree(Tree=text_split, Path="{0}")
panel_10 = Panel(replace_text_2)
dispatch = Dispatch(List=flatten_tree, DispatchPattern=text_length)  # -> ListA, ListB
text_length_2 = TextLength(Text=flatten_tree_2)
dispatch_2 = Dispatch(List=flatten_tree_2, DispatchPattern=text_length_2)  # -> ListA, ListB
replace_text_3 = ReplaceText(Text=dispatch.ListA, FindY="y", ReplaceY=list_item_3.Item1, RecursiveReplace=False)

# ----
# Actual indexes
list_length_2 = ListLength(List=flatten(clean_tree_2))
series = Series(Start=1, Step=1, Count=list_length_2)
tree_statistics = TreeStatistics(Tree=clean_tree_2)  # -> Paths, Length, Count
unflatten_tree = UnflattenTree(Tree=series, Guide=clean_tree_2)
deconstruct_path = DeconstructPath(Branch=tree_statistics.Paths)
list_length_3 = ListLength(List=unflatten_tree)  # -> expr("x-1", Length)
dispatch_3 = Dispatch(List=unflatten_tree, DispatchPattern=list_length_3)  # -> ListA, ListB
dispatch_4 = Dispatch(List="-", DispatchPattern=list_length_3)  # -> ListA, ListB
list_item_4 = ListItem(List=dispatch_3.ListA, Index=0, Wrap=True)
list_item_5 = ListItem(List=reverse(dispatch_3.ListA), Index=0, Wrap=True)
text_join = TextJoin(Text=[list_item_4, dispatch_4.ListA, list_item_5])
merge_3 = Merge(Data1=text_join, Data2=dispatch_3.ListB)
integer_2 = Integer(merge_3)
null_item = NullItem(Item=integer_2)  # -> NullFlags, InvalidFlags, Description

replace_text_4 = ReplaceText(Text=replace_text_3, FindY="Y", ReplaceY=list_item_3.Item1, RecursiveReplace=False)

# ----
# Inserting data from OMG dropdown
relay = Relay()
number = Number(flatten(clean_tree_2))
list_length_4 = ListLength(List=relay)  # -> expr("x+0", Length)
relay_2 = Relay()
boolean = Boolean(list_length_4)
insert_items = InsertItems(List=number, Item=relay, Indices=relay_2, Wrap=True)
addition = Addition(A=boolean, B=0)
stream_filter_9 = StreamFilter(Gate=addition, Stream0=number, Stream1=insert_items)

replace_text_5 = ReplaceText(Text=dispatch_2.ListA, FindX="x", ReplaceX=list_item_3.Item, RecursiveReplace=False)
replace_text_6 = ReplaceText(Text=replace_text_5, FindX="X", ReplaceX=list_item_3.Item, RecursiveReplace=False)  # -> simplify(Result)

# ----
# Lines filled
tree_statistics_2 = TreeStatistics(Tree=simplify(clean_tree_2))  # -> Paths, Length, Count
list_item_6 = ListItem(List=reverse(tree_statistics_2.Paths), Index=0, Wrap=True)
deconstruct_path_2 = DeconstructPath(Branch=list_item_6)  # -> flatten(Indices)
list_item_7 = ListItem(List=deconstruct_path_2, Index=0, Wrap=True)

integer_3 = Integer(replace_text_6)
poceededinput_horizontal_spacings = RemoteSender(integer_3)
elevations_0_or_spacings_1_4 = Boolean(elevations_0_or_spacings_1_3)

# ---- group: Stupid solution
expression = Expression(x=list_item_7, Expression="if(x=0, 1, x+1)")

# ----
# To not freeze because of too small input
number_slider = Slider(100, range=0..1000)
mass_addition = MassAddition(Input=stream_filter_9)  # -> Result, PartialResults
larger_than = LargerThan(FirstNumber=mass_addition.Result, SecondNumber=number_slider)  # -> LargerThan, OrEqualTo
dispatch_5 = Dispatch(List=stream_filter_9, DispatchPattern=larger_than.LargerThan)  # -> ListA, ListB

panel_11 = Panel(list_item_7)

# ---- group: Actual indexes for horiz input
dispatch_6 = Dispatch(List=merge_3, DispatchPattern=null_item.NullFlags)  # -> ListA, flatten(ListB)

# ----
clean_tree_3 = CleanTree(RemoveNulls=True, RemoveInvalid=True, RemoveEmpty=False, Tree=dispatch_5.ListA)
horizontal_spacings_2 = Text(dispatch_5.ListA)
panel_12 = Panel(clean_tree_3)
poceededinput_horizontal_spacings_2 = RemoteReceiver(poceededinput_horizontal_spacings)

# ---- group: If there is no input, use 1000000 as spacing
list_length_5 = ListLength(List=poceededinput_horizontal_spacings_2)
null_item_2 = NullItem(Item=list_length_5)  # -> NullFlags, InvalidFlags, Description
stream_filter_10 = StreamFilter(Gate=null_item_2.NullFlags, Stream0=poceededinput_horizontal_spacings_2, Stream1="1000000")

# ----
selected_geometry_3 = RemoteReceiver(selected_geometry)
selected_geometry_4 = ExtendedGeometry(selected_geometry_3)
horizontal_spacings_3 = Integer(stream_filter_10)
panel_13 = Panel("""HO_Type
HO_FacadeFaceUID
HO_FacadeSubFaceUID
HO_BasePlane
HO_FacadeSubFaceColumnRowID
HO_Shifts-Vertical
HO_Shifts-Horizontal
HO_Counter_Separators-Vertical
HO_Counter_Separators-Horiz""")

# ----
# GETTING ATTRIBUTES
# OF SELECTED GEOMETRY
panel_14 = Panel("""HO_Type
HO_FacadeFaceUID
HO_FacadeSubFaceUID
HO_BasePlane
HO_FacadeSubFaceColumnRowID
BakeObject Name""")
selected_geometry_5 = ExtendedGeometry(selected_geometry_4)
get_user_value_4 = GetUserValue(Geometry=selected_geometry_5, Key=panel_14)  # -> simplify(Values)
path_mapper_2 = PathMapper(get_user_value_4, source=["{A}", "{A;B}"], target=["{A}", "{path_index}"])
list_item_8 = ListItem(List=path_mapper_2, Index=0, Wrap=invert(True))  # -> Item, Item1, Item2, Item3, Item4, Item5
bakeobject_name = Text(list_item_8.Item5)
ho_facadesubfacecolumnrowid = Text(list_item_8.Item4)
ho_facadesubfaceuid = Text(list_item_8.Item2)
ho_facadefaceuid = Text(list_item_8.Item1)
ho_baseplane = Text(list_item_8.Item3)
ho_type = Text(list_item_8.Item)
bakeobject_name_2 = Text(bakeobject_name)
ho_facadesubfaceuid_2 = Text(ho_facadesubfaceuid)
text_split_3 = TextSplit(Text=bakeobject_name_2, Separators="_")
ho_type_2 = Text(ho_type)
expression_2 = Expression(x=ho_type_2, Expression="if(x=\"FacadeFace\",0,if(x=\"FacadeSubFace\",1,-1))")
path_mapper_3 = PathMapper(text_split_3, source=["{A}", "{A;B}"], target=["{A}", "{A}"])
list_item_9 = ListItem(List=path_mapper_3, Index=0, Wrap=False)  # -> Item, Item1, Item2, Item3, Item4
text_5 = Text(list_item_9.Item4)
text_join_2 = TextJoin(Text=[list_item_9.Item, list_item_9.Item1, list_item_9.Item2], Join="_")  # -> simplify(Result)
bakeobject_name_3 = Text(text_join_2)
face_0_subfcace_1_else_1 = Text(expression_2)
ho_facadesubfaceuid_3 = Text(ho_facadesubfaceuid)
ho_facadefaceuid_2 = Text(ho_facadefaceuid)
pick_n_choose = PickNChoose(Pattern=face_0_subfcace_1_else_1, Stream0=ho_facadefaceuid_2, Stream1=ho_facadesubfaceuid_3)  # -> simplify(Result)
path_mapper_4 = PathMapper(pick_n_choose, source=["{A}", "{A;B;C;D}"], target=["{A}", "{A}"])
selected_face_uid_or_subface_uid = Text(path_mapper_4)

# ----
# Getting plane info
# from attributes
ho_baseplane_2 = Text(ho_baseplane)  # disabled
text_split_4 = TextSplit(Text=ho_baseplane_2, Separators="/")  # disabled
list_item_10 = ListItem(List=text_split_4, Index=0, Wrap=True)  # -> Item, Item1, Item2; disabled
construct_plane = ConstructPlane(Origin=list_item_10.Item, XAxis=list_item_10.Item1, YAxis=list_item_10.Item2)  # -> simplify(Plane); disabled
path_mapper_5 = PathMapper(
    construct_plane,
    source=["{A}", "{A;B}", "{A;B;C}", "{A;B;C;D}", "{A;B;C;D;E}"],
    target=["{A}", "{path_index}", "{path_index}", "{path_index}", "{path_index}"])  # disabled
plane_from_attribures = Plane(path_mapper_5)  # disabled

python = PythonScript(key="HO_Counter_FacadeFace")  # -> value; inputs writeNow: Boolean
# ---------- python: Python ----------
import rhinoscriptsyntax as rs
import scriptcontext as sc
import Rhino

sc.doc = Rhino.RhinoDoc.ActiveDoc

if writeNow == True:
  value = rs.SetDocumentUserText(key,value)
  a=1
else:
  a=0

sc.doc = ghdoc

print value
# ---------- end python ----------

# ----
# Message if The face is not planar
# Text is not clear
selected_geometry_6 = ExtendedGeometry(selected_geometry_4)
is_planar = IsPlanar(Surface=selected_geometry_6, Interior=True)  # -> Planar, Plane
boolean_2 = Boolean(invert(is_planar.Planar))
selected_geometry_7 = ExtendedGeometry(selected_geometry_4)
mass_addition_2 = MassAddition(Input=flatten(boolean_2))  # -> Result, PartialResults
boolean_3 = Boolean(mass_addition_2.Result)
evaluate = Evaluate(
    Expression="if(x=0, \"\", Format(\"{0} faces are not planar. Tangent vector off the center will be used to define direction of sections\",x))",
    x=mass_addition_2.Result)
stream_filter_11 = StreamFilter(Gate=boolean_3, Stream1=selected_geometry_7)
dispatch_7 = Dispatch(List=stream_filter_11, DispatchPattern=boolean_2)  # -> ListA, ListB
message = Panel(evaluate)
not_planar_faces = Geometry(dispatch_7.ListA)

# ----
# GETTING FACE PLANE
# X axis is horizontal and goes ->
# Y axis is vertical in face plane (could be tilted)
# Plane in face's plane
# x vector projection goes up
# Plane for circle
# and section
# Circle outside to
# sort points by it
selected_geometry_8 = ExtendedGeometry(selected_geometry_4)
evaluate_surface = EvaluateSurface(Surface=reparameterize(selected_geometry_8), Point=Point(0.5, 0.5, 0))  # -> Point, Normal, UDirection, VDirection, Frame
unit_z = UnitZ(Factor=1)
vector = Vector(evaluate_surface.Frame)
expression_3 = Expression(x=vector, z=unit_z, Expression="if(x=z, 0, 1)")
dispatch_8 = Dispatch(List=evaluate_surface.Frame, DispatchPattern=expression_3)  # -> NonHorizontal, Horizontal
clean_tree_4 = CleanTree(RemoveNulls=True, RemoveInvalid=True, RemoveEmpty=True, Tree=dispatch_8.NonHorizontal)
unit_z_2 = UnitZ(Factor=1)
deconstruct_plane = DeconstructPlane(Plane=clean_tree_4)  # -> Origin, XAxis, YAxis, ZAxis
angle = Angle(VectorA=deconstruct_plane.YAxis, VectorB=unit_z_2, Plane=clean_tree_4)  # -> Angle, Reflex
rotate_plane = RotatePlane(Plane=clean_tree_4, Angle=angle.Angle)
deconstruct_plane_2 = DeconstructPlane(Plane=rotate_plane)  # -> Origin, XAxis, YAxis, ZAxis
move = Move(Geometry=deconstruct_plane_2.Origin, Motion=expr("x*1000", deconstruct_plane_2.ZAxis))  # -> Geometry, Transform
deconstruct_plane_3 = DeconstructPlane(Plane=move.Geometry)  # -> Origin, XAxis, YAxis, ZAxis
angle_2 = Angle(VectorA=deconstruct_plane_2.ZAxis, VectorB=deconstruct_plane_3.XAxis, Plane=move.Geometry)  # -> Angle, Reflex
rotate_plane_2 = RotatePlane(Plane=move.Geometry, Angle=expr("-x", angle_2.Angle))
selected_geometry_9 = ExtendedGeometry(selected_geometry_4)
plane = Plane(rotate_plane_2)
brep_plane = BrepPlane(Brep=selected_geometry_9, Plane=plane)  # -> Curves, Points
circle = Circle(Plane=plane, Radius1000=1)
end_points = EndPoints(Curve=brep_plane.Curves)  # -> Start, End
sort_along_curve = SortAlongCurve(Points=[end_points.Start, end_points.End], Curve=circle)  # -> Points, Indices
list_item_11 = ListItem(List=sort_along_curve.Points, Index=0, Wrap=True)  # -> Item, Item1
point = Point(list_item_11.Item1)
vector_2pt = Vector2Pt(PointA=list_item_11.Item1, PointB=list_item_11.Item, Unitize=True)  # -> Vector, Length
unit_z_3 = UnitZ(Factor=1)
construct_plane_2 = ConstructPlane(Origin=deconstruct_plane_2.Origin, XAxis=vector_2pt.Vector, YAxis=deconstruct_plane_2.YAxis)
construct_plane_3 = ConstructPlane(Origin=deconstruct_plane_2.Origin, XAxis=vector_2pt.Vector, YAxis=unit_z_3)
face_plane = Plane(construct_plane_2)
vertical_face_plane_in_the_middle = Plane(construct_plane_3)
deconstruct_plane_4 = DeconstructPlane(Plane=face_plane)  # -> Origin, XAxis, YAxis, ZAxis
face_horiz_vector = Vector(simplify(deconstruct_plane_4.XAxis))

# ----
# Message if The face is horizontal
boolean_4 = Boolean(invert(expression_3))
selected_geometry_10 = ExtendedGeometry(selected_geometry_4)
mass_addition_3 = MassAddition(Input=flatten(boolean_4))  # -> Result, PartialResults
evaluate_2 = Evaluate(Expression="if(x=0, \"\", Format(\"{0} faces are horizontal and will be skipped\",x))", x=mass_addition_3.Result)
boolean_5 = Boolean(mass_addition_3.Result)
stream_filter_12 = StreamFilter(Gate=boolean_5, Stream1=selected_geometry_10)
dispatch_9 = Dispatch(List=stream_filter_12, DispatchPattern=boolean_4)  # -> ListA, ListB
message_2 = Panel(evaluate_2)
not_planar_faces_2 = Geometry(dispatch_9.ListA)

concatenate = Concatenate(FragmentA=not_planar_faces, FragmentB=not_planar_faces_2)
line = Line(StartPoint=list_item_11.Item1, EndPoint=list_item_11.Item)
selected_geometry_11 = ExtendedGeometry(selected_geometry_4)
vertical_face_plane = Plane(PlaneXZ(2000, 0, 3000))
brep = Brep(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)
panel_15 = Panel(selected_geometry_11)
bounding_box = BoundingBox(Content=brep, Plane=vertical_face_plane)  # -> Box, Box_2
equality = Equality()  # -> Equality, Inequality

selected_geometry_12 = ExtendedGeometry(selected_geometry_4)  # disabled
bounding_box_2 = BoundingBox(Content=selected_geometry_12, Plane=rotate_plane)  # -> Box, Box_2; disabled
deconstruct_box = DeconstructBox(Box=bounding_box_2.Box)  # -> Plane, X, Y, Z; disabled
path_mapper_6 = PathMapper(deconstruct_box.X, source=["{A;B}", "{A}"], target=["{A}", "{A}"])  # disabled
path_mapper_7 = PathMapper(deconstruct_box.Y, source=["{A;B}", "{A}"], target=["{A}", "{A}"])  # disabled
deconstruct_domain = DeconstructDomain(Domain=path_mapper_6)  # -> Start, End; disabled
deconstruct_domain_2 = DeconstructDomain(Domain=path_mapper_7)  # -> Start, End; disabled

elevations_0_or_spacings_1_5 = Text(elevations_0_or_spacings_1_2)
path_mapper_8 = PathMapper(line, source=["{A;B;C}", "{A;B}", "{A}"], target=["{2;A}", "{2;A}", "{2;A}"])

# ----
# parent's  attributes + right layer
selected_geometry_13 = ExtendedGeometry(selected_geometry_4)
get_user_attributes = GetUserAttributes(Geometry=selected_geometry_13)  # -> Keys, Values, BakeName
get_rhino_attributes = GetRhinoAttributes(Geometry=selected_geometry_13, readFullPath=True)  # -> Name, Layer, Color
text_split_5 = TextSplit(Text=get_rhino_attributes.Layer, Separators="::")
list_item_12 = ListItem(List=text_split_5, Index=0, Wrap=True)  # -> Item, Item1, Item2
expression_4 = Expression(
    x=list_item_12.Item,
    y=list_item_12.Item2,
    original=get_rhino_attributes.Layer,
    Expression="if(x=\"FacadeFace\",\">::FacadeSubFace\",if(y=\"FacadeFace\",\">::FacadeSubFace\",original))")
define_object_attributes = DefineObjectAttributes(
    UserKeys=get_user_attributes.Keys,
    UserValues=get_user_attributes.Values,
    Name=get_rhino_attributes.Name,
    Layer=expression_4)

# ----
# Changing attributes that are the
# same for all children of the parent
panel_16 = Panel("(1. BG-Nummer)")
panel_17 = Panel("""HO_Type
1. BG-Nummer
3. BG-Menge """)
merge_4 = Merge(Data1="FacadeSubFace", Data2=panel_16, Data3="1")
modify_elefront_attributes = ModifyElefrontAttributes(ReferencedGeometryOrElefrontAttributes=define_object_attributes, UserKeys=panel_17, UserValues=merge_4)

apply_3 = Boolean(apply_2)
boolean_6 = Boolean(invert(apply_3))
python_2 = PythonScript(key="HO_Counter_FacadeFace", checkNow=apply_3)  # -> value; inputs checkNow: Boolean
# ---------- python_2: Python ----------
import rhinoscriptsyntax as rs
import scriptcontext as sc
import Rhino

sc.doc = Rhino.RhinoDoc.ActiveDoc

#if checkNow == True:
if checkNow == True:
    value = rs.GetDocumentUserText(key)
    if value is None:
        value = "0"

sc.doc = ghdoc
# ---------- end python_2 ----------
addition_2 = Addition(A=python_2, B=0)
apply_4 = Boolean(apply_2)
boolean_7 = Boolean(invert(apply_4))
apply_5 = Boolean(apply_2)

# ----
# CHANGING ATTRIBUTES OF USED GEOMETRY
# (MOVING IT TO HIDDEN LAYER)
face_0_subfcace_1_else_1_2 = Text(face_0_subfcace_1_else_1)
selected_geometry_14 = ExtendedGeometry(selected_geometry_4)
get_user_value_5 = GetUserValue(Geometry=selected_geometry_14, Key="HO_Type")
apply_6 = Boolean(apply_2)  # disabled
guid = Guid(selected_geometry_14)
expression_5 = Expression(x=get_user_value_5, Expression="if(x=\"FacadeFace\",0,1)")
dispatch_10 = Dispatch(List=selected_geometry_14, DispatchPattern=expression_5)  # -> ListA, ListB
clean_tree_5 = CleanTree(RemoveNulls=True, RemoveInvalid=True, RemoveEmpty=True, Tree=dispatch_10.ListB)

# ---- group: Delete Selected FacadeSubFaces
c_script = CSharpScript(
    guids=guid,
    delete=apply_6,
    Reference=["C:\Program Files\Rhino 7\Plug-ins\Grasshopper\Components\ScriptComponents.gha", "C:\Program Files\NoDoubts\Godzilla\System\Godzilla.dll", "C:\Program Files\NoDoubts\Godzilla\System\RhGodzilla.rhp"])  # -> out, A; inputs guids: tree of Guid, delete: Boolean; disabled
# ---------- c_script: C# ----------
    ids = guids.AllData();
    if(delete)
      GrasshopperDocument.ScheduleSolution(5, SolutionCallback);
    A = "True";
# ---------- c_script: C# additional code ----------
  List<Guid> ids;
  void SolutionCallback(GH_Document doc)
  {
    RhinoDocument.Objects.Delete(ids, true);
  }
# ---------- end c_script ----------

# ----
# General
dimension_offset = Slider(150, range=-1000..1000)
annotation_style = Text("Millimeter Small2")
dimension_offset_2 = Integer(dimension_offset)

panel_18 = Panel("HO_GH-APP")
panel_19 = Panel("""-X*2
X*2+50""")
panel_20 = Panel("""-X*2
X*2+30""")

# ----
# Changelog
panel_21 = Panel("""CHANGELOG

20.11.2020 by Yury Nasonov
-splitter can divide also tilted faces, not rectangular faces
-definition now is not depending on plane info in attributes
-SubFace UID is tree-level only like A.B.C
-added checkings
-updated attributes
-child id counter for FacadeFaces
-fixed bugs
-cleaned def
-FacadeFaces now can be in not in LURB order (edges order: Left-Upper-Right-Bottom)
Limitation: def will not work for horizontal faces

09.10.2020 by Yury Nasonov
-Added highlight for selected dimensions
-Added dimension chain for selected horizontal dimension

06.10.2020 by Yury Nasonov
Clustered and cleaned up a bit

02.10.2020 by Yury Nasonov
-OMG Dropdown: User is able to insert horizontal spacings if he skipped something, User is able to copy their input to clipboard
-Graphics: added elevations

29.09.2020 by Yury Nasonov
-User is able to use elevations instead of horizontal spacings
-Works with one or multiple selected geometries
-Works also if horizontal or verticals spacings are are left empty (for these cases it uses 1000000 as input)
-Can perform inline addition and subtraction (when user input is like 100+20-10
-It also possible to split FacadeSubFaces (needs to finish attributes for this case)
-Numeration of SubFaces always goes according data (BasePlane) stored in FacadeFace attributes.
-User input is used if sum of it larger than 100 to prevent feezing while grasshopper tries to split surface with spacings like 1 milimeter

24.09.2020 by Yury Nasonov
-Added graphics: dimensions
-If Spacing input is empty "1000000" will be used
-Attributes are saved to created end used geometries

TO DO
Clean up when preferable logics will be choosed (now it has 2 different types of logics and hense does unnessesaty work)

REQUIREMENTS


BUGS or LIMITATIONS
Sum of widths/heights can not be more than total width/height of selected Face""")
text_6 = Text(panel_21)

gh_contours_of_all_re_of_selected_type_2 = RemoteReceiver(gh_contours_of_all_re_of_selected_type)  # disabled
colour_swatch = ColourSwatch(SwatchColor=RGB(3, 3, 3))
gh_blocks_to_work_with_3 = RemoteReceiver(simplify(graft(gh_blocks_to_work_with)))
path_mapper_9 = PathMapper(gh_blocks_to_work_with_3, source="{A}", target="{0;A}")

relay_3 = Relay()
clean_tree_6 = CleanTree(RemoveNulls=True, RemoveInvalid=True, RemoveEmpty=True, Tree=text_4)  # -> simplify(Tree)
integer_4 = Integer(simplify(replace_text_4))
number_2 = Number(flatten(clean_tree_6))

poceededinput_vertical_spacings = RemoteSender(integer_4)

# ----
# To not freeze because of too small input
stream_gate = StreamGate(Stream=number_2, Gate=elevations_0_or_spacings_1_4)  # -> Target0, Target1
mass_addition_4 = MassAddition(Input=stream_gate.Target1)  # -> Result, PartialResults
larger_than_2 = LargerThan(FirstNumber=mass_addition_4.Result, SecondNumber=Slider(100, range=0..1000))  # -> LargerThan, OrEqualTo
dispatch_11 = Dispatch(List=stream_gate.Target1, DispatchPattern=larger_than_2.LargerThan)  # -> ListA, ListB
elevations_0_or_spacings_1_6 = Boolean(elevations_0_or_spacings_1_3)
stream_filter_13 = StreamFilter(Gate=elevations_0_or_spacings_1_6, Stream0=stream_gate.Target0, Stream1=dispatch_11.ListA)

vertical_spacings_or_elevations_2 = Text(stream_filter_13)

mass_addition_5 = MassAddition(Input=stream_filter_13)  # -> Result, PartialResults

poceededinput_vertical_spacings_2 = RemoteReceiver(poceededinput_vertical_spacings)
stream_gate_2 = StreamGate(Stream=poceededinput_vertical_spacings_2, Gate=elevations_0_or_spacings_1_2)  # -> Target0, Target1
elevations = Integer(stream_gate_2.Target0)

# ---- group: If there is no input, use 1000000 as spacing
list_length_6 = ListLength(List=stream_gate_2.Target1)
null_item_3 = NullItem(Item=list_length_6)  # -> NullFlags, InvalidFlags, Description
stream_filter_14 = StreamFilter(Gate=null_item_3.NullFlags, Stream0=stream_gate_2.Target1, Stream1="1000000")

# ----
vertical_spacings = Integer(stream_filter_14)
elevations_2 = Integer(elevations)

# ----
# Actual indexes
list_length_7 = ListLength(List=flatten(clean_tree_6))
series_2 = Series(Start=1, Step=1, Count=list_length_7)
tree_statistics_3 = TreeStatistics(Tree=clean_tree_6)  # -> Paths, Length, Count
unflatten_tree_2 = UnflattenTree(Tree=series_2, Guide=clean_tree_6)
deconstruct_path_3 = DeconstructPath(Branch=tree_statistics_3.Paths)
list_item_13 = ListItem(List=reverse(tree_statistics_3.Paths), Index=0, Wrap=True)
list_length_8 = ListLength(List=unflatten_tree_2)  # -> expr("x-1", Length)
deconstruct_path_4 = DeconstructPath(Branch=list_item_13)  # -> flatten(Indices)
list_item_14 = ListItem(List=deconstruct_path_4, Index=0, Wrap=True)
dispatch_12 = Dispatch(List=unflatten_tree_2, DispatchPattern=list_length_8)  # -> ListA, ListB
dispatch_13 = Dispatch(List="-", DispatchPattern=list_length_8)  # -> ListA, ListB
list_item_15 = ListItem(List=dispatch_12.ListA, Index=0, Wrap=True)
list_item_16 = ListItem(List=reverse(dispatch_12.ListA), Index=0, Wrap=True)
text_join_3 = TextJoin(Text=[list_item_15, dispatch_13.ListA, list_item_16])
merge_5 = Merge(Data1=text_join_3, Data2=dispatch_12.ListB)
integer_5 = Integer(merge_5)
null_item_4 = NullItem(Item=integer_5)  # -> NullFlags, InvalidFlags, Description

expression_6 = Expression(x=list_item_14, Expression="if(x=0, 1, x+1)")

addition_3 = Addition(A=expression_6, B=0)

addition_4 = Addition(A=expression, B=0)
maximum = Maximum(A=addition_4, B=addition_3)
maximum_2 = Maximum(A=maximum, B=1)
addition_5 = Addition(A=maximum_2, B=Slider(0, range=0..10))

# ---- group: Show field row?
duplicate_data = DuplicateData(Data=True, Number=addition_5, Order=True)
boolean_8 = Boolean(maximum)
merge_6 = Merge(Data1=flatten(duplicate_data), Data2=boolean_8, Data3=Toggle(False))

# ---- group: Show number and radiobutton?
duplicate_data_2 = DuplicateData(Data=True, Number=addition_5, Order=True)
merge_7 = Merge(Data1=flatten(duplicate_data_2), Data2=Toggle(False))

# ---- group: Actual indexes for horiz input
dispatch_14 = Dispatch(List=merge_5, DispatchPattern=null_item_4.NullFlags)  # -> ListA, flatten(ListB)

# ----
# GETTING ATTRIBUTES
# OF PARENT
face_0_subfcace_1_else_1_3 = Text(face_0_subfcace_1_else_1)
bounds = Bounds(Numbers=flatten(face_0_subfcace_1_else_1_3))  # disabled
deconstruct_domain_3 = DeconstructDomain(Domain=bounds)  # -> Start, End; disabled
ho_facadefaceuid_3 = Text(ho_facadefaceuid)
stream_filter_15 = StreamFilter(Gate=Toggle(True), Stream1="FacadeFace*")
reference_by_layer = ReferenceByLayer(LayerName=stream_filter_15)
ho_facadefaceuid_4 = Text(ho_facadefaceuid)
panel_22 = Panel("""HO_Type
HO_FacadeFaceUID
HO_FacadeSubFaceUID
HO_BasePlane
HO_FacadeSubFaceColumnRowID
HO_Shifts-Vertical
HO_Shifts-Horizontal
HO_Counter_Separators-Vertical
HO_Counter_Separators-Horiz
BakeObject Name""")

# ----
# Getting plane info
# from attributes
panel_23 = Panel("HO_FacadeFaceUID")
ho_facadefaceuid_5 = Text(ho_facadefaceuid)  # disabled
filter_by_user_attributes_3 = FilterByUserAttributes(Attributes=reference_by_layer, Key=panel_23, Val=ho_facadefaceuid_5)  # -> Geometry, Key, Val; disabled
get_user_value_6 = GetUserValue(Geometry=filter_by_user_attributes_3.Geometry, Key="HO_BasePlane")  # -> simplify(HO_BasePlane); disabled
end_points_2 = EndPoints(Curve=filter_by_user_attributes_3.Geometry)  # -> Start, End; disabled
text_split_6 = TextSplit(Text=get_user_value_6, Separators="/")  # disabled
list_item_17 = ListItem(List=text_split_6, Index=0, Wrap=True)  # -> Item, Item1, Item2; disabled
construct_plane_4 = ConstructPlane(Origin=list_item_17.Item, XAxis=list_item_17.Item1, YAxis=list_item_17.Item2)  # -> simplify(Plane); disabled
path_mapper_10 = PathMapper(construct_plane_4, source=["{A}", "{A;B;C;D;E;F;G;H}"], target=["{A}", "{A}"])  # disabled

pick_n_choose_2 = PickNChoose(Pattern=face_0_subfcace_1_else_1_3, Stream1=ho_facadefaceuid_3)  # -> simplify(Result)

create_set_2 = CreateSet(List=flatten(pick_n_choose_2))  # -> Set, Map
replace_text_7 = ReplaceText(Text=create_set_2.Map, Find="-1", RecursiveReplace=False)
unflatten_tree_3 = UnflattenTree(Tree=replace_text_7, Guide=ho_facadefaceuid_4)
panel_24 = Panel(unflatten_tree_3)

filter_by_user_attributes_4 = FilterByUserAttributes(Attributes=reference_by_layer, Key="HO_FacadeFaceUID", Val=create_set_2.Set)  # -> Geometry, Key, Val

panel_25 = Panel(filter_by_user_attributes_4.Geometry)
get_user_value_7 = GetUserValue(Geometry=filter_by_user_attributes_4.Geometry, Key=panel_22)  # -> simplify(Values)
list_item_18 = ListItem(List=get_user_value_7, Index=0, Wrap=invert(True))  # -> Item, Item1, Item2, Item3, Item4, Item5, Item6, Item7, Item8, Item9
panel_26 = Panel(list_item_18.Item9)
text_split_7 = TextSplit(Text=list_item_18.Item5, Separators="●")  # -> simplify(Result)
text_split_8 = TextSplit(Text=list_item_18.Item6, Separators="●")  # -> simplify(Result)
panel_27 = Panel(text_split_7)

# ----
# Is surface tilted?
selected_geometry_15 = ExtendedGeometry(selected_geometry_4)
vertical_face_plane_2 = Plane(vertical_face_plane_in_the_middle)

brep_2 = Brep(selected_geometry_15)

bounding_box_3 = BoundingBox(Content=brep_2, Plane=vertical_face_plane_2)  # -> Box, Box_2
text_7 = Text(bounding_box_3.Box)
expression_7 = Expression(x=text_7, Expression="If(x=\"Box\",1,(If(x=\"Flat Box\",0,-1)))")
dispatch_15 = Dispatch(List=bounding_box_3.Box, DispatchPattern=expression_7)  # -> ListA, ListB

# ----
# GETTING VERTICAL OUTER PLANE
# For dimensions
# outside plane
# Index of outside plane
move_2 = Move(Geometry=deconstruct_plane_4.Origin, Motion=expr("x*10", deconstruct_plane_4.ZAxis))  # -> Geometry, Transform
merge_8 = Merge(Data1=deconstruct_plane_4.Origin, Data2=move_2.Geometry)
deconstruct_brep = DeconstructBrep(Brep=dispatch_15.ListA)  # -> Faces, Edges, Vertices
list_item_19 = ListItem(List=deconstruct_brep.Faces, Index4=4, Wrap=True)  # -> Item, Item1
evaluate_surface_2 = EvaluateSurface(Surface=reparameterize(list_item_19.Item), Point=Point(0.5, 0.5, 0))  # -> Point, Normal, UDirection, VDirection, Frame
closest_point = ClosestPoint(Point=evaluate_surface_2.Point, Cloud=merge_8)  # -> ClosestPoint, CPIndex, Distance
boolean_9 = Boolean(invert(closest_point.CPIndex))
list_item_20 = ListItem(List=deconstruct_brep.Faces, Index=expr("4+x", boolean_9), Wrap=True)
trim_tree = TrimTree(Tree=list_item_20, Depth=1)
merge_9 = Merge(Data1=trim_tree, Data2=dispatch_15.ListB)
null_item_5 = NullItem(Item=merge_9)  # -> NullFlags, InvalidFlags, Description
dispatch_16 = Dispatch(List=merge_9, DispatchPattern=null_item_5.NullFlags)  # -> ListA, ListB
evaluate_surface_3 = EvaluateSurface(Surface=reparameterize(dispatch_16.ListB), Point=Point(0.5, 0.5, 0))  # -> Point, Normal, UDirection, VDirection, Frame
vertical_face_plane_3 = Plane(vertical_face_plane_in_the_middle)
point_2 = Point(evaluate_surface_3.Point)
plane_origin = PlaneOrigin(Base=vertical_face_plane_3, Origin=point_2)
vertical_face_plane_outer = Plane(plane_origin)
deconstruct_brep_2 = DeconstructBrep(Brep=dispatch_16.ListB)  # -> Faces, Edges, Vertices
circle_2 = Circle(Plane=vertical_face_plane_outer, Radius=1)
sort_along_curve_2 = SortAlongCurve(Points=deconstruct_brep_2.Vertices, Curve=circle_2)  # -> Points, Indices

# ----
# Edges
list_item_21 = ListItem(List=deconstruct_brep_2.Edges, Index=0, Wrap=True)  # -> Item, Item1, Item2, Item3

# ----
# Points
list_item_22 = ListItem(List=sort_along_curve_2.Points, Index=0, Wrap=True)  # -> Item, Item1, Item2, Item3

deconstruct_plane_5 = DeconstructPlane(Plane=vertical_face_plane_outer)  # -> Origin, XAxis, YAxis, ZAxis
vertical_face_z_vector_outside = Vector(deconstruct_plane_5.ZAxis)
vertical_face_y_vector_vertical = Vector(deconstruct_plane_5.YAxis)

length = Length(Curve=list_item_21.Item)  # -> simplify(Length)
length_2 = Length(Curve=list_item_21.Item1)  # -> simplify(Length)
curve_2 = Curve(list_item_21.Item1)
start_of_the_face_lb = Point(simplify(list_item_22.Item2))
start_of_the_face = Point(list_item_22.Item2)

face_length = Number(length)
face_height = Number(length_2)

face_length_2 = Number(face_length)
face_height_2 = Number(face_height)
start_of_the_face_lb_2 = Point(start_of_the_face_lb)
start_of_the_face_lb_3 = Point(start_of_the_face_lb)

# ----
# Getting shifts for dividers
subtraction = Subtraction(A=deconstruct_domain.End, B=deconstruct_domain.Start)  # -> simplify(Result); disabled
subtraction_2 = Subtraction(A=deconstruct_domain_2.End, B=deconstruct_domain_2.Start)  # -> simplify(Result); disabled
horizontal_spacings_4 = Integer(horizontal_spacings_3)
vertical_spacings_2 = Integer(vertical_spacings)
face_height_3 = Number(face_height)
horizontal_flip_2 = Boolean(horizontal_flip)
vertical_flip_2 = Boolean(vertical_flip)
face_length_3 = Number(face_length)
cluster = Cluster(face_length=face_length_3, spacings=horizontal_spacings_4, flip=vertical_flip_2)  # -> offsets_for_splitting_2, distances_for_dimensions_2
cluster_2 = Cluster(face_length=face_height_3, spacings=vertical_spacings_2, flip=horizontal_flip_2)  # -> offsets_for_splitting_2, distances_for_dimensions_2

path_mapper_11 = PathMapper(face_height_3, source=["{A;B;C;D;E}", "{A}"], target=["{A}", "{A}"])
integer_6 = Integer(face_length_3)
integer_7 = Integer(face_height_3)
merge_10 = Merge(Data1="0", Data2=elevations_2, Data3=path_mapper_11)
smaller_than = SmallerThan(FirstNumber=cluster_2.offsets_for_splitting_2, SecondNumber=integer_7)  # -> SmallerThan, OrEqualTo

smaller_than_2 = SmallerThan(FirstNumber=cluster.offsets_for_splitting_2, SecondNumber=integer_6)  # -> SmallerThan, OrEqualTo
dispatch_17 = Dispatch(List=cluster.offsets_for_splitting_2, DispatchPattern=smaller_than_2.SmallerThan)  # -> ListA, ListB

sort_list = SortList(Keys=merge_10)  # -> Keys, ValuesValuesA
dispatch_18 = Dispatch(List=cluster_2.offsets_for_splitting_2, DispatchPattern=smaller_than.SmallerThan)  # -> ListA, ListB
stream_filter_16 = StreamFilter(Gate=elevations_0_or_spacings_1_5, Stream0=sort_list.Keys, Stream1=cluster_2.distances_for_dimensions_2)
panel_28 = Panel(dispatch_17.ListA)
negative = Negative(Value=dispatch_17.ListA)

vertical_offsets = Number(stream_filter_16)
list_length_9 = ListLength(List=vertical_offsets)  # -> expr("x-2", Length)
dispatch_19 = Dispatch(List=vertical_offsets, DispatchPattern=list_length_9)  # -> ListA, ListB

panel_29 = Panel(vertical_offsets)

# ----
# To show if there is more than one dimension
horizontal_offsets = Number(cluster.distances_for_dimensions_2)
list_length_10 = ListLength(List=horizontal_offsets)  # -> expr("x-2", Length)
dispatch_20 = Dispatch(List=horizontal_offsets, DispatchPattern=list_length_10)  # -> ListA, ListB

# ----
# DISPLAY:  Vertical Dimensions
panel_30 = Panel(dispatch_19.ListA)

# ----
# Dividers
# Horizontal lines
# Vertical plane
# Vertical lines
elevations_0_or_spacings_1_7 = Text(elevations_0_or_spacings_1_2)
elevations_0_or_spacings_1_8 = Text(elevations_0_or_spacings_1_2)
start_of_the_face_lb_4 = Point(start_of_the_face_lb)
elevations_3 = Integer(elevations)
stream_filter_17 = StreamFilter(Gate=elevations_0_or_spacings_1_7, Stream0="0,0,0", Stream1=start_of_the_face_lb_4)
stream_filter_18 = StreamFilter(Gate=elevations_0_or_spacings_1_8, Stream0=elevations_3, Stream1=dispatch_18.ListA)
vertical_face_z_vector_outside_2 = Vector(vertical_face_z_vector_outside)
unit_z_4 = UnitZ(Factor=1)
start_of_the_face_lb_5 = Point(start_of_the_face_lb)
selected_geometry_16 = ExtendedGeometry(selected_geometry_4)
construct_plane_5 = ConstructPlane(Origin=start_of_the_face_lb_5, XAxis=vertical_face_z_vector_outside_2, YAxis=unit_z_4)
contour_ex = ContourEx(Shape=selected_geometry_16, Plane=simplify(construct_plane_5), Offsets=expr("-x", simplify(dispatch_17.ListA)))
shift_paths = ShiftPaths(Data=contour_ex, Offset=-1)

# ---- group: Horizontal planes
xy_plane = XYPlane(Origin=stream_filter_17)

# ----
panel_31 = Panel(stream_filter_18)
negative_2 = Negative(Value=stream_filter_18)
panel_32 = Panel(contour_ex)

contour_ex_2 = ContourEx(Shape=selected_geometry_16, Plane=simplify(xy_plane), Offsets=simplify(stream_filter_18))
shift_paths_2 = ShiftPaths(Data=contour_ex_2, Offset=-1)

list_length_11 = ListLength(List=shift_paths_2)
duplicate_data_3 = DuplicateData(Data=line, Number=list_length_11, Order=True)  # -> simplify(graft(Data))

# ----
# Curves direction: up/right
vertical_face_plane_in_the_middle_2 = Plane(vertical_face_plane_in_the_middle)
end_points_3 = EndPoints(Curve=simplify(graft(shift_paths_2)))  # -> Start, End
end_points_4 = EndPoints(Curve=simplify(graft(shift_paths)))  # -> Start, End
rotate = Rotate(Geometry=line, Angle=degrees(90), Plane=vertical_face_plane_in_the_middle_2)  # -> Geometry, Transform
sort_along_curve_3 = SortAlongCurve(Points=[end_points_3.Start, end_points_3.End], Curve=duplicate_data_3)  # -> Points, Indices
sort_along_curve_4 = SortAlongCurve(Points=[end_points_4.Start, end_points_4.End], Curve=rotate.Geometry)  # -> Points, Indices
polyline = PolyLine(Vertices=sort_along_curve_3.Points, Closed=False)
polyline_2 = PolyLine(Vertices=sort_along_curve_4.Points, Closed=False)

dividers = Curve(flatten([polyline, polyline_2]))

path_mapper_12 = PathMapper(polyline, source=["{A;B;C;D}", "{A;B;C}", "{A;B}", "{A}"], target=["{1;A}", "{1;A}", "{1;A}", "{1;A}"])
path_mapper_13 = PathMapper(polyline_2, source=["{A;B;C;D}", "{A;B;C}", "{A;B}", "{A}"], target=["{3;A}", "{3;A}", "{3;A}", "{3;A}"])
path_mapper_14 = PathMapper(rotate.Geometry, source=["{A;B;C}", "{A;B}", "{A}"], target=["{4;A}", "{4;A}", "{4;A}"])
merge_11 = Merge(Data1=path_mapper_12, Data2=path_mapper_8, Data3=path_mapper_13, Data4=path_mapper_14)
output_for_mullions_and_transoms_creatin = RemoteSender(merge_11)  # "Output.For mullions and transoms creating cluster"

# ----
# FacadeSubFaces
# FacadeSubFaces
surface_split = SurfaceSplit(Surface=selected_geometry_16, Curves=dividers)  # -> simplify(Fragments)
curve_3 = Curve(simplify(graft(surface_split)))
boundary_surfaces = BoundarySurfaces(Edges=curve_3)

facade_faces = Surface(boundary_surfaces)

path_mapper_15 = PathMapper(facade_faces, source=["{A}", "{A;B}"], target=["{A}", "{A}"])

facade_faces_2 = Surface(path_mapper_15)

is_planar_2 = IsPlanar(Surface=facade_faces_2, Interior=True)  # -> Planar, Plane

# ----
# FacadeSubFaces flipped
#  in the same direction
vector_2 = Vector(rotate_plane)
vector_3 = Vector(is_planar_2.Plane)
deconstruct_vector = DeconstructVector(Vector=vector_3)  # -> XComponent, YComponent, ZComponent
deconstruct_vector_2 = DeconstructVector(Vector=vector_2)  # -> XComponent, YComponent, ZComponent
expression_8 = Expression(x=deconstruct_vector.XComponent, Expression="Format(\"{0:0.00}\",x)")
expression_9 = Expression(x=deconstruct_vector.YComponent, Expression="Format(\"{0:0.00}\",x)")
expression_10 = Expression(x=deconstruct_vector.ZComponent, Expression="Format(\"{0:0.00}\",x)")
expression_11 = Expression(x=deconstruct_vector_2.XComponent, Expression="Format(\"{0:0.00}\",x)")
expression_12 = Expression(x=deconstruct_vector_2.YComponent, Expression="Format(\"{0:0.00}\",x)")
expression_13 = Expression(x=deconstruct_vector_2.ZComponent, Expression="Format(\"{0:0.00}\",x)")
equality_2 = Equality(FirstNumber=expression_8, SecondNumber=expression_11)  # -> Equality, Inequality
equality_3 = Equality(FirstNumber=expression_9, SecondNumber=expression_12)  # -> Equality, Inequality
equality_4 = Equality(FirstNumber=expression_10, SecondNumber=expression_13)  # -> Equality, Inequality
gate_and = GateAnd(A=equality_2.Equality, B=equality_3.Equality, C=equality_4.Equality)  # -> graft(Result)
dispatch_21 = Dispatch(List=facade_faces, DispatchPattern=gate_and)  # -> ListA, ListB
flip = Flip(Surface=dispatch_21.ListB)  # -> Surface, Result
merge_12 = Merge(Data1=flip.Surface, Data2=dispatch_21.ListA)
facade_faces_3 = Surface(simplify(merge_12))
facade_sub_faces_to_bake = Surface(facade_faces_3)
path_mapper_16 = PathMapper(facade_faces_3, source=["{A}", "{A;B}"], target=["{A}", "{A}"])

panel_33 = Panel(dispatch_21.ListB)
facade_sub_faces_to_bake_2 = Surface(facade_sub_faces_to_bake)

# ----
# FacadeSubFace UID
panel_34 = Panel("HO_FacadeFaceUID")
selected_geometry_17 = ExtendedGeometry(selected_geometry_4)
get_user_value_8 = GetUserValue(Geometry=selected_geometry_17, Key=panel_34)
list_item_23 = ListItem(List=get_user_value_8, Index=0, Wrap=True)  # -> Item, Item1
panel_35 = Panel(get_user_value_8)
reference_by_user_atributes = ReferenceByUserAtributes(Key="HO_Type", Val="FacadeFace", DisableAutoUpdate=False, ignoreCase=False)

facade_face_uid_for_selected_geo = Text(list_item_23.Item)

# ----
# GETTING (&CHANGING) ATTRIBUTES THAT
# ARE UNIQUE FOR EVERY CHILD
facade_sub_faces_to_bake_3 = Surface(facade_sub_faces_to_bake)
panel_36 = Panel("""4. BG-Breite 
5. BG-Höhe
6. BG-Fläche
HO_FacadeSubFaceUID""")

panel_37 = Panel(facade_sub_faces_to_bake_3)

path_mapper_17 = PathMapper(facade_sub_faces_to_bake_3, source=["{A}", "{A;B}", "{A;B;C}"], target=["{A}", "{A}", "{A}"])
list_length_12 = ListLength(List=path_mapper_17)

path_mapper_18 = PathMapper(facade_sub_faces_to_bake_3, source=["{A}", "{A;B}", "{A;B;C}"], target=["{0}", "{A}", "{A}"])
number_of_new_subfaces_1 = Integer(list_length_12)

# ----
# Dimensions
facade_sub_faces_to_bake_4 = Surface(facade_sub_faces_to_bake)
face_plane_2 = Plane(face_plane)
bounding_box_4 = BoundingBox(Content=facade_sub_faces_to_bake_4, Plane=face_plane_2)  # -> simplify(Box), Box_2
deconstruct_box_2 = DeconstructBox(Box=bounding_box_4.Box)  # -> Plane, X, Y, Z
path_mapper_19 = PathMapper(deconstruct_box_2.X, source=["{A;B}", "{A}"], target=["{A}", "{A}"])
path_mapper_20 = PathMapper(deconstruct_box_2.Y, source=["{A;B}", "{A}"], target=["{A}", "{A}"])
deconstruct_domain_4 = DeconstructDomain(Domain=path_mapper_19)  # -> Start, End
deconstruct_domain_5 = DeconstructDomain(Domain=path_mapper_20)  # -> Start, End
subtraction_3 = Subtraction(A=deconstruct_domain_4.End, B=deconstruct_domain_4.Start)  # -> simplify(Result)
subtraction_4 = Subtraction(A=deconstruct_domain_5.End, B=deconstruct_domain_5.Start)  # -> simplify(Result)
area = Area(Geometry=graft(facade_sub_faces_to_bake_3))  # -> expr("x/1000000", Area), Centroid
integer_8 = Integer(graft(subtraction_3))
integer_9 = Integer(graft(subtraction_4))
subface_length = Number(integer_8)
subface_height = Number(integer_9)
format = Format(Format="{0: 0.00}", Culture=127, Data0=area.Area)
unflatten_tree_4 = UnflattenTree(Tree=format, Guide=subface_height)

list_length_13 = ListLength(List=flatten(subface_height))
series_3 = Series(Start=expr("X+1", addition_2), Step=1, Count=list_length_13)

create_set_3 = CreateSet(List=flatten(facade_face_uid_for_selected_geo))  # -> Set, Map
filter_by_user_attributes_5 = FilterByUserAttributes(Attributes=reference_by_user_atributes, Key="HO_FacadeFaceUID", Val=create_set_3.Set)  # -> Geometry, Key, Val
facade_face_uid_for_all_faces = Text(filter_by_user_attributes_5.Val)
all_facade_faces = ExtendedGeometry(filter_by_user_attributes_5.Geometry)
get_user_value_9 = GetUserValue(Geometry=filter_by_user_attributes_5.Geometry, Key="HO_Counter_FacadeSubFaces")
addition_6 = Addition(A=get_user_value_9, B=0)
number_of_new_subfaces_2 = Integer(number_of_new_subfaces_1)
ho_counter_facadesubfaces = Text(addition_6)
list_item_24 = ListItem(List=addition_6, Index=graft(create_set_3.Map), Wrap=True)
duplicate_data_4 = DuplicateData(Data=facade_face_uid_for_selected_geo, Number=number_of_new_subfaces_2, Order=True)  # -> simplify(Data)
series_4 = Series(Start=list_item_24, Step=1, Count=number_of_new_subfaces_2)  # -> simplify(Series)
concatenate_2 = Concatenate(Fragment_A=duplicate_data_4, A=".", Fragment_B=series_4)
unflatten_tree_5 = UnflattenTree(Tree=series_3, Guide=subface_height)

list_length_14 = ListLength(List=path_mapper_18)
number_of_new_subfaces_2_2 = Integer(list_length_14)
number_of_new_subfaces_1_2 = Integer(number_of_new_subfaces_1)
duplicate_data_5 = DuplicateData(Data=modify_elefront_attributes, Number=number_of_new_subfaces_1_2, Order=True)  # -> simplify(graft(Data))
merge_13 = Merge(
    Data1=simplify(subface_length),
    Data2=simplify(subface_height),
    Data3=simplify(unflatten_tree_4),
    Data4=simplify(unflatten_tree_5))
modify_elefront_attributes_2 = ModifyElefrontAttributes(ReferencedGeometryOrElefrontAttributes=duplicate_data_5, UserKeys=panel_36, UserValues=merge_13)

panel_38 = Panel(filter_by_user_attributes_5.Geometry)
list_item_25 = ListItem(List=reverse(series_3), Index1=0, Wrap=True)
addition_7 = Addition(A=list_item_25, B=0)
maximum_3 = Maximum(A=addition_2, B=addition_7)
text_8 = Text(maximum_3)
python_3 = PythonScript(key="HO_Counter_FacadeFace", value=text_8, writeNow=apply_4)  # -> value; inputs writeNow: Boolean; same code as python
duplicate_data_6 = DuplicateData(Data=expression_4, Number=number_of_new_subfaces_1_2, Order=True)  # -> simplify(graft(Data))
panel_39 = Panel(python_3)
deconstruct_attributes = DeconstructAttributes(ReferencedGeometryOrAttributes=modify_elefront_attributes_2)  # -> simplify(Keys), simplify(Values)
define_object_attributes_2 = DefineObjectAttributes(UserKeys=deconstruct_attributes.Keys, UserValues=deconstruct_attributes.Values, Layer=duplicate_data_6)
# BAKIING
bake_objects = BakeObjects(Geometry=facade_sub_faces_to_bake_2, Attributes=define_object_attributes_2, Bake=apply_5)

# ----
# Faces-parents of
# selected geometry
panel_40 = Panel("HO_FacadeFaceUID")
get_user_value_10 = GetUserValue(Geometry=clean_tree_5, Key=panel_40)
create_set_4 = CreateSet(List=flatten(get_user_value_10))  # -> Set, Map
list_length_15 = ListLength(List=create_set_4.Set)
addition_8 = Addition(A=list_length_15, B=0)
facade_face_uid_for_all_faces_2 = Text(facade_face_uid_for_all_faces)
create_set_5 = CreateSet(List=flatten(facade_face_uid_for_all_faces_2))  # -> Set, Map
facade_face_uid_for_selected_geo_2 = Text(facade_face_uid_for_selected_geo)
all_facade_faces_2 = ExtendedGeometry(all_facade_faces)
number_of_new_subfaces_2_3 = Integer(number_of_new_subfaces_2_2)
ho_counter_facadesubfaces_2 = Text(ho_counter_facadesubfaces)
apply_7 = Boolean(apply_2)

# ---- group: Stupid. to make sure putput is not empty
panel_41 = Panel("yrxiytcl;lihpub")
merge_14 = Merge(Data1=create_set_4.Set, Data2=addition_8)

# ----
set_difference = SetDifference(SetA=create_set_5.Set, SetB=merge_14)
member_index_3 = MemberIndex(Set=flatten(facade_face_uid_for_selected_geo_2), Member=set_difference)  # -> Index, Count
filter_by_user_attributes_6 = FilterByUserAttributes(Attributes=flatten(all_facade_faces_2), Key="HO_FacadeFaceUID", Val=set_difference)  # -> ALLFACADEFACES, Key, Val
list_item_26 = ListItem(List=flatten(number_of_new_subfaces_2_3), Index=member_index_3.Index, Wrap=True)
mass_addition_6 = MassAddition(Input=list_item_26)  # -> Result, PartialResults
addition_9 = Addition(A=ho_counter_facadesubfaces_2, B=mass_addition_6.Result)
modify_elefront_attributes_3 = ModifyElefrontAttributes(
    ReferencedGeometryOrElefrontAttributes=filter_by_user_attributes_6.ALLFACADEFACES,
    UserKeys="HO_Counter_FacadeSubFaces",
    UserValues=addition_9)
modify_rhinoobject_attributes = ModifyRhinoObjectAttributes(Geometry=filter_by_user_attributes_6.ALLFACADEFACES, Attributes=modify_elefront_attributes_3, Modify=apply_7)

# ----
# DISPLAY: Horizontal Dimensions
start_of_the_face_lb_6 = Point(start_of_the_face_lb)
face_horiz_vector_2 = Vector(face_horiz_vector)
face_length_4 = Number(face_length)
face_height_4 = Number(face_height)
unit_z_5 = UnitZ(Factor=face_height_4)
highlight_3 = Text(highlight_2)
explode_tree_2 = ExplodeTree(Data=highlight_3)  # -> Branch0, Branch1
face_horiz_vector_3 = Vector(face_horiz_vector)
list_length_16 = ListLength(List=explode_tree_2.Branch0)
addition_10 = Addition(A=list_length_16, B=0)
amplitude = Amplitude(Vector=face_horiz_vector_3, Amplitude=dispatch_20.ListA)
start_of_the_face_lb_7 = Point(start_of_the_face_lb)
boolean_10 = Boolean(addition_10)
move_3 = Move(Geometry=start_of_the_face_lb_7, Motion=amplitude)  # -> Geometry, Transform
list_length_17 = ListLength(List=move_3.Geometry)  # -> expr("x-1", Length)
duplicate_data_7 = DuplicateData(Data=0, Number=list_length_17, Order=True)
item_index = ItemIndex(List=move_3.Geometry, Item=move_3.Geometry)
replace_items = ReplaceItems(List=duplicate_data_7, Item=1, Indices=0, Wrap=False)
list_item_27 = ListItem(List=move_3.Geometry, Index=item_index, Wrap=True)  # -> Item, Item1
vertical_face_plane_outer_2 = Plane(vertical_face_plane_outer)
dimension_offset_3 = Integer(dimension_offset_2)
number_slider_2 = Slider(-300, range=-1000..1000)  # disabled
multiplication = Multiplication(A=dimension_offset_3, _2Or2=[-2, 2])
rotate_plane_3 = RotatePlane(Plane=vertical_face_plane_outer_2, Angle=3.141592654)
horizontal_flip_3 = Boolean(horizontal_flip)
reverse_list = ReverseList(List=replace_items)
stream_filter_19 = StreamFilter(Gate=horizontal_flip_3, Stream0=replace_items, Stream1=reverse_list)
colour_swatch_2 = ColourSwatch(SwatchColor=RGB(237, 5, 5))
colour_swatch_3 = ColourSwatch(SwatchColor=RGB(180, 194, 219))
colour_swatch_4 = ColourSwatch(SwatchColor=RGB(5, 237, 210))
list_item_28 = ListItem(List=["255,255,255", "227,160,16"], Index=stream_filter_19, Wrap=True)
replace_items_2 = ReplaceItems(List=list_item_28, Item=colour_swatch_4, Indices=explode_tree_2.Branch0, Wrap=False)
detailed_chain_colors = Colour(replace_items_2)
vertical_face_y_vector_vertical_2 = Vector(vertical_face_y_vector_vertical)
start_of_the_face_lb_8 = Point(start_of_the_face_lb)
amplitude_2 = Amplitude(Vector=vertical_face_y_vector_vertical_2, Amplitude=dispatch_19.ListA)
move_4 = Move(Geometry=start_of_the_face_lb_8, Motion=amplitude_2)  # -> Geometry, Transform
list_length_18 = ListLength(List=move_4.Geometry)  # -> expr("x-1", Length)
duplicate_data_8 = DuplicateData(Data=0, Number=list_length_18, Order=True)
replace_items_3 = ReplaceItems(List=duplicate_data_8, Item=1, Indices=0, Wrap=False)
reverse_list_2 = ReverseList(List=replace_items_3)
vertical_flip_3 = Boolean(vertical_flip)
stream_filter_20 = StreamFilter(Gate=vertical_flip_3, Stream0=replace_items_3, Stream1=reverse_list_2)
elevations_0_or_spacings_1_9 = Text(elevations_0_or_spacings_1_2)
stream_filter_21 = StreamFilter(Gate=elevations_0_or_spacings_1_9, Stream0="0", Stream1=stream_filter_20)
list_item_29 = ListItem(List=["255,255,255", "227,160,16"], Index=stream_filter_21, Wrap=True)
replace_items_4 = ReplaceItems(List=list_item_29, Item=colour_swatch_4, Indices=explode_tree_2.Branch1, Wrap=False)
colors_vertical_dim = Text(replace_items_4)

# ----
# Bottom edge ->
line_sdl = LineSDL(Start=start_of_the_face_lb_6, Direction=face_horiz_vector_2, Length=face_length_4)

# ----
# Upper edge ->
move_5 = Move(Geometry=line_sdl, Motion=unit_z_5)  # -> Geometry, Transform

merge_15 = Merge(Data1=flatten(start_of_the_face_lb_3), Data2=flatten(list_item_27.Item), Data3=flatten(list_item_22.Item3))
evaluate_3 = Evaluate(Expression=panel_19, X=dimension_offset_3)

# ----
# Selected subfaces
get_user_attributes_2 = GetUserAttributes(Geometry=dispatch_10.ListA)  # -> Keys, Values, BakeName
get_rhino_attributes_2 = GetRhinoAttributes(Geometry=dispatch_10.ListA, readFullPath=True)  # -> Name, Layer, Color
apply_8 = Boolean(apply_2)

# ---- group: if the layer is not under ">" then just add "old"
replace_text_8 = ReplaceText(Text=get_rhino_attributes_2.Layer, Find=">", Replace="Old", RecursiveReplace=False)
expression_14 = Expression(x=get_rhino_attributes_2.Layer, y=replace_text_8, Expression="If(x=y,Format(\"Old::{0}x\",x),y)")

# ----
define_object_attributes_3 = DefineObjectAttributes(
    UserKeys=get_user_attributes_2.Keys,
    UserValues=get_user_attributes_2.Values,
    Name=get_rhino_attributes_2.Name,
    Layer=expression_14,
    Color=get_rhino_attributes_2.Color)
modify_rhinoobject_attributes_2 = ModifyRhinoObjectAttributes(Geometry=dispatch_10.ListA, Attributes=define_object_attributes_3, Modify=apply_8)
panel_42 = Panel(modify_rhinoobject_attributes_2)

# ----
# Selected faces
panel_43 = Panel("HO_Counter_FacadeSubFaces")
get_rhino_attributes_3 = GetRhinoAttributes(Geometry=clean_tree_5, readFullPath=True)  # -> Name, Layer, Color
get_user_value_11 = GetUserValue(Geometry=clean_tree_5, Key=panel_43)
number_of_new_subfaces_2_4 = Integer(number_of_new_subfaces_2_2)
get_user_attributes_3 = GetUserAttributes(Geometry=clean_tree_5)  # -> Keys, Values, BakeName
addition_11 = Addition(A=get_user_value_11, B=0)
list_length_19 = ListLength(List=get_rhino_attributes_3.Layer)
addition_12 = Addition(A=addition_11, B=number_of_new_subfaces_2_4)
duplicate_data_9 = DuplicateData(Data=panel_43, Number=list_length_19, Order=True)
unflatten_tree_6 = UnflattenTree(Tree=duplicate_data_9, Guide=get_rhino_attributes_3.Layer)
merge_16 = Merge(Data1=get_user_attributes_3.Keys, Data2=graft(unflatten_tree_6))
merge_17 = Merge(Data1=get_user_attributes_3.Values, Data2=graft(addition_12))
panel_44 = Panel(merge_16)
apply_9 = Boolean(apply_2)

# ---- group: if the layer is not under ">" then just add "old"
replace_text_9 = ReplaceText(Text=get_rhino_attributes_3.Layer, Find=">", Replace="Old", RecursiveReplace=False)
expression_15 = Expression(x=get_rhino_attributes_3.Layer, y=replace_text_9, Expression="If(x=y,Format(\"Old::{0}x\",x),y)")

# ----
panel_45 = Panel(addition_11)

define_object_attributes_4 = DefineObjectAttributes(
    UserKeys=merge_16,
    UserValues=merge_17,
    Name=get_rhino_attributes_3.Name,
    Layer=expression_15,
    Color=get_rhino_attributes_3.Color)
modify_rhinoobject_attributes_3 = ModifyRhinoObjectAttributes(Geometry=clean_tree_5, Attributes=define_object_attributes_4, Modify=apply_9)
panel_46 = Panel(modify_rhinoobject_attributes_3)

# ----
# DISPLAY:  Elevation marks
vertical_face_plane_outer_3 = Plane(vertical_face_plane_outer)  # disabled
face_horiz_vector_4 = Vector(face_horiz_vector)  # disabled
face_length_5 = Number(face_length)  # disabled
amplitude_3 = Amplitude(Vector=face_horiz_vector_4, Amplitude=face_length_5)  # disabled
deconstruct_plane_6 = DeconstructPlane(Plane=vertical_face_plane_outer_3)  # -> Origin, XAxis, YAxis, ZAxis; disabled
number_slider_3 = Slider(1600, range=0..10000)  # disabled
amplitude_4 = Amplitude(Vector=deconstruct_plane_6.XAxis, Amplitude=expr("-x", number_slider_3))  # disabled
number_slider_4 = Slider(406, range=0..1000)  # disabled
amplitude_5 = Amplitude(Vector=deconstruct_plane_6.XAxis, Amplitude=number_slider_3)  # disabled
unit_z_6 = UnitZ(Factor=number_slider_4)  # disabled
panel_47 = Panel("{0:0.00}")  # disabled
curve_4 = Curve(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)  # disabled

relay_4 = Relay([move_5.Geometry, line_sdl])
end_points_5 = EndPoints(Curve=move_5.Geometry)  # -> Start, End; disabled
cull_index_2 = CullIndex(List=reverse(merge_15), Indices=0, Wrap=True)  # -> reverse(List)
path_mapper_21 = PathMapper(cull_index_2, source=["{A;B;C;D;E}", "{A;B;C;D}", "{A;B}"], target=["{path_index}", "{path_index}", "{path_index}"])
list_item_30 = ListItem(List=path_mapper_21, Index=explode_tree_2.Branch0, Wrap=True)  # -> simplify(Item), Item1
cull_index_3 = CullIndex(List=merge_15, Indices=0, Wrap=True)
end_points_6 = EndPoints(Curve=relay_4)  # -> Start, End

point_3 = Point(simplify(end_points_5.Start))  # disabled
point_4 = Point(simplify(end_points_5.End))  # disabled
point_5 = Point(end_points_6.End)

# ----
# Detailed chain Bottom
define_linear_dimension = DefineLinearDimension(
    Point1=cull_index_2,
    Point2=cull_index_3,
    DimensionPlane=rotate_plane_3,
    Offset=dimension_offset_2,
    DimensionStyle=annotation_style)  # disabled

# ----
# Max dimensions
define_linear_dimension_2 = DefineLinearDimension(
    Point1=end_points_6.Start,
    Point2=end_points_6.End,
    DimensionPlane=rotate_plane_3,
    Offset=evaluate_3,
    DimensionStyle=annotation_style)

item_index_2 = ItemIndex(List=move_4.Geometry, Item=move_4.Geometry)
list_item_31 = ListItem(List=move_4.Geometry, Index=item_index_2, Wrap=True)  # -> Item, Item1
vertical_face_plane_outer_4 = Plane(vertical_face_plane_outer)
rotate_plane_4 = RotatePlane(Plane=vertical_face_plane_outer_4, Angle=-1.570796327)

merge_18 = Merge(Data1=flatten(start_of_the_face_lb_2), Data2=flatten(list_item_31.Item))

unit_z_7 = UnitZ(Factor=1)
start_of_the_face_lb_9 = Point(start_of_the_face_lb)
face_horiz_vector_5 = Vector(face_horiz_vector)
face_height_5 = Number(face_height)
face_length_6 = Number(face_length)
amplitude_6 = Amplitude(Vector=face_horiz_vector_5, Amplitude=face_length_6)
line_sdl_2 = LineSDL(Start=start_of_the_face_lb_9, Direction=unit_z_7, Length=face_height_5)
move_6 = Move(Geometry=line_sdl_2, Motion=amplitude_6)  # -> Geometry, Transform
end_points_7 = EndPoints(Curve=[line_sdl_2, move_6.Geometry])  # -> Start, End
dimension_offset_4 = Integer(dimension_offset_2)
multiplication_2 = Multiplication(A=dimension_offset_4, _2Or2=[-2, 2])

evaluate_4 = Evaluate(Expression=panel_20, X=dimension_offset_4)

# ----
# Element height
define_linear_dimension_3 = DefineLinearDimension(
    Point1=end_points_7.Start,
    Point2=end_points_7.End,
    DimensionPlane=rotate_plane_4,
    Offset=evaluate_4,
    DimensionStyle=annotation_style)

max_dimensions_vert = ExtendedGeometry(define_linear_dimension_3)

end_points_8 = EndPoints(Curve=line_sdl_2)  # -> Start, End
vector_2pt_2 = Vector2Pt(PointA=end_points_8.Start, PointB=end_points_8.End, Unitize=False)  # -> Vector, Length
move_7 = Move(Geometry=[list_item_30.Item, list_item_30.Item1], Motion=vector_2pt_2.Vector)  # -> simplify(Geometry), Transform; disabled
path_mapper_22 = PathMapper(move_7.Geometry, source=["{A}", "{A;B;C;D}"], target=["{path_index}", "{path_index}"])  # disabled
cull_duplicates = CullDuplicates(Points=[point_3, path_mapper_22, point_4], Tolerance=0.1, CullMode=3)  # -> Points, Indices, Valence; disabled
cull_index_4 = CullIndex(List=reverse(cull_duplicates.Points), Indices=0, Wrap=True)  # -> reverse(List); disabled
cull_index_5 = CullIndex(List=cull_duplicates.Points, Indices=0, Wrap=True)  # disabled
stream_filter_22 = StreamFilter(Gate=boolean_10, Stream1=cull_index_4)  # disabled
stream_filter_23 = StreamFilter(Gate=boolean_10, Stream1=cull_index_5)  # disabled
detailed_chain_bottom = ExtendedGeometry(define_linear_dimension)
longest_list = LongestList(ListListA=define_linear_dimension_2, ListListB=ColourSwatch(SwatchColor=RGB(255, 255, 255)), PaddingMode=2)  # -> ListListA, ListListB
max_dimensions = ExtendedGeometry(longest_list.ListListA)

# ----
# Selected dimensions
define_linear_dimension_4 = DefineLinearDimension(
    Point1=stream_filter_22,
    Point2=stream_filter_23,
    DimensionPlane=rotate_plane_3,
    Offset=number_slider_2,
    DimensionStyle=annotation_style)  # disabled

selected_dimensions = ExtendedGeometry(define_linear_dimension_4)  # disabled

elevation_points = Point(merge_18)
cull_index_6 = CullIndex(List=reverse(elevation_points), Indices=0, Wrap=True)  # -> reverse(List)
cull_index_7 = CullIndex(List=elevation_points, Indices=0, Wrap=True)

elevation_points_2 = Point(elevation_points)  # disabled
move_8 = Move(Geometry=elevation_points_2, Motion=amplitude_3)  # -> Geometry, Transform; disabled
elevation_points_3 = Point(elevation_points)  # disabled
plane_origin_2 = PlaneOrigin(Base=vertical_face_plane_outer_3, Origin=elevation_points_3)  # disabled
plane_origin_3 = PlaneOrigin(Base=vertical_face_plane_outer_3, Origin=move_8.Geometry)  # disabled
move_9 = Move(Geometry=plane_origin_3, Motion=amplitude_5)  # -> Geometry, Transform; disabled
move_10 = Move(Geometry=plane_origin_2, Motion=amplitude_4)  # -> Geometry, Transform; disabled
flip_plane = FlipPlane(Plane=move_9.Geometry, ReverseX=True, ReverseY=False, SwapAxes=False)  # disabled
deconstruct = Deconstruct(Point=move_9.Geometry)  # -> XComponent, YComponent, expr("x/1000", ZComponent); disabled
move_11 = Move(Geometry=move_9.Geometry, Motion=unit_z_6)  # -> Geometry, Transform; disabled
move_12 = Move(Geometry=move_10.Geometry, Motion=unit_z_6)  # -> Geometry, Transform; disabled
flip_plane_2 = FlipPlane(Plane=move_11.Geometry, ReverseX=True, ReverseY=False, SwapAxes=False)  # disabled
format_2 = Format(Format=panel_47, Culture=127, Data0=deconstruct.ZComponent)  # disabled
orient = Orient(Geometry=curve_4, Source=PlaneXY(0, 0, 0), Target=[flip_plane, move_10.Geometry])  # -> flatten(Geometry), Transform; disabled
expression_16 = Expression(Variable_x=format_2, Expression="Format(\"{0}, {1}\", x, y)")  # disabled
define_text_object = DefineTextObject(Text=format_2, Plane=flip_plane_2, DimensionStyle=annotation_style, OutputType="Text")  # disabled
define_text_object_2 = DefineTextObject(Text=format_2, Plane=move_12.Geometry, DimensionStyle=annotation_style, OutputType="Text")  # disabled
elevation_marks = Curve(orient.Geometry)  # disabled
elevations_right = ExtendedGeometry(define_text_object)  # disabled
elevations_left = ExtendedGeometry(define_text_object_2)  # disabled

# ----
# Detailed chain Left
define_linear_dimension_5 = DefineLinearDimension(
    Point1=cull_index_6,
    Point2=cull_index_7,
    DimensionPlane=rotate_plane_4,
    Offset=expr("-x", dimension_offset_2),
    DimensionStyle=annotation_style)  # disabled

detailed_chain_left = ExtendedGeometry(define_linear_dimension_5)

face_horiz_vector_6 = Vector(face_horiz_vector)
face_length_7 = Number(face_length)
amplitude_7 = Amplitude(Vector=face_horiz_vector_6, Amplitude=face_length_7)
move_13 = Move(Geometry=cull_index_6, Motion=amplitude_7)  # -> Geometry, Transform
move_14 = Move(Geometry=cull_index_7, Motion=amplitude_7)  # -> Geometry, Transform

# ----
# Detailed chain Right
define_linear_dimension_6 = DefineLinearDimension(
    Point1=move_13.Geometry,
    Point2=move_14.Geometry,
    DimensionPlane=rotate_plane_4,
    Offset=dimension_offset_2,
    DimensionStyle=annotation_style)  # disabled

detailed_chain_right = ExtendedGeometry(define_linear_dimension_6)

# ----
# OUTPUT
colour_swatch_5 = ColourSwatch(SwatchColor=RGB(255, 255, 255))
elevations_right_2 = ExtendedGeometry(elevations_right)
elevations_left_2 = ExtendedGeometry(elevations_left)
selected_dimensions_2 = ExtendedGeometry(selected_dimensions)
elevation_marks_2 = Curve(elevation_marks)
max_dimensions_vert_2 = ExtendedGeometry(max_dimensions_vert)
relay_5 = Relay([elevations_left_2, elevations_right_2])
list_length_20 = ListLength(List=flatten(elevation_marks_2))
list_length_21 = ListLength(List=flatten(relay_5))
longest_list_2 = LongestList(ListListA=max_dimensions_vert_2, ListCOLORS=colour_swatch_5, PaddingMode=2)  # -> ListListA, ListCOLORS
list_length_22 = ListLength(List=selected_dimensions_2)
duplicate_data_10 = DuplicateData(Data=ColourSwatch(SwatchColor=RGB(255, 255, 255)), Number=list_length_22, Order=True)
duplicate_data_11 = DuplicateData(Data=colour_swatch_5, Number=list_length_20, Order=True)
duplicate_data_12 = DuplicateData(Data=colour_swatch_5, Number=list_length_21, Order=True)
selected_dimensions_3 = ExtendedGeometry(selected_dimensions)
detailed_chain_colors_2 = Colour(detailed_chain_colors)
colors_vertical_dim_2 = Text(colors_vertical_dim)
detailed_chain_bottom_2 = ExtendedGeometry(detailed_chain_bottom)
detailed_chain_right_2 = ExtendedGeometry(detailed_chain_right)
elevation_marks_3 = Curve(elevation_marks)
detailed_chain_left_2 = ExtendedGeometry(detailed_chain_left)
max_dimensions_2 = ExtendedGeometry(max_dimensions)
merge_19 = Merge(
    Data1=flatten(detailed_chain_bottom_2),
    Data2=flatten(max_dimensions_2),
    Data3=flatten(detailed_chain_left_2),
    Data4=flatten(detailed_chain_right_2),
    Data5=flatten(longest_list_2.ListListA),
    Data6=flatten(selected_dimensions_3),
    Data7=flatten(elevation_marks_3),
    Data8=flatten(relay_5))  # -> flatten(Result)
merge_20 = Merge(
    Data1=flatten(detailed_chain_colors_2),
    Data2=flatten(longest_list.ListListB),
    Data3=flatten(colors_vertical_dim_2),
    Data4=flatten(colors_vertical_dim_2),
    Data5=flatten(longest_list_2.ListCOLORS),
    Data6=flatten(duplicate_data_10),
    Data7=flatten(duplicate_data_11),
    Data8=flatten(duplicate_data_12))  # -> flatten(Result)
face_length_8 = Number(face_length)
face_height_6 = Number(face_height)
selected_geometry_18 = ExtendedGeometry(selected_geometry_4)
text_9 = Text(concatenate)
dividers_2 = Curve(dividers)
integer_10 = Integer(face_length_8)
integer_11 = Integer(face_height_6)
entwine_2 = Entwine(Branch00=integer_10, Branch01=integer_11, Branch02=text_9, FlattenInputs=True)  # -> simplify(Result)
entwine_3 = Entwine(
    Branch00=ColourSwatch(SwatchColor=RGB(234, 255, 0)),
    Branch01=ColourSwatch(SwatchColor=RGB(0, 242, 255)),
    Branch02=ColourSwatch(SwatchColor=RGB(0, 0, 0)),
    Branch03=ColourSwatch(SwatchColor=RGB(255, 255, 255)),
    FlattenInputs=True)  # -> simplify(Result)
entwine_4 = Entwine(
    Branch00=selected_geometry_18,
    Branch01=gh_contours_of_all_re_of_selected_type_2,
    Branch02=dividers_2,
    Branch03=merge_19,
    FlattenInputs=True)  # -> simplify(Result)
entwine_5 = Entwine(
    Branch00=Slider(11, range=0..20),
    Branch01=Slider(11, range=0..20),
    Branch02=Slider(5, range=0..10),
    Branch03=Slider(2, range=0..10),
    FlattenInputs=True)  # -> simplify(Result)
display_widths = Number(entwine_5)

geometry = Geometry(elevation_marks_3)
custom_preview_lineweights = CustomPreviewLineweights(Geometry=entwine_4, Shader=entwine_3, Thickness=display_widths, Absolute=False)

# ----
# OUTPUT
# Tree:
# 0) blocks
# 1) horizontal axes
# 2) horizontal direction
# 3) vertical axes
# 4) vertical direction
output_for_mullions_and_transoms_creatin_2 = RemoteReceiver(output_for_mullions_and_transoms_creatin)  # "Output.For mullions and transoms creating cluster"
generated_geo_facadesubfaces = ExtendedGeometry(facade_sub_faces_to_bake_2)
attributes = EFDataDescription(modify_elefront_attributes_2)
ui_messages = Text(entwine_2)
gen_attributes = ClusterOutput(attributes)  # Gen. Attributes
display_widths_2 = ClusterOutput(display_widths)  # Display: widths
generated_geo = ClusterOutput(generated_geo_facadesubfaces)  # Generated geo
display_geo = ClusterOutput(entwine_4)  # Display: geo
display_colors = ClusterOutput(entwine_3)  # Display: colors
info_help = ClusterOutput(text_6)  # Info&Help
ui_messages_2 = ClusterOutput(ui_messages)  # UI Messages

merge_21 = Merge(Data1=path_mapper_9, Data2=output_for_mullions_and_transoms_creatin_2)

create_mullions = ClusterOutput(merge_21)  # --> Create mullions

panel_48 = Panel(output_for_mullions_and_transoms_creatin_2)

# ==== cluster DBPaths: Gets paths for fatabase, project and current json
project_name = ClusterInput()  # project_name
gh_doc_path = ClusterInput()  # .gh doc path
gh_depth = ClusterInput()  # how many levels inside APP/GH directory is the file placed
list_length = ListLength(List=project_name)
text_split = TextSplit(Text=gh_doc_path, Separators="\")
addition = Addition(A=list_length, B=0)
split_list = SplitList(List=reverse(text_split), Index=expr("x+1", gh_depth))  # -> ListA, reverse(ListB)

# ----
# Read project name
# Check now is disabled for now
getting_rhinodoc_attribute = Panel("HO_ProjectName")
addition_2 = Addition(A=addition, B=1)
python = PythonScript(key=getting_rhinodoc_attribute, checkNow=addition_2)  # -> value
# ---------- python: Python ----------
import rhinoscriptsyntax as rs
import scriptcontext as sc
import Rhino

sc.doc = Rhino.RhinoDoc.ActiveDoc

#if checkNow == True:
value = rs.GetDocumentUserText(key)

sc.doc = ghdoc

print value
# ---------- end python ----------
panel = Panel(python)

text_join = TextJoin(Text=flatten(split_list.ListB), Join="\")
concatenate = Concatenate(FragmentA=text_join, FragmentB="\DB")
stream_filter = StreamFilter(Gate=addition, Stream0=python, Stream1=project_name)
concatenate_2 = Concatenate(FragmentA=concatenate, FragmentB="\Projects\", FragmentC=stream_filter)
concatenate_3 = Concatenate(FragmentA=concatenate_2, FragmentB="\", FragmentC="elements.json")
db_path = ClusterOutput(concatenate)  # db_path
project_path = ClusterOutput(concatenate_2)  # project path
json_path = ClusterOutput(concatenate_3)  # json_path

# ==== cluster GHAppPaths_2: Gets paths used by app
gh_depth = ClusterInput()  # how many levels inside APP/GH directory is the file placed
gh_doc_path = ClusterInput()  # .gh doc path
text_split = TextSplit(Text=gh_doc_path, Separators="\")
text = Text(gh_depth)
split_list = SplitList(List=reverse(text_split), Index=gh_depth)  # -> ListA, reverse(ListB)
cull_index = CullIndex(List=text_split, Indices=-1, Wrap=True)
ghpython_script = GhPythonScript()  # -> gh_local_dir, user_settings_path; same code as ghpython_script
text_join = TextJoin(Text=split_list.ListB, Join="\")
text_join_2 = TextJoin(Text=cull_index, Join="\")
panel = Panel(text_join)
gh_depth_2 = ClusterOutput(text)  # .gh depth
gh_app_dir = ClusterOutput(text_join)  # gh app dir
module_dir = ClusterOutput(text_join_2)  # module dir
gh_local_dir = ClusterOutput(ghpython_script.gh_local_dir)  # gh_local_dir
user_settings_path = ClusterOutput(ghpython_script.user_settings_path)  # user_settings_path

# ==== cluster UserSettings: Retrieves app settings from database
user_path = ClusterInput()  # user_path
user_settings = GhPythonScript(user_path=user_path)  # -> out, db_path, UI_window_height, user_name
# ---------- user_settings: Python ----------
__author__ = "Yury Nasonov"
__version__ = "2020.10.15"

import rhinoscriptsyntax as rs
import json
db_path = user_path + "\UserData\UserSettings.db"
f = open(db_path, "r")
a = (f.read())

y = json.loads(a)
UI_window_height = y["UI_window_height"]
user_name = y["user_name"] 
f.close()
# ---------- end user_settings ----------
panel = Panel(user_settings.db_path)
db_path = ClusterOutput(user_settings.db_path)  # db_path
ui_window_height = ClusterOutput(user_settings.UI_window_height)  # UI_window_height
user_name = ClusterOutput(user_settings.user_name)  # user_name
status = ClusterOutput(user_settings.out)  # status

# ==== cluster CreateProfile: Create Profile
gzaddreferences = CSharpScript(
    Run=True,
    Reference=["C:\Program Files\Rhino 7\Plug-ins\Grasshopper\Components\ScriptComponents.gha", "C:\Program Files\NoDoubts\Godzilla\System\Godzilla.dll", "C:\Program Files\NoDoubts\Godzilla\System\RhGodzilla.rhp"])  # -> Done; inputs Run: Boolean; same code as gzaddreferences
# Go to clicked step
gzopengh = CSharpScript(Reference=["C:\Program Files\Rhino 7\Plug-ins\Grasshopper\Components\ScriptComponents.gha", "C:\Program Files\NoDoubts\Godzilla\System\Godzilla.dll", "C:\Program Files\NoDoubts\Godzilla\System\RhGodzilla.rhp"])  # -> done; inputs resName: String, runNow: Boolean
# ---------- gzopengh: C# usings ----------
using RhGodzilla;
using Godzilla;
# ---------- gzopengh: C# ----------
    done = false;
    if (runNow == true){
      RhGodzilla.GhApp.GhDefManager.Instance.OpenGetGhDefinition(resName, true);
    }
    done = runNow;
# ---------- end gzopengh ----------
gz_menu = CSharpScript(Reference=["C:\Program Files\Rhino 7\Plug-ins\Grasshopper\Components\ScriptComponents.gha", "C:\Program Files\NoDoubts\Godzilla\System\Godzilla.dll", "C:\Program Files\NoDoubts\Godzilla\System\RhGodzilla.rhp"])  # -> resources, names, tooltips
# ---------- gz_menu: C# ----------
    //    var gz = Rhino.RhinoApp.GetPlugInObject("RhGodzilla");
    //    var gz2 = RhGodzilla.RhGodzillaPlugin.Instance as RhGodzilla.RhGodzillaPlugin;
    names = RhGodzilla.GhApp.GhAppHelpers.GetMenuNames();
    resources = RhGodzilla.GhApp.GhAppHelpers.GetMenuResourceNames();
    tooltips = RhGodzilla.GhApp.GhAppHelpers.GetMenuTooltips();
# ---------- end gz_menu ----------
# Save block info to DocUserText
panel = Panel(gzaddreferences)
docinfo = DocumentInfo(AutoUpdate=False, Recursive=False)  # -> DocumentName, DocumentFilePath, Components, Params, _3rdPartyAssemblies
value_list = ValueList({"Point": 0, "Curve": 1, "Arc": 2, "Circle": 3, "Ellipse": 4, "Line": 5, "Polyline": 6, "Surface": 7, "Brep": 8, "Mesh": 9, "Polysurface": 10, "Block": 11, "Text": 12, "TextDot": 13, "Dimension": 14, "LinearDimension": 15, "AngularDimension": 16, "Hatch": 17, "Leader": 18}, selected="Point")
gzcommand = CSharpScript(
    runNow=False,
    echo=False,
    Reference=["C:\Program Files\Rhino 7\Plug-ins\Grasshopper\Components\ScriptComponents.gha", "C:\Program Files\NoDoubts\Godzilla\System\Godzilla.dll", "C:\Program Files\NoDoubts\Godzilla\System\RhGodzilla.rhp"])  # -> done; inputs command: String, runNow: Boolean, echo: Boolean
# ---------- gzcommand: C# ----------
    done = false;
    if (runNow == true){
      Rhino.RhinoApp.RunScript(command, echo);
      done = true;
    }
# ---------- end gzcommand ----------
tsort = SortText(Keys=docinfo.Components, Culture=127)  # -> Keys, Values
gzuicolors = CSharpScript(Reference=["C:\Program Files\Rhino 7\Plug-ins\Grasshopper\Components\ScriptComponents.gha", "C:\Program Files\NoDoubts\Godzilla\System\Godzilla.dll", "C:\Program Files\NoDoubts\Godzilla\System\RhGodzilla.rhp"])  # -> Current_step_bg
# ---------- gzuicolors: C# ----------
    var gz = Rhino.RhinoApp.GetPlugInObject("RhGodzilla");
    var gz2 = RhGodzilla.RhGodzillaPlugin.Instance as RhGodzilla.RhGodzillaPlugin;

    Current_step_bg = RhGodzilla.GhApp.GhAppHelpers.GetUIColor("UI_color_current_step_bg");
# ---------- end gzuicolors ----------
panel_2 = Panel(docinfo._3rdPartyAssemblies)
panel_3 = Panel(tsort.Keys)
gzconduit = CSharpScript(Reference=["C:\Program Files\Rhino 7\Plug-ins\Grasshopper\Components\ScriptComponents.gha", "C:\Program Files\NoDoubts\Godzilla\System\Godzilla.dll", "C:\Program Files\NoDoubts\Godzilla\System\RhGodzilla.rhp"])  # -> out; inputs geo: tree, colors: tree of Color, widths: tree of Int32
# ---------- gzconduit: C# ----------
    var gzPlugin = Rhino.RhinoApp.GetPlugInObject("RhGodzilla");
    var gz = RhGodzilla.RhGodzillaPlugin.Instance as RhGodzilla.RhGodzillaPlugin;
    var conduit = gz.GhConduit;
    conduit.SetGeoAndData(geo, colors, widths);
    conduit.Enabled = true;
# ---------- end gzconduit ----------
input_is_profile_selected_as_tree = RemoteReceiver()  # disabled
text = Text(Tree({0}: ["HO_DefaultProfile-Window head"], {1}: ["HO_DefaultProfile-Window jamb L", "HO_DefaultProfile-Window jamb R"], {2}: ["HO_DefaultProfile-Window mullion"], {3}: ["HO_DefaultProfile-Window sill"], {4}: ["HO_DefaultProfile-Window transom"], {5}: ["HO_DefaultProfile-Door head"]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))  # disabled
text_2 = Text(Tree({0}: ["1;0;LU"], {1}: ["0;0;LU", "0;1;LU"], {2}: ["0;0;MM"], {3}: ["1;0;RB"], {4}: ["1;0;MM"], {5}: ["1;0;LU"]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))  # disabled
panel_4 = Panel(text)  # disabled
dispatch = Dispatch(List=text, DispatchPattern=input_is_profile_selected_as_tree)  # -> flatten(ListA), ListB; disabled
dispatch_2 = Dispatch(List=text_2, DispatchPattern=input_is_profile_selected_as_tree)  # -> flatten(ListA), ListB; disabled
panel_5 = Panel(text_2)  # disabled
panel_6 = Panel("Profile - Rectangular - ")  # disabled
input_selected_existing_profile = RemoteReceiver()  # disabled
panel_7 = Panel(" x ")  # disabled
panel_8 = Panel(";")  # disabled
project_of_next_unique_block = RemoteReceiver()  # disabled
cluster = Cluster_2(text=input_selected_existing_profile)  # disabled
panel_9 = Panel(";")  # disabled
panel_10 = Panel("Profile custom #")  # disabled
input_block_name = RemoteReceiver()  # disabled
panel_11 = Panel(";")  # disabled
concatenate = Concatenate(FragmentA=cluster, FragmentF=panel_9, FragmentE=dispatch_2.ListA)  # disabled
concatenate_2 = Concatenate(
    FragmentA=panel_10,
    FragmentB=project_of_next_unique_block,
    FragmentE=" - ",
    FragmentD=input_block_name,
    FragmentC=panel_11,
    FragmentF=dispatch_2.ListA)  # disabled
panel_12 = Panel("""HO_GH-APP SMALL bottom
HO_GH-APP SMALL left""")
move_text = Panel("""{0,-20,0}
{-20,0,0}""")
vector_xyz = VectorXYZ(XComponent=Slider(281, range=-400..401), YComponent=Slider(46, range=-200..200), ZComponent=0)  # -> Vector, Length
vector_xyz_2 = VectorXYZ(XComponent=Slider(-89, range=-400..401), YComponent=Slider(-2, range=-200..200), ZComponent=0)  # -> Vector, Length
vector_xyz_3 = VectorXYZ(XComponent=Slider(234, range=-400..401), YComponent=Slider(-9, range=-200..200), ZComponent=0)  # -> Vector, Length
vector_xyz_4 = VectorXYZ(XComponent=Slider(-42, range=-400..401), YComponent=Slider(55, range=-200..200), ZComponent=0)  # -> Vector, Length
number_slider = Slider(81, range=0..1000)
value_list_2 = ValueList({"Default", "Millimeter Architectural", "Millimeter Large", "Millimeter Small", "HO_GH-APP", "HO_GH-APP BIG", "HO_GH-APP 100", "HO_GH-APP 200", "Millimeter Small2", "HO_GH-APP SMALL bottom", "HO_GH-APP SMALL left"}, selected="Millimeter Architectural")
colour_swatch = ColourSwatch(SwatchColor=RGB(54, 54, 54))
define_text_object = DefineTextObject(Plane=PlaneXY(0, 0, 0), DimensionStyle="HO_GH-APP 45", OutputType="Text")  # disabled
panel_13 = Panel("""HO_GH-APP SMALL bottom
HO_GH-APP SMALL left""")
colour_swatch_2 = ColourSwatch(SwatchColor=RGB(234, 255, 0))
colour_swatch_3 = ColourSwatch(SwatchColor=RGB(255, 255, 255))

# ----
# Changelog
panel_14 = Panel("""CHANGELOG

17.02.2021 by Yury Nasonov
initial release

TO DO
Clean up 

REQUIREMENTS


BUGS or LIMITATIONS""")
text_3 = Text(panel_14)

dimensions = Relay()
colour_swatch_4 = ColourSwatch(SwatchColor=RGB(0, 149, 255))
entwine = Entwine(
    Branch00=colour_swatch_4,
    Branch01=colour_swatch_4,
    Branch02=ColourSwatch(SwatchColor=RGB(54, 54, 54)),
    Branch03=ColourSwatch(SwatchColor=RGB(240, 74, 74)),
    Branch04=ColourSwatch(SwatchColor=RGB(224, 224, 224)),
    FlattenInputs=True)  # -> simplify(Result)
entwine_2 = Entwine(Branch00=Slider(11, range=0..20), Branch02=Slider(2, range=0..10), Branch03=Slider(8, range=0..10), FlattenInputs=True)  # -> simplify(Result)
entwine_3 = Entwine(FlattenInputs=True)  # -> simplify(Result)
display_widths = Number(entwine_2)

# ----
# General settings
# For rectangle profiles
# For custom profiles
# Actions
base_point_coordinates = ClusterInput()  # Base Point Coordinates
rectangle_depth = ClusterInput()  # Rectangle depth
isprofileeditoractive = ClusterInput()  # IsProfileEditorActive?
profile_type = ClusterInput()  # Profile type(0=rectangle,..)
profile_orientation = ClusterInput()  # Profile orientation
rectangle_width = ClusterInput()  # Rectangle width
custom_profile_name = ClusterInput()  # Custom profile name
custom_profile_number = ClusterInput()  # Custom profile number
customprofilegeo = ClusterInput()  # CustomProfileGeo
bake_ancor_points = ClusterInput()  # Bake ancor Points?
apply = ClusterInput()  # Apply

parameter = Parameter(x=profile_type)  # -> a
# ---------- parameter: Python ----------
# ACTION:   just uses input as output  
# LIMITATION: 
# TO DO:      

__author__ = "Yury Nasonov"
__version__ = "1"

ghenv.Component.Name = "Parameter"
ghenv.Component.NickName = 'Parameter'
ghenv.Component.Message = 'a = x'

a=x
# ---------- end parameter ----------
parameter_2 = Parameter(x=customprofilegeo)  # -> a; same code as parameter
parameter_3 = Parameter(x=profile_orientation)  # -> a; same code as parameter
parameter_4 = Parameter(x=base_point_coordinates)  # -> a; same code as parameter
parameter_5 = Parameter(x=rectangle_width)  # -> a; same code as parameter
parameter_6 = Parameter(x=rectangle_depth)  # -> a; same code as parameter
parameter_7 = Parameter(x=isprofileeditoractive)  # -> a; same code as parameter
parameter_8 = Parameter(x=custom_profile_name)  # -> a; same code as parameter
parameter_9 = Parameter(x=bake_ancor_points)  # -> a; same code as parameter
parameter_10 = Parameter(x=apply)  # -> a; same code as parameter
parameter_11 = Parameter(x=custom_profile_number)  # -> a; same code as parameter

input_selectedgeoforcustomprofile = RemoteSender(parameter_2)
input_profile_type_0_rectangle = RemoteSender(parameter)
input_of_next_unique_block = RemoteSender(parameter_11)
input_basepointcoordinates = RemoteSender(parameter_4)
input_profile_orientation = RemoteSender(parameter_3)
input_rectanglewidth = RemoteSender(parameter_5)
input_rectangledepth = RemoteSender(parameter_6)
isprofileeditoractive_2 = RemoteSender(parameter_7)
bake_ancor_points_2 = RemoteSender(parameter_9)
input_blockname = RemoteSender(parameter_8)
input_apply = RemoteSender(parameter_10)

input_profile_type_0_exist = RemoteSender(parameter)
input_rectanglewidth_2 = RemoteReceiver(input_rectanglewidth)  # disabled
input_rectangledepth_2 = RemoteReceiver(input_rectangledepth)  # disabled
input_profile_type_0_exist_2 = RemoteReceiver(input_profile_type_0_exist)  # disabled
concatenate_3 = Concatenate(
    FragmentA=panel_6,
    FragmentB=input_rectanglewidth_2,
    FragmentC=panel_7,
    FragmentD=input_rectangledepth_2,
    FragmentF=panel_8,
    FragmentE=dispatch_2.ListA)  # disabled
# CREATE PROFILE
stream_filter = StreamFilter(Gate=input_profile_type_0_exist_2, Stream0=concatenate, Stream1=concatenate_3, Stream2=concatenate_2)  # disabled
input_rectanglewidth_3 = RemoteReceiver(input_rectanglewidth)

# ----
# Create rectangular profile
input_rectanglewidth_4 = RemoteReceiver(input_rectanglewidth)
vector_xyz_5 = VectorXYZ(XComponent=expr("-x/2", input_rectanglewidth_4), YComponent=0, ZComponent=0)  # -> Vector, Length
point_0_0_0 = Point(Point(0, 0, 0))
move = Move(Geometry=point_0_0_0, Motion=vector_xyz_5.Vector)  # -> Geometry, Transform
vector_xyz_6 = VectorXYZ(XComponent=input_rectanglewidth_4, YComponent=0, ZComponent=0)  # -> Vector, Length
move_2 = Move(Geometry=move.Geometry, Motion=vector_xyz_6.Vector)  # -> Geometry, Transform
merge = Merge(Data1=move.Geometry, Data2=point_0_0_0, Data3=move_2.Geometry)
input_rectangledepth_3 = RemoteReceiver(input_rectangledepth)
gh_ancorpoints_for_rectangle_profile = RemoteSender(merge)
rectangle = Rectangle(Plane=move.Geometry, XSize=input_rectanglewidth_3, YSize=input_rectangledepth_3, Radius=0)  # -> Rectangle, Length
orient = Orient(Geometry=rectangle.Rectangle, Source=point_0_0_0, Target=PlaneXY(0, 0, 0))  # -> Geometry, Transform
gh_rectangle_at_xy_plane = RemoteSender(orient.Geometry)

input_profile_orientation_2 = RemoteReceiver(input_profile_orientation)
gh_ancorpoints_for_rectangle_profile_2 = RemoteReceiver(gh_ancorpoints_for_rectangle_profile)
input_profile_type_0_rectangle_2 = RemoteReceiver(input_profile_type_0_rectangle)
input_profile_orientation_3 = RemoteReceiver(input_profile_orientation)
input_apply_2 = RemoteReceiver(input_apply)
done = ClusterOutput(input_apply_2)  # Done

# ----
# Analyze ancor points
input_selectedgeoforcustomprofile_2 = RemoteReceiver(input_selectedgeoforcustomprofile)
panel_15 = Panel("Point")
filter_by_type = FilterByType(Geometry=input_selectedgeoforcustomprofile_2, ObjectType=value_list)  # -> flatten(Geometry)
unit_x = UnitX(Factor=1)
panel_16 = Panel("""0 to 44
45 to 134
135 to 224
225 to 314
314 to 360""")
_0_horizont_1_vert = Panel("""0
1
0
1
0""")
horizont = Panel("""L
M
R""")
panel_17 = Panel("""LU
MM
RB""")
panel_18 = Panel("""RB
MM
LU""")
vert = Panel("""B
M
U""")
horizont_2 = Panel("""LU
MM
RB""")

point = Point(input_selectedgeoforcustomprofile_2)

# ---- group: LB
# Create custom profile
# TO DO:  Align, rotate
input_selectedgeoforcustomprofile_3 = RemoteReceiver(input_selectedgeoforcustomprofile)
filter_by_type_2 = FilterByType(Geometry=input_selectedgeoforcustomprofile_3, ObjectType="Curve")  # -> flatten(Geometry)
curve = Curve(flatten(input_selectedgeoforcustomprofile_3))  # disabled
clean_tree = CleanTree(RemoveNulls=True, RemoveInvalid=True, RemoveEmpty=False, Tree=filter_by_type_2)
planar = Planar(Curve=clean_tree)  # -> Planar, Plane, Deviation
deconstruct = Deconstruct(Point=planar.Plane)  # -> XComponent, YComponent, ZComponent
input_basepointcoordinates_2 = RemoteReceiver(input_basepointcoordinates)
isprofileeditoractive_3 = RemoteReceiver(isprofileeditoractive_2)
symbol_simple = SymbolSimple(Style=Slider(3, range=0..100), Size=12, Rotation=0, Colour=RGB(255, 105, 180))
isprofileeditoractive_4 = RemoteReceiver(isprofileeditoractive_2)
symbol_simple_2 = SymbolSimple(Style=Slider(2, range=0..100), Size=15, Rotation=0, Colour=RGB(255, 105, 180))
panel_19 = Panel(deconstruct.ZComponent)
isprofileeditoractive_5 = RemoteReceiver(isprofileeditoractive_2)
unit_z = UnitZ(Factor=1)
move_3 = Move(Geometry=clean_tree, Motion=unit_z)  # -> Geometry, Transform
number_slider_2 = Slider(90, range=0..100)
number_slider_3 = Slider(0, range=0..100)
number_slider_4 = Slider(57, range=0..1000)
x = Panel("Interior")
x_2 = Panel("Exterior")
isprofileeditoractive_6 = RemoteReceiver(isprofileeditoractive_2)
isprofileeditoractive_7 = RemoteReceiver(isprofileeditoractive_2)
colour_swatch_5 = ColourSwatch(SwatchColor=RGB(224, 224, 224))

# ----
# AncorPointLU
# AncorPointRB
bounding_box = BoundingBox(Content=clean_tree, Plane=PlaneXY(0, 0, 0), UnionBox=True)  # -> Box, Box_2
deconstruct_brep = DeconstructBrep(Brep=bounding_box.Box)  # -> Faces, Edges, Vertices
list_item = ListItem(List=deconstruct_brep.Vertices, Index=0, Wrap=True)  # -> Item, Item1, Item2, Item3
point_2 = Point(list_item.Item)
point_3 = Point(list_item.Item1)
input_profile_orientation_4 = RemoteReceiver(input_profile_orientation)
line = Line(StartPoint=point_2, EndPoint=point_3)
line_2 = Line(StartPoint=point_2, EndPoint=list_item.Item3)
stream_filter_2 = StreamFilter(Gate=input_profile_orientation_4, Stream0=line, Stream1=line_2)
point_on_curve = PointOnCurve(stream_filter_2, parameter=0.5)
stream_filter_3 = StreamFilter(Gate=input_profile_orientation_4, Stream0=point_2, Stream1=list_item.Item3)
stream_filter_4 = StreamFilter(Gate=input_profile_orientation_4, Stream0=list_item.Item1, Stream1=point_2)
merge_2 = Merge(Data1=stream_filter_3, Data2=point_on_curve, Data3=stream_filter_4)

deconstruct_box = DeconstructBox(Box=bounding_box.Box)  # -> Plane, X, Y, Z; disabled
deconstruct_domain = DeconstructDomain(Domain=deconstruct_box.X)  # -> Start, End; disabled
deconstruct_domain_2 = DeconstructDomain(Domain=deconstruct_box.Y)  # -> Start, End; disabled
subtraction = Subtraction(A=deconstruct_domain.End, B=deconstruct_domain.Start)  # disabled
subtraction_2 = Subtraction(A=deconstruct_domain_2.End, B=deconstruct_domain_2.Start)  # disabled
display_selectedgeo = RemoteSender(move_3.Geometry)
display_selectedgeo_2 = RemoteReceiver(display_selectedgeo)

clean_tree_2 = CleanTree(RemoveNulls=True, RemoveInvalid=True, RemoveEmpty=False, Tree=point)  # -> flatten(Tree)
list_length = ListLength(List=clean_tree_2)
gh_ancorpoints = RemoteSender(clean_tree_2)
addition = Addition(A=list_length, B=0)
boolean = Boolean(addition)
gh_ancorpoints_2 = RemoteReceiver(gh_ancorpoints)
fit_line = FitLine(Points=gh_ancorpoints_2)
angle = Angle(VectorA=fit_line, VectorB=unit_x, Plane=PlaneXY(0, 0, 0))  # -> expr("deg(x)", Angle), Reflex
gh_ancorpoints_3 = RemoteReceiver(gh_ancorpoints)
find_domain = FindDomain(Domains=panel_16, Number=angle.Angle, Strict=False)  # -> Index, Neighbour
rotate = Rotate(Geometry=gh_ancorpoints_3, Angle=-1.570796327, Plane=PlaneXY(0, 0, 0))  # -> Geometry, Transform
list_item_2 = ListItem(List=_0_horizont_1_vert, Index=find_domain.Index, Wrap=True)
stream_filter_5 = StreamFilter(Gate=list_item_2, Stream0=gh_ancorpoints_3, Stream1=rotate.Geometry)
sort_points = SortPoints(Points=stream_filter_5)  # -> Points, Indices
stream_filter_6 = StreamFilter(Gate=list_item_2, Stream0=panel_17, Stream1=panel_18)
list_item_3 = ListItem(List=stream_filter_6, Index=sort_points.Indices, Wrap=True)

gh_ancorpoints_are_referenced = RemoteSender(boolean)
gh_referenced_ancorpoint_orientation = RemoteSender(list_item_2)
gh_ancorpoints_are_referenced_2 = RemoteReceiver(gh_ancorpoints_are_referenced)
gh_ancorpoints_are_referenced_3 = RemoteReceiver(gh_ancorpoints_are_referenced)

stream_filter_7 = StreamFilter(Gate=gh_ancorpoints_are_referenced_2, Stream0=horizont_2, Stream1=list_item_3)

# ----
# To do more stable when
# different amount of  points is used
gh_ancorpoints_4 = RemoteReceiver(gh_ancorpoints)
orient_2 = Orient(Geometry=gh_ancorpoints_4, Source=point_on_curve, Target=PlaneXY(0, 0, 0))  # -> Geometry, Transform
stream_filter_8 = StreamFilter(Gate=gh_ancorpoints_are_referenced_3, Stream0=merge_2, Stream1=orient_2.Geometry)
list_item_4 = ListItem(List=stream_filter_8, Index=0, Wrap=True)  # -> Item, Item1, Item2
panel_20 = Panel("""AncorPoint
AncorPoint
AncorPoint""")
panel_21 = Panel(">::SupportGeo::AncorPoints")
panel_22 = Panel("""HO_Type
HO_AncorPointType""")
merge_3 = Merge(Data1=graft(panel_20), Data2=graft(stream_filter_7))
define_object_attributes = DefineObjectAttributes(UserKeys=panel_22, UserValues=merge_3, Layer=panel_21)
bake_ancor_points_3 = RemoteReceiver(bake_ancor_points_2)
bake_objects = BakeObjects(Geometry=graft(stream_filter_8), Attributes=define_object_attributes, Bake=bake_ancor_points_3)

gh_referenced_ancorpoint_orientation_2 = RemoteReceiver(gh_referenced_ancorpoint_orientation)
gh_ancorpoints_are_referenced_4 = RemoteReceiver(gh_ancorpoints_are_referenced)
gh_referenced_ancorpoint_orientation_3 = RemoteReceiver(gh_referenced_ancorpoint_orientation)
stream_filter_9 = StreamFilter(
    Gate=gh_ancorpoints_are_referenced_4,
    Stream0=input_profile_orientation_2,
    Stream1=gh_referenced_ancorpoint_orientation_2)
gh_ancorpoints_5 = RemoteReceiver(gh_ancorpoints)
list_item_5 = ListItem(List=[number_slider_3, number_slider_2], Index=stream_filter_9, Wrap=True)
list_item_6 = ListItem(List=panel_12, Index=gh_referenced_ancorpoint_orientation_3, Wrap=True)
list_item_7 = ListItem(List=move_text, Index=gh_referenced_ancorpoint_orientation_3, Wrap=True)
move_4 = Move(Geometry=gh_ancorpoints_5, Motion=list_item_7)  # -> Geometry, Transform
define_text_object_2 = DefineTextObject(Text=stream_filter_7, Plane=move_4.Geometry, DimensionStyle=list_item_6, OutputType="Text")
display_text_for_ancorpoints = RemoteSender(define_text_object_2)
gh_ancorpoints_are_referenced_5 = RemoteReceiver(gh_ancorpoints_are_referenced)
stream_filter_10 = StreamFilter(Gate=gh_ancorpoints_are_referenced_5, Stream0=stream_filter_7, Stream1=stream_filter_7)
orient_3 = Orient(Geometry=stream_filter_8, Source=point_on_curve, Target=PlaneXY(0, 0, 0))  # -> Geometry, Transform
gh_referenced_ancorpoint_orientation_4 = RemoteReceiver(gh_referenced_ancorpoint_orientation)
gh_ancorpoints_are_referenced_6 = RemoteReceiver(gh_ancorpoints_are_referenced)
stream_filter_11 = StreamFilter(Gate=input_profile_type_0_rectangle_2, Stream1=gh_ancorpoints_for_rectangle_profile_2, Stream2=orient_3.Geometry)
gh_ancorpoints_are_referenced_7 = RemoteReceiver(gh_ancorpoints_are_referenced)

# ---- group: LB (continued)
project = Project(Geometry=list_item_4.Item1, Plane=PlaneXY(0, 0, 0))  # -> Geometry, Transform
stream_filter_12 = StreamFilter(Gate=isprofileeditoractive_3, Stream1=project.Geometry)
move_5 = Move(Geometry=project.Geometry, Motion=expr("-x", input_basepointcoordinates_2))  # -> Geometry, Transform
move_6 = Move(Geometry=stream_filter_12, Motion=Vector(0, 0, 2))  # -> Geometry, Transform
symbol_display = SymbolDisplay(Location=move_6.Geometry, Display=symbol_simple)
line_sdl = LineSDL(
    Start=move_5.Geometry,
    Direction=[Vector(1, 0, 0), Vector(0, 1, 0), Vector(-1, 0, 0), Vector(0, -1, 0)],
    Length=Slider(500, range=0..1000))
stream_filter_13 = StreamFilter(Gate=isprofileeditoractive_4, Stream1=move_5.Geometry)
stream_filter_14 = StreamFilter(Gate=isprofileeditoractive_5, Stream1=line_sdl)
symbol_display_2 = SymbolDisplay(Location=stream_filter_13, Display=symbol_simple_2)
plane = Plane(move_5.Geometry)
orient_4 = Orient(Geometry=clean_tree, Source=point_on_curve, Target=PlaneXY(0, 0, 0))  # -> Geometry, Transform
gh_custom_profile_at_xy_plane = RemoteSender(orient_4.Geometry)

# ----
display_axes = RemoteSender(stream_filter_14)
move_7 = Move(Geometry=plane, Motion=vector_xyz.Vector)  # -> Geometry, Transform
move_8 = Move(Geometry=plane, Motion=vector_xyz_2.Vector)  # -> Geometry, Transform
move_9 = Move(Geometry=plane, Motion=vector_xyz_3.Vector)  # -> Geometry, Transform
move_10 = Move(Geometry=plane, Motion=vector_xyz_4.Vector)  # -> Geometry, Transform
entwine_4 = Entwine(Branch00=[move_7.Geometry, move_8.Geometry], Branch01=[move_9.Geometry, move_10.Geometry], FlattenInputs=True)  # -> simplify(Result)
tree_branch = TreeBranch(Tree=entwine_4, Path=stream_filter_9, MaintainPaths=True)

# ---- group: LB (continued)
rotate_2 = Rotate(Geometry=tree_branch, Angle=degrees(list_item_5), Plane=move_5.Geometry)  # -> Geometry, Transform
stream_filter_15 = StreamFilter(Gate=isprofileeditoractive_6, Stream1=rotate_2.Geometry)
stream_filter_16 = StreamFilter(Gate=isprofileeditoractive_7, Stream1=rotate_2.Geometry)  # disabled

# ----
define_text_object_3 = DefineTextObject(Text=[x, x_2], Plane=[stream_filter_15, stream_filter_16], DimensionStyle="HO_GH-APP 45", OutputType="Text")

# ---- group: LB
text_tag_3d = TextTag3D(Location=stream_filter_15, Text=x, Size=number_slider_4, Colour=colour_swatch_5, Justification=7)
text_tag_3d_2 = TextTag3D(Location=stream_filter_16, Text=x_2, Size=number_slider_4, Colour=colour_swatch_5, Justification=3)

# ----
display_text_interior_exterior = RemoteSender(define_text_object_3)
display_text_interior_exterior_2 = RemoteReceiver(display_text_interior_exterior)
display_axes_2 = RemoteReceiver(display_axes)
selectablepreview = SelectablePreview(Geometry=display_axes_2, lock=False, maintain=False, order=False)  # -> Geometry, Path, Index; disabled
display_axes_3 = RemoteReceiver(display_axes)
entwine_5 = Entwine(Branch00=display_axes_3, FlattenInputs=True)

# ----
# Display text for ancor points
number_slider_5 = Slider(40, range=0..1000)
text_tag_3d_3 = TextTag3D(Location=stream_filter_8, Text=stream_filter_7, Size=number_slider_5, Justification=5)  # disabled
input_profile_orientation_5 = RemoteReceiver(input_profile_orientation)
move_text_2 = Panel("""{0,-20,0}
{-20,0,0}""")
list_item_8 = ListItem(List=move_text_2, Index=input_profile_orientation_5, Wrap=True)
move_11 = Move(Geometry=stream_filter_8, Motion=list_item_8)  # -> Geometry, Transform

list_item_9 = ListItem(List=panel_13, Index=input_profile_orientation_5, Wrap=True)

define_text_object_4 = DefineTextObject(Text=stream_filter_7, Plane=move_11.Geometry, DimensionStyle=list_item_9, OutputType="Text")
display_text_for_ancorpoints_2 = RemoteSender(define_text_object_4)

display_text_for_ancorpoints_3 = RemoteReceiver([display_text_for_ancorpoints_2, display_text_for_ancorpoints])
move_12 = Move(Geometry=display_text_for_ancorpoints_3, Motion=Vector(0, 0, 10))  # -> Geometry, Transform

# ----
# Create block with profile
input_profile_type_0_rectangle_3 = RemoteReceiver(input_profile_type_0_rectangle)
gh_custom_profile_at_xy_plane_2 = RemoteReceiver(gh_custom_profile_at_xy_plane)
gh_rectangle_at_xy_plane_2 = RemoteReceiver(gh_rectangle_at_xy_plane)
unit_z_2 = UnitZ(Factor=1)
stream_filter_17 = StreamFilter(Gate=input_profile_type_0_rectangle_3, Stream1=gh_rectangle_at_xy_plane_2, Stream2=gh_custom_profile_at_xy_plane_2)
extrude = Extrude(Base=stream_filter_17, Direction=unit_z_2)
input_rectanglewidth_5 = RemoteReceiver(input_rectanglewidth)
input_rectangledepth_4 = RemoteReceiver(input_rectangledepth)
input_profile_type_0_rectangle_4 = RemoteReceiver(input_profile_type_0_rectangle)
cap_holes = CapHoles(Brep=extrude)
panel_23 = Panel("""HO_ProfileType
HO_W
HO_D""")
_1_rect_2_custom = Panel("HO_ProfileType")
input_rectanglewidth_6 = RemoteReceiver(input_rectanglewidth)
input_rectangledepth_5 = RemoteReceiver(input_rectangledepth)
merge_4 = Merge(Data1="1", Data2=input_rectanglewidth_5, Data3=input_rectangledepth_4)
input_of_next_unique_block_2 = RemoteReceiver(input_of_next_unique_block)
input_blockname_2 = RemoteReceiver(input_blockname)
input_profile_type_0_rectangle_5 = RemoteReceiver(input_profile_type_0_rectangle)
panel_24 = Panel("""HO_W
HO_H""")
stream_filter_18 = StreamFilter(Gate=input_profile_type_0_rectangle_4, Stream1=merge_4, Stream2=_1_rect_2_custom)
stream_filter_19 = StreamFilter(Gate=input_profile_type_0_rectangle_4, Stream1=merge_4, Stream2="2")
concatenate_4 = Concatenate(
    FragmentA="Profile - Rectangular - ",
    FragmentB=input_rectanglewidth_6,
    FragmentC=" x ",
    FragmentD=input_rectangledepth_5)
concatenate_5 = Concatenate(FragmentA="Profile custom #", FragmentB=input_of_next_unique_block_2, FragmentE=" - ", FragmentD=input_blockname_2)
stream_filter_20 = StreamFilter(Gate=input_profile_type_0_rectangle_5, Stream1=concatenate_4, Stream2=concatenate_5)
input_apply_3 = RemoteReceiver(input_apply)
define_object_attributes_2 = DefineObjectAttributes(UserKeys=panel_22, UserValues=merge_3, Layer=panel_21)  # -> flatten(Attributes)
define_object_attributes_3 = DefineObjectAttributes(UserKeys=stream_filter_18, UserValues=stream_filter_19, Layer=">::Block::Block - Profile")
list_length_2 = ListLength(List=cap_holes)
gate_or = GateOr(B=input_apply_3)
xy_plane = XYPlane(Origin=Point(0, 0, 0))
gh_ancorpoints_for_rectangle_profile_3 = RemoteReceiver(gh_ancorpoints_for_rectangle_profile)
dispatch_3 = Dispatch(List=stream_filter_20, DispatchPattern=gate_or)  # -> ListA, ListB
rotate_3 = Rotate(Geometry=xy_plane, Angle=degrees(-90), Plane=xy_plane)  # -> Geometry, Transform
duplicate_data = DuplicateData(Data=define_object_attributes_3, Number=list_length_2, Order=True)  # -> flatten(Data)
input_profile_type_0_rectangle_6 = RemoteReceiver(input_profile_type_0_rectangle)
addition_2 = Addition(A=gh_referenced_ancorpoint_orientation_4, B=0)
merge_5 = Merge(Data1=cap_holes, Data2=stream_filter_11)  # -> flatten(Result)
merge_6 = Merge(Data1=duplicate_data, Data2=define_object_attributes_2)  # -> flatten(Result)
stream_filter_21 = StreamFilter(Gate=input_profile_type_0_rectangle_6, Stream1=gh_ancorpoints_for_rectangle_profile_3, Stream2=stream_filter_8)
gh_ancorpoints_are_referenced_8 = RemoteReceiver(gh_ancorpoints_are_referenced)
gh_ancorpoints_6 = RemoteReceiver(gh_ancorpoints)
hide_created_blocks = Panel("-_SelLayer \">::Block::Block - Profile\" _Hide")
input_profile_type_0_rectangle_7 = RemoteReceiver(input_profile_type_0_rectangle)
stream_filter_22 = StreamFilter(Gate=gh_ancorpoints_are_referenced_8, Stream0=stream_filter_21, Stream1=gh_ancorpoints_6)
define_object_attributes_4 = DefineObjectAttributes(Layer=">::Block::Block - Profile")
list_length_3 = ListLength()  # disabled
input_apply_4 = RemoteReceiver(input_apply)
boolean_2 = Boolean(input_profile_type_0_rectangle_7)
move_13 = Move(Geometry=stream_filter_22, Motion="{0,0,1}")  # -> Geometry, Transform
gate_and = GateAnd(A=input_apply_4, B=boolean_2)
gzcommand_2 = CSharpScript(
    command=hide_created_blocks,
    runNow=list_length_3,
    echo=False,
    Reference=["C:\Program Files\Rhino 7\Plug-ins\Grasshopper\Components\ScriptComponents.gha", "C:\Program Files\NoDoubts\Godzilla\System\Godzilla.dll", "C:\Program Files\NoDoubts\Godzilla\System\RhGodzilla.rhp"])  # -> done; inputs command: String, runNow: Boolean, echo: Boolean; disabled; same code as gzcommand
cross_sign = Curve(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)
orient_5 = Orient(Geometry=cross_sign, Source=PlaneXY(0, 0, 0), Target=move_13.Geometry)  # -> Geometry, Transform
display_cross_signs = RemoteSender(orient_5.Geometry)

stream_filter_23 = StreamFilter(Gate=gh_ancorpoints_are_referenced_6, Stream0=input_profile_orientation_3, Stream1=addition_2)

stream_filter_24 = StreamFilter(Gate=stream_filter_23, Stream0=xy_plane, Stream1=rotate_3.Geometry)
define_block = DefineBlock(Geometry=flatten(merge_5), Attributes=flatten(merge_6), BlockName=stream_filter_20, BasePlane=stream_filter_24)
bake_objects_2 = BakeObjects(Geometry=define_block, BakeName=define_object_attributes_4, Bake=gate_and)

plane_origin = PlaneOrigin(Base=stream_filter_24)
display_cross_signs_2 = RemoteReceiver(display_cross_signs)
entwine_6 = Entwine(
    Branch00=display_selectedgeo_2,
    Branch01=move_12.Geometry,
    Branch02=display_axes_2,
    Branch03=display_cross_signs_2,
    Branch04=display_text_interior_exterior_2,
    FlattenInputs=True)  # -> simplify(Result)
custom_preview_lineweights = CustomPreviewLineweights(Geometry=entwine_6, Shader=entwine, Thickness=display_widths, Absolute=False)

# ----
# OUTPUTS
attributes = EFDataDescription()
ui_messages = Text(entwine_3)
info_help = ClusterOutput(text_3)  # Info&Help
ancorpts_used = ClusterOutput(gh_ancorpoints_are_referenced_7)  # AncorPts used?
gen_attributes = ClusterOutput(attributes)  # Gen. Attributes
display_widths_2 = ClusterOutput(display_widths)  # Display: widths
ui_messages_2 = ClusterOutput(ui_messages)  # UI Messages
generated_geo = ClusterOutput(entwine_5)  # Generated geo
display_geo = ClusterOutput(entwine_6)  # Display: geo
display_colors = ClusterOutput(entwine)  # Display: colors

block_name = ClusterOutput(stream_filter_20)  # Block name

# ==== cluster CreateREBlocks: Create RE Blocks
# Go to clicked step
gzopengh = CSharpScript(Reference=["C:\Program Files\Rhino 7\Plug-ins\Grasshopper\Components\ScriptComponents.gha", "C:\Program Files\NoDoubts\Godzilla\System\Godzilla.dll", "C:\Program Files\NoDoubts\Godzilla\System\RhGodzilla.rhp"])  # -> done; inputs resName: String, runNow: Boolean; same code as gzopengh
gz_menu = CSharpScript(Reference=["C:\Program Files\Rhino 7\Plug-ins\Grasshopper\Components\ScriptComponents.gha", "C:\Program Files\NoDoubts\Godzilla\System\Godzilla.dll", "C:\Program Files\NoDoubts\Godzilla\System\RhGodzilla.rhp"])  # -> resources, names, tooltips; same code as gz_menu
gzaddreferences = CSharpScript(
    Run=True,
    Reference=["C:\Program Files\Rhino 7\Plug-ins\Grasshopper\Components\ScriptComponents.gha", "C:\Program Files\NoDoubts\Godzilla\System\Godzilla.dll", "C:\Program Files\NoDoubts\Godzilla\System\RhGodzilla.rhp"])  # -> Done; inputs Run: Boolean; same code as gzaddreferences
docinfo = DocumentInfo(AutoUpdate=False, Recursive=False)  # -> DocumentName, DocumentFilePath, Components, Params, _3rdPartyAssemblies
# Proceed at the end
panel = Panel(gzaddreferences)
layers = Panel("""Window",0
Door",1
CurtainWall",2
Vent-Other",3
MS-Other",4
Aluninium",5
Ceiling",6
Column",7
Glass/Stone",8
CW-railHead",9
CW-railJambL",10
CW-railJambR",11
CW-railMullion",12
CW-railTransom",13
CW-railSill-14,
99""")
gzcommand = CSharpScript(
    runNow=False,
    echo=False,
    Reference=["C:\Program Files\Rhino 7\Plug-ins\Grasshopper\Components\ScriptComponents.gha", "C:\Program Files\NoDoubts\Godzilla\System\Godzilla.dll", "C:\Program Files\NoDoubts\Godzilla\System\RhGodzilla.rhp"])  # -> done; inputs command: String, runNow: Boolean, echo: Boolean; same code as gzcommand
tsort = SortText(Keys=docinfo.Components, Culture=127)  # -> Keys, Values
gzuicolors = CSharpScript(Reference=["C:\Program Files\Rhino 7\Plug-ins\Grasshopper\Components\ScriptComponents.gha", "C:\Program Files\NoDoubts\Godzilla\System\Godzilla.dll", "C:\Program Files\NoDoubts\Godzilla\System\RhGodzilla.rhp"])  # -> Current_step_bg; same code as gzuicolors
panel_2 = Panel(docinfo._3rdPartyAssemblies)
panel_3 = Panel(tsort.Keys)

# ----
# Check now is disabled for now
getting_rhinodoc_attribute = Panel("HO_DefaultSize-PanelGaps")
python = PythonScript(key=getting_rhinodoc_attribute)  # -> value; same code as python
addition = Addition(A=python, B=0)
panel_4 = Panel(python)
defaultwallpanelgap = RemoteSender(addition)

layers_2 = Panel("if(x=\">::FacadeSubFace::Window\",0,(if(x=\">::FacadeSubFace::Door\",1,(if(x=\">::FacadeSubFace::CurtainWall\",2,(if(x=\">::FacadeSubFace::Vent-Other\",3,(if(x=\">::FacadeSubFace::MS-Other\",4,(if(x=\">::FacadeSubFace::Aluninium\",5,(if(x=\">::FacadeSubFace::Ceiling\",6,(if(x=\">::FacadeSubFace::Column\",7,(if(x=\">::FacadeSubFace::Glass/Stone\",8,(if(x=\">::SupportGeo::CurtainWall::CW-railHead\",9,(if(x=\">::SupportGeo::CurtainWall::CW-railJambL\",10,(if(x=\">::SupportGeo::CurtainWall::CW-railJambR\",11,(if(x=\">::SupportGeo::CurtainWall::CW-railMullion\",12,(if(x=\">::SupportGeo::CurtainWall::CW-railTransom\",13,(if(x=\">::SupportGeo::CurtainWall::CW-railSill\",14,99)))))))))))))))))))))))))))))")
# Create embedded blocks
panel_5 = Panel("Create embedded blocks")  # disabled
create_button = CreateButton(ButtonName=panel_5, ButtonStyle=1)  # disabled
panel_6 = Panel("!ZE -_LayerStateManager _Restore \"HO_Only BlockFacadeSubFace and EmptyLayer\" Cancel")
value_listener = ValueListener(Elements=create_button, SomeProperty=True)  # -> Values, Indices; disabled
bake = Boolean()  # disabled
gzcommand_2 = CSharpScript(
    command=panel_6,
    runNow=bake,
    echo=False,
    Reference=["C:\Program Files\Rhino 7\Plug-ins\Grasshopper\Components\ScriptComponents.gha", "C:\Program Files\NoDoubts\Godzilla\System\Godzilla.dll", "C:\Program Files\NoDoubts\Godzilla\System\RhGodzilla.rhp"])  # -> done; inputs command: String, runNow: Boolean, echo: Boolean; same code as gzcommand
panel_7 = Panel("""Window
Door
CurtainWall
MullionAxes
MS-Other
Vent-Other
Aluninium
Attika
Ceiling
Column
Glass/Stone
Opening
Questioning
Steel Construction
Subcontractors
CW-railJambL
CW-railJambR
CW-railSill
CW-railHead
CW-railTransom
CW-railMullion""")
panel_8 = Panel("""1
2
3
4
5
5
5
5
5
5
5
0
0
0
0
4
4
4
4
4
4""")
layers_3 = Panel("if(x=\">::FacadeSubFace::Window\",0,(if(x=\">::FacadeSubFace::Door\",1,(if(x=\">::FacadeSubFace::CurtainWall\",2,(if(x=\">::FacadeSubFace::Vent-Other\",3,(if(x=\">::FacadeSubFace::MS-Other\",4,(if(x=\">::FacadeSubFace::Aluninium\",5,(if(x=\">::FacadeSubFace::Ceiling\",6,(if(x=\">::FacadeSubFace::Column\",7,(if(x=\">::FacadeSubFace::Glass/Stone\",8,(if(x=\">::SupportGeo::CurtainWall::CW-railHead\",9,(if(x=\">::SupportGeo::CurtainWall::CW-railJambL\",10,(if(x=\">::SupportGeo::CurtainWall::CW-railJambR\",11,(if(x=\">::SupportGeo::CurtainWall::CW-railMullion\",12,(if(x=\">::SupportGeo::CurtainWall::CW-railTransom\",13,(if(x=\">::SupportGeo::CurtainWall::CW-railSill\",14,99)))))))))))))))))))))))))))))")
cluster = Cluster_5()  # disabled
defaultwallpanelgap_2 = RemoteReceiver(defaultwallpanelgap)

integer = Integer(Tree({0}: [1, 0, 0, 1], {1}: [1, 0, 0, 1], {9}: [1], {10}: [0], {11}: [0], {12}: [0], {13}: [1], {14}: [1]))
integer_2 = Integer(Tree({0}: [4], {1}: [4], {9}: [1], {10}: [1], {11}: [1], {12}: [1], {13}: [1], {14}: [1]))

# ----
# Names of blocks to use: >::Regelelement::Window::Window - Panel
# >::Regelelement::Door::Door - Panel
# >::Regelelement::CW::CW - Panel
# >::Regelelement::Vent-Other::Vent-Other - Panel
# >::Regelelement::Vent-Other::Vent-Other - Panel
# >::Regelelement::Vent-Other::Vent-Other - Panel
# >::Regelelement::Vent-Other::Vent-Other - Panel
# >::Regelelement::Vent-Other::Vent-Other - Panel
# >::Regelelement::Vent-Other::Vent-Other - Panel
names_of_blocks_to_use = Panel(""">::Regelelement::Window::Window - Panel
>::Regelelement::Door::Door - Panel
>::Regelelement::CurtainWall::CurtainWall - Panel
>::Regelelement::Vent-Other::Vent-Other - Panel
>::Regelelement::Vent-Other::Vent-Other - Panel
>::Regelelement::Vent-Other::Vent-Other - Panel
>::Regelelement::Vent-Other::Vent-Other - Panel
>::Regelelement::Vent-Other::Vent-Other - Panel
>::Regelelement::Vent-Other::Vent-Other - Panel""")

text = Text(Tree({0}: ["HO_DefaultProfile-Window head", "HO_DefaultProfile-Window jamb L", "HO_DefaultProfile-Window jamb R", "HO_DefaultProfile-Window sill"], {1}: ["HO_DefaultProfile-Door head", "HO_DefaultProfile-Door jamb L", "HO_DefaultProfile-Door jamb R", "HO_DefaultProfile-Door sill"], {9}: ["HO_DefaultProfile-CW head"], {10}: ["HO_DefaultProfile-CW jamb L"], {11}: ["HO_DefaultProfile-CW jamb R"], {12}: ["HO_DefaultProfile-CW mullion"], {13}: ["HO_DefaultProfile-CW transom"], {14}: ["HO_DefaultProfile-CW sill"]))
getdocumentusertext = GetDocumentUserText(key=text)  # -> value; inputs updateNow: Boolean
# ---------- getdocumentusertext: Python ----------
# Gets document user text from current 3dm file

__author__ = "Yury Nasonov"
__version__ = "1"

ghenv.Component.Name = "Get Document user text"
ghenv.Component.NickName = 'GetDocumentUserText'
ghenv.Component.Message = 'Get Document user text'

# ———————————————————————————————————————————————————————————

import rhinoscriptsyntax as rs
import scriptcontext as sc
import Rhino

# ———————————————————————————————————————————————————————————

sc.doc = Rhino.RhinoDoc.ActiveDoc

if updateNow != True:
    value = rs.GetDocumentUserText(key)
sc.doc = ghdoc

print value
# ---------- end getdocumentusertext ----------
text_split = TextSplit(Text=getdocumentusertext, Separators=";")
list_item = ListItem(List=text_split, Index=0, Wrap=True)  # -> Item, Item1, Item2, Item3
defaults_profileorientation_0_horiz_1_ve = RemoteSender(list_item.Item1)  # "Defaults.ProfileOrientation (0-horiz 1=vert)"
defaults_profilenames = RemoteSender(list_item.Item)
defaults_profilemirror = RemoteSender(list_item.Item2)
defaults_ancorpoint = RemoteSender(list_item.Item3)
defaults_profileorientation_0_horiz_1_ve_2 = RemoteReceiver(defaults_profileorientation_0_horiz_1_ve)  # "Defaults.ProfileOrientation (0-horiz 1=vert)"
defaults_profilenames_2 = RemoteReceiver(flatten(defaults_profilenames))
defaults_profilemirror_2 = RemoteReceiver(defaults_profilemirror)
defaults_ancorpoint_2 = RemoteReceiver(defaults_ancorpoint)
defaults_profilenames_3 = RemoteReceiver(defaults_profilenames)

panel_9 = Panel("""4
4
1
1
1
1
1
1""")
text_2 = Text(Tree({0}: ["Profile - Window head", "Profile - Window jamb L", "Profile - Window jamb L", "Profile - Window sill"], {1}: ["Profile - Door head", "Profile - Door jamb L", "Profile - Door jamb R", "Profile - Door sill"], {9}: ["Profile - CW head"], {10}: ["Profile - CW jamb L"], {11}: ["Profile - CW jamb R"], {12}: ["Profile - CW mullion"], {13}: ["Profile - CW transom"], {14}: ["Profile - CW sill"]))
integer_3 = Integer(Tree({0}: [4], {1}: [4], {9}: [1], {10}: [1], {11}: [1], {12}: [1], {13}: [1], {14}: [1]))
text_3 = Text(Tree({0}: ["Profile - Default - Window head", "Profile - Default - Window jamb L", "Profile - Default - Window jamb L", "Profile - Default - Window sill"], {1}: ["Profile - Default - Door head", "Profile - Default - Door jamb L", "Profile - Default - Door jamb L", "Profile - Default - Door sill"], {9}: ["Profile - Default - CW head"], {10}: ["Profile - Default - CW jamb L"], {11}: ["Profile - Default - CW jamb L"], {12}: ["Profile - Default - CW mullion"], {13}: ["Profile - Default - CW transom"], {14}: ["Profile - Default - CW sill"]))

panel_10 = Panel(text_3)
panel_11 = Panel(text_2)
defaults_profilenames_4 = RemoteReceiver(defaults_profilenames)
shift_paths = ShiftPaths(Data=defaults_profilenames_4, Offset=-1)
text_4 = Text(Tree({0}: [">::Regelelement::Window::Window - Frame", ">::Regelelement::Window::Window - Frame", ">::Regelelement::Window::Window - Frame", ">::Regelelement::Window::Window - Frame"], {1}: [">::Regelelement::Door::Door - Frame", ">::Regelelement::Door::Door - Frame", ">::Regelelement::Door::Door - Frame", ">::Regelelement::Door::Door - Frame"], {9}: [">::Regelelement::CurtainWall::CurtainWall - Frame"], {10}: [">::Regelelement::CurtainWall::CurtainWall - Frame"], {11}: [">::Regelelement::CurtainWall::CurtainWall - Frame"], {12}: [">::Regelelement::CurtainWall::CurtainWall - Frame"], {13}: [">::Regelelement::CurtainWall::CurtainWall - Frame"], {14}: [">::Regelelement::CurtainWall::CurtainWall - Frame"]))
panel_12 = Panel(text_4)
defaults_profileorientation_0_horiz_1_ve_3 = RemoteReceiver(defaults_profileorientation_0_horiz_1_ve)  # "Defaults.ProfileOrientation (0-horiz 1=vert)"
defaults_profilemirror_3 = RemoteReceiver(defaults_profilemirror)
defaults_ancorpoint_3 = RemoteReceiver(defaults_ancorpoint)

part = Text(Tree({0}: ["Head", "JambL", "JambR", "Sill"], {1}: ["Head", "JambL", "JambR", "Sill"], {9}: ["LU"], {10}: ["LU"], {11}: ["LU"], {12}: ["MM"], {13}: ["MM"], {14}: ["RB"]))
block_orientation = Text(Tree({0}: ["0", "1", "1", "0"], {1}: ["0", "1", "1", "0"], {9}: ["0"], {10}: ["1"], {11}: ["1"], {12}: ["1"], {13}: ["0"], {14}: ["0"]))
lu_mm_rb = Text(Tree({0}: ["LU", "LU", "LU", "RB"], {1}: ["LU", "LU", "LU", "RB"], {9}: ["LU"], {10}: ["LU"], {11}: ["LU"], {12}: ["MM"], {13}: ["MM"], {14}: ["RB"]))

selected_facadesubfaces = ClusterInput()  # Selected FacadeSubFaces
existing_blocks_list = ClusterInput()  # Existing blocks list
parameter = Parameter(x=selected_facadesubfaces)  # -> a; same code as parameter

extended_geometry = ExtendedGeometry(selected_facadesubfaces)
parameter_2 = Parameter(x=existing_blocks_list)  # -> a; same code as parameter

input_selection = RemoteSender(extended_geometry)
input_existing_blicks_list = RemoteSender(parameter_2)

panel_13 = Panel(input_selection)
input_selection_2 = RemoteReceiver(input_selection)
get_rhino_attributes = GetRhinoAttributes(Geometry=input_selection_2, readFullPath=True)  # -> Name, Layer, Color
evaluate = Evaluate(Expression=layers_2, x=get_rhino_attributes.Layer)
smaller_than = SmallerThan(FirstNumber=evaluate, SecondNumber=99)  # -> SmallerThan, OrEqualTo
dispatch = Dispatch(List=evaluate, DispatchPattern=smaller_than.SmallerThan)  # -> ListA, ListB
dispatch_2 = Dispatch(List=input_selection_2, DispatchPattern=smaller_than.SmallerThan)  # -> ListA, ListB
clean_tree = CleanTree(RemoveNulls=True, RemoveInvalid=True, RemoveEmpty=True, Tree=dispatch.ListA)
clean_tree_2 = CleanTree(RemoveNulls=True, RemoveInvalid=True, RemoveEmpty=True, Tree=dispatch_2.ListA)

list_length = ListLength(List=flatten(clean_tree_2))
boolean = Boolean(list_length)
input_bakeblocks = RemoteSender(boolean)

gh_geo_type_number = RemoteSender(clean_tree)
input_selectedgeotoblock = RemoteSender(clean_tree_2)
panel_14 = Panel(evaluate)

# ----
# Get data for definig SizeType
input_selectedgeotoblock_2 = RemoteReceiver(input_selectedgeotoblock)
get_rhino_attributes_2 = GetRhinoAttributes(Geometry=input_selectedgeotoblock_2)  # -> Name, Layer, Color
graft_tree = GraftTree(Tree=flatten(input_selectedgeotoblock_2), IncludeEmptyLists=True, IncludeNullItems=True)

# ----
# Getting actual dimensions of RE
surface = Surface(graft_tree)  # disabled
item_selector = ItemSelector(surface)  # disabled
curve = Curve(surface)  # disabled
simplify_curve = SimplifyCurve(Curve=surface)  # -> Curve, Simplified; disabled
explode = Explode(Curve=simplify_curve.Curve, Recursive=True)  # -> Segments, Vertices; disabled
list_item_2 = ListItem(List=explode.Segments, Index=0, Wrap=True)  # -> Item, Item1; disabled
length = Length(Curve=list_item_2.Item)  # disabled
length_2 = Length(Curve=list_item_2.Item1)  # disabled

# ----
# Edge relation
panel_15 = Panel("HO_EdgeRelation")
get_user_value = GetUserValue(Geometry=graft_tree, Key=panel_15)
null_item = NullItem(Item=get_user_value)  # -> NullFlags, InvalidFlags, Description
pick_n_choose = PickNChoose(Pattern=null_item.NullFlags, Stream0=get_user_value, Stream1="na")

# ----
# 4. BG-Breite
panel_16 = Panel("4. BG-Breite")
get_user_value_2 = GetUserValue(Geometry=graft_tree, Key=panel_16)
integer_4 = Integer(get_user_value_2)
null_item_2 = NullItem(Item=integer_4)  # -> NullFlags, InvalidFlags, Description
pick_n_choose_2 = PickNChoose(Pattern=null_item_2.NullFlags, Stream0=integer_4, Stream1="na")

# ----
# Getting RE Type
panel_17 = Panel("HO_RE-Type")
get_user_value_3 = GetUserValue(Geometry=graft_tree, Key=panel_17)
null_item_3 = NullItem(Item=get_user_value_3)  # -> NullFlags, InvalidFlags, Description
pick_n_choose_3 = PickNChoose(Pattern=null_item_3.NullFlags, Stream0=get_user_value_3, Stream1="na")

# ----
# Getting REType
panel_18 = Panel("HO_RE-type-by-user")
get_user_value_4 = GetUserValue(Geometry=graft_tree, Key=panel_18)
null_item_4 = NullItem(Item=get_user_value_4)  # -> NullFlags, InvalidFlags, Description
pick_n_choose_4 = PickNChoose(Pattern=null_item_4.NullFlags, Stream0=get_user_value_4, Stream1="na")

# ----
# CW rails length
panel_19 = Panel("curve")
filter_by_type = FilterByType(Geometry=graft_tree, ObjectType=panel_19)
length_3 = Length(Curve=filter_by_type)
integer_5 = Integer(length_3)

# ----
# getting one value only
# either length of curve either
# attrubute value
# it is ok when
#  it is red!
# 5. BG-Höhe
panel_20 = Panel("5. BG-Höhe")
get_user_value_5 = GetUserValue(Geometry=graft_tree, Key=panel_20)
integer_6 = Integer(get_user_value_5)
null_item_5 = NullItem(Item=integer_6)  # -> NullFlags, InvalidFlags, Description
pick_n_choose_5 = PickNChoose(Pattern=null_item_5.NullFlags, Stream0=integer_6, Stream1="na")
integer_7 = Integer(pick_n_choose_5)
merge = Merge(Data1=integer_5, Data2=integer_7)
clean_tree_3 = CleanTree(RemoveNulls=True, RemoveInvalid=True, RemoveEmpty=False, Tree=merge)
list_item_3 = ListItem(List=clean_tree_3, Index=0, Wrap=True)

# ----
# Layer name
list_length_2 = ListLength(List=input_selectedgeotoblock_2)
duplicate_data = DuplicateData(Data=simplify(get_rhino_attributes_2.Layer), Number=simplify(list_length_2), Order=True)
graft_tree_2 = GraftTree(Tree=flatten(duplicate_data), IncludeEmptyLists=True, IncludeNullItems=True)

panel_21 = Panel(graft_tree_2)
panel_22 = Panel(pick_n_choose_2)
input_existing_blicks_list_2 = RemoteReceiver(input_existing_blicks_list)
text_split_2 = TextSplit(Text=input_existing_blicks_list_2, Separators="_")
list_item_4 = ListItem(List=text_split_2, Index=0, Wrap=True)  # -> flatten(Item)
cull_index = CullIndex(List=text_split_2, Indices=0, Wrap=True)
text_join = TextJoin(Text=cull_index, Join="_")  # -> flatten(Result)
input_bakeblocks_2 = RemoteReceiver(input_bakeblocks)
addition_2 = Addition(A=input_bakeblocks_2, B=0)

# ----
# Move selected to hidden layer
# Needs to be executed
# at the end
input_selectedgeotoblock_3 = RemoteReceiver(input_selectedgeotoblock)
panel_23 = Panel("""Surface
Curve""")
filter_by_type_2 = FilterByType(Geometry=simplify(graft(input_selectedgeotoblock_3)), ObjectType=panel_23)  # -> flatten(Geometry)
clean_tree_4 = CleanTree(RemoveNulls=True, RemoveInvalid=True, RemoveEmpty=False, Tree=filter_by_type_2)
graft_tree_3 = GraftTree(Tree=clean_tree_4, IncludeEmptyLists=True, IncludeNullItems=True)
get_rhino_attributes_3 = GetRhinoAttributes(Geometry=graft_tree_3, readFullPath=True)  # -> Name, Layer, Color
get_user_attributes = GetUserAttributes(Geometry=graft_tree_3)  # -> Keys, Values, BakeName
replace_text = ReplaceText(Text=get_rhino_attributes_3.Layer, Find=">::FacadeSubFace::", Replace=">::Used::FacadeSubFace::", RecursiveReplace=False)
replace_text_2 = ReplaceText(Text=replace_text, Find=">::SupportGeo::", Replace=">::Used::FacadeSubFace::", RecursiveReplace=False)  # -> graft(Result)
define_object_attributes = DefineObjectAttributes(UserKeys=get_user_attributes.Keys, UserValues=get_user_attributes.Values, Layer=replace_text_2)
input_bakeblocks_3 = RemoteReceiver(input_bakeblocks)
shift_paths_2 = ShiftPaths(Data=define_object_attributes, Offset=-1)
modify_rhinoobject_attributes = ModifyRhinoObjectAttributes(Geometry=graft_tree_3, Attributes=shift_paths_2, Modify=input_bakeblocks_3)

input_selectedgeotoblock_4 = RemoteReceiver(input_selectedgeotoblock)  # disabled
cluster_2 = Cluster_5(geometry=input_selectedgeotoblock_4)  # disabled

# ----
# Defining block SizeTypes, names, planes. etc
# SizeTypes
# Block Name
# ID_TypeOfObject_Type#_H_L
panel_24 = Panel("{1}_{2}_W={3}_H={4}_R={5}")
format = Format(
    Format=panel_24,
    Culture=127,
    Data0=simplify(graft_tree_2),
    Data1=simplify(pick_n_choose_3),
    Data2=simplify(pick_n_choose_4),
    Data3=simplify(pick_n_choose_2),
    Data4=simplify(list_item_3),
    Data5=simplify(pick_n_choose))
panel_25 = Panel(format)
create_set = CreateSet(List=flatten(format))  # -> Set, Map
gh_blocktype = RemoteSender(create_set.Map)
item_index = ItemIndex(List=gh_blocktype, Item=gh_blocktype)
create_tree = CreateTree(Data=item_index, Path=gh_blocktype)
input_selectedgeotoblock_5 = RemoteReceiver(input_selectedgeotoblock)
cluster_3 = Cluster_5(geometry=input_selectedgeotoblock_5)
allgeometrybaseplanes = RemoteSender(cluster_3)
# Existing
# block names
#  without IDs
integer_8 = Integer(list_item_4)
clean_tree_5 = CleanTree(RemoveNulls=True, RemoveInvalid=True, RemoveEmpty=True, Tree=integer_8)
addition_3 = Addition(A=clean_tree_5, B=0)
panel_26 = Panel(addition_3)
nextnumber = NextNumber(numbers=addition_3)  # -> next_number; inputs numbers: list of Int32
# ---------- nextnumber: Python ----------
# ACTION:   Finds the smallest number that is not presented in list of numbers 
# LIMITATION: 
# TO DO:      

__author__ = "Yury Nasonov"
__version__ = "1"

ghenv.Component.Name = "NextNumber"
ghenv.Component.NickName = 'NextNumber'
ghenv.Component.Message = 'NextNumber'

# ———————————————————————————————————————————————————————————

import rhinoscriptsyntax as rs

# ———————————————————————————————————————————————————————————

i = 1 #allowed minimum
while (i in numbers):
#    print(i,"exists")
    i=i+1
next_number = i
# ---------- end nextnumber ----------

panel_27 = Panel(gh_blocktype)

# ---- group: index of 1st unique srf in a group
list_item_5 = ListItem(List=create_tree, Index=0, Wrap=True)

# ---- group: index of other srf
cull_index_2 = CullIndex(List=create_tree, Indices=0, Wrap=True)

# ----
# NESTED BLOCKS Attributes
regelelement_layer_names = Panel(""">::Regelelement::Window
>::Regelelement::Door
>::Regelelement::CurtainWall
>::Regelelement::Vent-Other
>::Regelelement::MS-Other
>::Regelelement::Aluninium
>::Regelelement::Ceiling
>::Regelelement::Column
>::Regelelement::Glass/Stone
>::Regelelement::CurtainWall:Frame
>::Regelelement::CurtainWall:Frame
>::Regelelement::CurtainWall:Frame
>::Regelelement::CurtainWall:Frame
>::Regelelement::CurtainWall:Frame
>::Regelelement::CurtainWall:Frame""")
gh_inputgeometrytype = RemoteReceiver()
gh_blocktype_2 = RemoteReceiver(gh_blocktype)
list_item_6 = ListItem(List=flatten(gh_inputgeometrytype), Index=gh_blocktype_2, Wrap=True)  # -> simplify(graft(Item))
branch_to_place = Panel(gh_inputgeometrytype)
input_selectedgeotoblock_6 = RemoteReceiver(input_selectedgeotoblock)
gh_geo_type_number_2 = RemoteReceiver(gh_geo_type_number)
list_length_3 = ListLength(List=list_item_6)
get_user_attributes_2 = GetUserAttributes(Geometry=input_selectedgeotoblock_6)  # -> simplify(Keys), simplify(Values), BakeName
list_item_7 = ListItem(List=flatten(regelelement_layer_names), Index=gh_geo_type_number_2, Wrap=True)  # -> simplify(graft(Item))
duplicate_data_2 = DuplicateData(Data="HO_Type", Number=list_length_3, Order=True)  # -> simplify(Data)
duplicate_data_3 = DuplicateData(Data="RE-Block", Number=list_length_3, Order=True)  # -> simplify(Data)
list_item_8 = ListItem(List=flatten(regelelement_layer_names), Index=list_item_6, Wrap=True)  # -> simplify(graft(Item))
merge_2 = Merge(Data1=get_user_attributes_2.Keys, Data2=duplicate_data_2)
merge_3 = Merge(Data1=get_user_attributes_2.Values, Data2=duplicate_data_3)
define_object_attributes_2 = DefineObjectAttributes(UserKeys=merge_2, UserValues=merge_3, Layer=list_item_7)

list_item_9 = ListItem(List=flatten(format), Index=list_item_5, Wrap=True)
gh_indexof1stuniquefssinagroup = RemoteSender(list_item_5)
list_item_10 = ListItem(List=flatten(input_selectedgeotoblock_5), Index=list_item_5, Wrap=True)
cluster_4 = Cluster_5(geometry=list_item_10)
uniquegeometrybaseplanes = RemoteSender(cluster_4)
gh_sizetypefull = RemoteSender(list_item_9)
gh_sizetypefull_2 = RemoteReceiver(gh_sizetypefull)

# ----
# 1 = create new
# 0 = use created
set_difference = SetDifference(SetA=list_item_9, SetB=text_join)
list_length_4 = ListLength(List=set_difference)
gh_create_new_1_of_use_created_0 = RemoteSender(list_length_4)
get_rhino_attributes_4 = GetRhinoAttributes(Geometry=list_item_10, readFullPath=True)  # -> Name, Layer, Color
flatten_tree = FlattenTree(Tree=set_difference, Path="{0}")
# Existing
# block names
#  without IDs
graft_tree_4 = GraftTree(Tree=flatten_tree, IncludeEmptyLists=True, IncludeNullItems=True)  # -> simplify(Tree)
gh_create_new_1_of_use_created_0_2 = RemoteReceiver(gh_create_new_1_of_use_created_0)

item_index_2 = ItemIndex(List=flatten(list_item_9), Item=flatten(list_item_9))  # -> graft(Index)
format_2 = Format(Format="{0}_{1}", Culture=127, Data0=item_index_2, Data1=list_item_9)

dispatch_3 = Dispatch(List=list_item_9, DispatchPattern=gh_create_new_1_of_use_created_0_2)  # -> ListA, ListB

gh_create_new_1_of_use_created_0_3 = RemoteReceiver(gh_create_new_1_of_use_created_0)
dispatch_4 = Dispatch(List=list_item_9, DispatchPattern=gh_create_new_1_of_use_created_0_3)  # -> ListA, ListB

member_index = MemberIndex(Set=text_join, Member=dispatch_3.ListB)  # -> Index, Count
list_item_11 = ListItem(List=input_existing_blicks_list_2, Index=member_index.Index, Wrap=True)  # -> simplify(Item)
gh_existingblockname = RemoteSender(list_item_11)
panel_28 = Panel(list_item_9)
panel_29 = Panel(list_item_11)

item_index_3 = ItemIndex(List=flatten_tree, Item=flatten_tree)

addition_4 = Addition(A=nextnumber, B=item_index_3)
unflatten_tree = UnflattenTree(Tree=addition_4, Guide=set_difference)
panel_30 = Panel(unflatten_tree)

format_3 = Format(Format="{0}_{1}", Culture=127, Data0=unflatten_tree, Data1=set_difference)

clean_tree_6 = CleanTree(RemoveNulls=True, RemoveInvalid=True, RemoveEmpty=False, Tree=format_3)

gh_blockname = RemoteSender(clean_tree_6)
list_item_12 = ListItem(List=flatten(gh_blockname), Index=gh_blocktype, Wrap=True)
gh_namesforallblocks = RemoteSender(list_item_12)

merge_4 = Merge(Data1=clean_tree_6, Data2=list_item_11)
panel_31 = Panel(gh_blockname)
gh_blockname_2 = RemoteReceiver(simplify(gh_blockname))
gh_namesforallblocks_2 = RemoteReceiver(gh_namesforallblocks)
tree_statistics = TreeStatistics(Tree=gh_blockname_2)  # -> Paths, Length, Count
panel_32 = Panel(tree_statistics.Paths)
gh_blockname_3 = RemoteReceiver(simplify(gh_blockname))

# ----
# Filter geometry to use
evaluate_2 = Evaluate(Expression=layers_3, x=get_rhino_attributes_4.Layer)
smaller_than_2 = SmallerThan(FirstNumber=evaluate_2, SecondNumber=99)  # -> SmallerThan, OrEqualTo
dispatch_5 = Dispatch(List=list_item_10, DispatchPattern=smaller_than_2.SmallerThan)  # -> ListA, ListB
clean_tree_7 = CleanTree(RemoveNulls=True, RemoveInvalid=True, RemoveEmpty=True, Tree=dispatch_5.ListA)
panel_33 = Panel(get_rhino_attributes_4.Layer)
gh_inputgeometrytype_2 = RemoteReceiver()
gh_inputgeometrytype_3 = RemoteReceiver()
tree_statistics_2 = TreeStatistics(Tree=gh_inputgeometrytype_2)  # -> Paths, Length, Count
deconstruct_path = DeconstructPath(Branch=tree_statistics_2.Paths)
smaller_than_3 = SmallerThan(FirstNumber=gh_inputgeometrytype_3, SecondNumber=9)  # -> SmallerThan, OrEqualTo
panel_34 = Panel(gh_inputgeometrytype_3)
type_of_geometry_input = Panel(gh_inputgeometrytype_2)
dispatch_6 = Dispatch(List=gh_inputgeometrytype_3, DispatchPattern=smaller_than_3.SmallerThan)  # -> ListA, ListB
panel_35 = Panel(deconstruct_path)

gh_create_new_1_of_use_created_0_4 = RemoteReceiver(gh_create_new_1_of_use_created_0)
dispatch_7 = Dispatch(List=evaluate_2, DispatchPattern=gh_create_new_1_of_use_created_0_4)  # -> ListA, ListB

gh_create_new_1_of_use_created_0_5 = RemoteReceiver(gh_create_new_1_of_use_created_0)
dispatch_8 = Dispatch(List=clean_tree_7, DispatchPattern=gh_create_new_1_of_use_created_0_5)  # -> ListA, ListB

uniquegeometrytoblock = RemoteSender(dispatch_8.ListA)
uniquegeometrytoblock_2 = RemoteReceiver(uniquegeometrytoblock)
gh_inputgeometrytype_4 = RemoteSender(dispatch_7.ListA)
dispatch_9 = Dispatch(List=uniquegeometrytoblock_2, DispatchPattern=smaller_than_3.SmallerThan)  # -> ListA, ListB

input_selectedgeotoblock_7 = RemoteReceiver(input_selectedgeotoblock)  # disabled
tree_statistics_3 = TreeStatistics(Tree=uniquegeometrytoblock_2)  # -> Paths, Length, Count; disabled
tree_statistics_4 = TreeStatistics(Tree=input_selectedgeotoblock_7)  # -> Paths, Length, Count; disabled
panel_36 = Panel(tree_statistics_3.Count)  # disabled
panel_37 = Panel(tree_statistics_4.Count)  # disabled

panel_38 = Panel(dispatch_9.ListB)
panel_39 = Panel(dispatch_9.ListA)
initial_tree = Panel(dispatch_6.ListA)

# ----
# Profiles
create_tree_2 = CreateTree(Data=dispatch_9.ListB, Path=dispatch_6.ListB)  # -> graft(Data)
tree_statistics_5 = TreeStatistics(Tree=dispatch_9.ListB)  # -> Paths, Length, Count
list_length_5 = ListLength(List=dispatch_9.ListB)
gh_selectedgeoforprofiles = RemoteSender(create_tree_2)
dispatch_10 = Dispatch(List=tree_statistics_5.Paths, DispatchPattern=flatten(list_length_5))  # -> ListA, ListB
initial_tree_2 = Panel(dispatch_10.ListA)
tree_statistics_6 = TreeStatistics(Tree=create_tree_2)  # -> Paths, Length, Count
tree_by_layer = Panel(tree_statistics_6.Paths)

gh_selectedgeoforprofiles_2 = RemoteReceiver(gh_selectedgeoforprofiles)
gh_selectedgeoforprofiles_3 = RemoteReceiver(gh_selectedgeoforprofiles)
uniquegeometrytoblock_3 = RemoteReceiver(uniquegeometrytoblock)

# ----
# Panels
create_tree_3 = CreateTree(Data=dispatch_9.ListA, Path=dispatch_6.ListA)  # -> graft(Data)
create_tree_4 = CreateTree(Data=dispatch_6.ListA, Path=dispatch_6.ListA)  # -> graft(Data)
tree_statistics_7 = TreeStatistics(Tree=dispatch_9.ListA)  # -> Paths, Length, Count
list_length_6 = ListLength(List=dispatch_9.ListA)
gh_selectedgeoforpanels = RemoteSender(create_tree_3)
dispatch_11 = Dispatch(List=tree_statistics_7.Paths, DispatchPattern=flatten(list_length_6))  # -> ListA, ListB
initial_tree_3 = Panel(dispatch_11.ListA)
tree_statistics_8 = TreeStatistics(Tree=create_tree_3)  # -> Paths, Length, Count
tree_by_layer_2 = Panel(tree_statistics_8.Paths)

gh_panels_initial_tree = RemoteSender(dispatch_11.ListA)
panel_41 = Panel(gh_selectedgeoforpanels)

# ----
# Blocks to use
names_of_blocks_to_use_2 = Panel("""Panel - Default - Window
Panel - Default - Door
Panel - Default - CW
Panel - Default - Vent
Panel - Default - Vent
Panel - Default - Vent
Panel - Default - Vent
Panel - Default - Vent
Panel - Default - Vent""")
list_item_13 = ListItem(List=names_of_blocks_to_use_2, Index=create_tree_4, Wrap=True)
gh_namesofblockstouse = RemoteSender(list_item_13)

# ----
# Layers for RE
regelelement_layer_names_2 = Panel(""">::Regelelement::Window::Window - Panel
>::Regelelement::Door::Door - Panel
>::Regelelement::CurtainWall::CurtainWall - Panel
>::Regelelement::Vent-Other::Vent-Other - Panel
>::Regelelement::MS-Other::MS-Other - Panel
>::Regelelement::Aluninium::Aluninium - Panel
>::Regelelement::Ceiling::Ceiling - Panel
>::Regelelement::Column::Column - Panel
>::Regelelement::Glass/Stone::Glass/Stone - Panel""")
list_item_14 = ListItem(List=regelelement_layer_names_2, Index=create_tree_4, Wrap=True)
gh_re_layernames = RemoteSender(list_item_14)

list_item_15 = ListItem(List=names_of_blocks_to_use, Index=create_tree_4, Wrap=True)
gh_selectedgeoforpanels_2 = RemoteReceiver(gh_selectedgeoforpanels)
merge_5 = Merge(Data1=gh_selectedgeoforpanels_2, Data2=gh_selectedgeoforprofiles_2)
path_mapper = PathMapper(merge_5, source=["{A;B;C}", "{A;B}"], target=["{A;B}", "{A;B}"])
gh_panels_initial_tree_2 = RemoteReceiver(gh_panels_initial_tree)
replace_text_3 = ReplaceText(Text=gh_panels_initial_tree_2, Find="{", RecursiveReplace=False)
replace_text_4 = ReplaceText(Text=replace_text_3, Find="}", RecursiveReplace=False)
item_index_4 = ItemIndex(List=gh_panels_initial_tree_2, Item=gh_panels_initial_tree_2)
panel_42 = Panel(item_index_4)

# ----
# Deconstruct geometry
gh_selectedgeoforpanels_3 = RemoteReceiver(gh_selectedgeoforpanels)
cluster_5 = Cluster_3(selected_geometry=gh_selectedgeoforpanels_3)
gh_selectedgeoforpanels_4 = RemoteReceiver(gh_selectedgeoforpanels)
deconstruct_brep = DeconstructBrep(Brep=gh_selectedgeoforpanels_4)  # -> Faces, Edges, Vertices
circle = Circle(Plane=cluster_5, Radius=1)
sort_along_curve = SortAlongCurve(Points=deconstruct_brep.Vertices, Curve=circle)  # -> Points, Indices
shift_paths_3 = ShiftPaths(Data=sort_along_curve.Points, Offset=-2)
deconstruct_plane = DeconstructPlane(Plane=cluster_5)  # -> Origin, XAxis, YAxis, ZAxis; disabled
construct_plane = ConstructPlane(Origin=deconstruct_plane.Origin, XAxis=expr("-x", deconstruct_plane.YAxis), YAxis=expr("-x", deconstruct_plane.ZAxis))  # disabled
construct_plane_2 = ConstructPlane(Origin=deconstruct_plane.Origin, XAxis=deconstruct_plane.XAxis, YAxis=expr("-x", deconstruct_plane.ZAxis))  # disabled
gh_horizontalplane = RemoteSender(construct_plane_2)  # disabled
gh_verticalplane = RemoteSender(construct_plane)  # disabled

# ----
# Points
list_item_16 = ListItem(List=shift_paths_3, Index=0, Wrap=True)  # -> Item, Item1, Item2, Item3

line = Line(StartPoint=list_item_16.Item1, EndPoint=list_item_16.Item)
line_2 = Line(StartPoint=list_item_16.Item2, EndPoint=list_item_16.Item1)
line_3 = Line(StartPoint=list_item_16.Item3, EndPoint=list_item_16.Item)
line_4 = Line(StartPoint=list_item_16.Item2, EndPoint=list_item_16.Item3)

# ----
# Windows' and doors' edges
tree_statistics_9 = TreeStatistics(Tree=shift_paths_3)  # -> Paths, Length, Count
deconstruct_path_2 = DeconstructPath(Branch=tree_statistics_9.Paths)
list_item_17 = ListItem(List=deconstruct_path_2, Index=0, Wrap=True)
smaller_than_4 = SmallerThan(FirstNumber=list_item_17, SecondNumber=2)  # -> SmallerThan, OrEqualTo
unflatten_tree_2 = UnflattenTree(Tree=smaller_than_4.SmallerThan, Guide=line)
dispatch_multiple = DispatchMultiple(
    DispatchPattern=unflatten_tree_2,
    ListList0=line,
    List0=line_2,
    List1=line_3,
    List2=line_4,
    List3=cluster_5,
    List4=list_item_16.Item,
    List5=list_item_16.Item1,
    List6=list_item_16.Item2,
    List7=list_item_16.Item3)  # -> ListList0, List0, List1, List2, List3, List4, List5, List6, List7
plane = Plane(dispatch_multiple.List3)
deconstruct_plane_2 = DeconstructPlane(Plane=plane)  # -> Origin, XAxis, YAxis, ZAxis
merge_6 = Merge(
    Data1=dispatch_multiple.ListList0,
    Data2=dispatch_multiple.List0,
    Data3=dispatch_multiple.List1,
    Data4=dispatch_multiple.List2)
merge_7 = Merge(
    Data1=dispatch_multiple.List5,
    Data2=dispatch_multiple.List6,
    Data3=dispatch_multiple.List7,
    Data4=dispatch_multiple.List6)
curve_2 = Curve(merge_6)
construct_plane_3 = ConstructPlane(Origin=deconstruct_plane_2.Origin, XAxis=deconstruct_plane_2.XAxis, YAxis=expr("-x", deconstruct_plane_2.ZAxis))
construct_plane_4 = ConstructPlane(Origin=deconstruct_plane_2.Origin, XAxis=expr("-x", deconstruct_plane_2.ZAxis), YAxis=deconstruct_plane_2.YAxis)
merge_8 = Merge(Data1=construct_plane_4, Data2=construct_plane_3, Data3=construct_plane_3, Data4=construct_plane_4)
plane_origin = PlaneOrigin(Base=merge_8, Origin=merge_7)

# ----
# Construct transform for panels
# Edge relations => offsets&sizes
# ATM Wall panel gap is applied for all
#  panels (also CW, window,...)
value_list = ValueList({"1. BG-Nummer", "2. BG-Bezeichnung", "3. BG-Menge", "4. BG-Breite", "5. BG-Höhe", "6. BG-Fläche", "BakeObject Name", "Element Type", "HO_BasePlane", "HO_EdgeRelation", "HO_FacadeFaceOrientation", "HO_FacadeFaceUID", "HO_FacadeSubFaceUID", "HO_Kat.1", "HO_Kat.2", "HO_LevelElevation", "HO_LevelExtrudeOrLoft", "HO_LevelHeight", "HO_LevelUID", "HO_RE-Type", "HO_RE-type-by-user", "HO_Type", "Parent Address"}, selected="HO_EdgeRelation")
gh_selectedgeoforpanels_5 = RemoteReceiver(gh_selectedgeoforpanels)
get_user_value_6 = GetUserValue(Geometry=flatten(gh_selectedgeoforpanels_5), Key=value_list)  # -> simplify(graft(HO_EdgeRelation))
text_split_3 = TextSplit(Text=get_user_value_6, Separators=",")
left = Panel("1")
upper = Panel("2")
right = Panel("3")
bottom = Panel("4")
equality = Equality(FirstNumber=text_split_3, SecondNumber=left)  # -> Equality, Inequality
equality_2 = Equality(FirstNumber=text_split_3, SecondNumber=upper)  # -> Equality, Inequality
equality_3 = Equality(FirstNumber=text_split_3, SecondNumber=right)  # -> Equality, Inequality
equality_4 = Equality(FirstNumber=text_split_3, SecondNumber=bottom)  # -> Equality, Inequality
mass_addition = MassAddition(Input=equality.Equality)  # -> Result, PartialResults
mass_addition_2 = MassAddition(Input=equality_2.Equality)  # -> Result, PartialResults
mass_addition_3 = MassAddition(Input=equality_3.Equality)  # -> Result, PartialResults
mass_addition_4 = MassAddition(Input=equality_4.Equality)  # -> Result, PartialResults
defaultwallpanelgap_3 = RemoteReceiver(defaultwallpanelgap)
addition_5 = Addition(A=mass_addition.Result, B=mass_addition_3.Result)
addition_6 = Addition(A=mass_addition_2.Result, B=mass_addition_4.Result)
getdocumentusertext_2 = GetDocumentUserText(key="HO_DefaultState-CornerPanelsGap", checkNow=Toggle(True))  # -> value
# ---------- getdocumentusertext_2: Python ----------
# Gets document user text from current 3dm file

__author__ = "Yury Nasonov"
__version__ = "1"

ghenv.Component.Name = "Get Document user text"
ghenv.Component.NickName = 'GetDocumentUserText'
ghenv.Component.Message = 'Get Document user text'

# ———————————————————————————————————————————————————————————

import rhinoscriptsyntax as rs
import scriptcontext as sc
import Rhino

# ———————————————————————————————————————————————————————————

sc.doc = Rhino.RhinoDoc.ActiveDoc

# checkNow is currently disabled
#if checkNow != False:
#    value = rs.GetDocumentUserText(key)

value = rs.GetDocumentUserText(key)
sc.doc = ghdoc

print value
# ---------- end getdocumentusertext_2 ----------
division = Division(A=defaultwallpanelgap_3, B=2)
multiplication = Multiplication(A=addition_6, B=division)
multiplication_2 = Multiplication(A=addition_5, B=division)
evaluate_3 = Evaluate(Expression="if((x= \"Merged\"),0,1)", x=getdocumentusertext_2)
subtraction = Subtraction(A=defaultwallpanelgap_3, B=multiplication_2)
subtraction_2 = Subtraction(A=defaultwallpanelgap_3, B=multiplication)
defaultwallpanelgap_4 = RemoteReceiver(defaultwallpanelgap)
vertical_face_plane_in_the_middle = Plane(cluster_5)
length_4 = Length(Curve=line)  # -> simplify(Length)
length_5 = Length(Curve=line_2)  # -> simplify(Length)
defaultwallpanelgap_5 = RemoteReceiver(defaultwallpanelgap)
plane_origin_2 = PlaneOrigin(Base=vertical_face_plane_in_the_middle, Origin=list_item_16.Item2)
deconstruct_plane_3 = DeconstructPlane(Plane=plane_origin_2)  # -> Origin, XAxis, YAxis, ZAxis
boolean_toggle = BooleanToggle(True)

stream_filter = StreamFilter(Gate=evaluate_3, Stream0="0", Stream1=defaultwallpanelgap_4)
division_2 = Division(A=defaultwallpanelgap_4, B=2)

face_length = Number(length_4)
face_height = Number(length_5)

list_item_18 = ListItem(List=flatten([division_2, "0"]), Index=mass_addition.Result, Wrap=True)
list_item_19 = ListItem(List=flatten([division_2, "0"]), Index=mass_addition_4.Result, Wrap=True)
stream_filter_2 = StreamFilter(Gate=addition_2, Stream0=boolean_toggle, Stream1=boolean_toggle)

subtraction_3 = Subtraction(A=face_height, B=subtraction_2)
subtraction_4 = Subtraction(A=face_length, B=subtraction)
amplitude = Amplitude(Vector=deconstruct_plane_3.XAxis, Amplitude=list_item_18)
amplitude_2 = Amplitude(Vector=deconstruct_plane_3.YAxis, Amplitude=list_item_19)
integer_9 = Integer(subtraction_4)
integer_10 = Integer(subtraction_3)
attributes_ho_plattebreite = RemoteSender(integer_9)
attributes_ho_plattehöhe = RemoteSender(integer_10)
addition_7 = Addition(A=amplitude, B=amplitude_2)
move = Move(Geometry=plane_origin_2, Motion=addition_7)  # -> simplify(Geometry), Transform
getdocumentusertext_3 = GetDocumentUserText(key="HO_PanelDepthOffsets", checkNow=stream_filter_2)  # -> value; same code as getdocumentusertext_2
text_split_4 = TextSplit(Text=getdocumentusertext_3, Separators=",")
path_mapper_2 = PathMapper(move.Geometry, source=["{A}", "{A;B}", "{A;B;C}"], target=["{A}", "{A}", "{A}"])
panel_depth_offsets = Panel(text_split_4)
tree_statistics_10 = TreeStatistics(Tree=path_mapper_2)  # -> Paths, Length, Count
tree_branch = TreeBranch(Tree=simplify(graft(panel_depth_offsets)), Path=tree_statistics_10.Paths, MaintainPaths=True)
plane_offset = PlaneOffset(BasePlane=path_mapper_2, Offset=expr("-x", graft(Slider(15, range=0..100))))
unflatten_tree_3 = UnflattenTree(Tree=plane_offset, Guide=move.Geometry)
scale_nu = ScaleNU(Plane=PlaneXY(0, 0, 0), ScaleX=integer_9, ScaleY=integer_10, ScaleZ=1)  # -> Geometry, Transform
orient = Orient(Source=PlaneXY(0, 0, 0), Target=unflatten_tree_3)  # -> Geometry, Transform
merge_9 = Merge(Data1=simplify(scale_nu.Transform), Data2=simplify(orient.Transform))
compound = Compound(Transforms=merge_9)
gh_transformforpanels = RemoteSender(compound)

gh_selectedgeoforpanels_6 = RemoteReceiver(gh_selectedgeoforpanels)  # disabled
panel_43 = Panel(" ")  # disabled
defaultwallpanelgap_6 = RemoteReceiver(defaultwallpanelgap)  # disabled
cluster_6 = Cluster_4(plane=plane_origin_2)  # disabled
cluster_7 = Cluster_4(plane=unflatten_tree_3)  # disabled
new_blocks_attributes = Panel("""4. BG-Breite
5. BG-Höhe
HO_PlatteBreite
HO_PlatteHöhe
HO_BasePlane
HO_PlatteBasePlane
HO_Gap
HO_NoGap""")  # disabled
list_length_7 = ListLength(List=gh_selectedgeoforpanels_6)  # disabled
duplicate_data_4 = DuplicateData(Data=defaultwallpanelgap_6, Number=list_length_7, Order=True)  # -> simplify(Data); disabled
duplicate_data_5 = DuplicateData(Data=panel_43, Number=list_length_7, Order=True)  # -> simplify(Data); disabled
object_attributes = ObjectAttributes(ObjectOrAttributes=gh_selectedgeoforpanels_6)  # -> Name, LayerName, LayerFullPath, Color, MaterialName, LinetypeName, GroupIndices, PlotWeight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; disabled
duplicate_data_6 = DuplicateData(Data=new_blocks_attributes, Number=list_length_7, Order=True)  # -> simplify(Data); disabled
merge_10 = Merge(
    Data1=face_length,
    Data2=face_height,
    Data3=integer_9,
    Data4=integer_10,
    Data5=cluster_6,
    Data6=cluster_7,
    Data7=duplicate_data_4,
    Data8=duplicate_data_5)  # disabled
gh_re_layernames_2 = RemoteReceiver(gh_re_layernames)  # disabled
createattributes = CreateAttributes(
    LayerName=gh_re_layernames_2,
    UserDataKeys=[object_attributes.UserDataKeys, duplicate_data_6],
    UserDataValues=[object_attributes.UserDataValues, merge_10],
    enableFullPath=True)  # disabled

panel_44 = Panel(subtraction)

# ----
# Panels for RE
gh_namesofblockstouse_2 = RemoteReceiver(gh_namesofblockstouse)
gh_transformforpanels_2 = RemoteReceiver(gh_transformforpanels)
insert_block = InsertBlock(BlockName=gh_namesofblockstouse_2, SourcePlane=PlaneXY(0, 0, 0))
transform = Transform(Geometry=insert_block, Transform=gh_transformforpanels_2)

# ----
# Construct transform for profiles
gh_selectedgeoforprofiles_4 = RemoteReceiver(gh_selectedgeoforprofiles)
clean_tree_8 = CleanTree(RemoveNulls=True, RemoveInvalid=True, RemoveEmpty=True, Tree=plane_origin)
branckes_to_mirror_r = Panel("""2
10
11""")
cluster_8 = Cluster_5(geometry=gh_selectedgeoforprofiles_4)
graft_tree_5 = GraftTree(Tree=clean_tree_8, IncludeEmptyLists=True, IncludeNullItems=True)
list_item_20 = ListItem(List=clean_tree_8, Index="2", Wrap=True)
tree_statistics_11 = TreeStatistics(Tree=gh_selectedgeoforprofiles_4)  # -> Paths, Length, Count
path_mapper_3 = PathMapper(list_item_20, source="{A;B}", target="{A;B;2}")
unflatten_tree_4 = UnflattenTree(Tree=cluster_8, Guide=gh_selectedgeoforprofiles_4)
unflatten_tree_5 = UnflattenTree(Tree=tree_statistics_11.Paths, Guide=gh_selectedgeoforprofiles_4)
branckes_to_mirror_r_2 = Panel("11")
plane_2 = Plane(unflatten_tree_4)
path_mapper_4 = PathMapper(unflatten_tree_5, source=["{A}", "{A;B}"], target=["{A}", "{A}"])
path_mapper_5 = PathMapper(plane_2, source=["{A}", "{A;B}"], target=["{A}", "{A}"])
tree_branch_2 = TreeBranch(Tree=path_mapper_4, Path=branckes_to_mirror_r_2, MaintainPaths=True)  # -> simplify(graft(Branch))
tree_branch_3 = TreeBranch(Tree=path_mapper_5, Path=branckes_to_mirror_r_2, MaintainPaths=True)  # -> simplify(graft(Branch))
gh_selectedgeoforprofiles_5 = RemoteReceiver(gh_selectedgeoforprofiles)
create_tree_5 = CreateTree(Data=tree_branch_3, Path=tree_branch_2)
merge_11 = Merge(Data1=path_mapper_3, Data2=create_tree_5)
merge_12 = Merge(Data1=graft(curve_2), Data2=gh_selectedgeoforprofiles_5)
deconstruct_plane_4 = DeconstructPlane(Plane=merge_11)  # -> Origin, XAxis, YAxis, ZAxis
length_6 = Length(Curve=merge_12)
merge_13 = Merge(Data1=graft_tree_5, Data2=plane_2)
construct_plane_5 = ConstructPlane(Origin=deconstruct_plane_4.Origin, XAxis=deconstruct_plane_4.ZAxis, YAxis=deconstruct_plane_4.YAxis)
path_mapper_6 = PathMapper(merge_13, source=["{A}", "{A;B}", "{A;B;C}"], target=["{A}", "{A}", "{A}"])
getdocumentusertext_4 = GetDocumentUserText(key="HO_ProfileDepthOffsets", checkNow=Toggle(True))  # -> value; same code as getdocumentusertext_2
text_split_5 = TextSplit(Text=getdocumentusertext_4, Separators=",")
tree_statistics_12 = TreeStatistics(Tree=path_mapper_6)  # -> Paths, Length, Count
panel_depth_offsets_2 = Panel(text_split_5)
tree_branch_4 = TreeBranch(Tree=simplify(graft(panel_depth_offsets_2)), Path=tree_statistics_12.Paths, MaintainPaths=True)
mirror = Mirror(Plane=construct_plane_5)  # -> Geometry, Transform; disabled
scale_nu_2 = ScaleNU(Plane=PlaneXY(0, 0, 0), ScaleX=1, ScaleY=1, ScaleZ=length_6)  # -> Geometry, Transform

list_length_8 = ListLength(List=path_mapper_6)
tree_branch_5 = TreeBranch(Tree=integer_2, Path=tree_statistics_12.Paths, MaintainPaths=True)
division_3 = Division(A=list_length_8, B=tree_branch_5)
deconstruct_plane_5 = DeconstructPlane(Plane=path_mapper_6)  # -> Origin, XAxis, YAxis, ZAxis
tree_branch_6 = TreeBranch(Tree=simplify(integer), Path=tree_statistics_12.Paths, MaintainPaths=True)
duplicate_data_7 = DuplicateData(Data=tree_branch_6, Number=division_3, Order=True)
pick_n_choose_6 = PickNChoose(Pattern=duplicate_data_7, Stream0=deconstruct_plane_5.YAxis, Stream1=deconstruct_plane_5.XAxis)
amplitude_3 = Amplitude(Vector=pick_n_choose_6, Amplitude=tree_branch_4)
move_2 = Move(Geometry=path_mapper_6, Motion=amplitude_3)  # -> Geometry, Transform

unflatten_tree_6 = UnflattenTree(Tree=move_2.Geometry, Guide=merge_13)
orient_2 = Orient(Source=PlaneXY(0, 0, 0), Target=unflatten_tree_6)  # -> Geometry, Transform
merge_14 = Merge(Data1=scale_nu_2.Transform, Data2=orient_2.Transform, Data3=mirror.Transform)
clean_tree_9 = CleanTree(RemoveNulls=True, RemoveInvalid=True, RemoveEmpty=True, Tree=merge_14)
compound_2 = Compound(Transforms=clean_tree_9)
gh_transformforprofiles = RemoteSender(compound_2)

gh_transformforprofiles_2 = RemoteReceiver(gh_transformforprofiles)
path_mapper_7 = PathMapper(gh_transformforprofiles_2, source=["{A;B;C}", "{A;B}"], target=["{A}", "{A}"])
gh_transformforprofiles_3 = RemoteReceiver(gh_transformforprofiles)
list_length_9 = ListLength(List=path_mapper_7)
list_item_21 = ListItem(List=path_mapper_7, Index=0, Wrap=True)
tree_statistics_13 = TreeStatistics(Tree=path_mapper_7)  # -> Paths, Length, Count
path_mapper_8 = PathMapper(gh_transformforprofiles_3, source=["{A;B;C}", "{A;B}"], target=["{A;B}", "{A;B}"])
list_length_10 = ListLength(List=path_mapper_8)
tree_branch_7 = TreeBranch(Tree=integer_3, Path=tree_statistics_13.Paths, MaintainPaths=True)
tree_statistics_14 = TreeStatistics(Tree=list_length_10)  # -> Paths, Length, Count
tree_branch_8 = TreeBranch(Tree=path_mapper, Path=tree_statistics_14.Paths, MaintainPaths=True)
division_4 = Division(A=list_length_9, B=tree_branch_7)
unflatten_tree_7 = UnflattenTree(Tree=division_4, Guide=list_item_21)
duplicate_data_8 = DuplicateData(Data=tree_branch_8, Number=list_length_10, Order=True)
gh_number_of_elements_in_branch = RemoteSender(unflatten_tree_7)
gh_number_of_elements_in_branch_2 = RemoteReceiver(gh_number_of_elements_in_branch)
tree_branch_9 = TreeBranch(Tree=shift_paths, Path=tree_statistics_13.Paths, MaintainPaths=True)
gh_number_of_elements_in_branch_3 = RemoteReceiver(gh_number_of_elements_in_branch)
tree_branch_10 = TreeBranch(Tree=shift_paths, Path=tree_statistics_13.Paths, MaintainPaths=True)
gh_transformforprofiles_4 = RemoteReceiver(gh_transformforprofiles)
tree_branch_11 = TreeBranch(Tree=text_4, Path=tree_statistics_13.Paths, MaintainPaths=True)
duplicate_data_9 = DuplicateData(Data=tree_branch_9, Number=gh_number_of_elements_in_branch_2, Order=True)
# Profiles for RE
duplicate_data_10 = DuplicateData(Data=tree_branch_10, Number=gh_number_of_elements_in_branch_2, Order=True)
shift_paths_4 = ShiftPaths(Data=gh_transformforprofiles_4, Offset=-1)
insert_block_2 = InsertBlock(BlockName=duplicate_data_9, SourcePlane=PlaneXY(0, 0, 0))
duplicate_data_11 = DuplicateData(Data=tree_branch_11, Number=gh_number_of_elements_in_branch_3, Order=True)
unflatten_tree_8 = UnflattenTree(Tree=duplicate_data_10, Guide=shift_paths_4)
unflatten_tree_9 = UnflattenTree(Tree=insert_block_2, Guide=shift_paths_4)
unflatten_tree_10 = UnflattenTree(Tree=duplicate_data_11, Guide=shift_paths_4)
gh_profile_type = RemoteSender(unflatten_tree_8)
transform_2 = Transform(Geometry=unflatten_tree_9, Transform=shift_paths_4)
gh_number_of_elements_in_branch_4 = RemoteReceiver(gh_number_of_elements_in_branch)
panel_45 = Panel(transform_2)
gh_number_of_elements_in_branch_5 = RemoteReceiver(gh_number_of_elements_in_branch)
duplicate_data_12 = DuplicateData(Data=gh_selectedgeoforprofiles_3, Number=gh_number_of_elements_in_branch_4, Order=True)
cluster_9 = Cluster_6(data=defaults_ancorpoint_3, path=tree_statistics_13.Paths, number=gh_number_of_elements_in_branch_5, guide=shift_paths_4)  # -> graft(tree)
cluster_10 = Cluster_6(
    data=defaults_profileorientation_0_horiz_1_ve_3,
    path=tree_statistics_13.Paths,
    number=gh_number_of_elements_in_branch_5,
    guide=shift_paths_4)  # -> graft(tree)
cluster_11 = Cluster_6(
    data=defaults_profilemirror_3,
    path=tree_statistics_13.Paths,
    number=gh_number_of_elements_in_branch_5,
    guide=shift_paths_4)  # -> graft(tree)
list_item_22 = ListItem(List=[0, -90], Index=cluster_10, Wrap=True)
deconstruct_block = DeconstructBlock(Block=graft(transform_2))  # -> Name, Plane, Geometry
deconstruct_plane_6 = DeconstructPlane(Plane=deconstruct_block.Plane)  # -> Origin, XAxis, YAxis, ZAxis
shift_paths_5 = ShiftPaths(Data=deconstruct_block.Geometry, Offset=-1)
deconstruct_attributes = DeconstructAttributes(ReferencedGeometryOrAttributes=shift_paths_5)  # -> Keys, Values
construct_plane_6 = ConstructPlane(Origin=deconstruct_plane_6.Origin, XAxis=deconstruct_plane_6.YAxis, YAxis=deconstruct_plane_6.ZAxis)
filter_by_user_attributes = FilterByUserAttributes(Attributes=shift_paths_5, Key="HO_AncorPointType", Val=cluster_9)  # -> Objects, Key, Val
key_value_search = KeyValueSearch(Keys=deconstruct_attributes.Keys, Values=deconstruct_attributes.Values, Search="HO_AncorPointType")
shift_paths_6 = ShiftPaths(Data=key_value_search, Offset=-1)
member_index_2 = MemberIndex(Set=shift_paths_6, Member=cluster_9)  # -> Index, Count
list_item_23 = ListItem(List=shift_paths_5, Index=member_index_2.Index, Wrap=True)
vector_2pt = Vector2Pt(PointA=list_item_23, PointB=deconstruct_block.Plane, Unitize=False)  # -> Vector, Length
move_3 = Move(Geometry=flatten(transform_2), Motion=flatten(vector_2pt.Vector))  # -> Geometry, Transform
gh_profile_type_2 = RemoteReceiver(gh_profile_type)

# ----
# Attributes for profiles
panel_46 = Panel("Default - ")
replace_text_5 = ReplaceText(Text=gh_namesofblockstouse_2, Find=panel_46, RecursiveReplace=False)  # disabled
panel_47 = Panel("""HO_PlatteBreite
HO_PlatteHöhe
PanelGap""")
list_length_11 = ListLength(List=replace_text_5)  # disabled
duplicate_data_13 = DuplicateData(Data=panel_47, Number=list_length_11, Order=True)  # disabled
gh_number_of_elements_in_branch_6 = RemoteReceiver(gh_number_of_elements_in_branch)
panel_48 = Panel("Frame")
panel_49 = Panel("HO_BlockType")
list_length_12 = ListLength(List=gh_profile_type_2)
duplicate_data_14 = DuplicateData(Data="HO_BG-type", Number=list_length_12, Order=True)
duplicate_data_15 = DuplicateData(Data="HO_AncorPoint", Number=list_length_12, Order=True)
duplicate_data_16 = DuplicateData(Data="HO_BlockDirection", Number=list_length_12, Order=True)
duplicate_data_17 = DuplicateData(Data="Profile", Number=list_length_12, Order=True)
duplicate_data_18 = DuplicateData(Data="HO_Part", Number=list_length_12, Order=True)
tree_statistics_15 = TreeStatistics(Tree=gh_number_of_elements_in_branch_6)  # -> Paths, Length, Count
duplicate_data_19 = DuplicateData(Data="HO_RE-Type", Number=list_length_12, Order=True)
unflatten_tree_11 = UnflattenTree(Tree=simplify(duplicate_data_8), Guide=shift_paths_4)
shift_paths_7 = ShiftPaths(Data=duplicate_data_14, Offset=-1)  # -> graft(Data)
shift_paths_8 = ShiftPaths(Data=duplicate_data_15, Offset=-1)  # -> graft(Data)
shift_paths_9 = ShiftPaths(Data=duplicate_data_16, Offset=-1)  # -> graft(Data)
shift_paths_10 = ShiftPaths(Data=duplicate_data_17, Offset=-1)  # -> graft(Data)
shift_paths_11 = ShiftPaths(Data=duplicate_data_18, Offset=-1)  # -> graft(Data)
get_user_attributes_3 = GetUserAttributes(Geometry=unflatten_tree_11)  # -> Keys, Values, BakeName
shift_paths_12 = ShiftPaths(Data=duplicate_data_19, Offset=-1)  # -> graft(Data)
tree_branch_12 = TreeBranch(Tree=lu_mm_rb, Path=tree_statistics_15.Paths, MaintainPaths=True)
tree_branch_13 = TreeBranch(Tree=part, Path=tree_statistics_15.Paths, MaintainPaths=True)
tree_branch_14 = TreeBranch(Tree=block_orientation, Path=tree_statistics_15.Paths, MaintainPaths=True)
duplicate_data_20 = DuplicateData(Data="1", Number=gh_number_of_elements_in_branch_6, Order=True)  # -> simplify(Data)
duplicate_data_21 = DuplicateData(Data=tree_branch_13, Number=duplicate_data_20, Order=True)  # -> simplify(graft(Data))
duplicate_data_22 = DuplicateData(Data=tree_branch_14, Number=duplicate_data_20, Order=True)  # -> simplify(graft(Data))
duplicate_data_23 = DuplicateData(Data=tree_branch_12, Number=duplicate_data_20, Order=True)  # -> simplify(graft(Data))
unflatten_tree_12 = UnflattenTree(Tree=duplicate_data_21, Guide=shift_paths_10)
unflatten_tree_13 = UnflattenTree(Tree=duplicate_data_22, Guide=shift_paths_10)
unflatten_tree_14 = UnflattenTree(Tree=duplicate_data_23, Guide=shift_paths_10)
gh_profile_type_3 = RemoteReceiver(gh_profile_type)
merge_15 = Merge(
    Data1=get_user_attributes_3.Keys,
    Data2=shift_paths_12,
    Data3=shift_paths_7,
    Data4=shift_paths_8,
    Data5=shift_paths_9,
    Data6=shift_paths_11)
merge_16 = Merge(
    Data1=get_user_attributes_3.Values,
    Data2=graft(gh_profile_type_3),
    Data3=shift_paths_10,
    Data4=unflatten_tree_14,
    Data5=unflatten_tree_13,
    Data6=unflatten_tree_12)
panel_50 = Panel(merge_16)
define_object_attributes_3 = DefineObjectAttributes(UserKeys=merge_15, UserValues=merge_16, Layer=graft(unflatten_tree_10))
shift_paths_13 = ShiftPaths(Data=define_object_attributes_3, Offset=-1)
attributes_newforprofiles = RemoteSender(shift_paths_13)

rotate = Rotate(Geometry=move_3.Geometry, Angle=flatten(degrees(list_item_22)), Plane=flatten(deconstruct_block.Plane))  # -> Geometry, Transform
dispatch_12 = Dispatch(List=rotate.Geometry, DispatchPattern=flatten(cluster_11))  # -> ListA, ListB
dispatch_13 = Dispatch(List=construct_plane_6, DispatchPattern=cluster_11)  # -> ListA, ListB
mirror_2 = Mirror(Geometry=dispatch_12.ListA, Plane=flatten(dispatch_13.ListA))  # -> Geometry, Transform
custom_preview_lineweights = CustomPreviewLineweights(
    Geometry=move_3.Geometry,
    Shader={diffuse=RGB(255, 105, 180), emission=RGB(76, 32, 54), shine=0.5, specular=RGB(255, 255, 255), transparency=0},
    Absolute=False)
unflatten_tree_15 = UnflattenTree(Tree=mirror_2.Geometry, Guide=dispatch_13.ListA)
unflatten_tree_16 = UnflattenTree(Tree=dispatch_12.ListB, Guide=dispatch_13.ListB)
merge_17 = Merge(Data2=unflatten_tree_16, Data3=unflatten_tree_15)
unflatten_tree_17 = UnflattenTree(Tree=merge_17, Guide=transform_2)

# ----
# Attributes for panels
gh_transformforpanels_3 = RemoteReceiver(gh_transformforpanels)
gh_namesofblockstouse_3 = RemoteReceiver(gh_namesofblockstouse)
defaultwallpanelgap_7 = RemoteReceiver(defaultwallpanelgap)
list_length_13 = ListLength(List=gh_transformforpanels_3)  # -> simplify(Length)
gh_selectedgeoforpanels_7 = RemoteReceiver(gh_selectedgeoforpanels)
text_split_6 = TextSplit(Text=gh_namesofblockstouse_3, Separators=" ")
duplicate_data_24 = DuplicateData(Data=defaultwallpanelgap_7, Number=list_length_13, Order=True)  # -> simplify(Data)
gh_namesofblockstouse_4 = RemoteReceiver(gh_namesofblockstouse)
list_item_24 = ListItem(List=text_split_6, Index=-1, Wrap=True)
get_user_attributes_4 = GetUserAttributes(Geometry=gh_selectedgeoforpanels_7)  # -> simplify(Keys), simplify(Values), BakeName
cluster_12 = Cluster_4(plane=unflatten_tree_3)
attributes_ho_plattebreite_2 = RemoteReceiver(attributes_ho_plattebreite)
attributes_ho_plattehöhe_2 = RemoteReceiver(attributes_ho_plattehöhe)
cluster_13 = Cluster_4(plane=plane_origin_2)
attributes_ho_plattebreite_3 = RemoteReceiver(attributes_ho_plattebreite)
attributes_ho_plattehöhe_3 = RemoteReceiver(attributes_ho_plattehöhe)
attributes_panelgap = RemoteSender(duplicate_data_24)
replace_text_6 = ReplaceText(Text=gh_namesofblockstouse_4, Find="Default - ", RecursiveReplace=False)
concatenate = Concatenate(FragmentE=">::Regelelement::", FragmentD=list_item_24, FragmentC="::", FragmentA=list_item_24, FragmentB=" - Panel")
panel_51 = Panel("""HO_RE-Type
HO_PlatteBreite
HO_PlatteHöhe
HO_PanelGap
HO_BasePlane
HO_PlatteBasePlane
HO_PlatteBreite
HO_PlatteHöhe
HO_BG-type""")
shift_paths_14 = ShiftPaths(Data=list_item_15, Offset=-1)
list_length_14 = ListLength(List=attributes_panelgap)
duplicate_data_25 = DuplicateData(Data=panel_51, Number=list_length_14, Order=True)  # -> simplify(Data)

duplicate_data_26 = DuplicateData(Data="Panel", Number=list_length_13, Order=True)  # -> simplify(Data)
panel_52 = Panel(concatenate)
shift_paths_15 = ShiftPaths(Data=duplicate_data_26, Offset=-1)  # -> graft(Data)

merge_18 = Merge(
    Data1=get_user_attributes_4.Values,
    Data2=simplify(replace_text_6),
    Data3=attributes_panelgap,
    Data4=simplify(attributes_ho_plattebreite_2),
    Data5=simplify(attributes_ho_plattehöhe_2),
    Data6=cluster_13,
    Data7=cluster_12,
    Data8=simplify(attributes_ho_plattebreite_3),
    Data9=simplify(attributes_ho_plattehöhe_3),
    Data10=duplicate_data_26)
define_object_attributes_4 = DefineObjectAttributes(UserKeys=[get_user_attributes_4.Keys, duplicate_data_25], UserValues=merge_18, Layer=shift_paths_14)  # -> simplify(Attributes)
attributes_newforpanels = RemoteSender(define_object_attributes_4)

# ----
# Trees for unique RE Blocks
# Unique RE Blocks
gh_inputgeometrytype_5 = RemoteReceiver()
list_length_15 = ListLength(List=transform)
merge_19 = Merge(Data1=transform, Data2=unflatten_tree_17)
index = Panel(gh_inputgeometrytype_5)
list_length_16 = ListLength(List=merge_19)
list_length_17 = ListLength(List=merge_19)
flatten_tree_2 = FlattenTree(Tree=gh_inputgeometrytype_5, Path="{0}")
gh_re_layernames_3 = RemoteReceiver(gh_re_layernames)
item_index_5 = ItemIndex(List=gh_inputgeometrytype_5, Item=gh_inputgeometrytype_5)
list_length_18 = ListLength(List=transform)
index_2 = Panel(item_index_5)
create_tree_6 = CreateTree(Data=item_index_5, Path=gh_inputgeometrytype_5)
duplicate_data_27 = DuplicateData(Data=create_tree_6, Number=list_length_18, Order=True)  # -> simplify(Data)
branch_to_place_3 = Panel(create_tree_6)
shift_paths_16 = ShiftPaths(Data=duplicate_data_27, Offset=-1)
uniquegeometrytoblock_4 = RemoteReceiver(uniquegeometrytoblock)
get_user_attributes_5 = GetUserAttributes(Geometry=uniquegeometrytoblock_4)  # -> Keys, Values, BakeName
get_rhino_attributes_5 = GetRhinoAttributes(Geometry=uniquegeometrytoblock_4, readFullPath=True)  # -> Name, Layer, Color; disabled
attributes_newforprofiles_2 = RemoteReceiver(attributes_newforprofiles)
attributes_newforpanels_2 = RemoteReceiver(attributes_newforpanels)
merge_20 = Merge(Data1=attributes_newforpanels_2, Data2=attributes_newforprofiles_2)
replace_text_7 = ReplaceText(Text=get_rhino_attributes_5.Layer, Find="FacadeSubFace", Replace="Used", RecursiveReplace=False)  # disabled
replace_text_8 = ReplaceText(Text=replace_text_7, Find="SupportGeo", Replace="Used", RecursiveReplace=False)  # disabled
define_object_attributes_5 = DefineObjectAttributes(UserKeys=get_user_attributes_5.Keys, UserValues=get_user_attributes_5.Values, Layer=">::SupportGeo::RE-Base")  # -> simplify(Attributes)
uniquegeometrybaseplanes_2 = RemoteReceiver(uniquegeometrybaseplanes)
gh_blockname_4 = RemoteReceiver(simplify(gh_blockname))

panel_53 = Panel(shift_paths_16)

tree_statistics_16 = TreeStatistics(Tree=merge_19)  # -> Paths, Length, Count
item_selector_2 = ItemSelector(tree_statistics_16.Paths)
tree_branch_15 = TreeBranch(Tree=merge_19, Path=item_selector_2, MaintainPaths=True)

# ----
# Types of elements
tree_statistics_17 = TreeStatistics(Tree=create_tree_6)  # -> Paths, Length, Count
deconstruct_path_3 = DeconstructPath(Branch=tree_statistics_17.Paths)
smaller_than_5 = SmallerThan(FirstNumber=deconstruct_path_3, SecondNumber="2")  # -> SmallerThan, OrEqualTo
dispatch_14 = Dispatch(List=create_tree_6, DispatchPattern=simplify(smaller_than_5.SmallerThan))  # -> graft(ListA), ListB
merge_21 = Merge(Data1=dispatch_14.ListA, Data2=dispatch_14.ListB)
clean_tree_10 = CleanTree(RemoveNulls=True, RemoveInvalid=True, RemoveEmpty=True, Tree=merge_21)  # -> graft(Tree)
tree_statistics_18 = TreeStatistics(Tree=clean_tree_10)  # -> Paths, Length, Count
deconstruct_path_4 = DeconstructPath(Branch=tree_statistics_18.Paths)
list_item_25 = ListItem(List=deconstruct_path_4, Index=0, Wrap=True)
smaller_than_6 = SmallerThan(FirstNumber=list_item_25, SecondNumber="2")  # -> SmallerThan, OrEqualTo
panel_54 = Panel("""1
5""")
list_item_26 = ListItem(List=panel_54, Index=smaller_than_6.SmallerThan, Wrap=True)  # -> simplify(Item)
unflatten_tree_18 = UnflattenTree(Tree=create_tree_6, Guide=clean_tree_10)
unflatten_tree_19 = UnflattenTree(Tree=list_item_26, Guide=clean_tree_10)
duplicate_data_28 = DuplicateData(Data=unflatten_tree_18, Number=unflatten_tree_19, Order=True)
shift_paths_17 = ShiftPaths(Data=duplicate_data_28, Offset=-2)  # -> graft(Data)

key_value_search_2 = KeyValueSearch(Keys=item_index_4, Values=replace_text_4, Search=shift_paths_17)
shift_paths_18 = ShiftPaths(Data=duplicate_data_28, Offset=-2)
create_tree_7 = CreateTree(Data=merge_20, Path=shift_paths_18)
clean_tree_11 = CleanTree(RemoveNulls=True, RemoveInvalid=True, RemoveEmpty=True, Tree=gh_blockname_4)

create_tree_8 = CreateTree(Data=merge_19, Path=shift_paths_17)
create_tree_9 = CreateTree(Data=merge_20, Path=shift_paths_17)

extended_geometry_2 = ExtendedGeometry([uniquegeometrytoblock_3, create_tree_8])
relay = Relay([define_object_attributes_5, create_tree_9])

# ----
# Define unique
# RE blocks
gh_create_new_1_of_use_created_0_6 = RemoteReceiver(gh_create_new_1_of_use_created_0)
dispatch_15 = Dispatch(List=extended_geometry_2, DispatchPattern=gh_create_new_1_of_use_created_0_6)  # -> ListA, ListB

dispatch_16 = Dispatch(List=relay, DispatchPattern=gh_create_new_1_of_use_created_0_6)  # -> ListA, ListB
dispatch_17 = Dispatch(List=uniquegeometrybaseplanes_2, DispatchPattern=gh_create_new_1_of_use_created_0_6)  # -> ListA, ListB

tree_statistics_19 = TreeStatistics(Tree=create_tree_8)  # -> Paths, Length, Count
item_selector_3 = ItemSelector(tree_statistics_19.Paths)
tree_branch_16 = TreeBranch(Tree=create_tree_8, Path=item_selector_3, MaintainPaths=True)

clean_tree_12 = CleanTree(RemoveNulls=True, RemoveInvalid=True, RemoveEmpty=True, Tree=dispatch_15.ListA)
clean_tree_13 = CleanTree(RemoveNulls=True, RemoveInvalid=True, RemoveEmpty=True, Tree=dispatch_16.ListA)
clean_tree_14 = CleanTree(RemoveNulls=True, RemoveInvalid=True, RemoveEmpty=True, Tree=dispatch_17.ListA)

define_block = DefineBlock(Geometry=clean_tree_12, Attributes=clean_tree_13, BlockName=clean_tree_11, BasePlane=clean_tree_14)
gh_new_unique_re_blocks = RemoteSender(define_block)

flatten_tree_3 = FlattenTree(Tree=define_block, Path="{0}")
item_selector_4 = ItemSelector(flatten_tree_3)
extended_geometry_3 = ExtendedGeometry(item_selector_4)

# ----
# NESTED BLOCKS
# All RE blocks
# Trees according
# to the input
# Place RE blocks
# Bake RE blocks
gh_create_new_1_of_use_created_0_7 = RemoteReceiver(gh_create_new_1_of_use_created_0)
gh_blocktype_3 = RemoteReceiver(gh_blocktype)
uniquegeometrybaseplanes_3 = RemoteReceiver(uniquegeometrybaseplanes)
gh_existingblockname_2 = RemoteReceiver(gh_existingblockname)
xy_plane = XYPlane(Origin=Point(0, 0, 0))
gh_new_unique_re_blocks_2 = RemoteReceiver(gh_new_unique_re_blocks)
insert_block_3 = InsertBlock(BlockName=gh_existingblockname_2, SourcePlane=PlaneXY(0, 0, 0))
dispatch_18 = Dispatch(List=xy_plane, DispatchPattern=gh_create_new_1_of_use_created_0_7)  # -> ListA, ListB
dispatch_19 = Dispatch(List=uniquegeometrybaseplanes_3, DispatchPattern=gh_create_new_1_of_use_created_0_7)  # -> ListA, ListB
pick_n_choose_7 = PickNChoose(Pattern=gh_create_new_1_of_use_created_0_7, Stream0=xy_plane, Stream1=uniquegeometrybaseplanes_3)
merge_22 = Merge(Data1=gh_new_unique_re_blocks_2, Data2=insert_block_3)
merge_23 = Merge(Data1=dispatch_19.ListA, Data2=dispatch_18.ListB)
allgeometrybaseplanes_2 = RemoteReceiver(allgeometrybaseplanes)
list_item_27 = ListItem(List=flatten(merge_22), Index=gh_blocktype_3, Wrap=True)  # -> simplify(graft(Item))
list_item_28 = ListItem(List=flatten(pick_n_choose_7), Index=gh_blocktype_3, Wrap=True)  # -> simplify(graft(Item))
orient_3 = Orient(Geometry=list_item_27, Source=list_item_28, Target=allgeometrybaseplanes_2)  # -> simplify(graft(Geometry)), Transform
input_bakeblocks_4 = RemoteReceiver(input_bakeblocks)
bake_objects = BakeObjects(Geometry=orient_3.Geometry, Attributes=define_object_attributes_2, Bake=input_bakeblocks_4, groupObject=False)

panel_55 = Panel(gh_blocktype_3)
panel_56 = Panel(merge_22)
tree_branch_17 = TreeBranch(Tree=merge_22, Path=gh_blocktype_3, MaintainPaths=True)

tree_statistics_20 = TreeStatistics(Tree=merge_22)  # -> Paths, Length, Count
item_selector_5 = ItemSelector(tree_statistics_20.Paths, {"{0;0}"}, selected="{0;0}")
tree_branch_18 = TreeBranch(Tree=merge_22, Path=item_selector_5, MaintainPaths=True)

panel_57 = Panel(tree_branch_17)
tree_statistics_21 = TreeStatistics(Tree=allgeometrybaseplanes_2)  # -> Paths, Length, Count

line_5 = Line(StartPoint=list_item_28, EndPoint=allgeometrybaseplanes_2)
item_selector_6 = ItemSelector(line_5)
tree_statistics_22 = TreeStatistics(Tree=list_item_28)  # -> Paths, Length, Count
extended_geometry_4 = ExtendedGeometry(item_selector_6)
text_tag_3d = TextTag3D(
    Location=flatten(allgeometrybaseplanes_2),
    Text=tree_statistics_22.Paths,
    Size=150,
    Colour=RGB(10, 0, 0),
    Justification=7)
text_tag_3d_2 = TextTag3D(Location=flatten(list_item_28), Text=tree_statistics_21.Paths, Size=150, Colour=RGB(255, 255, 255), Justification=3)

# ==== cluster SetViewAndCplaneToObject: Input: 0 = Object top view 1= Object perspective view
view = ClusterInput()  # 0 = Object top view 1= Object perspective view
# TO DO: Zoom selected firstly
gzaddreferences = CSharpScript(
    Run=True,
    Reference=["C:\Program Files\Rhino 7\Plug-ins\Grasshopper\Components\ScriptComponents.gha", "C:\Program Files\NoDoubts\Godzilla\System\Godzilla.dll", "C:\Program Files\NoDoubts\Godzilla\System\RhGodzilla.rhp"])  # -> Done; inputs Run: Boolean; same code as gzaddreferences
# Go to clicked step
gzopengh = CSharpScript(Reference=["C:\Program Files\Rhino 7\Plug-ins\Grasshopper\Components\ScriptComponents.gha", "C:\Program Files\NoDoubts\Godzilla\System\Godzilla.dll", "C:\Program Files\NoDoubts\Godzilla\System\RhGodzilla.rhp"])  # -> done; inputs resName: String, runNow: Boolean; same code as gzopengh
gz_menu = CSharpScript(Reference=["C:\Program Files\Rhino 7\Plug-ins\Grasshopper\Components\ScriptComponents.gha", "C:\Program Files\NoDoubts\Godzilla\System\Godzilla.dll", "C:\Program Files\NoDoubts\Godzilla\System\RhGodzilla.rhp"])  # -> resources, names, tooltips; same code as gz_menu
panel = Panel(gzaddreferences)
docinfo = DocumentInfo(AutoUpdate=False, Recursive=False)  # -> DocumentName, DocumentFilePath, Components, Params, _3rdPartyAssemblies
integer = Integer(view)
view_number_to_set = RemoteSender(integer)
list_length = ListLength(List=integer)
gzcommand = CSharpScript(
    runNow=False,
    echo=False,
    Reference=["C:\Program Files\Rhino 7\Plug-ins\Grasshopper\Components\ScriptComponents.gha", "C:\Program Files\NoDoubts\Godzilla\System\Godzilla.dll", "C:\Program Files\NoDoubts\Godzilla\System\RhGodzilla.rhp"])  # -> done; inputs command: String, runNow: Boolean, echo: Boolean; same code as gzcommand
tsort = SortText(Keys=docinfo.Components, Culture=127)  # -> Keys, Values
gzuicolors = CSharpScript(Reference=["C:\Program Files\Rhino 7\Plug-ins\Grasshopper\Components\ScriptComponents.gha", "C:\Program Files\NoDoubts\Godzilla\System\Godzilla.dll", "C:\Program Files\NoDoubts\Godzilla\System\RhGodzilla.rhp"])  # -> Current_step_bg; same code as gzuicolors
addition = Addition(A=list_length, B=0)
panel_2 = Panel(docinfo._3rdPartyAssemblies)
panel_3 = Panel(tsort.Keys)

# ----
# Get surface to orient
panel_4 = Panel("HO_Preview")
stream_filter = StreamFilter(Gate=addition, Stream1=panel_4)
reference_by_layer = ReferenceByLayer(LayerName=stream_filter)
# SET VIEW AND CPLANE TO OBJECT
panel_5 = Panel("Layer")
filter_by_user_attributes = FilterByUserAttributes(Attributes=reference_by_layer, Key=panel_5, Val=">::SupportGeo::RE-Base")  # -> Geometry, Key, Val

cluster = Cluster_7(selected_geometry=filter_by_user_attributes.Geometry)  # -> face_horiz_vector_2, vertical_face_plane_in_the_middle_2
plane = Plane(cluster.vertical_face_plane_in_the_middle_2)
deconstruct_plane = DeconstructPlane(Plane=plane)  # -> Origin, XAxis, YAxis, ZAxis
deconstruct = Deconstruct(Point=deconstruct_plane.Origin)  # -> XComponent, YComponent, ZComponent
integer_2 = Integer(deconstruct.YComponent)
integer_3 = Integer(deconstruct.XComponent)
integer_4 = Integer(deconstruct.ZComponent)
construct_point = ConstructPoint(XCoordinate=integer_3, YCoordinate=integer_2, ZCoordinate=integer_4)
unit_vector = UnitVector(Vector=deconstruct_plane.XAxis)
# '_SetView _CPlane _Top ZS Cancel
#  '_SetView _World _Perspective ZS Cancel
unit_vector_2 = UnitVector(Vector=deconstruct_plane.YAxis)
# CPlane origin
text_join = TextJoin(Text=[integer_3, integer_2, integer_4], Join=",")  # -> flatten(Result)
move = Move(Geometry=construct_point, Motion=unit_vector)  # -> Geometry, Transform
move_2 = Move(Geometry=construct_point, Motion=unit_vector_2)  # -> Geometry, Transform
concatenate = Concatenate(FragmentA="w", FragmentB=text_join)
panel_6 = Panel("""_NoEcho '_SetView _CPlane _Top _Cancel _Echo
_NoEcho '_SetView _World _Perspective _Cancel _Echo""")
# Vector X
deconstruct_2 = Deconstruct(Point=move.Geometry)  # -> XComponent, YComponent, ZComponent
# Vector Y
deconstruct_3 = Deconstruct(Point=move_2.Geometry)  # -> XComponent, YComponent, ZComponent
view_number_to_set_2 = RemoteReceiver(view_number_to_set)
text_join_2 = TextJoin(Text=[deconstruct_3.XComponent, deconstruct_3.YComponent, deconstruct_3.ZComponent], Join=",")  # -> flatten(Result)
text_join_3 = TextJoin(Text=[deconstruct_2.XComponent, deconstruct_2.YComponent, deconstruct_2.ZComponent], Join=",")  # -> flatten(Result)
list_length_2 = ListLength(List=flatten(view_number_to_set_2))  # -> flatten(Length)
list_item = ListItem(List=panel_6, Index=view_number_to_set_2, Wrap=True)  # -> flatten(Item)
concatenate_2 = Concatenate(FragmentA="w", FragmentB=text_join_2)
concatenate_3 = Concatenate(FragmentA="w", FragmentB=text_join_3)
text_join_4 = TextJoin(Text=["-'_CPlane _3Point ", concatenate, concatenate_3, concatenate_2, list_item], Join=" ")
panel_7 = Panel(text_join_4)
gzcommand_2 = CSharpScript(
    command=text_join_4,
    runNow=list_length_2,
    echo=False,
    Reference=["C:\Program Files\Rhino 7\Plug-ins\Grasshopper\Components\ScriptComponents.gha", "C:\Program Files\NoDoubts\Godzilla\System\Godzilla.dll", "C:\Program Files\NoDoubts\Godzilla\System\RhGodzilla.rhp"])  # -> done; inputs command: String, runNow: Boolean, echo: Boolean; same code as gzcommand

# ==== cluster AddMullionsAndTransoms: Add mullions and transoms

# ----
# PROCEED INPUTS
divide_element = ClusterInput()  # --> Divide element
input_applyallchanges = ClusterInput()  # Input.ApplyAllChanges
selected_geometry = ClusterInput()
tree_statistics = TreeStatistics(Tree=divide_element)  # -> Paths, Length, Count
deconstruct_path = DeconstructPath(Branch=tree_statistics.Paths)
list_item = ListItem(List=deconstruct_path, Index=0, Wrap=True)
duplicate_data = DuplicateData(Data=graft(list_item), Number=graft(tree_statistics.Length), Order=True)  # -> simplify(Data)
unweave = Unweave(List=divide_element, UnweavePattern=duplicate_data)  # -> Data0, Data1, Data2, Data3, Data4
explode_tree = ExplodeTree(Data=divide_element)  # -> Branch0, Branch1, Branch2, Branch3, Branch4
clean_tree = CleanTree(RemoveNulls=True, RemoveInvalid=True, RemoveEmpty=True, Tree=unweave.Data0)  # -> simplify(Tree)
clean_tree_2 = CleanTree(RemoveNulls=True, RemoveInvalid=True, RemoveEmpty=True, Tree=unweave.Data1)
clean_tree_3 = CleanTree(RemoveNulls=True, RemoveInvalid=True, RemoveEmpty=True, Tree=unweave.Data2)
clean_tree_4 = CleanTree(RemoveNulls=True, RemoveInvalid=True, RemoveEmpty=True, Tree=unweave.Data3)
clean_tree_5 = CleanTree(RemoveNulls=True, RemoveInvalid=True, RemoveEmpty=True, Tree=unweave.Data4)
shift_paths = ShiftPaths(Data=clean_tree_2, Offset=1)
shift_paths_2 = ShiftPaths(Data=clean_tree_3, Offset=1)
shift_paths_3 = ShiftPaths(Data=clean_tree_4, Offset=1)
shift_paths_4 = ShiftPaths(Data=clean_tree_5, Offset=1)
# Horizontal
input_applyallchanges_2 = RemoteSender(input_applyallchanges)
selected_geometry_2 = RemoteSender(clean_tree)
input_horizontal_axes = RemoteSender(shift_paths)
input_vertical_axes = RemoteSender(shift_paths_3)

gzaddreferences = CSharpScript(
    Run=True,
    Reference=["C:\Program Files\Rhino 7\Plug-ins\Grasshopper\Components\ScriptComponents.gha", "C:\Program Files\NoDoubts\Godzilla\System\Godzilla.dll", "C:\Program Files\NoDoubts\Godzilla\System\RhGodzilla.rhp"])  # -> Done; inputs Run: Boolean; same code as gzaddreferences
panel = Panel(gzaddreferences)
# Proceed at the end
delete_preview_geo = Panel("_NoEcho -_SelLayer HO_Preview Delete Echo")
rhino_command = RhinoCommand(SendCommandToggle=Button(), CommandString=delete_preview_geo)
rhino_command_2 = RhinoCommand(SendCommandToggle=Button(), CommandString="_SelLast -_SetObjectDisplayMode Wireframe")

# ----
# Input.Horizontal direction
list_item_2 = ListItem(List=shift_paths, Index=0, Wrap=True)

# ----
# Input.Vertical direction
list_item_3 = ListItem(List=shift_paths_3, Index=0, Wrap=True)

selected_geometry_3 = RemoteReceiver(selected_geometry_2)
list_length = ListLength(List=flatten(selected_geometry_3))
addition = Addition(A=list_length, B=0)
boolean = Boolean(addition)
gh_isblockselectedtoedit = RemoteSender(boolean)

# ----
# Lock layer
# Proceed at the end
lock_all_layers_except_preview = Panel("""_NoEcho -_Layer _UnLock > _Current "Manual drawings" Enter Echo
_NoEcho -_Layer _Current HO_Preview _Lock > Enter Echo""")
gh_isblockselectedtoedit_2 = RemoteReceiver(gh_isblockselectedtoedit)
boolean_2 = Boolean(gh_isblockselectedtoedit_2)
list_item_4 = ListItem(List=lock_all_layers_except_preview, Index=boolean_2, Wrap=True)
ghpython_script = GhPythonScript(layer_name=">", is_locked=boolean_2)  # -> out, a; inputs is_locked: Boolean
# ---------- ghpython_script: Python ----------
__author__ = "Me"
__version__ = "2021.02.01"

import rhinoscriptsyntax as rs
from scriptcontext import doc
import Rhino
import scriptcontext as sc

sc.doc = Rhino.RhinoDoc.ActiveDoc

def lock(layer_name, is_locked):
    sc.doc = Rhino.RhinoDoc.ActiveDoc
    layerName = layer_name
    lock_boolean = is_locked

    matchingLayers = [layer for layer in doc.Layers if layer.Name == layerName]

    layerToLock = None
    if len(matchingLayers) == 0:
        print "Layer \"{0}\" does not exist.".format(layerName)
    elif len(matchingLayers) == 1:
        layerToLock = matchingLayers[0]
    elif len(matchingLayers) > 1:
        i = 0;
        for layer in matchingLayers:
            print "({0}) {1}".format(i+1, matchingLayers[i].FullPath.replace("::", "->"))
            i += 1

        selectedLayer = rs.GetInteger("which layer?", -1, 1, len(matchingLayers))
        #if selectedLayer == None:
            #return
        layerToLock = matchingLayers[selectedLayer - 1]


    layerToLock.IsLocked = lock_boolean
    layerToLock.CommitChanges()
    sc.doc = ghdoc

lock(layer_name,is_locked)

sc.doc = ghdoc
# ---------- end ghpython_script ----------
panel_2 = Panel(list_item_4)
ghpython_script_2 = GhPythonScript(layer_name=">", is_locked=boolean_2)  # -> out, a; inputs is_locked: Boolean; disabled
# ---------- ghpython_script_2: Python ----------
__author__ = "Me"
__version__ = "2021.02.01"

import rhinoscriptsyntax as rs
from scriptcontext import doc
import Rhino
import scriptcontext as sc

sc.doc = Rhino.RhinoDoc.ActiveDoc

def lock(layer_name, is_locked):
    layerName = layer_name
    lock_boolean = is_locked

    matchingLayers = [layer for layer in doc.Layers if layer.Name == layerName]

    layerToLock = None
    if len(matchingLayers) == 0:
        print "Layer \"{0}\" does not exist.".format(layerName)
    elif len(matchingLayers) == 1:
        layerToLock = matchingLayers[0]
    elif len(matchingLayers) > 1:
        i = 0;
        for layer in matchingLayers:
            print "({0}) {1}".format(i+1, matchingLayers[i].FullPath.replace("::", "->"))
            i += 1

        selectedLayer = rs.GetInteger("which layer?", -1, 1, len(matchingLayers))
        if selectedLayer == None:
            return
        layerToLock = matchingLayers[selectedLayer - 1]


    layerToLock.IsLocked = lock_boolean
    layerToLock.CommitChanges()

if __name__ == "__main__":
    lock(layer_name,is_locked)

sc.doc = ghdoc
# ---------- end ghpython_script_2 ----------
rhino_command_3 = RhinoCommand(SendCommandToggle=Toggle(True), CommandString=list_item_4)

# ----
# Change material
# for preview layer
selected_geometry_4 = RemoteReceiver(selected_geometry_2)
layer_table = LayerTable(Update=True, AutoUpdate=False)  # -> Layers, FullLayerPaths, LayerColors, Linetypes, MaterialNames, Visible, PrintWidth, PrintColor
get_rhino_attributes = GetRhinoAttributes(Geometry=selected_geometry_4, readFullPath=True)  # -> Name, Layer, Color
text = Text(get_rhino_attributes.Layer)
text_2 = Text(layer_table.FullLayerPaths)
key_value_search = KeyValueSearch(Keys=text_2, Values=layer_table.MaterialNames, Search=text)  # -> flatten(Result)
clean_tree_6 = CleanTree(RemoveNulls=True, RemoveInvalid=True, RemoveEmpty=False, Tree=key_value_search)
list_item_5 = ListItem(List=clean_tree_6, Index=0, Wrap=True)
gh_frame_material_of_selected_blocks = RemoteSender(list_item_5)
create_modify_layers = CreateModifyLayers(LayerName="HO_Preview", LayerMaterial=list_item_5, DeleteLayer=False, enableFullPath=True)  # -> LayerNames, LayerFullPath

selected_geometry_5 = RemoteReceiver(selected_geometry_2)
panel_3 = Panel("""HO_RE-Type
HO_RE-type-by-user""")
get_user_value = GetUserValue(Geometry=selected_geometry_5, Key=panel_3)
text_join = TextJoin(Text=get_user_value, Join="   of type#  ")
list_item_6 = ListItem(List=get_user_value, Index=0, Wrap=True)  # -> Item, Item1
create_set = CreateSet(List=flatten(list_item_6.Item))  # -> Set, Map
get_rhino_attributes_2 = GetRhinoAttributes(Geometry=selected_geometry_5, readFullPath=True)  # -> Name, Layer, Color
gh_object_type_window_door = RemoteSender(create_set.Set)
panel_4 = Panel(create_set.Set)
replace_text = ReplaceText(Text=get_rhino_attributes_2.Layer, Find="Regelelement", Replace="FacadeSubFace", RecursiveReplace=False)
reference_by_layer = ReferenceByLayer(LayerName=replace_text, DisableAutoUpdate=False, ignoreCase=False)
reference_by_layer_2 = ReferenceByLayer(LayerName=get_rhino_attributes_2.Layer, DisableAutoUpdate=False, ignoreCase=False)
filter_by_user_attributes = FilterByUserAttributes(Attributes=reference_by_layer, Key="HO_RE-type-by-user", Val=list_item_6.Item1)  # -> Geometry, Key, Val
filter_by_user_attributes_2 = FilterByUserAttributes(Attributes=reference_by_layer_2, Key="HO_RE-type-by-user", Val=list_item_6.Item1)  # -> Geometry, Key, Val
filter_by_user_attributes_3 = FilterByUserAttributes(Attributes=filter_by_user_attributes.Geometry, Key="HO_RE-Type", Val=list_item_6.Item)  # -> Objects, Key, Val
filter_by_user_attributes_4 = FilterByUserAttributes(Attributes=filter_by_user_attributes_2.Geometry, Key="HO_RE-Type", Val=list_item_6.Item)  # -> Objects, Key, Val
deconstruct_block = DeconstructBlock(Block=filter_by_user_attributes_4.Objects, recursive=False)  # -> Name, Plane, Geometry
curve = Curve(filter_by_user_attributes_3.Objects)
custom_preview_lineweights = CustomPreviewLineweights(Geometry=curve, Shader=ColourSwatch(SwatchColor=RGB(30, 250, 243)), Thickness=Slider(9, range=0..10), Absolute=False)
create_set_2 = CreateSet(List=flatten(deconstruct_block.Name))  # -> Set, Map
guid = Guid(filter_by_user_attributes_4.Objects)  # disabled
text_3 = Text(flatten(deconstruct_block.Name))  # disabled
text_4 = Text(guid)  # disabled
text_5 = Text(create_set_2.Set)  # disabled
key_value_search_2 = KeyValueSearch(Keys=text_3, Values=flatten(text_4), Search=text_5)  # disabled
reference_block_by_name = ReferenceBlockByName(BlockName=create_set_2.Set, DisableAutoUpdate=False, referenceAll=False)
blocksofsubtype_all = RemoteSender(flatten(reference_block_by_name))
list_item_7 = ListItem(List=reference_block_by_name, Index=0, Wrap=True)
blocksofsubtype_all_2 = RemoteReceiver(blocksofsubtype_all)
list_length_2 = ListLength(List=flatten(selected_geometry_5))
blockofsubtype = RemoteSender(list_item_7)
list_length_3 = ListLength(List=flatten(blocksofsubtype_all_2))
addition_2 = Addition(A=list_length_2, B=0)
concatenate = Concatenate(
    FragmentB="Selected RE:   ",
    FragmentC=text_join,
    FragmentD="The type has ",
    FragmentE=addition_2,
    FragmentF=" SizeType(s), ",
    FragmentG=list_length_3,
    FragmentH=" instance(s)")
message_selectioninfo = RemoteSender(concatenate)
panel_5 = Panel(message_selectioninfo)
selected_geometry_6 = RemoteReceiver(selected_geometry_2)
deconstruct_block_2 = DeconstructBlock(Block=selected_geometry_6)  # -> Name, Plane, Geometry
deconstruct_plane = DeconstructPlane(Plane=deconstruct_block_2.Plane)  # -> Origin, XAxis, YAxis, ZAxis

# ----
# Planes for mullions
input_vertical_axes_2 = RemoteReceiver(input_vertical_axes)
construct_plane = ConstructPlane(Origin=deconstruct_plane.Origin, XAxis=deconstruct_plane.XAxis, YAxis=expr("-x", deconstruct_plane.ZAxis))
list_length_4 = ListLength(List=input_vertical_axes_2)
duplicate_data_2 = DuplicateData(Data=construct_plane, Number=list_length_4, Order=True)
end_points = EndPoints(Curve=graft(input_vertical_axes_2))  # -> Start, End
shift_paths_5 = ShiftPaths(Data=duplicate_data_2, Offset=-2)  # -> graft(Data)
plane_origin = PlaneOrigin(Base=shift_paths_5, Origin=end_points.Start)

layers = Panel("if(x=\"Window\",0,(if(x=\"Door\",1,(if(x=\"CurtainWall\",2,(if(x=\"Vent-Other\",3,(if(x=\"MS-Other\",4,(if(x=\">::FacadeSubFace::Aluninium\",5,(if(x=\">::FacadeSubFace::Ceiling\",6,(if(x=\">::FacadeSubFace::Column\",7,(if(x=\">::FacadeSubFace::Glass/Stone\",8,(if(x=\">::SupportGeo::CurtainWall::CW-railHead\",9,(if(x=\">::SupportGeo::CurtainWall::CW-railJambL\",10,(if(x=\">::SupportGeo::CurtainWall::CW-railJambR\",11,(if(x=\">::SupportGeo::CurtainWall::CW-railMullion\",12,(if(x=\">::SupportGeo::CurtainWall::CW-railTransom\",13,(if(x=\">::SupportGeo::CurtainWall::CW-railSill\",14,99)))))))))))))))))))))))))))))")

# ----
# Planes for transoms
input_horizontal_axes_2 = RemoteReceiver(input_horizontal_axes)
construct_plane_2 = ConstructPlane(Origin=deconstruct_plane.Origin, XAxis=expr("-x", deconstruct_plane.ZAxis), YAxis=deconstruct_plane.YAxis)
list_length_5 = ListLength(List=input_horizontal_axes_2)
duplicate_data_3 = DuplicateData(Data=construct_plane_2, Number=list_length_5, Order=True)
end_points_2 = EndPoints(Curve=graft(input_horizontal_axes_2))  # -> Start, End
shift_paths_6 = ShiftPaths(Data=duplicate_data_3, Offset=-2)  # -> graft(Data)
plane_origin_2 = PlaneOrigin(Base=shift_paths_6, Origin=end_points_2.Start)

# ----
# Construct transforms for mullion blocks
text_split = TextSplit(Text=deconstruct_block_2.Name, Separators="_")
list_item_8 = ListItem(List=text_split, Index=1, Wrap=True)
getdocumentusertext = GetDocumentUserText(key="HO_ProfileDepthOffsets")  # -> value; same code as getdocumentusertext_2
evaluate = Evaluate(Expression=layers, x=list_item_8)
text_split_2 = TextSplit(Text=getdocumentusertext, Separators=",")
list_item_9 = ListItem(List=text_split_2, Index=evaluate, Wrap=True)
input_vertical_axes_3 = RemoteReceiver(graft(input_vertical_axes))
amplitude = Amplitude(Vector=deconstruct_plane.ZAxis, Amplitude=expr("-x", list_item_9))
length = Length(Curve=input_vertical_axes_3)
move = Move(Geometry=plane_origin, Motion=amplitude)  # -> Geometry, Transform
scale_nu = ScaleNU(Plane=PlaneXY(0, 0, 0), ScaleX=1, ScaleY=1, ScaleZ=length)  # -> Geometry, Transform
orient = Orient(Source=PlaneXY(0, 0, 0), Target=move.Geometry)  # -> Geometry, Transform
merge = Merge(Data1=simplify(scale_nu.Transform), Data2=simplify(orient.Transform))
path_mapper = PathMapper(merge, source=["{A}", "{A;B}", "{A;B;C}"], target=["{A}", "{A}", "{A}"])
compound = Compound(Transforms=path_mapper)

# ----
# Default mullion block
panel_6 = Panel("HO_DefaultProfile-")
gh_object_type_window_door_2 = RemoteReceiver(gh_object_type_window_door)
concatenate_2 = Concatenate(FragmentA=panel_6, FragmentB=gh_object_type_window_door_2, FragmentC=" mullion")
getdocumentusertext_2 = GetDocumentUserText(key=concatenate_2)  # -> value; inputs updateNow: Boolean; same code as getdocumentusertext
text_split_3 = TextSplit(Text=getdocumentusertext_2, Separators=";")
list_item_10 = ListItem(List=text_split_3, Index=0, Wrap=True)
insert_block = InsertBlock(BlockName=list_item_10, SourcePlane=PlaneXY(0, 0, 0))

# ----
# Get default transom block
panel_7 = Panel("HO_DefaultProfile-")
gh_object_type_window_door_3 = RemoteReceiver(gh_object_type_window_door)
concatenate_3 = Concatenate(FragmentA=panel_7, FragmentB=gh_object_type_window_door_3, FragmentC=" transom")
getdocumentusertext_3 = GetDocumentUserText(key=concatenate_3)  # -> value; inputs updateNow: Boolean; same code as getdocumentusertext
text_split_4 = TextSplit(Text=getdocumentusertext_3, Separators=";")
list_item_11 = ListItem(List=text_split_4, Index=0, Wrap=True)
insert_block_2 = InsertBlock(BlockName=list_item_11, SourcePlane=PlaneXY(0, 0, 0))

# ----
# NEW MULLIONS
transform = Transform(Geometry=insert_block, Transform=compound)
gh_newmullions = RemoteSender(transform)
gh_newmullions_2 = RemoteReceiver(gh_newmullions)
gh_frame_material_of_selected_blocks_2 = RemoteReceiver(gh_frame_material_of_selected_blocks)
blockofsubtype_2 = RemoteReceiver(flatten(blockofsubtype))
brep = Brep(<brep referenced from the Rhino model>)
deconstruct_block_3 = DeconstructBlock(Block=gh_newmullions_2, recursive=True)  # -> Name, Plane, Geometry
nickname = Name(x=brep)  # -> out, a; inputs x: GeometryBase
# ---------- nickname: Python ----------
# ACTION:     
# LIMITATION: 
# TO DO:      

__author__ = "Yury Nasonov"
__version__ = "1"

ghenv.Component.Name = "Name"
ghenv.Component.NickName = 'NickName'
ghenv.Component.Message = 'Message below'

# ———————————————————————————————————————————————————————————

import rhinoscriptsyntax as rs
import Rhino

# ———————————————————————————————————————————————————————————

#a= Rhino.DocObjects.ObjRef.ObjectId
a=x.GetObjectData.GetType
rs.ObjectName
# ---------- end nickname ----------
selected_geometry_7 = RemoteReceiver(selected_geometry_2)
panel_8 = Panel(nickname.a)
deconstruct_block_4 = DeconstructBlock(Block=blockofsubtype_2)  # -> Name, Plane, Geometry
custom_preview = CustomPreview(Geometry=deconstruct_block_3.Geometry, Material=gh_frame_material_of_selected_blocks_2)
blockofsubtype_3 = RemoteReceiver(flatten(blockofsubtype))
selected_geometry_8 = RemoteReceiver(selected_geometry_2)
get_rhino_attributes_3 = GetRhinoAttributes(Geometry=deconstruct_block_4.Geometry)  # -> Name, Layer, Color
deconstruct_block_5 = DeconstructBlock(Block=blockofsubtype_3)  # -> Name, Plane, Geometry
createattributes = CreateAttributes(LayerName=">::Regelelement::Window::Window - Panel", enableFullPath=True)
createattributes_2 = CreateAttributes(LayerName=">::Regelelement::Window::Window - Frame", enableFullPath=True)
reference_block_by_name_2 = ReferenceBlockByName(BlockName=deconstruct_block_4.Name, DisableAutoUpdate=False)
panel_9 = Panel(get_rhino_attributes_3.Layer)
deconstruct_block_6 = DeconstructBlock(Block=reference_block_by_name_2)  # -> Name, Plane, Geometry
frame = Relay()
createattributes_3 = CreateAttributes(LayerName=">::Regelelement::Window::Window - Panel", enableFullPath=True)
createattributes_4 = CreateAttributes(LayerName=">::Regelelement::Window::Window - Frame", enableFullPath=True)
longest_list = LongestList(ListListA=frame, ListListB=createattributes_2, PaddingMode=2)  # -> ListListA, ListListB
reference_block_by_name_3 = ReferenceBlockByName(BlockName=deconstruct_block_5.Name, DisableAutoUpdate=False)
get_rhino_attributes_4 = GetRhinoAttributes(Geometry=deconstruct_block_5.Geometry)  # -> Name, Layer, Color
longest_list_2 = LongestList(ListListA=deconstruct_block_4.Geometry, ListListB=createattributes, PaddingMode=2)  # -> ListListA, ListListB
surface = Surface(deconstruct_block_6.Geometry)
plane = Plane(deconstruct_block_5.Plane)
deconstruct_block_7 = DeconstructBlock(Block=reference_block_by_name_3)  # -> Name, Plane, Geometry
merge_2 = Merge(Data1=longest_list_2.ListListB, Data2=longest_list.ListListB)  # -> flatten(Result)
merge_3 = Merge(Data1=longest_list_2.ListListA, Data2=longest_list.ListListA)  # -> flatten(Result)
longest_list_3 = LongestList(ListListA=deconstruct_block_5.Geometry, ListListB=createattributes_3, PaddingMode=2)  # -> ListListA, ListListB
surface_2 = Surface(deconstruct_block_7.Geometry)
define_block = DefineBlock(Geometry=flatten(merge_3), Attributes=merge_2, BlockOrigin=deconstruct_block_4.Plane, Overwrite=True)  # disabled
orient_2 = Orient(Source=deconstruct_block_4.Plane, Target=flatten(deconstruct_block_6.Plane))  # -> Geometry, Transform
placeblock = PlaceBlock(BlockName=define_block, Transform=orient_2.Transform, Bake=True)  # disabled
orient_3 = Orient(Source=deconstruct_block_5.Plane, Target=flatten(deconstruct_block_7.Plane))  # -> Geometry, Transform

input_applyallchanges_3 = RemoteReceiver(input_applyallchanges_2)
stream_filter = StreamFilter(Gate=input_applyallchanges_3, Stream0="HO_Preview", Stream1="HO_Preview")
reference_by_layer_3 = ReferenceByLayer(LayerName=stream_filter, DisableAutoUpdate=False, ignoreCase=False)  # -> simplify(graft(HO_Preview))
gh_all_geo_at_gh_preview_layer = RemoteSender(reference_by_layer_3)

panel_10 = Panel(">::Regelelement::Window::Window - Frame")
define_object_attributes = DefineObjectAttributes(UserKeys=panel_10, UserValues=panel_10, Layer=panel_10)

panel_11 = Panel(">::Regelelement::Window::Window - Frame")
define_object_attributes_2 = DefineObjectAttributes(UserKeys=panel_11, UserValues=panel_11, Layer=panel_11)

gh_all_geo_at_gh_preview_layer_2 = RemoteReceiver(gh_all_geo_at_gh_preview_layer)
filter_by_type = FilterByType(Geometry=gh_all_geo_at_gh_preview_layer_2, ObjectType="Block")
gh_newmullions_3 = RemoteReceiver(gh_newmullions)
panel_12 = Panel(gh_newmullions_3)
get_user_value_2 = GetUserValue(Geometry=filter_by_type, Key="HO_Temp-Tree")
insert_block_3 = InsertBlock(BlockName=deconstruct_block_3.Name, SourcePlane=deconstruct_block_3.Plane)
create_tree = CreateTree(Data=filter_by_type, Path=get_user_value_2)
path_mapper_2 = PathMapper(create_tree, source=["{A}", "{A;B}", "{A;B;C}"], target=["{A}", "{A}", "{A}"])
clean_tree_7 = CleanTree(RemoveNulls=True, RemoveInvalid=True, RemoveEmpty=False, Tree=path_mapper_2)
gh_all_geo_at_gh_preview_layer_3 = RemoteReceiver(gh_all_geo_at_gh_preview_layer)
filter_by_type_2 = FilterByType(Geometry=gh_all_geo_at_gh_preview_layer_3, ObjectType="Surface")
clean_tree_8 = CleanTree(RemoveNulls=True, RemoveInvalid=True, RemoveEmpty=True, Tree=filter_by_type_2)
number_slider = Slider(200, range=0..1000)
explode = Explode(Curve=clean_tree_8, Recursive=True)  # -> Segments, Vertices
# Axes
extend_curve = ExtendCurve(Curve=explode.Segments, Type=0, Start=number_slider, End=number_slider)

# ----
# Axes display
deconstruct_plane_2 = DeconstructPlane(Plane=clean_tree_8)  # -> Origin, XAxis, YAxis, ZAxis; disabled
number_slider_2 = Slider(21, range=0..1000)  # disabled
amplitude_2 = Amplitude(Vector=deconstruct_plane_2.ZAxis, Amplitude=expr("-x", number_slider_2))  # disabled
move_2 = Move(Geometry=extend_curve, Motion=amplitude_2)  # -> Geometry, Transform; disabled
gh_isblockselectedtoedit_3 = RemoteReceiver(gh_isblockselectedtoedit)  # disabled
number_slider_3 = Slider(2, range=0..10)  # disabled
colour_swatch = ColourSwatch(SwatchColor=RGB(255, 255, 255))  # disabled
stream_filter_2 = StreamFilter(Gate=gh_isblockselectedtoedit_3, Stream1=move_2.Geometry)  # disabled
custom_preview_lineweights_2 = CustomPreviewLineweights(Geometry=stream_filter_2, Shader=colour_swatch, Thickness=number_slider_3, Absolute=False)  # disabled

list_item_12 = ListItem(List=extend_curve, Index=0, Wrap=True)  # -> Item, Item1, Item2, Item3

dimension_offset = Slider(200, range=-1000..1000)
height = Slider(800, range=0..1000)
annotation_style = Text("HO_GH-APP")
dimension_offset_2 = Integer(dimension_offset)
addition_3 = Addition(A=dimension_offset_2, B=height)

# ----
# Ticks for al selected REs
blocksofsubtype_all_3 = RemoteReceiver(graft(blocksofsubtype_all))
deconstruct_block_8 = DeconstructBlock(Block=blocksofsubtype_all_3, recursive=False)  # -> Name, Plane, Geometry
filter_by_layer = FilterByLayer(Geometry=deconstruct_block_8.Geometry, Layer=">::SupportGeo::RE-Base")
area = Area(Geometry=filter_by_layer)  # -> Area, Centroid
plane_origin_3 = PlaneOrigin(Base=deconstruct_block_8.Plane, Origin=area.Centroid)
plane_offset = PlaneOffset(BasePlane=plane_origin_3, Offset=50)
surface_3 = Surface(<surface referenced from the Rhino model>)
orient_4 = Orient(Geometry=surface_3, Source=PlaneXY(0, 0, 0), Target=plane_offset)  # -> Geometry, Transform
output_selected_type_ticks = RemoteSender(orient_4.Geometry)

rotate_plane = RotatePlane(Plane=clean_tree_8, Angle=degrees(Slider(90, range=0..100)))
plane_offset_2 = PlaneOffset(BasePlane=rotate_plane, Offset=Slider(21, range=0..1000))

# ----
# Highlight all blocks of selected type
curve_2 = Curve(filter_by_layer)
custom_preview_2 = CustomPreview(Geometry=filter_by_layer, Material=ColourSwatch(SwatchColor=RGBA(107, 216, 255, 51)))
custom_preview_lineweights_3 = CustomPreviewLineweights(Geometry=curve_2, Shader=ColourSwatch(SwatchColor=RGB(0, 187, 255)), Thickness=Slider(10, range=0..10), Absolute=False)

# ----
# Selected block contour
selected_geometry_9 = RemoteReceiver(selected_geometry_2)
deconstruct_block_9 = DeconstructBlock(Block=selected_geometry_9)  # -> Name, Plane, Geometry
filter_by_layer_2 = FilterByLayer(Geometry=deconstruct_block_9.Geometry, Layer=">::SupportGeo::RE-Base")
deconstruct_brep = DeconstructBrep(Brep=filter_by_layer_2)  # -> Faces, Edges, Vertices

# ----
# Changelog
panel_13 = Panel("""CHANGELOG

22.02.2021 by Yury Nasonov
-initial release

TO DO


REQUIREMENTS


BUGS or LIMITATIONS""")
text_6 = Text(panel_13)

output_selected_type_ticks_2 = RemoteReceiver(output_selected_type_ticks)

# ----
# Construct transforms from transom blocks
amplitude_3 = Amplitude(Vector=deconstruct_plane.ZAxis, Amplitude=expr("-x", list_item_9))
input_horizontal_axes_3 = RemoteReceiver(graft(input_horizontal_axes))
xy_plane = XYPlane(Origin=Point(0, 0, 0))
rotate = Rotate(Geometry=xy_plane, Angle=1.570796327, Plane=xy_plane)  # -> Geometry, Transform
length_2 = Length(Curve=input_horizontal_axes_3)
scale_nu_2 = ScaleNU(Plane=PlaneXY(0, 0, 0), ScaleX=1, ScaleY=1, ScaleZ=length_2)  # -> Geometry, Transform

duplicate_data_4 = DuplicateData(Data=amplitude_3, Number=list_length_5, Order=True)
shift_paths_7 = ShiftPaths(Data=duplicate_data_4, Offset=-3)  # -> graft(Data)

move_3 = Move(Geometry=plane_origin_2, Motion=shift_paths_7)  # -> Geometry, Transform
orient_5 = Orient(Source=rotate.Geometry, Target=move_3.Geometry)  # -> Geometry, Transform
merge_4 = Merge(Data1=scale_nu_2.Transform, Data2=orient_5.Transform)
path_mapper_3 = PathMapper(merge_4, source=["{A}", "{A;B}", "{A;B;C}"], target=["{A}", "{A}", "{A}"])
compound_2 = Compound(Transforms=merge_4)

panel_14 = Panel(compound_2)
# NEW TRANSOMS
transform_2 = Transform(Geometry=insert_block_2, Transform=compound_2)
gh_new_transoms = RemoteSender(transform_2)
gh_new_transoms_2 = RemoteReceiver(gh_new_transoms)
deconstruct_block_10 = DeconstructBlock(Block=gh_new_transoms_2, recursive=True)  # -> Name, Plane, Geometry
insert_block_4 = InsertBlock(BlockName=deconstruct_block_10.Name, SourcePlane=deconstruct_block_10.Plane)
merge_5 = Merge(Data1=create_tree, Data2=insert_block_3, Data3=insert_block_4)
merge_6 = Merge(Data2=insert_block_3, Data3=insert_block_4)
path_mapper_4 = PathMapper(merge_5, source=["{A}", "{A;B}", "{A;B;C}"], target=["{A}", "{A}", "{A}"])
path_mapper_5 = PathMapper(merge_6, source=["{A}", "{A;B}", "{A;B;C}"], target=["{A}", "{A}", "{A}"])
clean_tree_9 = CleanTree(RemoveNulls=True, RemoveInvalid=True, RemoveEmpty=False, Tree=path_mapper_4)
clean_tree_10 = CleanTree(RemoveNulls=True, RemoveInvalid=True, RemoveEmpty=False, Tree=path_mapper_5)
gh_inner_blocks = RemoteSender(clean_tree_9)
deconstruct_block_11 = DeconstructBlock(Block=clean_tree_9)  # -> Name, Plane, Geometry
deconstruct_block_12 = DeconstructBlock(Block=clean_tree_9, recursive=False)  # -> Name, Plane, Geometry
point = Point(deconstruct_block_12.Plane)
bounding_box = BoundingBox(Content=deconstruct_block_11.Geometry, Plane=deconstruct_block_11.Plane)  # -> Box, Box_2
deconstruct_box = DeconstructBox(Box=bounding_box.Box)  # -> Plane, X, Y, Z
deconstruct_domain = DeconstructDomain(Domain=deconstruct_box.X)  # -> Start, End
deconstruct_domain_2 = DeconstructDomain(Domain=deconstruct_box.Y)  # -> Start, End
deconstruct_domain_3 = DeconstructDomain(Domain=deconstruct_box.Z)  # -> Start, End
subtraction = Subtraction(A=deconstruct_domain.End, B=deconstruct_domain.Start)
subtraction_2 = Subtraction(A=deconstruct_domain_2.End, B=deconstruct_domain_2.Start)
subtraction_3 = Subtraction(A=deconstruct_domain_3.End, B=deconstruct_domain_3.Start)
deconstruct_plane_3 = DeconstructPlane(Plane=deconstruct_block_12.Plane)  # -> Origin, XAxis, YAxis, ZAxis; disabled
amplitude_4 = Amplitude(Vector=deconstruct_plane_3.ZAxis, Amplitude=subtraction_3)  # disabled
amplitude_5 = Amplitude(Vector=deconstruct_plane_3.ZAxis, Amplitude=subtraction_3)  # disabled
amplitude_6 = Amplitude(Vector=deconstruct_plane_3.XAxis, Amplitude=subtraction)  # disabled
amplitude_7 = Amplitude(Vector=deconstruct_plane_3.YAxis, Amplitude=subtraction_2)  # disabled
point_oriented = PointOriented(BasePlane=deconstruct_block_12.Plane, UComponent=0, VComponent=0, WComponent=expr("x/2", subtraction_3))
point_oriented_2 = PointOriented(BasePlane=deconstruct_block_12.Plane, UComponent=subtraction, VComponent=0, WComponent=expr("x/2", subtraction_3))
mass_addition = MassAddition(Input=[amplitude_6, amplitude_7, amplitude_5])  # -> Result, PartialResults; disabled
move_4 = Move(Geometry=point, Motion=expr("x/2", mass_addition.Result))  # -> Geometry, Transform; disabled
line = Line(StartPoint=point, EndPoint=point_oriented)  # disabled
line_2 = Line(StartPoint=point_oriented, EndPoint=point_oriented_2)  # disabled
point_2 = Point(point_oriented)  # disabled
line_3 = Line(StartPoint=point, EndPoint=move_4.Geometry)  # disabled

# ----
# Get planes of horizontal profiles
panel_15 = Panel("HO_BlockType")
panel_16 = Panel("Frame")
gh_inner_blocks_2 = RemoteReceiver(gh_inner_blocks)
extended_geometry = ExtendedGeometry(clean_tree_7)
filter_by_user_attributes_5 = FilterByUserAttributes(Attributes=extended_geometry, Key="HO_BG-type", Val="Profile")  # -> ExtendedGeometry, Key, Val
gh_new_transoms_3 = RemoteReceiver(gh_new_transoms)
filter_by_user_attributes_6 = FilterByUserAttributes(Attributes=filter_by_user_attributes_5.ExtendedGeometry, Key="HO_BlockDirection", Val="0")  # -> simplify(Objects), Key, Val
deconstruct_block_13 = DeconstructBlock(Block=gh_new_transoms_3)  # -> Name, simplify(Plane), Geometry
deconstruct_block_14 = DeconstructBlock(Block=filter_by_user_attributes_6.Objects)  # -> Name, Plane, Geometry
# Should be basesrf
path_mapper_6 = PathMapper(
    deconstruct_block_14.Plane,
    source=["{A}", "{A;B}", "{A;B;C}", "{A;B;C;D}", "{A;B;C;D;E}", "{A;B;C;D;E;F}"],
    target=["{A}", "{A}", "{A}", "{A}", "{A}", "{A}"])
path_mapper_7 = PathMapper(deconstruct_block_13.Plane, source=["{A}", "{A;B}"], target=["{A}", "{A}"])
merge_7 = Merge(Data1=path_mapper_6, Data2=path_mapper_7)
gh_planes_of_horizontal_profiles = RemoteSender(merge_7)
list_length_6 = ListLength(List=merge_7)  # disabled
subtraction_4 = Subtraction(A=list_length_6, B=2)  # disabled
gh_number_of_transoms_per_block = RemoteSender(subtraction_4)  # disabled

# ----
# Get planes of vertical profiles
panel_17 = Panel("HO_BlockDirection")
gh_newmullions_4 = RemoteReceiver(simplify(gh_newmullions))
filter_by_user_attributes_7 = FilterByUserAttributes(Attributes=filter_by_user_attributes_5.ExtendedGeometry, Key=panel_17, Val="1")  # -> simplify(Objects), Key, Val
deconstruct_block_15 = DeconstructBlock(Block=filter_by_user_attributes_7.Objects)  # -> Name, Plane, Geometry
deconstruct_block_16 = DeconstructBlock(Block=gh_newmullions_4)  # -> Name, simplify(Plane), Geometry
get_user_value_3 = GetUserValue(Geometry=filter_by_user_attributes_7.Objects, Key="HO_W")
path_mapper_8 = PathMapper(
    deconstruct_block_15.Plane,
    source=["{A}", "{A;B}", "{A;B;C}", "{A;B;C;D}", "{A;B;C;D;E}", "{A;B;C;D;E;F}"],
    target=["{A}", "{A}", "{A}", "{A}", "{A}", "{A}"])
path_mapper_9 = PathMapper(deconstruct_block_16.Plane, source=["{A}", "{A;B}"], target=["{A}", "{A}"])
merge_8 = Merge(Data1=path_mapper_8, Data2=path_mapper_9)
gh_planes_of_vertical_profiles = RemoteSender(merge_8)
list_length_7 = ListLength(List=merge_8)  # disabled
subtraction_5 = Subtraction(A=list_length_7, B=2)  # disabled
gh_number_of_mullions_per_block = RemoteSender(subtraction_5)  # disabled

path_mapper_10 = PathMapper(filter_by_user_attributes_6.Objects, source=["{A}", "{A;B}"], target=["{A}", "{A}"])
path_mapper_11 = PathMapper(gh_new_transoms_3, source=["{A}", "{A;B}"], target=["{A}", "{A}"])
merge_9 = Merge(Data1=path_mapper_10, Data2=path_mapper_11)  # -> graft(Result)
deconstruct_block_17 = DeconstructBlock(Block=merge_9)  # -> Name, simplify(Plane), Geometry
get_user_value_4 = GetUserValue(Geometry=deconstruct_block_17.Geometry, Key="HO_W")
clean_tree_11 = CleanTree(RemoveNulls=True, RemoveInvalid=True, RemoveEmpty=True, Tree=get_user_value_4)  # -> simplify(Tree)
path_mapper_12 = PathMapper(clean_tree_11, source=["{A}", "{A;B}"], target=["{A}", "{A}"])
gh_widths_of_horizontal_profiles = RemoteSender(path_mapper_12)

path_mapper_13 = PathMapper(filter_by_user_attributes_7.Objects, source=["{A}", "{A;B}"], target=["{A}", "{A}"])
path_mapper_14 = PathMapper(gh_newmullions_4, source=["{A}", "{A;B}"], target=["{A}", "{A}"])
merge_10 = Merge(Data1=path_mapper_13, Data2=path_mapper_14)  # -> graft(Result)
deconstruct_block_18 = DeconstructBlock(Block=merge_10)  # -> Name, simplify(Plane), Geometry
get_user_value_5 = GetUserValue(Geometry=deconstruct_block_18.Geometry, Key="HO_W")
clean_tree_12 = CleanTree(RemoveNulls=True, RemoveInvalid=True, RemoveEmpty=True, Tree=get_user_value_5)  # -> simplify(Tree)
path_mapper_15 = PathMapper(clean_tree_12, source=["{A}", "{A;B}"], target=["{A}", "{A}"])
gh_widths_of_vertical_profiles = RemoteSender(path_mapper_15)

point_3 = Point(flatten(deconstruct_block_11.Plane))
curve_closest_point = CurveClosestPoint(Point=point_3, Curve=list_item_12.Item3)  # -> Point, Parameter, Distance
remove_duplicate_points = RemoveDuplicatePoints(InputPoints=curve_closest_point.Point, Tolerance=0.001)  # -> OutputPoints, FirstPointIndexes
sort_along_curve = SortAlongCurve(Points=remove_duplicate_points.OutputPoints, Curve=list_item_12.Item3)  # -> Points, Indices
cull_index = CullIndex(List=sort_along_curve.Points, Indices=-1, Wrap=True)
cull_index_2 = CullIndex(List=sort_along_curve.Points, Indices=0, Wrap=True)
# DIMENSIONS
list_item_13 = ListItem(List=sort_along_curve.Points, Index=0, Wrap=True)  # -> Item1, Item

# ----
# Across element
define_linear_dimension = DefineLinearDimension(
    Point1=point_oriented,
    Point2=point_oriented_2,
    DimensionPlane=plane_offset_2,
    Offset=expr("-x", 0),
    DimensionStyle="Millimeter Small")  # disabled

# ----
# Dimensions top
define_linear_dimension_2 = DefineLinearDimension(
    Point1=list_item_13.Item,
    Point2=list_item_13.Item1,
    DimensionPlane=plane_offset_2,
    Offset=expr("-x", addition_3),
    DimensionStyle="Millimeter Small")

# ----
# Detailed chain Bottom
define_linear_dimension_3 = DefineLinearDimension(
    Point1=cull_index,
    Point2=cull_index_2,
    DimensionPlane=plane_offset_2,
    Offset=dimension_offset_2,
    DimensionStyle="Millimeter Small")  # disabled

item_selector = ItemSelector(
    define_linear_dimension_3,
    {"Linear Dimension: 1875.00", "Linear Dimension: 95.00", "Linear Dimension: 5.00"}, selected="Linear Dimension: 1875.00")  # disabled
item_selector_2 = ItemSelector(
    define_linear_dimension_2,
    {"Linear Dimension: 1000.00", "Linear Dimension: 1000.00", "Linear Dimension: 1000.00", "Linear Dimension: 1000.00"}, selected="Linear Dimension: 1000.00")  # disabled
detailed_chain_bottom = ExtendedGeometry(define_linear_dimension_2)  # disabled
detailed_chain_bottom_2 = ExtendedGeometry(define_linear_dimension_3)

gh_new_transoms_4 = RemoteReceiver(gh_new_transoms)
gh_newmullions_5 = RemoteReceiver(gh_newmullions)
value_list = ValueList({"Point": 0, "Curve": 1, "Arc": 2, "Circle": 3, "Ellipse": 4, "Line": 5, "Polyline": 6, "Surface": 7, "Brep": 8, "Mesh": 9, "Polysurface": 10, "Block": 11, "Text": 12, "TextDot": 13, "Dimension": 14, "LinearDimension": 15, "AngularDimension": 16, "Hatch": 17, "Leader": 18}, selected="Point")
deconstruct_block_19 = DeconstructBlock(Block=[gh_newmullions_5, gh_new_transoms_4], recursive=True)  # -> Name, Plane, graft(Geometry)
point_4 = Point(deconstruct_block_19.Geometry)
clean_tree_13 = CleanTree(RemoveNulls=True, RemoveInvalid=True, RemoveEmpty=False, Tree=point_4)
list_length_8 = ListLength(List=clean_tree_13)
dispatch = Dispatch(List=deconstruct_block_19.Geometry, DispatchPattern=list_length_8)  # -> ListA, ListB

# ----
# Bake all editing geo
# to HO_Preview layer
selected_geometry_10 = RemoteReceiver(selected_geometry_2)
deconstruct_block_20 = DeconstructBlock(Block=selected_geometry_10, recursive=False)  # -> Name, Plane, Geometry
shift_paths_8 = ShiftPaths(Data=deconstruct_block_20.Geometry, Offset=-1)  # -> graft(Data)
panel_18 = Panel("""Layer
HO_Temp-Tree""")
list_length_9 = ListLength(List=shift_paths_8)
get_user_attributes = GetUserAttributes(Geometry=shift_paths_8)  # -> simplify(Keys), simplify(Values), BakeName
get_rhino_attributes_5 = GetRhinoAttributes(Geometry=shift_paths_8, readFullPath=True)  # -> Name, simplify(Layer), Color
duplicate_data_5 = DuplicateData(Data=panel_18, Number=list_length_9, Order=True)  # -> simplify(Data)
selected_geometry_11 = RemoteReceiver(selected_geometry_2)
list_length_10 = ListLength(List=flatten(selected_geometry_11))
boolean_3 = Boolean(list_length_10)

# ----
# Bake new mullions and transoms
# to HO_TempToDel layer
gh_all_geo_at_gh_preview_layer_4 = RemoteReceiver(gh_all_geo_at_gh_preview_layer)
get_user_attributes_2 = GetUserAttributes(Geometry=gh_all_geo_at_gh_preview_layer_4)  # -> simplify(Keys), simplify(Values), BakeName
get_user_value_6 = GetUserValue(Geometry=gh_all_geo_at_gh_preview_layer_4, Key="Layer")
gh_new_transoms_5 = RemoteReceiver(gh_new_transoms)
gh_newmullions_6 = RemoteReceiver(gh_newmullions)
define_object_attributes_3 = DefineObjectAttributes(UserKeys=get_user_attributes_2.Keys, UserValues=get_user_attributes_2.Values, Layer=get_user_value_6)
list_length_11 = ListLength(List=flatten(gh_newmullions_6))
list_length_12 = ListLength(List=flatten(gh_new_transoms_5))
duplicate_data_6 = DuplicateData(Data=define_object_attributes, Number=list_length_11, Order=True)
flatten_tree = FlattenTree(Tree=gh_all_geo_at_gh_preview_layer_4, Path="{0}")
flatten_tree_2 = FlattenTree(Tree=define_object_attributes_3, Path="{0}")
duplicate_data_7 = DuplicateData(Data=define_object_attributes_2, Number=list_length_12, Order=True)
selected_geometry_12 = RemoteReceiver(selected_geometry_2)
get_user_attributes_3 = GetUserAttributes(Geometry=selected_geometry_12)  # -> simplify(Keys), simplify(Values), BakeName
gh_new_transoms_6 = RemoteReceiver(gh_new_transoms)
gh_newmullions_7 = RemoteReceiver(gh_newmullions)
input_applyallchanges_4 = RemoteReceiver(input_applyallchanges_2)
define_object_attributes_4 = DefineObjectAttributes(UserKeys=get_user_attributes_3.Keys, UserValues=get_user_attributes_3.Values, Layer="HO_TempToDel")
define_block_2 = DefineBlock(
    Geometry=flatten([flatten_tree, gh_newmullions_7, gh_new_transoms_6]),
    Attributes=flatten([flatten_tree_2, duplicate_data_6, duplicate_data_7]),
    BlockName=deconstruct_block_20.Name,
    BasePlane=deconstruct_block_20.Plane)
bake_objects = BakeObjects(Geometry=define_block_2, Attributes=define_object_attributes_4, Bake=input_applyallchanges_4)

tree_statistics_2 = TreeStatistics(Tree=simplify(deconstruct_block_20.Geometry))  # -> Paths, Length, Count
deconstruct_path_2 = DeconstructPath(Branch=tree_statistics_2.Paths)
list_item_14 = ListItem(List=deconstruct_path_2, Index=0, Wrap=True)
duplicate_data_8 = DuplicateData(Data=list_item_14, Number=graft(tree_statistics_2.Length), Order=True)  # -> simplify(graft(Data))

# ----
# SELECTABLE BLOCK CONTENTS
define_object_attributes_5 = DefineObjectAttributes(
    UserKeys=[get_user_attributes.Keys, duplicate_data_5],
    UserValues=[get_user_attributes.Values, get_rhino_attributes_5.Layer, duplicate_data_8],
    Layer="HO_Preview")
bake_objects_2 = BakeObjects(Geometry=shift_paths_8, Attributes=define_object_attributes_5, Bake=boolean_3)

# ----
# Moved points
# (according W)
selected_geometry_13 = RemoteReceiver(selected_geometry_2)
deconstruct_block_21 = DeconstructBlock(Block=selected_geometry_13, recursive=False)  # -> Name, Plane, Geometry
gh_planes_of_horizontal_profiles_2 = RemoteReceiver(gh_planes_of_horizontal_profiles)
filter_by_layer_3 = FilterByLayer(Geometry=deconstruct_block_21.Geometry, Layer=">::SupportGeo::RE-Base")
gh_widths_of_horizontal_profiles_2 = RemoteReceiver(gh_widths_of_horizontal_profiles)
get_user_value_7 = GetUserValue(Geometry=filter_by_layer_3, Key="4. BG-Breite")
deconstruct_plane_4 = DeconstructPlane(Plane=deconstruct_block_21.Plane)  # -> Origin, XAxis, YAxis, ZAxis
plane_2 = Plane(deconstruct_block_21.Plane)
rotate_plane_2 = RotatePlane(Plane=plane_2, Angle=degrees(90))

deconstruct_plane_5 = DeconstructPlane(Plane=deconstruct_block_21.Plane)  # -> Origin, XAxis, YAxis, ZAxis
get_user_value_8 = GetUserValue(Geometry=filter_by_layer_3, Key="5. BG-Höhe")
line_sdl = LineSDL(Start=deconstruct_plane_5.Origin, Direction=deconstruct_plane_5.XAxis, Length=get_user_value_7)  # -> simplify(Line)
line_sdl_2 = LineSDL(Start=deconstruct_plane_5.Origin, Direction=deconstruct_plane_5.YAxis, Length=get_user_value_8)  # -> simplify(Line)
extend_curve_2 = ExtendCurve(Curve=line_sdl, Type=0, Start=1000, End=1000)
extend_curve_3 = ExtendCurve(Curve=line_sdl_2, Type=0, Start=1000, End=1000)
input_horizontal_direction = RemoteSender(extend_curve_2)
input_horizontal_direction_2 = RemoteReceiver(input_horizontal_direction)
pipe = Pipe(Curve=input_horizontal_direction_2, Radius=Slider(20, range=0..100), Caps=1)  # -> flatten(Pipe)
longest_list_4 = LongestList(ListListA=pipe, ListListB=createattributes_4, PaddingMode=2)  # -> ListListA, ListListB
merge_11 = Merge(Data1=longest_list_3.ListListB, Data2=longest_list_4.ListListB)  # -> flatten(Result)
merge_12 = Merge(Data1=longest_list_3.ListListA, Data2=longest_list_4.ListListA)  # -> flatten(Result)
define_block_3 = DefineBlock(Geometry=flatten(merge_12), Attributes=merge_11, BlockOrigin=deconstruct_block_5.Plane, Overwrite=True)  # disabled
placeblock_2 = PlaceBlock(BlockName=define_block_3, Transform=orient_3.Transform, Bake=True)  # disabled

# ----
# Middle points
# Moved points
# (according W)
gh_planes_of_vertical_profiles_2 = RemoteReceiver(gh_planes_of_vertical_profiles)
input_horizontal_direction_3 = RemoteReceiver(input_horizontal_direction)
gh_widths_of_vertical_profiles_2 = RemoteReceiver(gh_widths_of_vertical_profiles)
sort_along_curve_2 = SortAlongCurve(Points=gh_planes_of_vertical_profiles_2, Curve=input_horizontal_direction_3)  # -> Points, Indices
deconstruct_plane_6 = DeconstructPlane(Plane=deconstruct_block_21.Plane)  # -> Origin, XAxis, YAxis, ZAxis
list_item_15 = ListItem(List=gh_widths_of_vertical_profiles_2, Index=sort_along_curve_2.Indices, Wrap=True)
amplitude_8 = Amplitude(Vector=deconstruct_plane_6.XAxis, Amplitude=expr("-x/2", list_item_15))
amplitude_9 = Amplitude(Vector=deconstruct_plane_6.XAxis, Amplitude=expr("x/2", list_item_15))
selected_geometry_14 = RemoteReceiver(selected_geometry_2)
move_5 = Move(Geometry=sort_along_curve_2.Points, Motion=amplitude_8)  # -> simplify(graft(Geometry)), Transform
move_6 = Move(Geometry=sort_along_curve_2.Points, Motion=amplitude_9)  # -> simplify(graft(Geometry)), Transform
get_user_value_9 = GetUserValue(Geometry=selected_geometry_14, Key="5. BG-Höhe")
merge_13 = Merge(Data1=move_5.Geometry, Data2=move_6.Geometry)
amplitude_10 = Amplitude(Vector=deconstruct_plane_6.YAxis, Amplitude=get_user_value_9)
shift_paths_9 = ShiftPaths(Data=merge_13, Offset=-1)
move_7 = Move(Geometry=shift_paths_9, Motion=amplitude_10)  # -> Geometry, Transform
cull_index_3 = CullIndex(List=move_7.Geometry, Indices=-1, Wrap=True)
cull_index_4 = CullIndex(List=move_7.Geometry, Indices=0, Wrap=True)
plane_3 = Plane(deconstruct_block_21.Plane)

input_vertical_direction = RemoteSender(extend_curve_3)

input_vertical_direction_2 = RemoteReceiver(input_vertical_direction)
sort_along_curve_3 = SortAlongCurve(Points=gh_planes_of_horizontal_profiles_2, Curve=input_vertical_direction_2)  # -> Points, Indices
list_item_16 = ListItem(List=gh_widths_of_horizontal_profiles_2, Index=sort_along_curve_3.Indices, Wrap=True)
panel_19 = Panel(list_item_16)
amplitude_11 = Amplitude(Vector=deconstruct_plane_4.YAxis, Amplitude=expr("x/2", list_item_16))
amplitude_12 = Amplitude(Vector=deconstruct_plane_4.YAxis, Amplitude=expr("-x/2", list_item_16))
move_8 = Move(Geometry=sort_along_curve_3.Points, Motion=amplitude_12)  # -> Geometry, Transform
move_9 = Move(Geometry=sort_along_curve_3.Points, Motion=amplitude_11)  # -> Geometry, Transform
input_vertical_direction_3 = RemoteReceiver(input_vertical_direction)
sort_along_curve_4 = SortAlongCurve(Points=[move_9.Geometry, move_8.Geometry], Curve=input_vertical_direction_3)  # -> Points, Indices
cull_index_5 = CullIndex(List=sort_along_curve_4.Points, Indices=0, Wrap=True)
cull_index_6 = CullIndex(List=sort_along_curve_4.Points, Indices=-1, Wrap=True)

# ----
# Ticks for editable REs
area_2 = Area(Geometry=filter_by_layer_3)  # -> Area, Centroid
plane_origin_4 = PlaneOrigin(Base=deconstruct_block_21.Plane, Origin=area_2.Centroid)
plane_offset_3 = PlaneOffset(BasePlane=plane_origin_4, Offset=60)
surface_4 = Surface(<surface referenced from the Rhino model>)
orient_6 = Orient(Geometry=surface_4, Source=PlaneXY(0, 0, 0), Target=plane_offset_3)  # -> Geometry, Transform
output_selected_type_ticks_editable_bloc = RemoteSender(orient_6.Geometry)  # "Output.Selected Type ticks (editable blocks)"

amplitude_13 = Amplitude(Vector=deconstruct_plane_4.XAxis, Amplitude=get_user_value_7)
input_horizontal_direction_4 = RemoteReceiver(input_horizontal_direction)
move_10 = Move(Geometry=sort_along_curve_3.Points, Motion=amplitude_13)  # -> Geometry, Transform
cull_index_7 = CullIndex(List=move_10.Geometry, Indices=-1, Wrap=True)
cull_index_8 = CullIndex(List=move_10.Geometry, Indices=0, Wrap=True)

list_item_17 = ListItem(List=sort_along_curve_4.Points, Index0=0, Wrap=True)
list_item_18 = ListItem(List=sort_along_curve_4.Points, Index1=-1, Wrap=True)
list_item_19 = ListItem(List=move_7.Geometry, Index0=0, Wrap=True)
list_item_20 = ListItem(List=move_7.Geometry, Index1=-1, Wrap=True)

cull_index_9 = CullIndex(List=sort_along_curve_2.Points, Indices=-1, Wrap=True)
cull_index_10 = CullIndex(List=sort_along_curve_2.Points, Indices=0, Wrap=True)
plane_4 = Plane(deconstruct_block_21.Plane)

# ----
# Dimensions top block sizes
define_linear_dimension_4 = DefineLinearDimension(Point1=cull_index_3, Point2=cull_index_4, DimensionPlane=plane_3, Offset=100, DimensionStyle="Millimeter Small2")

# ----
# Bottom between axes
define_linear_dimension_5 = DefineLinearDimension(Point1=cull_index_9, Point2=cull_index_10, DimensionPlane=plane_4, Offset=-180, DimensionStyle="Millimeter Small2")

# ----
# Dimensions left blocks
define_linear_dimension_6 = DefineLinearDimension(
    Point1=cull_index_6,
    Point2=cull_index_5,
    DimensionPlane=rotate_plane_2,
    Offset=Slider(100, range=0..1000),
    DimensionStyle="Millimeter Small2")

# ----
# Right between axes
define_linear_dimension_7 = DefineLinearDimension(Point1=cull_index_7, Point2=cull_index_8, DimensionPlane=rotate_plane_2, Offset=-180, DimensionStyle="Millimeter Small2")

# ----
# Dimensions top total
define_linear_dimension_8 = DefineLinearDimension(Point1=list_item_19, Point2=list_item_20, DimensionPlane=plane_3, Offset=280, DimensionStyle="Millimeter Small2")

# ----
# Dimensions left total
define_linear_dimension_9 = DefineLinearDimension(Point1=list_item_17, Point2=list_item_18, DimensionPlane=rotate_plane_2, Offset=280, DimensionStyle="Millimeter Small2")

entwine = Entwine(
    Branch00=define_linear_dimension_8,
    Branch01=define_linear_dimension_5,
    Branch02=define_linear_dimension_4,
    Branch03=define_linear_dimension_6,
    Branch04=define_linear_dimension_7,
    Branch05=define_linear_dimension_9,
    FlattenInputs=True)
output_dimensions = RemoteSender(entwine)

output_selected_type_ticks_editable_bloc_2 = RemoteReceiver(output_selected_type_ticks_editable_bloc)  # "Output.Selected Type ticks (editable blocks)"

# ----
# OUTPUT
colour_swatch_2 = ColourSwatch(SwatchColor=RGB(234, 255, 0))
number_slider_4 = Slider(5, range=0..10)
number_slider_5 = Slider(2, range=0..10)
number_slider_6 = Slider(11, range=0..20)
gh_frame_material_of_selected_blocks_3 = RemoteReceiver(gh_frame_material_of_selected_blocks)
message_selectioninfo_2 = RemoteReceiver(message_selectioninfo)
output_dimensions_2 = RemoteReceiver(output_dimensions)
text_7 = Text(message_selectioninfo_2)
entwine_2 = Entwine(Branch02=Slider(5, range=0..10), FlattenInputs=True)  # -> simplify(Result)
entwine_3 = Entwine(
    Branch00=gh_frame_material_of_selected_blocks_3,
    Branch01=ColourSwatch(SwatchColor=RGB(255, 255, 255)),
    Branch02=ColourSwatch(SwatchColor=RGB(94, 203, 242)),
    Branch03=ColourSwatch(SwatchColor=RGB(54, 54, 54)),
    Branch04=ColourSwatch(SwatchColor=RGB(102, 242, 41)),
    FlattenInputs=True)  # -> simplify(Result)
entwine_4 = Entwine(Branch00=text_7, FlattenInputs=True)  # -> simplify(Result)
entwine_5 = Entwine(
    Branch00=dispatch.ListB,
    Branch01=output_dimensions_2,
    Branch02=deconstruct_brep.Edges,
    Branch03=output_selected_type_ticks_2,
    Branch04=output_selected_type_ticks_editable_bloc_2,
    FlattenInputs=True)  # -> simplify(Result)
display_widths = Number(entwine_2)
custom_preview_lineweights_4 = CustomPreviewLineweights(Geometry=entwine_5, Shader=entwine_3, Thickness=display_widths, Absolute=False)

# ----
# OUTPUT
generated_geo_facadesubfaces = ExtendedGeometry()
attributes = EFDataDescription()
ui_messages = Text(entwine_4)
gen_attributes = ClusterOutput(attributes)  # Gen. Attributes
display_widths_2 = ClusterOutput(display_widths)  # Display: widths
ui_messages_2 = ClusterOutput(ui_messages)  # UI Messages
generated_geo = ClusterOutput(generated_geo_facadesubfaces)  # Generated geo
display_geo = ClusterOutput(entwine_5)  # Display: geo
display_colors = ClusterOutput(entwine_3)  # Display: colors
info_help = ClusterOutput(text_6)  # Info&Help

# ==== cluster ReplaceBlock: Replace block
gzaddreferences = CSharpScript(
    Run=True,
    Reference=["C:\Program Files\Rhino 7\Plug-ins\Grasshopper\Components\ScriptComponents.gha", "C:\Program Files\NoDoubts\Godzilla\System\Godzilla.dll", "C:\Program Files\NoDoubts\Godzilla\System\RhGodzilla.rhp"])  # -> Done; inputs Run: Boolean; same code as gzaddreferences
panel = Panel(gzaddreferences)
relay = ClusterInput()
block_to_replace = ClusterInput()  # Block to replace
block_to_replace_with = ClusterInput()  # Block to replace with
guid = Guid(relay)
replace_now = ClusterInput()  # Replace now?
extended_geometry = ExtendedGeometry(guid)
object_attributes = ObjectAttributes(ObjectOrAttributes=block_to_replace)  # -> Name, LayerName, LayerFullPath, Color, MaterialName, LinetypeName, GroupIndices, PlotWeight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
boolean = Boolean(replace_now)
# REPLACE BLOCK
explode_blocks = ExplodeBlocks(BlockObjects=block_to_replace, explodeGeom=False)  # -> Geometry, Attributes, BlockName, BoundingBox, BlockTransform, InsertionPlane, InstanceCount
key_value_search = KeyValueSearch(Keys=object_attributes.UserDataKeys, Values=object_attributes.UserDataValues, Search="HO_AncorPoint")
rhino_command = RhinoCommand(SendCommandToggle=boolean, CommandString="_Delete _SelNone")
insert_block = InsertBlock(BlockName=block_to_replace_with, SourcePlane=PlaneXY(0, 0, 0))
define_object_attributes = DefineObjectAttributes(UserKeys=object_attributes.UserDataKeys, UserValues=object_attributes.UserDataValues, Layer="HO_Preview")
transform = Transform(Geometry=insert_block, Transform=explode_blocks.BlockTransform)
deconstruct_block = DeconstructBlock(Block=transform)  # -> Name, Plane, Geometry
filter_by_user_attributes = FilterByUserAttributes(Attributes=deconstruct_block.Geometry, Key="HO_AncorPointType", Val=key_value_search)  # -> Geometry, Key, Val
deconstruct_block_2 = DeconstructBlock(Block=extended_geometry)  # -> Name, Plane, Geometry
key_value_search_2 = KeyValueSearch(Search="HO_AncorPointType")
filter_by_user_attributes_2 = FilterByUserAttributes(Attributes=deconstruct_block_2.Geometry, Key="HO_AncorPointType", Val=key_value_search)  # -> Geometry, Key, Val
panel_2 = Panel(filter_by_user_attributes_2.Geometry)
vector_2pt = Vector2Pt(PointA=filter_by_user_attributes.Geometry, PointB=filter_by_user_attributes_2.Geometry, Unitize=False)  # -> Vector, Length
panel_3 = Panel(vector_2pt.Vector)
move = Move(Geometry=transform, Motion=vector_2pt.Vector)  # -> Geometry, Transform
bake_objects = BakeObjects(Geometry=move.Geometry, Attributes=define_object_attributes, Bake=boolean)

# ==== cluster Cluster_8
text = ClusterInput()
replace_text = ReplaceText(Text=text, Find="Profile - Rectangular -", Replace="▮", RecursiveReplace=False)
replace_text_2 = ReplaceText(Text=replace_text, Find="Profile custom", Replace="▶", RecursiveReplace=False)
result = ClusterOutput(replace_text_2)

# ==== cluster Cluster
face_length = ClusterInput()  # Face length
spacings = ClusterInput()  # Spacings
flip = ClusterInput()  # Flip
face_length_2 = Number(simplify(face_length))
flip_2 = Boolean(flip)
spacings_2 = Integer(spacings)
boolean_toggle = BooleanToggle(True)
path_mapper = PathMapper(face_length_2, source=["{A;B;C;D;E}", "{A}"], target=["{A}", "{A}"])
mass_addition = MassAddition(Input=spacings_2)  # -> Result, PartialResults
division = Division(A=path_mapper, B=mass_addition.Result)
round = Round(Number=division)  # -> Nearest, Floor, Ceiling
duplicate_data = DuplicateData(Data=spacings_2, Number=round.Ceiling, Order=True)
mass_addition_2 = MassAddition(Input=duplicate_data)  # -> Result, PartialResults
larger_than = LargerThan(FirstNumber=path_mapper, SecondNumber=mass_addition_2.PartialResults)  # -> LargerThan, OrEqualTo
dispatch = Dispatch(List=duplicate_data, DispatchPattern=larger_than.OrEqualTo)  # -> ListA, ListB
stream_gate = StreamGate(Stream=dispatch.ListA, Gate=flip_2)  # -> Target0, Target1
mass_addition_3 = MassAddition(Input=stream_gate.Target0)  # -> Result, PartialResults
subtraction = Subtraction(A=path_mapper, B=mass_addition_3.Result)
addition = Addition(A=subtraction, B=stream_gate.Target0)
stream_filter = StreamFilter(Gate=flip_2, Stream0=addition, Stream1=stream_gate.Target1)
shift_paths = ShiftPaths(Data=stream_filter, Offset=-1)
mass_addition_4 = MassAddition(Input=shift_paths)  # -> Result, PartialResults
longest_list = LongestList(ListListA="0", ListListB=path_mapper, PaddingMode=2)  # -> ListListA, ListListB
offsets_for_splitting = Integer(mass_addition_3.PartialResults)
merge = Merge(Data1=longest_list.ListListA, Data2=offsets_for_splitting, Data3=path_mapper)
distances_for_dimensions = Integer(merge)
offsets_for_splitting_2 = ClusterOutput(offsets_for_splitting)
distances_for_dimensions_2 = ClusterOutput(distances_for_dimensions)  # Distances for dimensions

# ==== cluster Cluster_2
text = ClusterInput()
replace_text = ReplaceText(Text=text, Find="▮", Replace="Profile - Rectangular -", RecursiveReplace=False)
replace_text_2 = ReplaceText(Text=replace_text, Find="▶", Replace="Profile custom", RecursiveReplace=False)
result = ClusterOutput(replace_text_2)

# ==== cluster Cluster_3
selected_geometry = ClusterInput()
selected_geometry_2 = ExtendedGeometry(selected_geometry)

# ----
# GETTING FACE PLANE
# X axis is horizontal and goes ->
# Y axis is vertical in face plane (could be tilted)
# Plane in face's plane
# x vector projection goes up
# Plane for circle
# and section
# Circle outside to
# sort points by it
evaluate_surface = EvaluateSurface(Surface=reparameterize(selected_geometry_2), Point=Point(0.5, 0.5, 0))  # -> Point, Normal, UDirection, VDirection, Frame
unit_z = UnitZ(Factor=1)
vector = Vector(evaluate_surface.Frame)
expression = Expression(x=vector, z=unit_z, Expression="if(x=z, 0, 1)")
dispatch = Dispatch(List=evaluate_surface.Frame, DispatchPattern=expression)  # -> NonHorizontal, Horizontal
clean_tree = CleanTree(RemoveNulls=True, RemoveInvalid=True, RemoveEmpty=True, Tree=dispatch.NonHorizontal)
unit_z_2 = UnitZ(Factor=1)
deconstruct_plane = DeconstructPlane(Plane=clean_tree)  # -> Origin, XAxis, YAxis, ZAxis
angle = Angle(VectorA=deconstruct_plane.YAxis, VectorB=unit_z_2, Plane=clean_tree)  # -> Angle, Reflex
rotate_plane = RotatePlane(Plane=clean_tree, Angle=angle.Angle)
deconstruct_plane_2 = DeconstructPlane(Plane=rotate_plane)  # -> Origin, XAxis, YAxis, ZAxis
move = Move(Geometry=deconstruct_plane_2.Origin, Motion=expr("x*1000", deconstruct_plane_2.ZAxis))  # -> Geometry, Transform
deconstruct_plane_3 = DeconstructPlane(Plane=move.Geometry)  # -> Origin, XAxis, YAxis, ZAxis
angle_2 = Angle(VectorA=deconstruct_plane_2.ZAxis, VectorB=deconstruct_plane_3.XAxis, Plane=move.Geometry)  # -> Angle, Reflex
rotate_plane_2 = RotatePlane(Plane=move.Geometry, Angle=expr("-x", angle_2.Angle))
selected_geometry_3 = ExtendedGeometry(selected_geometry_2)
plane = Plane(rotate_plane_2)
brep_plane = BrepPlane(Brep=selected_geometry_3, Plane=plane)  # -> Curves, Points
circle = Circle(Plane=plane, Radius1000=1)
end_points = EndPoints(Curve=brep_plane.Curves)  # -> Start, End
sort_along_curve = SortAlongCurve(Points=[end_points.Start, end_points.End], Curve=circle)  # -> Points, Indices
list_item = ListItem(List=sort_along_curve.Points, Index=0, Wrap=True)  # -> Item, Item1
point = Point(list_item.Item1)
vector_2pt = Vector2Pt(PointA=list_item.Item1, PointB=list_item.Item, Unitize=True)  # -> Vector, Length
unit_z_3 = UnitZ(Factor=1)
construct_plane = ConstructPlane(Origin=deconstruct_plane_2.Origin, XAxis=vector_2pt.Vector, YAxis=unit_z_3)
construct_plane_2 = ConstructPlane(Origin=deconstruct_plane_2.Origin, XAxis=vector_2pt.Vector, YAxis=deconstruct_plane_2.YAxis)
vertical_face_plane_in_the_middle = Plane(simplify(construct_plane))
face_plane = Plane(construct_plane_2)
deconstruct_plane_4 = DeconstructPlane(Plane=face_plane)  # -> Origin, XAxis, YAxis, ZAxis
face_horiz_vector = Vector(simplify(deconstruct_plane_4.XAxis))

vertical_face_plane_in_the_middle_2 = ClusterOutput(vertical_face_plane_in_the_middle)

# ==== cluster Cluster_4
plane = ClusterInput()

# ----
# Plane info for attributes
deconstruct_plane = DeconstructPlane(Plane=simplify(graft(plane)))  # -> Origin, XAxis, YAxis, ZAxis
construct_plane = ConstructPlane(Origin=deconstruct_plane.Origin, XAxis=deconstruct_plane.XAxis, YAxis=deconstruct_plane.YAxis)
deconstruct_plane_2 = DeconstructPlane(Plane=construct_plane)  # -> Origin, XAxis, YAxis, ZAxis
text_join = TextJoin(Text=[deconstruct_plane_2.Origin, deconstruct_plane_2.XAxis, deconstruct_plane_2.YAxis], Join="/")  # -> simplify(Result)

result = ClusterOutput(text_join)

# ==== cluster Cluster_5
geometry = ClusterInput()

# ----
# Getting plane info
# from attributes
key_name = Panel("HO_BasePlane")
get_user_value = GetUserValue(Geometry=simplify(graft(geometry)), Key=key_name)
text_split = TextSplit(Text=get_user_value, Separators="/")
list_item = ListItem(List=text_split, Index=0, Wrap=True)  # -> Item, Item1, Item2
construct_plane = ConstructPlane(Origin=list_item.Item, XAxis=list_item.Item1, YAxis=list_item.Item2)  # -> simplify(Plane)

plane = ClusterOutput(construct_plane)

# ==== cluster Cluster_6
data = ClusterInput()
shift_paths = ShiftPaths(Data=data, Offset=-1)
path = ClusterInput()
tree_branch = TreeBranch(Tree=shift_paths, Path=path, MaintainPaths=True)
number = ClusterInput()
duplicate_data = DuplicateData(Data=tree_branch, Number=number, Order=True)
guide = ClusterInput()
unflatten_tree = UnflattenTree(Tree=duplicate_data, Guide=guide)
tree = ClusterOutput(unflatten_tree)

# ==== cluster Cluster_7
selected_geometry = ClusterInput()

# ----
# GETTING FACE PLANE
# X axis is horizontal and goes ->
# Y axis is vertical in face plane (could be tilted)
# Plane in face's plane
# x vector projection goes up
# Plane for circle
# and section
# Circle outside to
# sort points by it
selected_geometry_2 = ExtendedGeometry(graft(selected_geometry))
evaluate_surface = EvaluateSurface(Surface=reparameterize(selected_geometry_2), Point=Point(0.5, 0.5, 0))  # -> Point, Normal, UDirection, VDirection, Frame
unit_z = UnitZ(Factor=1)
vector = Vector(evaluate_surface.Frame)
expression = Expression(x=vector, z=unit_z, Expression="if(x=z, 0, 1)")
dispatch = Dispatch(List=evaluate_surface.Frame, DispatchPattern=expression)  # -> NonHorizontal, Horizontal
clean_tree = CleanTree(RemoveNulls=True, RemoveInvalid=True, RemoveEmpty=True, Tree=dispatch.NonHorizontal)
unit_z_2 = UnitZ(Factor=1)
deconstruct_plane = DeconstructPlane(Plane=clean_tree)  # -> Origin, XAxis, YAxis, ZAxis
angle = Angle(VectorA=deconstruct_plane.YAxis, VectorB=unit_z_2, Plane=clean_tree)  # -> Angle, Reflex
rotate_plane = RotatePlane(Plane=clean_tree, Angle=angle.Angle)
deconstruct_plane_2 = DeconstructPlane(Plane=rotate_plane)  # -> Origin, XAxis, YAxis, ZAxis
move = Move(Geometry=deconstruct_plane_2.Origin, Motion=expr("x*1000", deconstruct_plane_2.ZAxis))  # -> Geometry, Transform
deconstruct_plane_3 = DeconstructPlane(Plane=move.Geometry)  # -> Origin, XAxis, YAxis, ZAxis
angle_2 = Angle(VectorA=deconstruct_plane_2.ZAxis, VectorB=deconstruct_plane_3.XAxis, Plane=move.Geometry)  # -> Angle, Reflex
rotate_plane_2 = RotatePlane(Plane=move.Geometry, Angle=expr("-x", angle_2.Angle))
plane = Plane(rotate_plane_2)
brep_plane = BrepPlane(Brep=selected_geometry_2, Plane=plane)  # -> Curves, Points
circle = Circle(Plane=plane, Radius1000=1)
end_points = EndPoints(Curve=brep_plane.Curves)  # -> Start, End
sort_along_curve = SortAlongCurve(Points=[end_points.Start, end_points.End], Curve=circle)  # -> Points, Indices
list_item = ListItem(List=sort_along_curve.Points, Index=0, Wrap=True)  # -> Item, Item1
point = Point(list_item.Item1)
vector_2pt = Vector2Pt(PointA=list_item.Item1, PointB=list_item.Item, Unitize=True)  # -> Vector, Length
unit_z_3 = UnitZ(Factor=1)
construct_plane = ConstructPlane(Origin=deconstruct_plane_2.Origin, XAxis=vector_2pt.Vector, YAxis=deconstruct_plane_2.YAxis)
construct_plane_2 = ConstructPlane(Origin=deconstruct_plane_2.Origin, XAxis=vector_2pt.Vector, YAxis=unit_z_3)
face_plane = Plane(construct_plane)
deconstruct_plane_4 = DeconstructPlane(Plane=face_plane)  # -> Origin, XAxis, YAxis, ZAxis
face_horiz_vector = Vector(simplify(deconstruct_plane_4.XAxis))
vertical_face_plane_in_the_middle = Plane(construct_plane_2)

face_horiz_vector_2 = ClusterOutput(face_horiz_vector)
vertical_face_plane_in_the_middle_2 = ClusterOutput(vertical_face_plane_in_the_middle)
